# Grasshopper definition communication_Design_01.gh (Grasshopper 1.0.8)

# ---- group: Pulse Generator for New Dataset
c_script = CSharpScript(Signal=Toggle(True))  # -> Pulse, Status; inputs Signal: Boolean
# ---------- c_script: C# ----------
// Grasshopper Script Instance

#region Usings
using System;

using Rhino;
using Rhino.Geometry;

using Grasshopper;
using Grasshopper.Kernel;
using Grasshopper.Kernel.Data;
using Grasshopper.Kernel.Types;
#endregion


public class Script_Instance : GH_ScriptInstance
{
    //============================================================
    // Persistent state
    //============================================================

    private bool previousSignal = false;


    //============================================================
    // Main
    //============================================================

    private void RunScript(bool Signal, ref object Pulse, ref object Status)
    {
        bool pulse =
            Signal &&
            !previousSignal;

        previousSignal = Signal;

        Pulse = pulse;

        if (pulse)
        {
            Status =
                "Pulse generated.";
        }
        else if (Signal)
        {
            Status =
                "Waiting for reset.";
        }
        else
        {
            Status =
                "Ready.";
        }
    }
}
# ---------- end c_script ----------
panel = Panel(c_script.Pulse)
panel_2 = Panel(c_script.Status)

# ---- group: Session Name Generator
enable = BooleanToggle(True)
manual_start = Button()
need_new_dataset = Button()
reset_counter = Button()
ready_for_next_request = BooleanToggle(True)
c_script_2 = CSharpScript(
    Enable=enable,
    ManualStart=manual_start,
    NeedNewDataset=c_script.Pulse,
    ResetCounter=reset_counter,
    ReadyForNextRequest=ready_for_next_request,
    BaseSessionName="LSD",
    StartIndex="1",
    Padding="2")  # -> SubmitWorkflow, SessionName, SessionIndex, NextIndex, CycleCount, RequestAccepted, Status; inputs Enable: Boolean, ManualStart: Boolean, NeedNewDataset: Boolean, ResetCounter: Boolean, ReadyForNextRequest: Boolean, BaseSessionName: String, StartIndex: Int32, Padding: Int32
# ---------- c_script_2: C# ----------
// Grasshopper Script Instance

#region Usings
using System;
using System.Globalization;

using Rhino;
using Rhino.Geometry;

using Grasshopper;
using Grasshopper.Kernel;
using Grasshopper.Kernel.Data;
using Grasshopper.Kernel.Types;
#endregion


public class Script_Instance : GH_ScriptInstance
{
    // ============================================================
    // EDGE-DETECTION STATE
    // ============================================================

    private bool previousManualStart = false;
    private bool previousNeedNewDataset = false;
    private bool previousResetCounter = false;


    // ============================================================
    // SESSION-CYCLE STATE
    // ============================================================

    private bool initialized = false;

    private int currentIndex = 1;
    private int cycleCount = 0;

    private string activeSessionName = "";

    private string lastStatus =
        "Session cycle controller disabled.";

    private bool submitPulse = false;
    private bool requestAccepted = false;


    // ============================================================
    // MAIN
    // ============================================================

    private void RunScript(
		bool Enable,
		bool ManualStart,
		bool NeedNewDataset,
		bool ResetCounter,
		bool ReadyForNextRequest,
		string BaseSessionName,
		int StartIndex,
		int Padding,
		ref object SubmitWorkflow,
		ref object SessionName,
		ref object SessionIndex,
		ref object NextIndex,
		ref object CycleCount,
		ref object RequestAccepted,
		ref object Status)
    {
        // --------------------------------------------------------
        // One-solution outputs
        // --------------------------------------------------------

        submitPulse = false;
        requestAccepted = false;


        // --------------------------------------------------------
        // Normalize configuration
        // --------------------------------------------------------

        string normalizedBaseName =
            NormalizeBaseSessionName(
                BaseSessionName
            );

        int normalizedStartIndex =
            Math.Max(
                1,
                StartIndex
            );

        int normalizedPadding =
            Math.Max(
                1,
                Padding
            );


        // --------------------------------------------------------
        // Initialize internal counter once
        // --------------------------------------------------------

        if (!initialized)
        {
            currentIndex =
                normalizedStartIndex;

            initialized = true;

            lastStatus =
                "Session counter initialized.";
        }


        // --------------------------------------------------------
        // Rising-edge detection
        // --------------------------------------------------------

        bool manualStartPulse =
            ManualStart &&
            !previousManualStart;

        bool needNewDatasetPulse =
            NeedNewDataset &&
            !previousNeedNewDataset;

        bool resetPulse =
            ResetCounter &&
            !previousResetCounter;

        previousManualStart =
            ManualStart;

        previousNeedNewDataset =
            NeedNewDataset;

        previousResetCounter =
            ResetCounter;


        // --------------------------------------------------------
        // Disabled state
        // --------------------------------------------------------

        if (!Enable)
        {
            lastStatus =
                "Session cycle controller disabled.";

            SetOutputs(
                ref SubmitWorkflow,
                ref SessionName,
                ref SessionIndex,
                ref NextIndex,
                ref CycleCount,
                ref RequestAccepted,
                ref Status
            );

            return;
        }


        // --------------------------------------------------------
        // Reset
        // --------------------------------------------------------

        if (resetPulse)
        {
            currentIndex =
                normalizedStartIndex;

            cycleCount = 0;

            activeSessionName = "";

            submitPulse = false;
            requestAccepted = false;

            lastStatus =
                "Session counter reset to " +
                normalizedStartIndex.ToString(
                    CultureInfo.InvariantCulture
                ) +
                ".";

            SetOutputs(
                ref SubmitWorkflow,
                ref SessionName,
                ref SessionIndex,
                ref NextIndex,
                ref CycleCount,
                ref RequestAccepted,
                ref Status
            );

            return;
        }


        // --------------------------------------------------------
        // Detect a new session request
        // --------------------------------------------------------

        bool requestPulse =
            manualStartPulse ||
            needNewDatasetPulse;

        if (!requestPulse)
        {
            if (
                string.IsNullOrWhiteSpace(
                    activeSessionName
                )
            )
            {
                lastStatus =
                    "Waiting for the first session request.";
            }

            SetOutputs(
                ref SubmitWorkflow,
                ref SessionName,
                ref SessionIndex,
                ref NextIndex,
                ref CycleCount,
                ref RequestAccepted,
                ref Status
            );

            return;
        }


        // --------------------------------------------------------
        // Busy protection
        // --------------------------------------------------------

        if (!ReadyForNextRequest)
        {
            submitPulse = false;
            requestAccepted = false;

            lastStatus =
                "Session request ignored because " +
                "the processing workflow is busy.";

            SetOutputs(
                ref SubmitWorkflow,
                ref SessionName,
                ref SessionIndex,
                ref NextIndex,
                ref CycleCount,
                ref RequestAccepted,
                ref Status
            );

            return;
        }


        // --------------------------------------------------------
        // Generate the next session
        // --------------------------------------------------------

        activeSessionName =
            BuildSessionName(
                normalizedBaseName,
                currentIndex,
                normalizedPadding
            );

        submitPulse = true;
        requestAccepted = true;

        cycleCount++;

        lastStatus =
            "Created session '" +
            activeSessionName +
            "' and submitted workflow cycle " +
            cycleCount.ToString(
                CultureInfo.InvariantCulture
            ) +
            ".";


        // --------------------------------------------------------
        // Advance counter for the following request
        // --------------------------------------------------------

        currentIndex++;


        SetOutputs(
            ref SubmitWorkflow,
            ref SessionName,
            ref SessionIndex,
            ref NextIndex,
            ref CycleCount,
            ref RequestAccepted,
            ref Status
        );
    }


    // ============================================================
    // OUTPUTS
    // ============================================================

    private void SetOutputs(
        ref object SubmitWorkflow,
        ref object SessionName,
        ref object SessionIndex,
        ref object NextIndex,
        ref object CycleCount,
        ref object RequestAccepted,
        ref object Status)
    {
        SubmitWorkflow =
            submitPulse;

        SessionName =
            activeSessionName;

        SessionIndex =
            string.IsNullOrWhiteSpace(
                activeSessionName
            )
            ? (object)null
            : currentIndex - 1;

        NextIndex =
            currentIndex;

        CycleCount =
            cycleCount;

        RequestAccepted =
            requestAccepted;

        Status =
            lastStatus;
    }


    // ============================================================
    // SESSION-NAME GENERATION
    // ============================================================

    private string BuildSessionName(
        string baseSessionName,
        int sessionIndex,
        int padding)
    {
        string indexText =
            sessionIndex.ToString(
                "D" + padding.ToString(
                    CultureInfo.InvariantCulture
                ),
                CultureInfo.InvariantCulture
            );

        return
            baseSessionName +
            "_" +
            indexText;
    }


    private string NormalizeBaseSessionName(
        string value)
    {
        string normalized =
            string.IsNullOrWhiteSpace(
                value
            )
            ? "EOB_design"
            : value.Trim();

        normalized =
            normalized
                .Replace(" ", "_")
                .Replace("-", "_");

        while (
            normalized.Contains("__")
        )
        {
            normalized =
                normalized.Replace(
                    "__",
                    "_"
                );
        }

        normalized =
            normalized.Trim('_');

        if (
            string.IsNullOrWhiteSpace(
                normalized
            )
        )
        {
            return "EOB_design";
        }

        return normalized;
    }
}
# ---------- end c_script_2 ----------
panel_3 = Panel(c_script_2.SubmitWorkflow)
panel_4 = Panel(c_script_2.SessionName)
panel_5 = Panel(c_script_2.SessionIndex)
panel_6 = Panel(c_script_2.NextIndex)
panel_7 = Panel(c_script_2.CycleCount)
panel_8 = Panel(c_script_2.RequestAccepted)
panel_9 = Panel(c_script_2.Status)

# ---- group: Workflow Manager Client
connect = BooleanToggle(False)
submit_workflow = Button()
cancel_workflow = Button()
workflow_sequence = ValueList({"capture_transform_process_download", "transform_process_download", "download_only"}, selected="capture_transform_process_download")
capture_index = ValueList({"1", "2", "3", "4", "5"}, selected="1")
mode = ValueList({"pointcloud", "image", "depth", "all"}, selected="all")
transform_pipeline = ValueList({"base", "ref_cam", "eye_to_base"}, selected="eye_to_base")
eye_to_base_index = ValueList({"1", "2", "3"}, selected="1")
reference_index = ValueList({"1", "2", "3"}, selected="2")
output_index = ValueList({"1", "2", "3", "4", "5", "6", "7", "8", "9", "10"}, selected="1")
requested_solution_count = ValueList({"1", "2", "3", "4", "5", "6", "7", "8", "9", "10"}, selected="1")
processing_input_kind = ValueList({"merged", "eye_to_base"}, selected="eye_to_base")
show_processing_preview = BooleanToggle(True)
color_grouping_method = ValueList({"gmm_bic", "dbscan", "reference"}, selected="gmm_bic")
download_file_types = ValueList({"pointcloud", "image", "json"}, selected="json")
download_categories = ValueList({"all": "", "initial_pointcloud", "merged_pointcloud", "eye_to_base_pointcloud", "initial_rgb", "initial_depth", "initial_depth_rendered", "stitched_rgb", "stitched_height", "eye_to_base_rgb", "eye_to_base_height", "processed_clusters", "processing_params", "processing_report"}, selected="processed_clusters")
refresh_status = BooleanToggle(False)
panel_10 = Panel("EOB_test03")
processing_preview_time = Slider(1, range=0..5)
max_color_groups = Slider(1, range=1..5)
gmm_merge_distance = Slider(6, range=0..20)
c_script_3 = CSharpScript(
    ConnectButton=connect,
    SubmitWorkflow=c_script_2.SubmitWorkflow,
    CancelWorkflow=cancel_workflow,
    WorkflowSequence=workflow_sequence,
    SessionName=c_script_2.SessionName,
    CaptureIndex=capture_index,
    CaptureMode=mode,
    TransformPipeline=transform_pipeline,
    EyeToBaseIndex=eye_to_base_index,
    ReferenceIndex=reference_index,
    OutputIndex=output_index,
    RequestedSolutionCount=requested_solution_count,
    ProcessingInputKind=processing_input_kind,
    ShowProcessingPreview=show_processing_preview,
    ProcessingPreviewTime=processing_preview_time,
    ColorGroupingMethod=color_grouping_method,
    MaxColorGroups=max_color_groups,
    GmmMergeDistance=gmm_merge_distance,
    DownloadFileTypes=download_file_types,
    DownloadCategories=download_categories,
    RefreshStatus=refresh_status)  # -> State, Status, Message, WorkflowId, DownloadJobId, CurrentStage, Progress, PointCloudPaths, ImagePaths, JsonPaths; inputs ConnectButton: Boolean, SubmitWorkflow: Boolean, CancelWorkflow: Boolean, WorkflowSequence: String, SessionName: String, CaptureIndex: Int32, CaptureMode: String, TransformPipeline: String, EyeToBaseIndex: Int32, ReferenceIndex: Int32, OutputIndex: Int32, RequestedSolutionCount: Int32, ProcessingInputKind: String, ShowProcessingPreview: Boolean, ProcessingPreviewTime: Double, ColorGroupingMethod: String, MaxColorGroups: Int32, GmmMergeDistance: Double, DownloadFileTypes: String, DownloadCategories: String, RefreshStatus: Boolean
# ---------- c_script_3: C# ----------
// Grasshopper Script Instance
#region Usings
using System;
using System.Text;
using System.Net.Sockets;
using System.Collections.Generic;
using System.Globalization;

using Rhino;
using Rhino.Geometry;

using Grasshopper;
using Grasshopper.Kernel;
using Grasshopper.Kernel.Data;
using Grasshopper.Kernel.Types;
#endregion

public class Script_Instance : GH_ScriptInstance
{
    // ============================================================
    // CONFIGURATION
    // ============================================================

    private const string Host = "127.0.0.1";
    private const int Port = 6005;

    /*
    * User-facing GH modes:
    *
    * capture_transform_process_download
    *     Python: capture_transform_process
    *     GH Agent: download
    *
    * transform_process_download
    *     Python: transform_process
    *     GH Agent: download
    *
    * download_only
    *     Python: no workflow
    *     GH Agent: download existing session outputs
    */
    private const string FullPythonWorkflowName =
        "capture_transform_process";

    private const string SkipCapturePythonWorkflowName =
        "transform_process";

    // ============================================================
    // CONNECTION STATE
    // ============================================================

    private bool isConnected = false;
    private bool triedConnect = false;

    // ============================================================
    // BUTTON EDGE DETECTION
    // ============================================================

    private bool previousSubmitWorkflow = false;
    private bool previousCancelWorkflow = false;

    // ============================================================
    // COMPONENT STATE
    // ============================================================

    private enum ComponentPhase
    {
        Idle,
        SubmittingWorkflow,
        RunningPythonWorkflow,
        SubmittingDownload,
        RunningDownload,
        ReadingManifest,
        Finished,
        Failed,
        Cancelled
    }

    private ComponentPhase phase =
        ComponentPhase.Idle;

    private string lastStatus =
        "Disconnected";

    private string lastMessage =
        "Enable ConnectButton.";

    private string activeSession = "";
    private string activeSequence = "";
    private string activePythonWorkflowName = "";

    private string workflowId = "";
    private string downloadJobId = "";

    private string currentStage = "";
    private int workflowProgress = 0;

    private bool downloadWasSubmitted = false;
    private bool manifestWasRead = false;

    private int activeOutputIndex = 1;
    private string activeDownloadFileTypes = "";
    private string activeDownloadCategories = "";

    private List<string> lastPointCloudPaths =
        new List<string>();

    private List<string> lastImagePaths =
        new List<string>();

    private List<string> lastJsonPaths =
        new List<string>();

    // ============================================================
    // MAIN
    // ============================================================

    private void RunScript(
		bool ConnectButton,
		bool SubmitWorkflow,
		bool CancelWorkflow,
		string WorkflowSequence,
		string SessionName,
		int CaptureIndex,
		string CaptureMode,
		string TransformPipeline,
		int EyeToBaseIndex,
		int ReferenceIndex,
		int OutputIndex,
		int RequestedSolutionCount,
		string ProcessingInputKind,
		bool ShowProcessingPreview,
		double ProcessingPreviewTime,
		string ColorGroupingMethod,
		int MaxColorGroups,
		double GmmMergeDistance,
		string DownloadFileTypes,
		string DownloadCategories,
		bool RefreshStatus,
		ref object State,
		ref object Status,
		ref object Message,
		ref object WorkflowId,
		ref object DownloadJobId,
		ref object CurrentStage,
		ref object Progress,
		ref object PointCloudPaths,
		ref object ImagePaths,
		ref object JsonPaths)
    {
        bool submitPulse =
            SubmitWorkflow &&
            !previousSubmitWorkflow;

        bool cancelPulse =
            CancelWorkflow &&
            !previousCancelWorkflow;

        previousSubmitWorkflow =
            SubmitWorkflow;

        previousCancelWorkflow =
            CancelWorkflow;

        // --------------------------------------------------------
        // Connection off
        // --------------------------------------------------------

        if (!ConnectButton)
        {
            isConnected = false;
            triedConnect = false;

            lastStatus = "Disconnected";
            lastMessage = "Connection toggle is off.";

            SetOutputs(
                ref State,
                ref Status,
                ref Message,
                ref WorkflowId,
                ref DownloadJobId,
                ref CurrentStage,
                ref Progress,
                ref PointCloudPaths,
                ref ImagePaths,
                ref JsonPaths
            );

            return;
        }

        // --------------------------------------------------------
        // Initial connection
        // --------------------------------------------------------

        if (
            ConnectButton &&
            !isConnected &&
            !triedConnect)
        {
            triedConnect = true;

            string response = SendCommand(
                "{\"command\":\"ping\"}"
            );

            if (response.StartsWith("ERROR:"))
            {
                isConnected = false;
                lastStatus = "Connection failed";
                lastMessage = response;
            }
            else
            {
                string outerStatus =
                    ExtractJsonValue(
                        response,
                        "status"
                    );

                if (
                    string.Equals(
                        outerStatus,
                        "ok",
                        StringComparison.OrdinalIgnoreCase
                    ))
                {
                    isConnected = true;
                    lastStatus = "Connected";

                    string responseMessage =
                        ExtractJsonValue(
                            response,
                            "message"
                        );

                    lastMessage =
                        string.IsNullOrWhiteSpace(
                            responseMessage
                        )
                        ? response
                        : responseMessage;
                }
                else
                {
                    isConnected = false;
                    lastStatus = "Connection failed";

                    string responseMessage =
                        ExtractJsonValue(
                            response,
                            "message"
                        );

                    lastMessage =
                        string.IsNullOrWhiteSpace(
                            responseMessage
                        )
                        ? response
                        : responseMessage;
                }
            }
        }

        if (!isConnected)
        {
            SetOutputs(
                ref State,
                ref Status,
                ref Message,
                ref WorkflowId,
                ref DownloadJobId,
                ref CurrentStage,
                ref Progress,
                ref PointCloudPaths,
                ref ImagePaths,
                ref JsonPaths
            );

            return;
        }

        // --------------------------------------------------------
        // Submit
        // --------------------------------------------------------

        if (submitPulse)
        {
            SubmitNewWorkflow(
                WorkflowSequence,
                SessionName,
                CaptureIndex,
                CaptureMode,
                TransformPipeline,
                EyeToBaseIndex,
                ReferenceIndex,
                OutputIndex,
                RequestedSolutionCount,
                ProcessingInputKind,
                ShowProcessingPreview,
                ProcessingPreviewTime,
                ColorGroupingMethod,
                MaxColorGroups,
                GmmMergeDistance,
                DownloadFileTypes,
                DownloadCategories
            );
        }

        // --------------------------------------------------------
        // Cancel
        // --------------------------------------------------------

        if (cancelPulse)
        {
            CancelActiveWorkflow();
        }

        // --------------------------------------------------------
        // Poll workflow or download
        // --------------------------------------------------------

        if (RefreshStatus)
        {
            RefreshCurrentState();
        }

        SetOutputs(
            ref State,
            ref Status,
            ref Message,
            ref WorkflowId,
            ref DownloadJobId,
            ref CurrentStage,
            ref Progress,
            ref PointCloudPaths,
            ref ImagePaths,
            ref JsonPaths
        );
    }

    // ============================================================
    // SUBMISSION
    // ============================================================

    private void SubmitNewWorkflow(
        string workflowSequence,
        string sessionName,
        int captureIndex,
        string captureMode,
        string transformPipeline,
        int eyeToBaseIndex,
        int referenceIndex,
        int outputIndex,
        int requestedSolutionCount,
        string processingInputKind,
        bool showProcessingPreview,
        double processingPreviewTime,
        string colorGroupingMethod,
        int maxColorGroups,
        double gmmMergeDistance,
        string downloadFileTypes,
        string downloadCategories)
    {
        if (IsBusy())
        {
            lastStatus = "Workflow already active";
            lastMessage =
                "Wait for the current workflow to finish, fail, " +
                "or cancel it before submitting another workflow.";

            return;
        }

        string normalizedSequence =
            NormalizeWorkflowSequence(
                workflowSequence
            );

        if (string.IsNullOrWhiteSpace(
            normalizedSequence))
        {
            phase = ComponentPhase.Failed;
            lastStatus = "Workflow rejected";
            lastMessage =
                "Unsupported workflow sequence: " +
                workflowSequence;

            return;
        }

        string pythonWorkflowName =
            ResolvePythonWorkflowName(
                normalizedSequence
            );

        string session =
            string.IsNullOrWhiteSpace(
                sessionName
            )
            ? "RQC_Capture_Session"
            : sessionName.Trim();

        string pipeline =
            NormalizeTransformPipeline(
                transformPipeline
            );

        string processInputKind =
            ResolveProcessingInputKind(
                processingInputKind,
                pipeline
            );

        string groupingMethod =
            NormalizeColorGroupingMethod(
                colorGroupingMethod
            );

        string mode =
            string.IsNullOrWhiteSpace(
                captureMode
            )
            ? "all"
            : captureMode
                .Trim()
                .ToLowerInvariant();

        int safeCaptureIndex =
            Math.Max(1, captureIndex);

        int safeEyeToBaseIndex =
            Math.Max(1, eyeToBaseIndex);

        int safeReferenceIndex =
            Math.Max(1, referenceIndex);

        int safeOutputIndex =
            Math.Max(1, outputIndex);
        
        int safeRequestedSolutionCount =
            Math.Max(1, requestedSolutionCount);

        int safeMaxGroups =
            Math.Max(1, maxColorGroups);

        double safeMergeDistance =
            Math.Max(0.0, gmmMergeDistance);

        string previewTimeJson =
            BuildPreviewTimeJson(
                showProcessingPreview,
                processingPreviewTime
            );

        string stageConfigsJson =
            BuildStageConfigsJson(
                normalizedSequence,
                mode,
                safeCaptureIndex,
                pipeline,
                safeEyeToBaseIndex,
                safeReferenceIndex,
                safeOutputIndex,
                processInputKind,
                showProcessingPreview,
                previewTimeJson,
                groupingMethod,
                safeMaxGroups,
                safeMergeDistance
            );

        string payload =
            "{" +
            "\"command\":\"submit_workflow\"," +
            "\"workflow_name\":\"" +
            EscapeJson(pythonWorkflowName) +
            "\"," +
            "\"session\":\"" +
            EscapeJson(session) +
            "\"," +
            "\"stage_configs\":" +
            stageConfigsJson +
            "," +
            "\"runtime\":{" +
            "\"requested_by\":\"grasshopper\"," +
            "\"workflow_sequence\":\"" +
            EscapeJson(normalizedSequence) +
            "\"," +   // <-- comma added here
            "\"requested_solution_count\":" +
            safeRequestedSolutionCount.ToString(
                CultureInfo.InvariantCulture
            ) +
            "}" +
            "}";

        ResetRunState();

        activeSession = session;
        activeSequence = normalizedSequence;
        activePythonWorkflowName =
            pythonWorkflowName;

        activeOutputIndex =
            safeOutputIndex;

        activeDownloadFileTypes =
            downloadFileTypes;

        activeDownloadCategories =
            downloadCategories;

        // ----------------------------------------------------
        // Download-only mode
        // ----------------------------------------------------

        if (activeSequence == "download_only")
        {
            phase =
                ComponentPhase.SubmittingDownload;

            lastStatus = "Download-only started";
            lastMessage =
                "Skipping Python workflow. Existing outputs " +
                "from session '" +
                activeSession +
                "' will be downloaded.";

            return;
        }

        // ----------------------------------------------------
        // Python workflow modes
        // ----------------------------------------------------

        phase =
            ComponentPhase.SubmittingWorkflow;

        lastStatus = "Submitting workflow";
        lastMessage =
            "Sending workflow to GH Agent.";

        string response =
            SendCommand(payload);

        if (response.StartsWith("ERROR:"))
        {
            Fail(
                "Workflow submission failed",
                response
            );

            return;
        }

        string outerStatus =
            ExtractJsonValue(
                response,
                "status"
            );

        if (
            !string.Equals(
                outerStatus,
                "ok",
                StringComparison.OrdinalIgnoreCase
            ))
        {
            string responseMessage =
                ExtractJsonValue(
                    response,
                    "message"
                );

            Fail(
                "Workflow submission failed",
                string.IsNullOrWhiteSpace(
                    responseMessage
                )
                ? response
                : responseMessage
            );

            return;
        }

        workflowId =
            ExtractJsonValue(
                response,
                "workflow_id"
            );

        if (string.IsNullOrWhiteSpace(
            workflowId))
        {
            Fail(
                "Workflow submission failed",
                "The GH Agent returned success but no " +
                "workflow_id was provided.\n" +
                response
            );

            return;
        }

        phase =
            ComponentPhase.RunningPythonWorkflow;

        lastStatus = "Workflow submitted";
        lastMessage =
            "Python workflow submitted: " +
            workflowId;
    }

    private string BuildStageConfigsJson(
        string normalizedSequence,
        string captureMode,
        int captureIndex,
        string transformPipeline,
        int eyeToBaseIndex,
        int referenceIndex,
        int outputIndex,
        string processingInputKind,
        bool showProcessingPreview,
        string previewTimeJson,
        string groupingMethod,
        int maxColorGroups,
        double mergeDistance)
    {
        List<string> stageEntries =
            new List<string>();

        if (
            normalizedSequence ==
            "capture_transform_process_download")
        {
            string captureConfig =
                "\"capture\":{" +
                "\"camera_index\":0," +
                "\"capture_index\":" +
                captureIndex.ToString(
                    CultureInfo.InvariantCulture
                ) +
                "," +
                "\"mode\":\"" +
                EscapeJson(captureMode) +
                "\"" +
                "}";

            stageEntries.Add(captureConfig);
        }

        string transformConfig =
            "\"transform\":{" +
            "\"pipeline\":\"" +
            EscapeJson(transformPipeline) +
            "\"," +
            "\"eye_to_base_index\":" +
            eyeToBaseIndex.ToString(
                CultureInfo.InvariantCulture
            ) +
            "," +
            "\"reference_index\":" +
            referenceIndex.ToString(
                CultureInfo.InvariantCulture
            ) +
            "," +
            "\"output_index\":" +
            outputIndex.ToString(
                CultureInfo.InvariantCulture
            ) +
            "}";

        stageEntries.Add(transformConfig);

        string processConfig =
            "\"process\":{" +
            "\"output_index\":" +
            outputIndex.ToString(
                CultureInfo.InvariantCulture
            ) +
            "," +
            "\"input_kind\":\"" +
            EscapeJson(processingInputKind) +
            "\"," +
            "\"show_preview\":" +
            BoolToJson(
                showProcessingPreview
            ) +
            "," +
            "\"preview_time_sec\":" +
            previewTimeJson +
            "," +
            "\"color_grouping_method\":\"" +
            EscapeJson(groupingMethod) +
            "\"," +
            "\"gmm_max_groups\":" +
            maxColorGroups.ToString(
                CultureInfo.InvariantCulture
            ) +
            "," +
            "\"gmm_merge_distance\":" +
            mergeDistance.ToString(
                "0.########",
                CultureInfo.InvariantCulture
            ) +
            "}";

        stageEntries.Add(processConfig);

        return "{" +
            string.Join(",", stageEntries) +
            "}";
    }

    // ============================================================
    // REFRESH STATE
    // ============================================================

    private void RefreshCurrentState()
    {
        switch (phase)
        {
            case ComponentPhase.RunningPythonWorkflow:
                RefreshWorkflowStatus();
                break;

            case ComponentPhase.SubmittingDownload:
                SubmitDownload();
                break;

            case ComponentPhase.RunningDownload:
                RefreshDownloadStatus();
                break;

            case ComponentPhase.ReadingManifest:
                ReadLocalManifest();
                break;
        }
    }

    // ============================================================
    // PYTHON WORKFLOW STATUS
    // ============================================================

    private void RefreshWorkflowStatus()
    {
        if (string.IsNullOrWhiteSpace(
            workflowId))
        {
            Fail(
                "Workflow status error",
                "No active workflow_id is stored."
            );

            return;
        }

        string payload =
            "{" +
            "\"command\":\"get_workflow_status\"," +
            "\"workflow_id\":\"" +
            EscapeJson(workflowId) +
            "\"," +
            "\"session\":\"" +
            EscapeJson(activeSession) +
            "\"" +
            "}";

        string response =
            SendCommand(payload);

        if (response.StartsWith("ERROR:"))
        {
            ConnectionFailure(response);
            return;
        }

        string outerStatus =
            ExtractJsonValue(
                response,
                "status"
            );

        if (
            !string.Equals(
                outerStatus,
                "ok",
                StringComparison.OrdinalIgnoreCase
            ))
        {
            string responseMessage =
                ExtractJsonValue(
                    response,
                    "message"
                );

            lastStatus =
                "Workflow status request failed";

            lastMessage =
                string.IsNullOrWhiteSpace(
                    responseMessage
                )
                ? response
                : responseMessage;

            return;
        }

        string workflowJson =
            ExtractJsonObject(
                response,
                "workflow"
            );

        if (string.IsNullOrWhiteSpace(
            workflowJson))
        {
            lastStatus =
                "Workflow status unavailable";

            lastMessage =
                "The response did not contain a workflow object.\n" +
                response;

            return;
        }

        string workflowStatus =
            NormalizeStatus(
                ExtractJsonValue(
                    workflowJson,
                    "status"
                )
            );

        currentStage =
            ExtractJsonValue(
                workflowJson,
                "current_stage"
            );

        workflowProgress =
            ParseInteger(
                ExtractJsonValue(
                    workflowJson,
                    "progress"
                ),
                workflowProgress
            );

        string workflowMessage =
            ExtractJsonValue(
                workflowJson,
                "message"
            );

        string workflowError =
            ExtractJsonValue(
                workflowJson,
                "error"
            );

        lastStatus =
            string.IsNullOrWhiteSpace(
                workflowStatus
            )
            ? "Workflow status unknown"
            : workflowStatus;

        lastMessage =
            !string.IsNullOrWhiteSpace(
                workflowMessage
            )
            ? workflowMessage
            : (
                "Stage: " +
                (
                    string.IsNullOrWhiteSpace(
                        currentStage
                    )
                    ? "(none)"
                    : currentStage
                ) +
                " | Progress: " +
                workflowProgress.ToString(
                    CultureInfo.InvariantCulture
                ) +
                "%"
            );

        if (workflowStatus == "finished")
        {
            workflowProgress = 100;
            currentStage = "";

            if (!downloadWasSubmitted)
            {
                phase =
                    ComponentPhase.SubmittingDownload;

                lastStatus =
                    "Python workflow finished";

                lastMessage =
                    "Python workflow completed. " +
                    "Download is ready to be submitted.";
            }

            return;
        }

        if (
            workflowStatus == "failed" ||
            workflowStatus == "error")
        {
            Fail(
                "Python workflow failed",
                string.IsNullOrWhiteSpace(
                    workflowError
                )
                ? lastMessage
                : workflowError
            );

            return;
        }

        if (workflowStatus == "cancelled")
        {
            phase =
                ComponentPhase.Cancelled;

            lastStatus = "Workflow cancelled";

            lastMessage =
                string.IsNullOrWhiteSpace(
                    workflowMessage
                )
                ? "The Python workflow was cancelled."
                : workflowMessage;
        }
    }

    // ============================================================
    // DOWNLOAD
    // ============================================================

    private void SubmitDownload()
    {
        if (downloadWasSubmitted)
        {
            phase =
                ComponentPhase.RunningDownload;

            return;
        }

        string fileTypesJson =
            BuildFileTypesArray(
                activeDownloadFileTypes
            );

        string payload =
            "{" +
            "\"command\":\"downloadable_outputs\"," +
            "\"session\":\"" +
            EscapeJson(activeSession) +
            "\"," +
            "\"output_index\":" +
            activeOutputIndex.ToString(
                CultureInfo.InvariantCulture
            ) +
            "," +
            "\"file_types\":" +
            fileTypesJson +
            "}";

        lastStatus = "Submitting download";
        lastMessage =
            "Requesting workflow outputs from the Python Agent.";

        string response =
            SendCommand(payload);

        if (response.StartsWith("ERROR:"))
        {
            Fail(
                "Download submission failed",
                response
            );

            return;
        }

        string outerStatus =
            ExtractJsonValue(
                response,
                "status"
            );

        if (
            !string.Equals(
                outerStatus,
                "ok",
                StringComparison.OrdinalIgnoreCase
            ))
        {
            string responseMessage =
                ExtractJsonValue(
                    response,
                    "message"
                );

            Fail(
                "Download submission failed",
                string.IsNullOrWhiteSpace(
                    responseMessage
                )
                ? response
                : responseMessage
            );

            return;
        }

        downloadJobId =
            ExtractJsonValue(
                response,
                "job_id"
            );

        if (string.IsNullOrWhiteSpace(
            downloadJobId))
        {
            Fail(
                "Download submission failed",
                "The GH Agent returned success but did not " +
                "provide a download job_id.\n" +
                response
            );

            return;
        }

        downloadWasSubmitted = true;

        phase =
            ComponentPhase.RunningDownload;

        lastStatus = "Download submitted";
        lastMessage =
            "Download job submitted: " +
            downloadJobId;
    }

    private void RefreshDownloadStatus()
    {
        if (string.IsNullOrWhiteSpace(
            downloadJobId))
        {
            Fail(
                "Download status error",
                "No download job_id is stored."
            );

            return;
        }

        string payload =
            "{" +
            "\"command\":\"get_job_status\"," +
            "\"job_id\":\"" +
            EscapeJson(downloadJobId) +
            "\"" +
            "}";

        string response =
            SendCommand(payload);

        if (response.StartsWith("ERROR:"))
        {
            ConnectionFailure(response);
            return;
        }

        string outerStatus =
            ExtractJsonValue(
                response,
                "status"
            );

        if (
            !string.Equals(
                outerStatus,
                "ok",
                StringComparison.OrdinalIgnoreCase
            ))
        {
            string responseMessage =
                ExtractJsonValue(
                    response,
                    "message"
                );

            lastStatus =
                "Download status request failed";

            lastMessage =
                string.IsNullOrWhiteSpace(
                    responseMessage
                )
                ? response
                : responseMessage;

            return;
        }

        string jobJson =
            ExtractJsonObject(
                response,
                "job"
            );

        if (string.IsNullOrWhiteSpace(
            jobJson))
        {
            lastStatus =
                "Download status unavailable";

            lastMessage =
                "The response did not contain a job object.\n" +
                response;

            return;
        }

        string jobStatus =
            NormalizeStatus(
                ExtractJsonValue(
                    jobJson,
                    "status"
                )
            );

        string jobMessage =
            ExtractJsonValue(
                jobJson,
                "message"
            );

        string jobError =
            ExtractJsonValue(
                jobJson,
                "error"
            );

        lastStatus =
            string.IsNullOrWhiteSpace(
                jobStatus
            )
            ? "Download status unknown"
            : jobStatus;

        lastMessage =
            string.IsNullOrWhiteSpace(
                jobMessage
            )
            ? response
            : jobMessage;

        if (
            jobStatus == "download_finished" ||
            jobStatus == "finished")
        {
            phase =
                ComponentPhase.ReadingManifest;

            lastStatus = "Download finished";
            lastMessage =
                "Download completed. Reading local session manifest.";

            return;
        }

        if (
            jobStatus == "download_failed" ||
            jobStatus == "failed" ||
            jobStatus == "error")
        {
            Fail(
                "Download failed",
                string.IsNullOrWhiteSpace(
                    jobError
                )
                ? lastMessage
                : jobError
            );

            return;
        }

        if (jobStatus == "cancelled")
        {
            phase =
                ComponentPhase.Cancelled;

            lastStatus = "Download cancelled";
            lastMessage =
                string.IsNullOrWhiteSpace(
                    jobMessage
                )
                ? "The download job was cancelled."
                : jobMessage;
        }
    }

    // ============================================================
    // LOCAL MANIFEST
    // ============================================================

    private void ReadLocalManifest()
    {
        string fileTypesJson =
            BuildFileTypesArray(
                activeDownloadFileTypes
            );

        string categoriesJson =
            BuildCategoriesArray(
                activeDownloadCategories
            );

        string payload =
            "{" +
            "\"command\":\"list_local_downloads\"," +
            "\"session\":\"" +
            EscapeJson(activeSession) +
            "\"," +
            "\"output_index\":" +
            activeOutputIndex.ToString(
                CultureInfo.InvariantCulture
            ) +
            "," +
            "\"file_types\":" +
            fileTypesJson +
            "," +
            "\"categories\":" +
            categoriesJson +
            "}";

        string response =
            SendCommand(payload);

        if (response.StartsWith("ERROR:"))
        {
            Fail(
                "Manifest read failed",
                response
            );

            return;
        }

        string outerStatus =
            ExtractJsonValue(
                response,
                "status"
            );

        if (
            !string.Equals(
                outerStatus,
                "ok",
                StringComparison.OrdinalIgnoreCase
            ))
        {
            string responseMessage =
                ExtractJsonValue(
                    response,
                    "message"
                );

            Fail(
                "Manifest read failed",
                string.IsNullOrWhiteSpace(
                    responseMessage
                )
                ? response
                : responseMessage
            );

            return;
        }

        lastPointCloudPaths =
            ExtractLocalPathsByCategory(
                response,
                "pointclouds"
            );

        lastImagePaths =
            ExtractLocalPathsByCategory(
                response,
                "images"
            );

        lastJsonPaths =
            ExtractLocalPathsByCategory(
                response,
                "json"
            );

        manifestWasRead = true;
        phase = ComponentPhase.Finished;

        if (activeSequence == "download_only")
        {
            lastStatus = "Download finished";
            lastMessage =
                "Existing session outputs were downloaded and " +
                "the local manifest was read successfully.";
        }
        else
        {
            lastStatus = "Workflow finished";
            lastMessage =
                "Python workflow, download, and local manifest read " +
                "completed successfully.";
        }
    }

    // ============================================================
    // CANCELLATION
    // ============================================================

    private void CancelActiveWorkflow()
    {
        if (string.IsNullOrWhiteSpace(
            workflowId))
        {
            lastStatus = "Nothing to cancel";
            lastMessage =
                "No Python workflow_id is currently stored.";

            return;
        }

        if (
            phase !=
                ComponentPhase.RunningPythonWorkflow &&
            phase !=
                ComponentPhase.SubmittingWorkflow)
        {
            lastStatus =
                "Workflow cancellation unavailable";

            lastMessage =
                "Python workflow cancellation is only available " +
                "while the Python workflow is active.";

            return;
        }

        string payload =
            "{" +
            "\"command\":\"cancel_workflow\"," +
            "\"workflow_id\":\"" +
            EscapeJson(workflowId) +
            "\"," +
            "\"session\":\"" +
            EscapeJson(activeSession) +
            "\"" +
            "}";

        string response =
            SendCommand(payload);

        if (response.StartsWith("ERROR:"))
        {
            lastStatus =
                "Cancellation request failed";

            lastMessage = response;
            return;
        }

        string outerStatus =
            ExtractJsonValue(
                response,
                "status"
            );

        if (
            !string.Equals(
                outerStatus,
                "ok",
                StringComparison.OrdinalIgnoreCase
            ))
        {
            string responseMessage =
                ExtractJsonValue(
                    response,
                    "message"
                );

            lastStatus =
                "Cancellation request failed";

            lastMessage =
                string.IsNullOrWhiteSpace(
                    responseMessage
                )
                ? response
                : responseMessage;

            return;
        }

        lastStatus =
            "Cancellation requested";

        lastMessage =
            "Cancellation was requested for workflow " +
            workflowId +
            ". Refresh status to confirm.";
    }

    // ============================================================
    // NORMALIZATION
    // ============================================================

    private string NormalizeWorkflowSequence(
        string value)
    {
        string normalized =
            string.IsNullOrWhiteSpace(value)
            ? "capture_transform_process_download"
            : value
                .Trim()
                .ToLowerInvariant()
                .Replace(" ", "_")
                .Replace("-", "_")
                .Replace(">", "_")
                .Replace(",", "_");

        while (normalized.Contains("__"))
        {
            normalized =
                normalized.Replace("__", "_");
        }

        if (
            normalized == "full" ||
            normalized ==
                "capture_transform_process_download")
        {
            return
                "capture_transform_process_download";
        }

        if (
            normalized == "skip_capture" ||
            normalized ==
                "transform_process_download")
        {
            return
                "transform_process_download";
        }

        if (
            normalized == "download" ||
            normalized == "download_only")
        {
            return "download_only";
        }

        return "";
    }

    private string ResolvePythonWorkflowName(
        string normalizedSequence)
    {
        if (
            normalizedSequence ==
            "capture_transform_process_download")
        {
            return FullPythonWorkflowName;
        }

        if (
            normalizedSequence ==
            "transform_process_download")
        {
            return SkipCapturePythonWorkflowName;
        }

        if (normalizedSequence == "download_only")
        {
            return "";
        }

        return "";
    }

    private string NormalizeTransformPipeline(
        string value)
    {
        string normalized =
            string.IsNullOrWhiteSpace(value)
            ? "eye_to_base"
            : value.Trim().ToLowerInvariant();

        if (
            normalized != "eye_to_base" &&
            normalized != "base" &&
            normalized != "ref_cam")
        {
            return "eye_to_base";
        }

        return normalized;
    }

    private string ResolveProcessingInputKind(
        string requestedValue,
        string transformPipeline)
    {
        string normalized =
            string.IsNullOrWhiteSpace(
                requestedValue
            )
            ? ""
            : requestedValue
                .Trim()
                .ToLowerInvariant();

        if (
            normalized == "eye_to_base" ||
            normalized == "merged" ||
            normalized == "initial")
        {
            return normalized;
        }

        if (
            transformPipeline == "base" ||
            transformPipeline == "ref_cam")
        {
            return "merged";
        }

        return "eye_to_base";
    }

    private string NormalizeColorGroupingMethod(
        string value)
    {
        string normalized =
            string.IsNullOrWhiteSpace(value)
            ? "gmm_bic"
            : value.Trim().ToLowerInvariant();

        if (
            normalized != "gmm_bic" &&
            normalized != "dbscan" &&
            normalized != "reference")
        {
            return "gmm_bic";
        }

        return normalized;
    }

    private string NormalizeStatus(
        string value)
    {
        return string.IsNullOrWhiteSpace(value)
            ? ""
            : value.Trim().ToLowerInvariant();
    }

    private string BuildPreviewTimeJson(
        bool showPreview,
        double previewTime)
    {
        if (!showPreview)
            return "null";

        if (previewTime <= 0.0)
            return "null";

        return previewTime.ToString(
            "0.########",
            CultureInfo.InvariantCulture
        );
    }

    // ============================================================
    // FILE TYPE AND CATEGORY JSON
    // ============================================================

    private string BuildFileTypesArray(
        string fileTypes)
    {
        if (string.IsNullOrWhiteSpace(
            fileTypes))
        {
            return
                "[\"pointcloud\",\"image\",\"json\"]";
        }

        string[] parts =
            fileTypes.Split(',');

        List<string> cleaned =
            new List<string>();

        HashSet<string> unique =
            new HashSet<string>(
                StringComparer.OrdinalIgnoreCase
            );

        foreach (string part in parts)
        {
            string value =
                part.Trim().ToLowerInvariant();

            string normalized = "";

            if (
                value == "pointcloud" ||
                value == "pointclouds" ||
                value == "pcd" ||
                value == "ply")
            {
                normalized = "pointcloud";
            }
            else if (
                value == "image" ||
                value == "images" ||
                value == "img" ||
                value == "png")
            {
                normalized = "image";
            }
            else if (value == "json")
            {
                normalized = "json";
            }

            if (
                !string.IsNullOrWhiteSpace(
                    normalized
                ) &&
                unique.Add(normalized))
            {
                cleaned.Add(
                    "\"" +
                    normalized +
                    "\""
                );
            }
        }

        if (cleaned.Count == 0)
        {
            return
                "[\"pointcloud\",\"image\",\"json\"]";
        }

        return "[" +
            string.Join(",", cleaned) +
            "]";
    }

    private string BuildCategoriesArray(
        string categories)
    {
        if (string.IsNullOrWhiteSpace(
            categories))
        {
            return "[]";
        }

        string[] parts =
            categories.Split(',');

        List<string> cleaned =
            new List<string>();

        HashSet<string> unique =
            new HashSet<string>(
                StringComparer.OrdinalIgnoreCase
            );

        foreach (string part in parts)
        {
            string value =
                part
                    .Trim()
                    .ToLowerInvariant();

            if (string.IsNullOrWhiteSpace(
                value))
            {
                continue;
            }

            if (unique.Add(value))
            {
                cleaned.Add(
                    "\"" +
                    EscapeJson(value) +
                    "\""
                );
            }
        }

        return "[" +
            string.Join(",", cleaned) +
            "]";
    }

    // ============================================================
    // PATH EXTRACTION
    // ============================================================

    private List<string> ExtractLocalPathsByCategory(
        string json,
        string category)
    {
        HashSet<string> uniquePaths =
            new HashSet<string>(
                StringComparer.OrdinalIgnoreCase
            );

        List<string> paths =
            new List<string>();

        int searchStart = 0;

        while (true)
        {
            int localPathIndex =
                json.IndexOf(
                    "\"local_path\":",
                    searchStart,
                    StringComparison.Ordinal
                );

            if (localPathIndex < 0)
                break;

            string path =
                ExtractJsonStringAt(
                    json,
                    localPathIndex +
                    "\"local_path\":".Length
                );

            if (!string.IsNullOrWhiteSpace(
                path))
            {
                string normalizedPath =
                    path
                        .Replace("/", "\\")
                        .ToLowerInvariant();

                string categoryFolder =
                    "\\" +
                    category.ToLowerInvariant() +
                    "\\";

                if (
                    normalizedPath.Contains(
                        categoryFolder
                    ))
                {
                    if (uniquePaths.Add(path))
                    {
                        paths.Add(path);
                    }
                }
            }

            searchStart =
                localPathIndex + 1;
        }

        return paths;
    }

    private string ExtractJsonStringAt(
        string json,
        int start)
    {
        while (
            start < json.Length &&
            char.IsWhiteSpace(json[start]))
        {
            start++;
        }

        if (
            start >= json.Length ||
            json[start] != '"')
        {
            return "";
        }

        start++;

        StringBuilder value =
            new StringBuilder();

        bool escaped = false;

        for (
            int i = start;
            i < json.Length;
            i++)
        {
            char character = json[i];

            if (escaped)
            {
                switch (character)
                {
                    case '\\':
                        value.Append('\\');
                        break;

                    case '"':
                        value.Append('"');
                        break;

                    case 'n':
                        value.Append('\n');
                        break;

                    case 'r':
                        value.Append('\r');
                        break;

                    case 't':
                        value.Append('\t');
                        break;

                    default:
                        value.Append(character);
                        break;
                }

                escaped = false;
                continue;
            }

            if (character == '\\')
            {
                escaped = true;
                continue;
            }

            if (character == '"')
            {
                return value.ToString();
            }

            value.Append(character);
        }

        return "";
    }

    // ============================================================
    // COMPONENT STATE
    // ============================================================

    private bool IsBusy()
    {
        return (
            phase ==
                ComponentPhase.SubmittingWorkflow ||
            phase ==
                ComponentPhase.RunningPythonWorkflow ||
            phase ==
                ComponentPhase.SubmittingDownload ||
            phase ==
                ComponentPhase.RunningDownload ||
            phase ==
                ComponentPhase.ReadingManifest
        );
    }

    private void ResetRunState()
    {
        workflowId = "";
        downloadJobId = "";

        currentStage = "";
        workflowProgress = 0;

        downloadWasSubmitted = false;
        manifestWasRead = false;

        lastPointCloudPaths =
            new List<string>();

        lastImagePaths =
            new List<string>();

        lastJsonPaths =
            new List<string>();
    }

    private void Fail(
        string status,
        string message)
    {
        phase = ComponentPhase.Failed;
        lastStatus = status;
        lastMessage = message;
    }

    private void ConnectionFailure(
        string message)
    {
        isConnected = false;
        triedConnect = true;

        lastStatus = "Connection lost";
        lastMessage = message;
    }

    private string BuildStateText()
    {
        switch (phase)
        {
            case ComponentPhase.Idle:
                return "Idle";

            case ComponentPhase.SubmittingWorkflow:
                return "Submitting Python workflow";

            case ComponentPhase.RunningPythonWorkflow:
                return (
                    "Python workflow running" +
                    " | Stage: " +
                    (
                        string.IsNullOrWhiteSpace(
                            currentStage
                        )
                        ? "(none)"
                        : currentStage
                    ) +
                    " | Progress: " +
                    workflowProgress.ToString(
                        CultureInfo.InvariantCulture
                    ) +
                    "%"
                );

            case ComponentPhase.SubmittingDownload:
                return "Submitting download";
                            
            case ComponentPhase.RunningDownload:
                return "Download running";

            case ComponentPhase.ReadingManifest:
                return "Reading local manifest";

            case ComponentPhase.Finished:
                return "Finished";

            case ComponentPhase.Failed:
                return "Failed";

            case ComponentPhase.Cancelled:
                return "Cancelled";
        }

        return phase.ToString();
    }

    private void SetOutputs(
        ref object State,
        ref object Status,
        ref object Message,
        ref object WorkflowId,
        ref object DownloadJobId,
        ref object CurrentStage,
        ref object Progress,
        ref object PointCloudPaths,
        ref object ImagePaths,
        ref object JsonPaths)
    {
        State = BuildStateText();
        Status = lastStatus;
        Message = lastMessage;

        WorkflowId = workflowId;
        DownloadJobId = downloadJobId;

        CurrentStage = currentStage;
        Progress = workflowProgress;

        PointCloudPaths =
            lastPointCloudPaths;

        ImagePaths =
            lastImagePaths;

        JsonPaths =
            lastJsonPaths;
    }

    // ============================================================
    // TCP
    // ============================================================

    private string SendCommand(
        string command)
    {
        const int headerSize = 8;

        try
        {
            using (
                TcpClient client =
                    new TcpClient())
            {
                IAsyncResult result =
                    client.BeginConnect(
                        Host,
                        Port,
                        null,
                        null
                    );

                bool success =
                    result.AsyncWaitHandle.WaitOne(
                        TimeSpan.FromMilliseconds(
                            300
                        )
                    );

                if (!success)
                {
                    return
                        "ERROR: GH Agent connection timeout.";
                }

                client.EndConnect(result);

                using (
                    NetworkStream stream =
                        client.GetStream())
                {
                    byte[] payload =
                        Encoding.UTF8.GetBytes(
                            command
                        );

                    byte[] header =
                        new byte[headerSize];

                    ulong size =
                        (ulong)payload.Length;

                    for (
                        int i = 0;
                        i < headerSize;
                        i++)
                    {
                        header[
                            headerSize - 1 - i
                        ] = (byte)(
                            size & 0xFF
                        );

                        size >>= 8;
                    }

                    stream.Write(
                        header,
                        0,
                        header.Length
                    );

                    stream.Write(
                        payload,
                        0,
                        payload.Length
                    );

                    byte[] responseHeader =
                        ReadExact(
                            stream,
                            headerSize
                        );

                    ulong responseSize = 0;

                    for (
                        int i = 0;
                        i < headerSize;
                        i++)
                    {
                        responseSize =
                            (
                                responseSize << 8
                            ) +
                            responseHeader[i];
                    }

                    if (
                        responseSize >
                        int.MaxValue)
                    {
                        return
                            "ERROR: Agent response is too large.";
                    }

                    byte[] responsePayload =
                        ReadExact(
                            stream,
                            (int)responseSize
                        );

                    return Encoding.UTF8.GetString(
                        responsePayload
                    );
                }
            }
        }
        catch (Exception exception)
        {
            return (
                "ERROR: " +
                exception.Message
            );
        }
    }

    private byte[] ReadExact(
        NetworkStream stream,
        int size)
    {
        byte[] data =
            new byte[size];

        int offset = 0;

        while (offset < size)
        {
            int read =
                stream.Read(
                    data,
                    offset,
                    size - offset
                );

            if (read == 0)
            {
                throw new Exception(
                    "Connection closed."
                );
            }

            offset += read;
        }

        return data;
    }

    // ============================================================
    // JSON HELPERS
    // ============================================================

    private string BoolToJson(
        bool value)
    {
        return value
            ? "true"
            : "false";
    }

    private string EscapeJson(
        string value)
    {
        if (value == null)
            return "";

        return value
            .Replace("\\", "\\\\")
            .Replace("\"", "\\\"")
            .Replace("\r", "\\r")
            .Replace("\n", "\\n")
            .Replace("\t", "\\t");
    }

    private string ExtractJsonValue(
        string json,
        string key)
    {
        if (string.IsNullOrWhiteSpace(
            json))
        {
            return "";
        }

        string pattern =
            "\"" + key + "\":";

        int start =
            json.IndexOf(
                pattern,
                StringComparison.Ordinal
            );

        if (start < 0)
            return "";

        start += pattern.Length;

        while (
            start < json.Length &&
            char.IsWhiteSpace(json[start]))
        {
            start++;
        }

        if (start >= json.Length)
            return "";

        if (json[start] == '"')
        {
            start++;

            StringBuilder value =
                new StringBuilder();

            bool escaped = false;

            for (
                int i = start;
                i < json.Length;
                i++)
            {
                char character = json[i];

                if (escaped)
                {
                    switch (character)
                    {
                        case 'n':
                            value.Append('\n');
                            break;

                        case 'r':
                            value.Append('\r');
                            break;

                        case 't':
                            value.Append('\t');
                            break;

                        case '\\':
                            value.Append('\\');
                            break;

                        case '"':
                            value.Append('"');
                            break;

                        default:
                            value.Append(character);
                            break;
                    }

                    escaped = false;
                    continue;
                }

                if (character == '\\')
                {
                    escaped = true;
                    continue;
                }

                if (character == '"')
                {
                    return value.ToString();
                }

                value.Append(character);
            }

            return "";
        }

        if (
            json.Substring(start)
                .StartsWith(
                    "null",
                    StringComparison.Ordinal
                ))
        {
            return "";
        }

        int end = start;

        while (
            end < json.Length &&
            json[end] != ',' &&
            json[end] != '}')
        {
            end++;
        }

        return json
            .Substring(
                start,
                end - start
            )
            .Trim();
    }

    private string ExtractJsonObject(
        string json,
        string key)
    {
        if (string.IsNullOrWhiteSpace(
            json))
        {
            return "";
        }

        string pattern =
            "\"" + key + "\":";

        int keyIndex =
            json.IndexOf(
                pattern,
                StringComparison.Ordinal
            );

        if (keyIndex < 0)
            return "";

        int start =
            keyIndex + pattern.Length;

        while (
            start < json.Length &&
            char.IsWhiteSpace(json[start]))
        {
            start++;
        }

        if (
            start >= json.Length ||
            json[start] != '{')
        {
            return "";
        }

        int depth = 0;
        bool insideString = false;
        bool escaped = false;

        for (
            int i = start;
            i < json.Length;
            i++)
        {
            char character = json[i];

            if (insideString)
            {
                if (escaped)
                {
                    escaped = false;
                }
                else if (character == '\\')
                {
                    escaped = true;
                }
                else if (character == '"')
                {
                    insideString = false;
                }

                continue;
            }

            if (character == '"')
            {
                insideString = true;
                continue;
            }

            if (character == '{')
            {
                depth++;
            }
            else if (character == '}')
            {
                depth--;

                if (depth == 0)
                {
                    return json.Substring(
                        start,
                        i - start + 1
                    );
                }
            }
        }

        return "";
    }

    private int ParseInteger(
        string value,
        int fallback)
    {
        int parsed;

        if (
            int.TryParse(
                value,
                NumberStyles.Integer,
                CultureInfo.InvariantCulture,
                out parsed
            ))
        {
            return parsed;
        }

        /*
         * Handle a JSON number serialized as a decimal, if needed.
         */
        double parsedDouble;

        if (
            double.TryParse(
                value,
                NumberStyles.Float,
                CultureInfo.InvariantCulture,
                out parsedDouble
            ))
        {
            return (int)Math.Round(
                parsedDouble
            );
        }

        return fallback;
    }
}
# ---------- end c_script_3 ----------
panel_11 = Panel(c_script_3.State)
panel_12 = Panel(c_script_3.Status)
panel_13 = Panel(c_script_3.Message)
panel_14 = Panel(c_script_3.WorkflowId)
panel_15 = Panel(c_script_3.DownloadJobId)
panel_16 = Panel(c_script_3.CurrentStage)
panel_17 = Panel(c_script_3.Progress)
path = FilePath(c_script_3.PointCloudPaths)
path_2 = FilePath(c_script_3.JsonPaths)
import = ImportContent(FilePath=path)  # -> Objects, Layers, Linetypes, HatchPatterns, AnnotationStyles, Materials, BlockDefinitions

# ----
trigger = Trigger(Interval=1000, TimerInterval=1000, Target=[c_script_3, c_script_10, c_script_4, c_script_6])  # disabled

# ---- group: Data Convertor
path_3 = FilePath(path_2)
py3 = Python3Script(FileOrFolder=path_3, UseLatestInFolder=Toggle(True), MakeClosed=Toggle(True))  # -> Polylines, Centroids, MeanColors, Info
# ---------- py3: Python ----------
# GHPython script (Rhino/Grasshopper)
# Inputs:
#   FileOrFolder      : str (File Path OR folder)
#   UseLatestInFolder : bool (default True)
#   MakeClosed        : bool (default True)
# Outputs:
#   Polylines         : DataTree[Rhino.Geometry.Curve]           # in millimeters
#   Centroids         : DataTree[Rhino.Geometry.Point3d]         # in millimeters
#   MeanColors        : DataTree[System.Drawing.Color]
#   Info              : str

import os, json
import Rhino as rc
from Grasshopper import DataTree
from Grasshopper.Kernel.Data import GH_Path
import System
from System.Drawing import Color

# ---------- helpers ----------
def _bool_or_default(val, default):
    return default if (val is None) else bool(val)

def _latest_json_in_folder(folder):
    files = [os.path.join(folder, f) for f in os.listdir(folder) if f.lower().endswith(".json")]
    if not files:
        raise IOError("No .json files found in folder: {}".format(folder))
    files.sort(key=lambda p: os.path.getmtime(p), reverse=True)
    return files[0]

def _coerce_point3d(obj):
    if isinstance(obj, (list, tuple)) and len(obj) == 3:
        try:
            return rc.Geometry.Point3d(float(obj[0]), float(obj[1]), float(obj[2])), None
        except Exception as e:
            return None, "list/tuple cast failed: {}".format(e)
    if isinstance(obj, dict):
        lower = {str(k).lower(): v for k, v in obj.items()}
        if all(k in lower for k in ("x","y","z")):
            try:
                return rc.Geometry.Point3d(float(lower["x"]), float(lower["y"]), float(lower["z"])), None
            except Exception as e:
                return None, "dict cast failed: {}".format(e)
        return None, "dict missing x/y/z keys"
    return None, "unsupported type: {}".format(type(obj).__name__)

def _make_polylinecurve(pts, make_closed=True, tol=1e-9):
    if not pts or len(pts) < 2:
        return None
    pl = rc.Geometry.Polyline()
    for p in pts:
        pl.Add(p)
    if make_closed and pl.Count >= 3:
        last_idx = pl.Count - 1
        if pl[0].DistanceTo(pl[last_idx]) > tol:
            pl.Add(pl[0])
    try:
        plc = pl.ToPolylineCurve()
        if plc and plc.IsValid:
            return plc
    except:
        pass
    try:
        plc = rc.Geometry.PolylineCurve(list(pl))
        if plc and plc.IsValid:
            return plc
    except:
        pass
    return None

def _rgb_to_color(rgb):
    """rgb can be [r,g,b] in 0..1 or 0..255 -> System.Drawing.Color"""
    if not isinstance(rgb, (list, tuple)) or len(rgb) != 3:
        return None
    try:
        r, g, b = float(rgb[0]), float(rgb[1]), float(rgb[2])
    except:
        return None
    if max(r, g, b) <= 1.0:
        r, g, b = int(round(r * 255.0)), int(round(g * 255.0)), int(round(b * 255.0))
    else:
        r, g, b = int(round(r)), int(round(g)), int(round(b))
    r = max(0, min(255, r))
    g = max(0, min(255, g))
    b = max(0, min(255, b))
    return Color.FromArgb(255, r, g, b)

# --- meters -> millimeters helpers ---
def _mm_xform():
    """Uniform scale x1000 about world origin."""
    return rc.Geometry.Transform.Scale(rc.Geometry.Point3d.Origin, 1000.0)

def _to_mm_curve(curve):
    """Duplicate & scale a curve to mm."""
    if curve is None: return None
    dup = curve.DuplicateCurve()
    if dup is None: return None
    xf = _mm_xform()
    ok = dup.Transform(xf)
    return dup if ok else None

def _to_mm_point(pt):
    """Return a scaled copy of a point in mm."""
    if pt is None: return None
    p = rc.Geometry.Point3d(pt)
    p.Transform(_mm_xform())
    return p

# ---------- inputs / path ----------
if not FileOrFolder:
    raise ValueError("Provide a file path or a folder path to your JSON.")

use_latest = _bool_or_default(UseLatestInFolder, True)
make_closed = _bool_or_default(MakeClosed, True)

path = str(FileOrFolder)
if os.path.isdir(path):
    if use_latest:
        path = _latest_json_in_folder(path)
    else:
        raise ValueError("Folder given. Set UseLatestInFolder=True or pass a specific .json file path.")
elif not os.path.isfile(path):
    raise IOError("Path does not exist: {}".format(path))
elif not path.lower().endswith(".json"):
    raise IOError("File is not a .json: {}".format(path))

# ---------- load ----------
with open(path, "r") as f:
    data = json.load(f)

clusters = data.get("clusters", [])
units_in = data.get("units", "meters")  # original units in file (for Info)

# ---------- outputs ----------
Polylines  = DataTree[rc.Geometry.Curve]()          # in mm
Centroids  = DataTree[rc.Geometry.Point3d]()        # in mm
MeanColors = DataTree[Color]()                      

made_pl = 0
made_cent = 0
made_color = 0

# ---------- build ----------
for i, c in enumerate(clusters):
    # indices + color group
    try:
        plane_idx   = int(c.get("plane_index", 1)) if isinstance(c, dict) else 1
        cluster_idx = int(c.get("cluster_index", i)) if isinstance(c, dict) else i
    except:
        plane_idx, cluster_idx = 1, i

    cg = c.get("color_group", {}) if isinstance(c, dict) else {}
    try:
        group_id = int(cg.get("group_id", -1))
    except:
        group_id = -1

    # branch path = {group_id; cluster_index}
    path_key = GH_Path(group_id, cluster_idx)

    # hull -> polyline (meters)
    hull_raw = c.get("hull_3d", [])
    pts = []
    if isinstance(hull_raw, list):
        for h in hull_raw:
            pt, _ = _coerce_point3d(h)
            if pt is not None:
                pts.append(pt)

    plc_m = _make_polylinecurve(pts, make_closed)
    plc_mm = _to_mm_curve(plc_m) if (plc_m is not None and plc_m.IsValid) else None
    if plc_mm is not None and plc_mm.IsValid:
        Polylines.Add(plc_mm, path_key)
        made_pl += 1

    # centroid (meters -> mm)
    cent_raw = c.get("centroid_3d", None)
    if cent_raw is not None:
        cpt_m, _ = _coerce_point3d(cent_raw)
        cpt_mm = _to_mm_point(cpt_m)
        if cpt_mm is not None:
            Centroids.Add(cpt_mm, path_key)
            made_cent += 1

    # mean color (unitless)
    mean_rgb = cg.get("group_mean_rgb", None)
    col = _rgb_to_color(mean_rgb) if mean_rgb is not None else None
    if col is not None:
        MeanColors.Add(col, path_key)
        made_color += 1

# ---------- summary ----------
Info = "File: {} | Clusters: {} | Polylines(mm): {} | Centroids(mm): {} | MeanColors: {} | source_units: {}".format(
    os.path.basename(path), len(clusters), made_pl, made_cent, made_color, units_in
)
# ---------- end py3 ----------
panel_18 = Panel(py3.Info)
crv = Curve(py3.Polylines)
pt = Point(py3.Centroids)
panel_19 = Panel(py3.MeanColors)

# ----
panel_20 = Panel(path_2)

connect_2 = BooleanToggle(False)
refresh_status_2 = BooleanToggle(False)
c_script_4 = CSharpScript(ConnectButton=connect, RefreshStatus=refresh_status, ExpectedAction="run_design", Host="127.0.0.1", Port="6005")  # -> Trigger, ActionAvailable, Connected, State, Action, Session, SourceIndex, ActionId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; inputs ConnectButton: Boolean, RefreshStatus: Boolean, ExpectedAction: String, Host: String, Port: Int32
# ---------- c_script_4: C# ----------
// Grasshopper Script Instance

#region Usings
using System;
using System.Text;
using System.Net.Sockets;
using System.Globalization;

using Rhino;
using Rhino.Geometry;

using Grasshopper;
using Grasshopper.Kernel;
using Grasshopper.Kernel.Data;
using Grasshopper.Kernel.Types;
#endregion


public class Script_Instance : GH_ScriptInstance
{
    // ============================================================
    // CONNECTION STATE
    // ============================================================

    private bool isConnected = false;
    private bool triedConnect = false;


    // ============================================================
    // COMPONENT STATE
    // ============================================================

    private bool triggerPulse = false;
    private bool actionAvailable = false;
    private bool hasValidAction = false;
    private bool matchesExpectedAction = false;

    private string lastState =
        "Disconnected";

    private string lastAction = "";
    private string lastSession = "";
    private int lastSourceIndex = -1;
    private string lastActionId = "";
    private string lastLocalStatus = "";
    private string lastTarget = "";

    private string lastMessage =
        "Enable ConnectButton.";

    private string lastRawResponse = "";


    // ============================================================
    // MAIN
    // ============================================================

    private void RunScript(
		bool ConnectButton,
		bool RefreshStatus,
		string ExpectedAction,
		string Host,
		int Port,
		ref object Trigger,
		ref object ActionAvailable,
		ref object Connected,
		ref object State,
		ref object Action,
		ref object Session,
		ref object SourceIndex,
		ref object ActionId,
		ref object HasValidAction,
		ref object MatchesExpectedAction,
		ref object LocalStatus,
		ref object Target,
		ref object Message,
		ref object RawResponse)
    {
        // Trigger is always a one-solution pulse.
        triggerPulse = false;

        // RefreshStatus is intentionally level-triggered.
        // While true, the listener inspects the current action on every solution.
        bool shouldRefresh =
            RefreshStatus;


        // --------------------------------------------------------
        // Normalize configuration
        // --------------------------------------------------------

        string normalizedHost =
            string.IsNullOrWhiteSpace(
                Host
            )
            ? "127.0.0.1"
            : Host.Trim();

        int normalizedPort =
            Port > 0
            ? Port
            : 6005;

        string normalizedExpectedAction =
            NormalizeAction(
                ExpectedAction
            );


        // --------------------------------------------------------
        // Connection toggle off
        // --------------------------------------------------------

        if (!ConnectButton)
        {
            isConnected = false;
            triedConnect = false;

            lastState = "Disconnected";

            lastMessage =
                "Connection toggle is off.";

            lastRawResponse = "";

            actionAvailable = false;
            hasValidAction = false;
            matchesExpectedAction = false;

            ClearActionOutputs();

            SetOutputs(
                ref Trigger,
                ref ActionAvailable,
                ref Connected,
                ref State,
                ref Action,
                ref Session,
                ref SourceIndex,
                ref ActionId,
                ref HasValidAction,
                ref MatchesExpectedAction,
                ref LocalStatus,
                ref Target,
                ref Message,
                ref RawResponse
            );

            return;
        }


        // --------------------------------------------------------
        // Initial connection attempt
        // --------------------------------------------------------

        if (
            ConnectButton &&
            !isConnected &&
            !triedConnect
        )
        {
            triedConnect = true;

            string pingResponse =
                SendCommand(
                    normalizedHost,
                    normalizedPort,
                    "{\"command\":\"ping\"}"
                );

            lastRawResponse =
                pingResponse;

            if (
                pingResponse.StartsWith(
                    "ERROR:",
                    StringComparison.Ordinal
                )
            )
            {
                isConnected = false;

                lastState =
                    "Connection failed";

                lastMessage =
                    pingResponse;
            }
            else
            {
                string responseStatus =
                    ExtractJsonValue(
                        pingResponse,
                        "status"
                    );

                string responseMessage =
                    ExtractJsonValue(
                        pingResponse,
                        "message"
                    );

                if (
                    string.Equals(
                        responseStatus,
                        "ok",
                        StringComparison.OrdinalIgnoreCase
                    )
                )
                {
                    isConnected = true;

                    lastState =
                        "Connected";

                    lastMessage =
                        string.IsNullOrWhiteSpace(
                            responseMessage
                        )
                        ? "Connected to the local GH Agent."
                        : responseMessage;
                }
                else
                {
                    isConnected = false;

                    lastState =
                        "Connection failed";

                    lastMessage =
                        string.IsNullOrWhiteSpace(
                            responseMessage
                        )
                        ? pingResponse
                        : responseMessage;
                }
            }
        }


        // --------------------------------------------------------
        // Remain disconnected until user retries
        // --------------------------------------------------------

        if (!isConnected)
        {
            SetOutputs(
                ref Trigger,
                ref ActionAvailable,
                ref Connected,
                ref State,
                ref Action,
                ref Session,
                ref SourceIndex,
                ref ActionId,
                ref HasValidAction,
                ref MatchesExpectedAction,
                ref LocalStatus,
                ref Target,
                ref Message,
                ref RawResponse
            );

            return;
        }


        // --------------------------------------------------------
        // Validate expected action
        // --------------------------------------------------------

        if (
            string.IsNullOrWhiteSpace(
                normalizedExpectedAction
            )
        )
        {
            lastState =
                "Configuration error";

            lastMessage =
                "ExpectedAction cannot be empty.";

            SetOutputs(
                ref Trigger,
                ref ActionAvailable,
                ref Connected,
                ref State,
                ref Action,
                ref Session,
                ref SourceIndex,
                ref ActionId,
                ref HasValidAction,
                ref MatchesExpectedAction,
                ref LocalStatus,
                ref Target,
                ref Message,
                ref RawResponse
            );

            return;
        }


        // --------------------------------------------------------
        // Wait for controlled refresh pulse
        // --------------------------------------------------------

        if (!shouldRefresh)
        {
            if (
                lastState == "Connected" ||
                lastState == "Waiting"
            )
            {
                lastState =
                    "Waiting";

                lastMessage =
                    "Waiting while RefreshStatus is false.";
            }

            SetOutputs(
                ref Trigger,
                ref ActionAvailable,
                ref Connected,
                ref State,
                ref Action,
                ref Session,
                ref SourceIndex,
                ref ActionId,
                ref HasValidAction,
                ref MatchesExpectedAction,
                ref LocalStatus,
                ref Target,
                ref Message,
                ref RawResponse
            );

            return;
        }


        if (!actionAvailable)
        {
            hasValidAction = false;
            matchesExpectedAction = false;
        }


        // --------------------------------------------------------
        // Inspect the current local action
        // --------------------------------------------------------

        string inspectResponse =
            SendCommand(
                normalizedHost,
                normalizedPort,
                "{" +
                "\"command\":" +
                "\"get_local_project_action\"" +
                "}"
            );

        lastRawResponse =
            inspectResponse;

        if (
            inspectResponse.StartsWith(
                "ERROR:",
                StringComparison.Ordinal
            )
        )
        {
            HandleConnectionFailure(
                inspectResponse
            );

            SetOutputs(
                ref Trigger,
                ref ActionAvailable,
                ref Connected,
                ref State,
                ref Action,
                ref Session,
                ref SourceIndex,
                ref ActionId,
                ref HasValidAction,
                ref MatchesExpectedAction,
                ref LocalStatus,
                ref Target,
                ref Message,
                ref RawResponse
            );

            return;
        }


        string inspectStatus =
            ExtractJsonValue(
                inspectResponse,
                "status"
            );

        string inspectMessage =
            ExtractJsonValue(
                inspectResponse,
                "message"
            );

        lastTarget =
            ExtractJsonValue(
                inspectResponse,
                "target"
            );

        if (
            !string.Equals(
                inspectStatus,
                "ok",
                StringComparison.OrdinalIgnoreCase
            )
        )
        {
            lastState =
                "Action inspection failed";

            lastMessage =
                string.IsNullOrWhiteSpace(
                    inspectMessage
                )
                ? inspectResponse
                : inspectMessage;

            SetOutputs(
                ref Trigger,
                ref ActionAvailable,
                ref Connected,
                ref State,
                ref Action,
                ref Session,
                ref SourceIndex,
                ref ActionId,
                ref HasValidAction,
                ref MatchesExpectedAction,
                ref LocalStatus,
                ref Target,
                ref Message,
                ref RawResponse
            );

            return;
        }


        string actionJson =
            ExtractJsonObject(
                inspectResponse,
                "action"
            );


        // --------------------------------------------------------
        // No local action
        // --------------------------------------------------------

        if (
            string.IsNullOrWhiteSpace(
                actionJson
            )
        )
        {
            if (!actionAvailable)
            {
                ClearActionOutputs();
                hasValidAction = false;
                matchesExpectedAction = false;
            }

            lastTarget =
                ExtractJsonValue(
                    inspectResponse,
                    "target"
                );

            lastState =
                actionAvailable
                ? "Holding consumed action"
                : "Waiting for action";

            lastMessage =
                string.IsNullOrWhiteSpace(
                    inspectMessage
                )
                ? (
                    actionAvailable
                    ? "No new local action. Holding the last consumed action."
                    : "No active local project action."
                )
                : inspectMessage;

            SetOutputs(
                ref Trigger,
                ref ActionAvailable,
                ref Connected,
                ref State,
                ref Action,
                ref Session,
                ref SourceIndex,
                ref ActionId,
                ref HasValidAction,
                ref MatchesExpectedAction,
                ref LocalStatus,
                ref Target,
                ref Message,
                ref RawResponse
            );

            return;
        }


        // --------------------------------------------------------
        // Read local action
        // --------------------------------------------------------

        lastAction =
            NormalizeAction(
                ExtractJsonValue(
                    actionJson,
                    "action"
                )
            );

        lastSession =
            ExtractJsonValue(
                actionJson,
                "session"
            );

        lastActionId =
            ExtractJsonValue(
                actionJson,
                "action_id"
            );

        lastLocalStatus =
            NormalizeStatus(
                ExtractJsonValue(
                    actionJson,
                    "local_status"
                )
            );

        lastTarget =
            ExtractJsonValue(
                actionJson,
                "target"
            );

        lastSourceIndex =
            ParseInteger(
                ExtractJsonValue(
                    actionJson,
                    "source_output_index"
                ),
                -1
            );


        // --------------------------------------------------------
        // Safety validation
        // --------------------------------------------------------

        if (
            string.IsNullOrWhiteSpace(
                lastActionId
            )
        )
        {
            hasValidAction = false;
            matchesExpectedAction = false;

            lastState =
                "Invalid local action";

            lastMessage =
                "The local action is missing action_id.";

            SetOutputs(
                ref Trigger,
                ref ActionAvailable,
                ref Connected,
                ref State,
                ref Action,
                ref Session,
                ref SourceIndex,
                ref ActionId,
                ref HasValidAction,
                ref MatchesExpectedAction,
                ref LocalStatus,
                ref Target,
                ref Message,
                ref RawResponse
            );

            return;
        }

        if (
            string.IsNullOrWhiteSpace(
                lastSession
            )
        )
        {
            hasValidAction = false;
            matchesExpectedAction = false;

            lastState =
                "Invalid local action";

            lastMessage =
                "The local action is missing session.";

            SetOutputs(
                ref Trigger,
                ref ActionAvailable,
                ref Connected,
                ref State,
                ref Action,
                ref Session,
                ref SourceIndex,
                ref ActionId,
                ref HasValidAction,
                ref MatchesExpectedAction,
                ref LocalStatus,
                ref Target,
                ref Message,
                ref RawResponse
            );

            return;
        }

        if (lastSourceIndex < 1)
        {
            hasValidAction = false;
            matchesExpectedAction = false;

            lastState =
                "Invalid local action";

            lastMessage =
                "The local action is missing a valid " +
                "source_output_index.";

            SetOutputs(
                ref Trigger,
                ref ActionAvailable,
                ref Connected,
                ref State,
                ref Action,
                ref Session,
                ref SourceIndex,
                ref ActionId,
                ref HasValidAction,
                ref MatchesExpectedAction,
                ref LocalStatus,
                ref Target,
                ref Message,
                ref RawResponse
            );

            return;
        }


        hasValidAction = true;


        // --------------------------------------------------------
        // Compare received and expected actions
        // --------------------------------------------------------

        if (
            !string.Equals(
                lastAction,
                normalizedExpectedAction,
                StringComparison.OrdinalIgnoreCase
            )
        )
        {
            matchesExpectedAction = false;

            lastState =
                "Action mismatch";

            lastMessage =
                "Expected action '" +
                normalizedExpectedAction +
                "', but received '" +
                (
                    string.IsNullOrWhiteSpace(
                        lastAction
                    )
                    ? "(empty)"
                    : lastAction
                ) +
                "'. The action was not consumed.";

            SetOutputs(
                ref Trigger,
                ref ActionAvailable,
                ref Connected,
                ref State,
                ref Action,
                ref Session,
                ref SourceIndex,
                ref ActionId,
                ref HasValidAction,
                ref MatchesExpectedAction,
                ref LocalStatus,
                ref Target,
                ref Message,
                ref RawResponse
            );

            return;
        }


        matchesExpectedAction = true;


        // --------------------------------------------------------
        // Do not consume an already handled action
        // --------------------------------------------------------

        if (
            !string.Equals(
                lastLocalStatus,
                "claimed",
                StringComparison.OrdinalIgnoreCase
            )
        )
        {
            lastState =
                "Action already handled";

            lastMessage =
                "Action '" +
                lastAction +
                "' has local status '" +
                (
                    string.IsNullOrWhiteSpace(
                        lastLocalStatus
                    )
                    ? "(unknown)"
                    : lastLocalStatus
                ) +
                "'. No trigger was generated.";

            SetOutputs(
                ref Trigger,
                ref ActionAvailable,
                ref Connected,
                ref State,
                ref Action,
                ref Session,
                ref SourceIndex,
                ref ActionId,
                ref HasValidAction,
                ref MatchesExpectedAction,
                ref LocalStatus,
                ref Target,
                ref Message,
                ref RawResponse
            );

            return;
        }


        // --------------------------------------------------------
        // Consume matching claimed action
        // --------------------------------------------------------

        string consumeResponse =
            SendCommand(
                normalizedHost,
                normalizedPort,
                "{" +
                "\"command\":" +
                "\"consume_local_project_action\"" +
                "}"
            );

        lastRawResponse =
            consumeResponse;

        if (
            consumeResponse.StartsWith(
                "ERROR:",
                StringComparison.Ordinal
            )
        )
        {
            HandleConnectionFailure(
                consumeResponse
            );

            SetOutputs(
                ref Trigger,
                ref ActionAvailable,
                ref Connected,
                ref State,
                ref Action,
                ref Session,
                ref SourceIndex,
                ref ActionId,
                ref HasValidAction,
                ref MatchesExpectedAction,
                ref LocalStatus,
                ref Target,
                ref Message,
                ref RawResponse
            );

            return;
        }


        string consumeStatus =
            ExtractJsonValue(
                consumeResponse,
                "status"
            );

        string consumeMessage =
            ExtractJsonValue(
                consumeResponse,
                "message"
            );

        bool receivedTrigger =
            ParseBoolean(
                ExtractJsonValue(
                    consumeResponse,
                    "trigger"
                )
            );

        string consumedActionJson =
            ExtractJsonObject(
                consumeResponse,
                "action"
            );


        // --------------------------------------------------------
        // Consume rejected
        // --------------------------------------------------------

        if (
            !string.Equals(
                consumeStatus,
                "ok",
                StringComparison.OrdinalIgnoreCase
            )
        )
        {
            triggerPulse = false;

            lastState =
                "Action consumption failed";

            lastMessage =
                string.IsNullOrWhiteSpace(
                    consumeMessage
                )
                ? consumeResponse
                : consumeMessage;

            SetOutputs(
                ref Trigger,
                ref ActionAvailable,
                ref Connected,
                ref State,
                ref Action,
                ref Session,
                ref SourceIndex,
                ref ActionId,
                ref HasValidAction,
                ref MatchesExpectedAction,
                ref LocalStatus,
                ref Target,
                ref Message,
                ref RawResponse
            );

            return;
        }


        // --------------------------------------------------------
        // Refresh outputs from consumed action
        // --------------------------------------------------------

        if (
            !string.IsNullOrWhiteSpace(
                consumedActionJson
            )
        )
        {
            lastAction =
                NormalizeAction(
                    ExtractJsonValue(
                        consumedActionJson,
                        "action"
                    )
                );

            lastSession =
                ExtractJsonValue(
                    consumedActionJson,
                    "session"
                );

            lastActionId =
                ExtractJsonValue(
                    consumedActionJson,
                    "action_id"
                );

            lastLocalStatus =
                NormalizeStatus(
                    ExtractJsonValue(
                        consumedActionJson,
                        "local_status"
                    )
                );

            lastTarget =
                ExtractJsonValue(
                    consumedActionJson,
                    "target"
                );

            lastSourceIndex =
                ParseInteger(
                    ExtractJsonValue(
                        consumedActionJson,
                        "source_output_index"
                    ),
                    lastSourceIndex
                );
        }


        // --------------------------------------------------------
        // Emit the one-solution trigger
        // --------------------------------------------------------

        triggerPulse =
            receivedTrigger;

        if (triggerPulse)
        {
            actionAvailable = true;
            hasValidAction = true;
            matchesExpectedAction = true;

            lastState =
                "Action triggered";

            lastMessage =
                string.IsNullOrWhiteSpace(
                    consumeMessage
                )
                ? (
                    "Action '" +
                    lastAction +
                    "' was consumed and triggered."
                )
                : consumeMessage;

            AddRuntimeMessage(
                GH_RuntimeMessageLevel.Remark,
                "Triggered '" +
                lastAction +
                "' for session '" +
                lastSession +
                "'."
            );
        }
        else
        {
            lastState =
                "No trigger";

            lastMessage =
                string.IsNullOrWhiteSpace(
                    consumeMessage
                )
                ? "The action did not produce a trigger."
                : consumeMessage;
        }


        SetOutputs(
            ref Trigger,
            ref ActionAvailable,
            ref Connected,
            ref State,
            ref Action,
            ref Session,
            ref SourceIndex,
            ref ActionId,
            ref HasValidAction,
            ref MatchesExpectedAction,
            ref LocalStatus,
            ref Target,
            ref Message,
            ref RawResponse
        );
    }


    // ============================================================
    // OUTPUTS
    // ============================================================

    private void SetOutputs(
        ref object Trigger,
        ref object ActionAvailable,
        ref object Connected,
        ref object State,
        ref object Action,
        ref object Session,
        ref object SourceIndex,
        ref object ActionId,
        ref object HasValidAction,
        ref object MatchesExpectedAction,
        ref object LocalStatus,
        ref object Target,
        ref object Message,
        ref object RawResponse)
    {
        Trigger =
            triggerPulse;

        ActionAvailable =
            actionAvailable;

        Connected =
            isConnected;

        State =
            lastState;

        Action =
            lastAction;

        Session =
            lastSession;

        SourceIndex =
            lastSourceIndex >= 0
            ? (object)lastSourceIndex
            : null;

        ActionId =
            lastActionId;

        HasValidAction =
            hasValidAction;

        MatchesExpectedAction =
            matchesExpectedAction;

        LocalStatus =
            lastLocalStatus;

        Target =
            lastTarget;

        Message =
            lastMessage;

        RawResponse =
            lastRawResponse;
    }


    private void ClearActionOutputs()
    {
        lastAction = "";
        lastSession = "";
        lastSourceIndex = -1;
        lastActionId = "";
        lastLocalStatus = "";
        lastTarget = "";
    }


    // ============================================================
    // CONNECTION FAILURE
    // ============================================================

    private void HandleConnectionFailure(
        string message)
    {
        isConnected = false;
        triedConnect = true;

        triggerPulse = false;
        actionAvailable = false;
        hasValidAction = false;
        matchesExpectedAction = false;

        lastState =
            "Connection lost";

        lastMessage =
            message;
    }


    // ============================================================
    // NORMALIZATION
    // ============================================================

    private string NormalizeAction(
        string value)
    {
        if (
            string.IsNullOrWhiteSpace(
                value
            )
        )
        {
            return "";
        }

        string normalized =
            value
                .Trim()
                .ToLowerInvariant()
                .Replace(" ", "_")
                .Replace("-", "_");

        while (
            normalized.Contains("__")
        )
        {
            normalized =
                normalized.Replace(
                    "__",
                    "_"
                );
        }

        return normalized.Trim('_');
    }


    private string NormalizeStatus(
        string value)
    {
        return string.IsNullOrWhiteSpace(
            value
        )
            ? ""
            : value
                .Trim()
                .ToLowerInvariant();
    }


    // ============================================================
    // TCP
    // ============================================================

    private string SendCommand(
        string host,
        int port,
        string command)
    {
        const int headerSize = 8;

        try
        {
            using (
                TcpClient client =
                    new TcpClient()
            )
            {
                IAsyncResult result =
                    client.BeginConnect(
                        host,
                        port,
                        null,
                        null
                    );

                bool success =
                    result.AsyncWaitHandle.WaitOne(
                        TimeSpan.FromMilliseconds(
                            300
                        )
                    );

                if (!success)
                {
                    return
                        "ERROR: GH Agent connection timeout.";
                }

                client.EndConnect(
                    result
                );

                client.ReceiveTimeout = 5000;
                client.SendTimeout = 5000;

                using (
                    NetworkStream stream =
                        client.GetStream()
                )
                {
                    byte[] payload =
                        Encoding.UTF8.GetBytes(
                            command
                        );

                    byte[] header =
                        new byte[headerSize];

                    ulong size =
                        (ulong)payload.Length;

                    for (
                        int index = 0;
                        index < headerSize;
                        index++
                    )
                    {
                        header[
                            headerSize - 1 - index
                        ] = (byte)(
                            size & 0xFF
                        );

                        size >>= 8;
                    }

                    stream.Write(
                        header,
                        0,
                        header.Length
                    );

                    stream.Write(
                        payload,
                        0,
                        payload.Length
                    );

                    byte[] responseHeader =
                        ReadExact(
                            stream,
                            headerSize
                        );

                    ulong responseSize = 0;

                    for (
                        int index = 0;
                        index < headerSize;
                        index++
                    )
                    {
                        responseSize =
                            (
                                responseSize << 8
                            ) +
                            responseHeader[index];
                    }

                    if (
                        responseSize >
                        int.MaxValue
                    )
                    {
                        return
                            "ERROR: Agent response is too large.";
                    }

                    byte[] responsePayload =
                        ReadExact(
                            stream,
                            (int)responseSize
                        );

                    return
                        Encoding.UTF8.GetString(
                            responsePayload
                        );
                }
            }
        }
        catch (Exception exception)
        {
            return
                "ERROR: " +
                exception.Message;
        }
    }


    private byte[] ReadExact(
        NetworkStream stream,
        int size)
    {
        byte[] data =
            new byte[size];

        int offset = 0;

        while (offset < size)
        {
            int read =
                stream.Read(
                    data,
                    offset,
                    size - offset
                );

            if (read == 0)
            {
                throw new Exception(
                    "Connection closed."
                );
            }

            offset += read;
        }

        return data;
    }


    // ============================================================
    // JSON HELPERS
    // ============================================================

    private string ExtractJsonValue(
        string json,
        string key)
    {
        if (
            string.IsNullOrWhiteSpace(
                json
            )
        )
        {
            return "";
        }

        string pattern =
            "\"" +
            key +
            "\":";

        int start =
            json.IndexOf(
                pattern,
                StringComparison.Ordinal
            );

        if (start < 0)
        {
            return "";
        }

        start +=
            pattern.Length;

        while (
            start < json.Length &&
            char.IsWhiteSpace(
                json[start]
            )
        )
        {
            start++;
        }

        if (
            start >= json.Length
        )
        {
            return "";
        }

        if (
            json[start] == '"'
        )
        {
            start++;

            StringBuilder value =
                new StringBuilder();

            bool escaped = false;

            for (
                int index = start;
                index < json.Length;
                index++
            )
            {
                char character =
                    json[index];

                if (escaped)
                {
                    switch (character)
                    {
                        case 'n':
                            value.Append('\n');
                            break;

                        case 'r':
                            value.Append('\r');
                            break;

                        case 't':
                            value.Append('\t');
                            break;

                        case '\\':
                            value.Append('\\');
                            break;

                        case '"':
                            value.Append('"');
                            break;

                        default:
                            value.Append(
                                character
                            );
                            break;
                    }

                    escaped = false;
                    continue;
                }

                if (
                    character == '\\'
                )
                {
                    escaped = true;
                    continue;
                }

                if (
                    character == '"'
                )
                {
                    return
                        value.ToString();
                }

                value.Append(
                    character
                );
            }

            return "";
        }

        if (
            json.Substring(
                start
            ).StartsWith(
                "null",
                StringComparison.Ordinal
            )
        )
        {
            return "";
        }

        int end =
            start;

        while (
            end < json.Length &&
            json[end] != ',' &&
            json[end] != '}'
        )
        {
            end++;
        }

        return json
            .Substring(
                start,
                end - start
            )
            .Trim();
    }


    private string ExtractJsonObject(
        string json,
        string key)
    {
        if (
            string.IsNullOrWhiteSpace(
                json
            )
        )
        {
            return "";
        }

        string pattern =
            "\"" +
            key +
            "\":";

        int keyIndex =
            json.IndexOf(
                pattern,
                StringComparison.Ordinal
            );

        if (keyIndex < 0)
        {
            return "";
        }

        int start =
            keyIndex +
            pattern.Length;

        while (
            start < json.Length &&
            char.IsWhiteSpace(
                json[start]
            )
        )
        {
            start++;
        }

        if (
            start >= json.Length ||
            json[start] != '{'
        )
        {
            return "";
        }

        int depth = 0;
        bool insideString = false;
        bool escaped = false;

        for (
            int index = start;
            index < json.Length;
            index++
        )
        {
            char character =
                json[index];

            if (insideString)
            {
                if (escaped)
                {
                    escaped = false;
                }
                else if (
                    character == '\\'
                )
                {
                    escaped = true;
                }
                else if (
                    character == '"'
                )
                {
                    insideString = false;
                }

                continue;
            }

            if (
                character == '"'
            )
            {
                insideString = true;
                continue;
            }

            if (
                character == '{'
            )
            {
                depth++;
            }
            else if (
                character == '}'
            )
            {
                depth--;

                if (
                    depth == 0
                )
                {
                    return json.Substring(
                        start,
                        index - start + 1
                    );
                }
            }
        }

        return "";
    }


    private bool ParseBoolean(
        string value)
    {
        bool parsedBoolean;

        if (
            bool.TryParse(
                value,
                out parsedBoolean
            )
        )
        {
            return parsedBoolean;
        }

        int parsedInteger;

        if (
            int.TryParse(
                value,
                NumberStyles.Integer,
                CultureInfo.InvariantCulture,
                out parsedInteger
            )
        )
        {
            return
                parsedInteger != 0;
        }

        return false;
    }


    private int ParseInteger(
        string value,
        int fallback)
    {
        int parsed;

        if (
            int.TryParse(
                value,
                NumberStyles.Integer,
                CultureInfo.InvariantCulture,
                out parsed
            )
        )
        {
            return parsed;
        }

        double parsedDouble;

        if (
            double.TryParse(
                value,
                NumberStyles.Float,
                CultureInfo.InvariantCulture,
                out parsedDouble
            )
        )
        {
            return
                (int)Math.Round(
                    parsedDouble
                );
        }

        return fallback;
    }
}
# ---------- end c_script_4 ----------
panel_21 = Panel(c_script_4.Connected)
panel_22 = Panel(c_script_4.State)
panel_23 = Panel(c_script_4.Action)
panel_24 = Panel(c_script_4.Trigger)
panel_25 = Panel(c_script_4.ActionAvailable)
panel_26 = Panel(c_script_4.Session)
panel_27 = Panel(c_script_4.SourceIndex)
panel_28 = Panel(c_script_4.ActionId)
panel_29 = Panel(c_script_4.HasValidAction)
panel_30 = Panel(c_script_4.MatchesExpectedAction)
panel_31 = Panel(c_script_4.LocalStatus)
panel_32 = Panel(c_script_4.Target)
panel_33 = Panel(c_script_4.Message)
panel_34 = Panel(c_script_4.RawResponse)

rec = DataRecorder(c_script_4.ActionAvailable, DataLimit=-10, RecordData=True)
panel_35 = Panel(rec)

crv_2 = Curve(flatten(crv))
reduce = RandomReduce(List=crv_2, Reduction=Slider(2, range=0..10), Seed=1)
toggle = BooleanToggle(True)
lng = ListLength(List=reduce)
and = GateAnd(A=lng, B=c_script_4.ActionAvailable)
dispatch = Dispatch(List=reduce, DispatchPattern=and)  # -> ListA, ListB
X = UnitX(Factor=Slider(10, range=0..10))
move = Move(Geometry=dispatch.ListA, Motion=X)  # -> Geometry, Transform
panel_36 = Panel(and)
lng_2 = ListLength(List=crv_2)
null = NullItem(Item=move.Geometry)  # -> NullFlags, InvalidFlags, Description
null_2 = NullItem(Item=lng_2)  # -> NullFlags, InvalidFlags, Description
cset = CreateSet(List=null.InvalidFlags)  # -> Set, Map
cset_2 = CreateSet(List=null_2.InvalidFlags)  # -> Set, Map
bool = Boolean(cset_2.Set)
bool_2 = Boolean(invert(cset.Set))
and_2 = GateAnd(A=bool, B=bool_2)
crv_3 = Curve(graft(move.Geometry))
panel_37 = Panel(bool)
panel_38 = Panel(bool_2)
panel_39 = Panel(and_2)

button = Button()
reset = Button()
c_script_5 = CSharpScript(Signal=bool_2, Reset=reset)  # -> EventId, HasEvent, Status; inputs Signal: Boolean, Reset: Boolean
# ---------- c_script_5: C# ----------
// Grasshopper Script Instance

#region Usings
using System;

using Rhino;
using Rhino.Geometry;

using Grasshopper;
using Grasshopper.Kernel;
using Grasshopper.Kernel.Data;
using Grasshopper.Kernel.Types;
#endregion


public class Script_Instance : GH_ScriptInstance
{
    //============================================================
    // Persistent state
    //============================================================

    private bool previousSignal = false;
    private bool previousReset = false;

    private long currentEventId = 0;


    //============================================================
    // Main
    //============================================================

    private void RunScript(
		bool Signal,
		bool Reset,
		ref object EventId,
		ref object HasEvent,
		ref object Status)
    {
        // Detect reset button press (rising edge)
        bool resetEvent =
            Reset &&
            !previousReset;

        previousReset = Reset;

        if (resetEvent)
        {
            currentEventId = 0;
            previousSignal = false;

            EventId = currentEventId;
            HasEvent = false;
            Status = "Event tracker reset.";

            return;
        }

        // Detect new design workflow event (rising edge)
        bool newEvent =
            Signal &&
            !previousSignal;

        if (newEvent)
        {
            currentEventId++;
        }

        previousSignal = Signal;

        // Outputs
        EventId = currentEventId;
        HasEvent = currentEventId > 0;

        if (newEvent)
        {
            Status =
                "New design event #" +
                currentEventId +
                " detected.";
        }
        else if (Signal)
        {
            Status =
                "Signal HIGH. Tracking event #" +
                currentEventId + ".";
        }
        else
        {
            Status =
                currentEventId > 0
                ? "Tracking event #" + currentEventId + "."
                : "Waiting for first design event.";
        }
    }
}
# ---------- end c_script_5 ----------
panel_40 = Panel(c_script_5.HasEvent)
panel_41 = Panel(c_script_5.EventId)
panel_42 = Panel(c_script_5.Status)

# ---- group: Local Path Generator for Design Data
connect_3 = BooleanToggle(False)
c_script_6 = CSharpScript(
    ConnectButton=connect,
    EventId=c_script_5.EventId,
    RequestEnabled=refresh_status,
    SessionName=c_script_4.Session,
    Reset=reset)  # -> Status, Message, SessionFolder, ManifestPath, ProcessedEventId, PathAvailable; inputs ConnectButton: Boolean, EventId: Int64, RequestEnabled: Boolean, SessionName: String, Reset: Boolean
#   port EventId: Casts source data to object
# ---------- c_script_6: C# ----------
// Grasshopper Script Instance

#region Usings
using System;
using System.Text;
using System.Net.Sockets;

using Rhino;
using Rhino.Geometry;

using Grasshopper;
using Grasshopper.Kernel;
using Grasshopper.Kernel.Data;
using Grasshopper.Kernel.Types;
#endregion


public class Script_Instance : GH_ScriptInstance
{
    //============================================================
    // Persistent event state
    //============================================================

    private long lastProcessedEventId = 0;

    private bool previousReset = false;
    private bool pathAvailable = false;


    //============================================================
    // Persistent connection state
    //============================================================

    private bool isConnected = false;
    private bool triedConnect = false;


    //============================================================
    // Persistent output state
    //============================================================

    private string lastStatus =
        "Disconnected";

    private string lastMessage =
        "Enable ConnectButton.";

    private string lastSessionFolder =
        "";

    private string lastManifestPath =
        "";


    //============================================================
    // Main
    //============================================================

    private void RunScript(
		bool ConnectButton,
		long EventId,
		bool RequestEnabled,
		string SessionName,
		bool Reset,
		ref object Status,
		ref object Message,
		ref object SessionFolder,
		ref object ManifestPath,
		ref object ProcessedEventId,
		ref object PathAvailable)
    {
        const string host =
            "127.0.0.1";

        const int port =
            6005;

        try
        {
            //====================================================
            // RESET
            //====================================================

            bool resetEvent =
                Reset &&
                !previousReset;

            previousReset =
                Reset;

            if (resetEvent)
            {
                ResetEventState();

                SetOutputs(
                    ref Status,
                    ref Message,
                    ref SessionFolder,
                    ref ManifestPath,
                    ref ProcessedEventId,
                    ref PathAvailable
                );

                return;
            }


            //====================================================
            // CONNECTION DISABLED
            //====================================================

            if (!ConnectButton)
            {
                isConnected =
                    false;

                triedConnect =
                    false;

                lastStatus =
                    "Disconnected";

                lastMessage =
                    "Connection toggle is off.";

                SetOutputs(
                    ref Status,
                    ref Message,
                    ref SessionFolder,
                    ref ManifestPath,
                    ref ProcessedEventId,
                    ref PathAvailable
                );

                return;
            }


            //====================================================
            // INITIAL CONNECTION
            //====================================================

            if (
                ConnectButton &&
                !isConnected &&
                !triedConnect)
            {
                triedConnect =
                    true;

                string response =
                    SendCommand(
                        host,
                        port,
                        "{\"command\":\"ping\"}"
                    );

                if (
                    response.StartsWith(
                        "ERROR:",
                        StringComparison.Ordinal
                    ))
                {
                    isConnected =
                        false;

                    lastStatus =
                        "Connection failed";

                    lastMessage =
                        response;
                }
                else
                {
                    string responseStatus =
                        ExtractJsonValue(
                            response,
                            "status"
                        );

                    if (
                        string.Equals(
                            responseStatus,
                            "ok",
                            StringComparison.OrdinalIgnoreCase
                        ))
                    {
                        isConnected =
                            true;

                        lastStatus =
                            "Connected";

                        string responseMessage =
                            ExtractJsonValue(
                                response,
                                "message"
                            );

                        lastMessage =
                            string.IsNullOrWhiteSpace(
                                responseMessage
                            )
                            ? response
                            : responseMessage;
                    }
                    else
                    {
                        isConnected =
                            false;

                        lastStatus =
                            "Connection failed";

                        lastMessage =
                            response;
                    }
                }
            }


            //====================================================
            // NO ACTIVE CONNECTION
            //====================================================

            if (!isConnected)
            {
                SetOutputs(
                    ref Status,
                    ref Message,
                    ref SessionFolder,
                    ref ManifestPath,
                    ref ProcessedEventId,
                    ref PathAvailable
                );

                return;
            }


            //====================================================
            // EVENT VALIDATION
            //====================================================

            if (EventId <= 0)
            {
                if (pathAvailable)
                {
                    lastStatus =
                        "Upload session ready";

                    lastMessage =
                        "Holding the paths generated for event #" +
                        lastProcessedEventId +
                        ".";
                }
                else
                {
                    lastStatus =
                        "Connected";

                    lastMessage =
                        "Waiting for the first valid EventId.";
                }

                SetOutputs(
                    ref Status,
                    ref Message,
                    ref SessionFolder,
                    ref ManifestPath,
                    ref ProcessedEventId,
                    ref PathAvailable
                );

                return;
            }


            if (EventId < lastProcessedEventId)
            {
                lastStatus =
                    "Older EventId ignored";

                lastMessage =
                    "EventId " +
                    EventId +
                    " is older than processed event #" +
                    lastProcessedEventId +
                    ". Reset the Path Generator before restarting " +
                    "the event counter.";

                SetOutputs(
                    ref Status,
                    ref Message,
                    ref SessionFolder,
                    ref ManifestPath,
                    ref ProcessedEventId,
                    ref PathAvailable
                );

                return;
            }


            //====================================================
            // PERSISTENT EVENT CONDITION
            //====================================================

            bool shouldRequestPath =
                RequestEnabled &&
                EventId > lastProcessedEventId;


            if (!shouldRequestPath)
            {
                if (
                    EventId > lastProcessedEventId &&
                    !RequestEnabled)
                {
                    lastStatus =
                        "Path request paused";

                    lastMessage =
                        "Event #" +
                        EventId +
                        " is waiting because RequestEnabled is false.";
                }
                else if (
                    EventId == lastProcessedEventId &&
                    pathAvailable)
                {
                    lastStatus =
                        "Upload session ready";

                    lastMessage =
                        "Holding the paths generated for event #" +
                        lastProcessedEventId +
                        ".";
                }
                else
                {
                    lastStatus =
                        "Connected";

                    lastMessage =
                        "Waiting for a new event.";
                }

                SetOutputs(
                    ref Status,
                    ref Message,
                    ref SessionFolder,
                    ref ManifestPath,
                    ref ProcessedEventId,
                    ref PathAvailable
                );

                return;
            }


            //====================================================
            // REQUEST PATHS FOR NEW EVENT
            //====================================================

            string session =
                string.IsNullOrWhiteSpace(
                    SessionName
                )
                ? "RQC_Capture_Session"
                : SessionName.Trim();

            string payload =
                "{" +
                "\"command\":\"get_upload_session_path\"," +
                "\"session\":\"" +
                EscapeJson(session) +
                "\"" +
                "}";

            string pathResponse =
                SendCommand(
                    host,
                    port,
                    payload
                );


            //====================================================
            // CONNECTION ERROR
            //====================================================

            if (
                pathResponse.StartsWith(
                    "ERROR:",
                    StringComparison.Ordinal
                ))
            {
                isConnected =
                    false;

                triedConnect =
                    true;

                lastStatus =
                    "Connection lost";

                lastMessage =
                    pathResponse;

                /*
                 * Do not update lastProcessedEventId.
                 *
                 * EventId remains pending and can be retried after the
                 * connection toggle is turned off and on again.
                 */
                SetOutputs(
                    ref Status,
                    ref Message,
                    ref SessionFolder,
                    ref ManifestPath,
                    ref ProcessedEventId,
                    ref PathAvailable
                );

                return;
            }


            //====================================================
            // RESPONSE STATUS
            //====================================================

            string pathResponseStatus =
                ExtractJsonValue(
                    pathResponse,
                    "status"
                );

            if (
                !string.Equals(
                    pathResponseStatus,
                    "ok",
                    StringComparison.OrdinalIgnoreCase
                ))
            {
                lastStatus =
                    "Upload path request failed";

                string responseMessage =
                    ExtractJsonValue(
                        pathResponse,
                        "message"
                    );

                lastMessage =
                    string.IsNullOrWhiteSpace(
                        responseMessage
                    )
                    ? pathResponse
                    : responseMessage;

                /*
                 * Do not update lastProcessedEventId.
                 *
                 * The same event remains eligible for another request
                 * during a later Grasshopper solution.
                 */
                SetOutputs(
                    ref Status,
                    ref Message,
                    ref SessionFolder,
                    ref ManifestPath,
                    ref ProcessedEventId,
                    ref PathAvailable
                );

                return;
            }


            //====================================================
            // EXTRACT RETURNED PATHS
            //====================================================

            string returnedSessionFolder =
                ExtractJsonValue(
                    pathResponse,
                    "session_folder"
                );

            string returnedManifestPath =
                ExtractJsonValue(
                    pathResponse,
                    "manifest_path"
                );


            if (
                string.IsNullOrWhiteSpace(
                    returnedSessionFolder
                ) ||
                string.IsNullOrWhiteSpace(
                    returnedManifestPath
                ))
            {
                lastStatus =
                    "Upload path response invalid";

                lastMessage =
                    "The GH Agent returned success, but the session " +
                    "folder or manifest path was empty.";

                /*
                 * Keep the previous valid paths intact.
                 * Do not process the new EventId.
                 */
                SetOutputs(
                    ref Status,
                    ref Message,
                    ref SessionFolder,
                    ref ManifestPath,
                    ref ProcessedEventId,
                    ref PathAvailable
                );

                return;
            }


            //====================================================
            // COMMIT SUCCESSFUL EVENT
            //====================================================

            /*
             * Commit all state only after the request has completed
             * successfully and both returned paths are valid.
             */
            lastSessionFolder =
                returnedSessionFolder;

            lastManifestPath =
                returnedManifestPath;

            lastProcessedEventId =
                EventId;

            pathAvailable =
                true;

            lastStatus =
                "Upload session ready";

            lastMessage =
                "The local upload session folder and manifest are " +
                "ready for event #" +
                EventId +
                ".";


            SetOutputs(
                ref Status,
                ref Message,
                ref SessionFolder,
                ref ManifestPath,
                ref ProcessedEventId,
                ref PathAvailable
            );
        }
        catch (Exception exception)
        {
            lastStatus =
                "Path Generator failed";

            lastMessage =
                exception.Message;

            SetOutputs(
                ref Status,
                ref Message,
                ref SessionFolder,
                ref ManifestPath,
                ref ProcessedEventId,
                ref PathAvailable
            );
        }
    }


    //============================================================
    // RESET
    //============================================================

    private void ResetEventState()
    {
        lastProcessedEventId =
            0;

        lastSessionFolder =
            "";

        lastManifestPath =
            "";

        pathAvailable =
            false;

        lastStatus =
            isConnected
            ? "Connected"
            : "Reset";

        lastMessage =
            "Path Generator event state and stored paths were cleared.";
    }


    //============================================================
    // OUTPUTS
    //============================================================

    private void SetOutputs(
        ref object Status,
        ref object Message,
        ref object SessionFolder,
        ref object ManifestPath,
        ref object ProcessedEventId,
        ref object PathAvailable)
    {
        Status =
            lastStatus;

        Message =
            lastMessage;

        SessionFolder =
            lastSessionFolder;

        ManifestPath =
            lastManifestPath;

        ProcessedEventId =
            lastProcessedEventId;

        PathAvailable =
            pathAvailable;
    }


    //============================================================
    // TCP COMMUNICATION
    //============================================================

    private string SendCommand(
        string host,
        int port,
        string command)
    {
        const int headerSize =
            8;

        try
        {
            using (
                TcpClient client =
                    new TcpClient())
            {
                IAsyncResult result =
                    client.BeginConnect(
                        host,
                        port,
                        null,
                        null
                    );

                bool success =
                    result.AsyncWaitHandle.WaitOne(
                        TimeSpan.FromMilliseconds(
                            300
                        )
                    );

                if (!success)
                {
                    return
                        "ERROR: GH Agent connection timeout.";
                }

                client.EndConnect(
                    result
                );

                using (
                    NetworkStream stream =
                        client.GetStream())
                {
                    byte[] payload =
                        Encoding.UTF8.GetBytes(
                            command
                        );

                    byte[] header =
                        new byte[headerSize];

                    ulong size =
                        (ulong) payload.Length;

                    for (
                        int index = 0;
                        index < headerSize;
                        index++)
                    {
                        header[
                            headerSize - 1 - index
                        ] = (byte) (size & 0xFF);

                        size >>=
                            8;
                    }

                    stream.Write(
                        header,
                        0,
                        header.Length
                    );

                    stream.Write(
                        payload,
                        0,
                        payload.Length
                    );

                    byte[] responseHeader =
                        ReadExact(
                            stream,
                            headerSize
                        );

                    ulong responseSize =
                        0;

                    for (
                        int index = 0;
                        index < headerSize;
                        index++)
                    {
                        responseSize =
                            (responseSize << 8) +
                            responseHeader[index];
                    }

                    if (
                        responseSize >
                        int.MaxValue)
                    {
                        return
                            "ERROR: Agent response is too large.";
                    }

                    byte[] responsePayload =
                        ReadExact(
                            stream,
                            (int) responseSize
                        );

                    return
                        Encoding.UTF8.GetString(
                            responsePayload
                        );
                }
            }
        }
        catch (Exception exception)
        {
            return
                "ERROR: " +
                exception.Message;
        }
    }


    private byte[] ReadExact(
        NetworkStream stream,
        int size)
    {
        byte[] data =
            new byte[size];

        int offset =
            0;

        while (offset < size)
        {
            int read =
                stream.Read(
                    data,
                    offset,
                    size - offset
                );

            if (read == 0)
            {
                throw new Exception(
                    "Connection closed."
                );
            }

            offset +=
                read;
        }

        return
            data;
    }


    //============================================================
    // JSON HELPERS
    //============================================================

    private string EscapeJson(
        string value)
    {
        if (value == null)
        {
            return
                "";
        }

        return
            value
                .Replace(
                    "\\",
                    "\\\\"
                )
                .Replace(
                    "\"",
                    "\\\""
                )
                .Replace(
                    "\r",
                    "\\r"
                )
                .Replace(
                    "\n",
                    "\\n"
                )
                .Replace(
                    "\t",
                    "\\t"
                );
    }


    private string ExtractJsonValue(
        string json,
        string key)
    {
        if (
            string.IsNullOrWhiteSpace(
                json
            ))
        {
            return
                "";
        }

        string pattern =
            "\"" +
            key +
            "\":";

        int start =
            json.IndexOf(
                pattern,
                StringComparison.Ordinal
            );

        if (start < 0)
        {
            return
                "";
        }

        start +=
            pattern.Length;

        while (
            start < json.Length &&
            char.IsWhiteSpace(
                json[start]
            ))
        {
            start++;
        }

        if (
            start >= json.Length ||
            json[start] != '"')
        {
            return
                "";
        }

        start++;

        StringBuilder value =
            new StringBuilder();

        bool escaped =
            false;

        for (
            int index = start;
            index < json.Length;
            index++)
        {
            char character =
                json[index];

            if (escaped)
            {
                switch (character)
                {
                    case 'n':
                        value.Append(
                            '\n'
                        );
                        break;

                    case 'r':
                        value.Append(
                            '\r'
                        );
                        break;

                    case 't':
                        value.Append(
                            '\t'
                        );
                        break;

                    case '\\':
                        value.Append(
                            '\\'
                        );
                        break;

                    case '"':
                        value.Append(
                            '"'
                        );
                        break;

                    default:
                        value.Append(
                            character
                        );
                        break;
                }

                escaped =
                    false;

                continue;
            }

            if (character == '\\')
            {
                escaped =
                    true;

                continue;
            }

            if (character == '"')
            {
                return
                    value.ToString();
            }

            value.Append(
                character
            );
        }

        return
            "";
    }
}
# ---------- end c_script_6 ----------
panel_44 = Panel(c_script_6.Status)
panel_45 = Panel(c_script_6.Message)
panel_46 = Panel(c_script_6.SessionFolder)
panel_47 = Panel(c_script_6.ProcessedEventId)
panel_48 = Panel(c_script_6.ManifestPath)
panel_49 = Panel(c_script_6.PathAvailable)

# ----
c_script_7 = CSharpScript(EventId=c_script_5.EventId, Reset=reset, A=crv_3)  # -> CapturedEventId, HasCapturedData, InputSummary, Status, A_Out, B_Out, C_Out, D_Out, E_Out; inputs EventId: Int64, Reset: Boolean, A: tree, B: tree, C: tree, D: tree, E: tree
#   port EventId: Casts source data to object
# ---------- c_script_7: C# ----------
// Grasshopper C# Script Instance

#region Usings
using System;
using System.Collections;
using System.Collections.Generic;
using System.Linq;

using Grasshopper;
using Grasshopper.Kernel;
using Grasshopper.Kernel.Data;
using Grasshopper.Kernel.Types;
#endregion


public class Script_Instance : GH_ScriptInstance
{
    // Fixed inputs:
    // 0 EventId
    // 1 Reset
    //
    // Data inputs begin at index 2:
    // 2 A
    // 3 B
    // 4 C
    private const int FirstDataInputIndex = 2;

    //============================================================
    // Persistent state
    //============================================================

    private long lastCapturedEventId = 0;

    private bool previousReset = false;
    private bool hasCapturedData = false;
    private bool inputSettingsUpdateScheduled = false;

    private List<CapturedInputRecord> capturedInputs =
        new List<CapturedInputRecord>();

    private List<string> lastInputSummary =
        new List<string>();

    private string lastStatus =
        "Waiting for the first event.";


    //============================================================
    // Main
    //============================================================

    private void RunScript(
		long EventId,
		bool Reset,
		DataTree<object> A,
		DataTree<object> B,
		DataTree<object> C,
		DataTree<object> D,
		DataTree<object> E,
		ref object CapturedEventId,
		ref object HasCapturedData,
		ref object InputSummary,
		ref object Status,
		ref object A_Out,
		ref object B_Out,
		ref object C_Out,
		ref object D_Out,
		ref object E_Out)
    {
        try
        {
            /*
             * Apply Tree access and Optional=true to every data input.
             *
             * As in the Local Upload component, changing input settings
             * may schedule one additional Grasshopper solution.
             */
            EnsureDataInputSettings();

            // Reset is edge-triggered.
            bool resetEvent =
                Reset &&
                !previousReset;

            previousReset = Reset;

            if (resetEvent)
            {
                ResetState();

                SetOutputs(
                    ref CapturedEventId,
                    ref HasCapturedData,
                    ref InputSummary,
                    ref Status,
                    ref A_Out,
                    ref B_Out,
                    ref C_Out,
                    ref D_Out,
                    ref E_Out
                    
                );

                return;
            }

            // EventId zero means no valid design event has occurred yet.
            if (EventId <= 0)
            {
                lastStatus =
                    hasCapturedData
                    ? "Holding captured event #" +
                      lastCapturedEventId +
                      "."
                    : "Waiting for the first event.";

                SetOutputs(
                    ref CapturedEventId,
                    ref HasCapturedData,
                    ref InputSummary,
                    ref Status,
                    ref A_Out,
                    ref B_Out,
                    ref C_Out,
                    ref D_Out,
                    ref E_Out
                    
                );

                return;
            }

            /*
             * A new persistent event causes one capture.
             *
             * Repeated Grasshopper solutions with the same EventId
             * do not replace or modify the captured snapshot.
             */
            bool shouldCapture =
                EventId > lastCapturedEventId;

            if (shouldCapture)
            {
                CaptureCurrentInputs(EventId);
            }
            else if (EventId < lastCapturedEventId)
            {
                lastStatus =
                    "EventId " +
                    EventId +
                    " is older than captured event #" +
                    lastCapturedEventId +
                    ". Reset the component before restarting the counter.";
            }
            else
            {
                lastStatus =
                    "Holding captured event #" +
                    lastCapturedEventId +
                    ".";
            }

            SetOutputs(
                ref CapturedEventId,
                ref HasCapturedData,
                ref InputSummary,
                ref Status,
                ref A_Out,
                ref B_Out,
                ref C_Out,
                ref D_Out,
                ref E_Out
            );
        }
        catch (Exception exception)
        {
            lastStatus =
                "Custom Data Dam failed: " +
                exception.Message;

            SetOutputs(
                ref CapturedEventId,
                ref HasCapturedData,
                ref InputSummary,
                ref Status,
                ref A_Out,
                ref B_Out,
                ref C_Out,
                ref D_Out,
                ref E_Out
                
            );
        }
    }


    //============================================================
    // CAPTURE
    //============================================================

    private void CaptureCurrentInputs(
        long eventId)
    {
        List<CapturedInputRecord> newSnapshot =
            new List<CapturedInputRecord>();

        List<string> summaries =
            new List<string>();

        int connectedCount = 0;
        int populatedCount = 0;
        int totalItemCount = 0;

        int dataInputCount =
            Math.Max(
                0,
                Component.Params.Input.Count -
                FirstDataInputIndex
            );

        for (
            int relativeIndex = 0;
            relativeIndex < dataInputCount;
            relativeIndex++)
        {
            int inputIndex =
                FirstDataInputIndex +
                relativeIndex;

            IGH_Param parameter =
                Component.Params.Input[inputIndex];

            CapturedInputRecord record =
                CaptureInput(
                    GetAlphabeticName(relativeIndex),
                    relativeIndex,
                    parameter
                );

            newSnapshot.Add(record);
            summaries.Add(record.Summary);

            if (record.IsConnected)
            {
                connectedCount++;
            }

            if (record.ItemCount > 0)
            {
                populatedCount++;
            }

            totalItemCount +=
                record.ItemCount;
        }

        /*
         * Commit the snapshot only after all inputs have been copied.
         *
         * If copying one input fails, the previous valid snapshot
         * remains intact.
         */
        capturedInputs =
            newSnapshot;

        lastInputSummary =
            summaries;

        lastCapturedEventId =
            eventId;

        hasCapturedData =
            true;

        lastStatus =
            "Captured event #" +
            eventId +
            ": " +
            connectedCount +
            " input(s) connected; " +
            populatedCount +
            " input(s) contain data; " +
            totalItemCount +
            " item(s) stored.";
    }


    private CapturedInputRecord CaptureInput(
        string key,
        int relativeIndex,
        IGH_Param parameter)
    {
        CapturedInputRecord record =
            new CapturedInputRecord();

        record.Key =
            key;

        record.RelativeIndex =
            relativeIndex;

        record.Data =
            new GH_Structure<IGH_Goo>();

        if (parameter == null)
        {
            record.IsConnected = false;
            record.PathCount = 0;
            record.ItemCount = 0;
            record.Summary =
                key +
                " : No Data | Empty | Count: 0";

            return record;
        }

        record.IsConnected =
            parameter.SourceCount > 0;

        if (
            parameter.VolatileData == null ||
            parameter.VolatileData.IsEmpty)
        {
            record.PathCount = 0;
            record.ItemCount = 0;
            record.Summary =
                key +
                " : " +
                (
                    record.IsConnected
                    ? "Connected"
                    : "No Data"
                ) +
                " | Empty | Count: 0";

            return record;
        }

        HashSet<string> detectedTypes =
            new HashSet<string>(
                StringComparer.OrdinalIgnoreCase
            );

        int itemCount = 0;

        for (
            int branchIndex = 0;
            branchIndex <
            parameter.VolatileData.PathCount;
            branchIndex++)
        {
            GH_Path sourcePath =
                parameter.VolatileData.get_Path(
                    branchIndex
                );

            GH_Path copiedPath =
                new GH_Path(
                    sourcePath.Indices
                );

            IList sourceBranch =
                parameter.VolatileData.get_Branch(
                    branchIndex
                );

            /*
             * Explicitly create the branch, including empty branches,
             * so the captured topology matches the source topology.
             */
            record.Data.EnsurePath(
                copiedPath
            );

            if (sourceBranch == null)
            {
                continue;
            }

            for (
                int itemIndex = 0;
                itemIndex < sourceBranch.Count;
                itemIndex++)
            {
                IGH_Goo sourceGoo =
                    sourceBranch[itemIndex]
                    as IGH_Goo;

                if (sourceGoo == null)
                {
                    record.Data.Append(
                        null,
                        copiedPath
                    );

                    continue;
                }

                IGH_Goo copiedGoo =
                    sourceGoo.Duplicate();

                if (copiedGoo == null)
                {
                    throw new InvalidOperationException(
                        "Could not duplicate item " +
                        itemIndex +
                        " in input " +
                        key +
                        ". Runtime type: " +
                        sourceGoo.GetType().FullName
                    );
                }

                record.Data.Append(
                    copiedGoo,
                    copiedPath
                );

                itemCount++;

                string friendlyType =
                    GetFriendlyTypeName(
                        copiedGoo
                    );

                if (
                    !string.IsNullOrWhiteSpace(
                        friendlyType
                    ))
                {
                    detectedTypes.Add(
                        friendlyType
                    );
                }
            }
        }

        record.PathCount =
            record.Data.PathCount;

        record.ItemCount =
            itemCount;

        string typeName;

        if (detectedTypes.Count == 0)
        {
            typeName =
                record.IsConnected
                ? "Connected"
                : "No Data";
        }
        else if (detectedTypes.Count == 1)
        {
            typeName =
                detectedTypes.First();
        }
        else
        {
            typeName =
                "Mixed";
        }

        string structureName =
            GetStructureName(
                record.PathCount,
                record.ItemCount
            );

        record.Summary =
            key +
            " : " +
            typeName +
            " | " +
            structureName +
            " | Count: " +
            record.ItemCount;

        return record;
    }


    //============================================================
    // RESET
    //============================================================

    private void ResetState()
    {
        capturedInputs =
            new List<CapturedInputRecord>();

        lastInputSummary =
            new List<string>();

        lastCapturedEventId =
            0;

        hasCapturedData =
            false;

        lastStatus =
            "Custom Data Dam reset.";
    }


    //============================================================
    // PARAMETER SETTINGS
    //============================================================

    private void EnsureDataInputSettings()
    {
        bool updateRequired =
            false;

        for (
            int inputIndex = FirstDataInputIndex;
            inputIndex < Component.Params.Input.Count;
            inputIndex++)
        {
            IGH_Param parameter =
                Component.Params.Input[inputIndex];

            if (parameter == null)
            {
                continue;
            }

            if (
                parameter.Access != GH_ParamAccess.tree ||
                !parameter.Optional)
            {
                updateRequired =
                    true;

                break;
            }
        }

        if (
            !updateRequired ||
            inputSettingsUpdateScheduled)
        {
            return;
        }

        GH_Document document =
            Component.OnPingDocument();

        if (document == null)
        {
            return;
        }

        inputSettingsUpdateScheduled =
            true;

        document.ScheduleSolution(
            1,
            scheduledDocument =>
            {
                try
                {
                    for (
                        int inputIndex = FirstDataInputIndex;
                        inputIndex <
                        Component.Params.Input.Count;
                        inputIndex++)
                    {
                        IGH_Param parameter =
                            Component.Params.Input[inputIndex];

                        if (parameter == null)
                        {
                            continue;
                        }

                        parameter.Access =
                            GH_ParamAccess.tree;

                        parameter.Optional =
                            true;
                    }

                    Component.Params.OnParametersChanged();
                }
                finally
                {
                    inputSettingsUpdateScheduled =
                        false;
                }

                Component.ExpireSolution(
                    true
                );
            }
        );
    }


    //============================================================
    // OUTPUTS
    //============================================================

    private void SetOutputs(
        ref object CapturedEventId,
        ref object HasCapturedData,
        ref object InputSummary,
        ref object Status,
        ref object A_Out,
        ref object B_Out,
        ref object C_Out,
        ref object D_Out,
        ref object E_Out
        )
    {
        CapturedEventId =
            lastCapturedEventId;

        HasCapturedData =
            hasCapturedData;
            
        InputSummary =
            lastInputSummary;

        Status =
            lastStatus;

        A_Out =
            GetCapturedTree(0);

        B_Out =
            GetCapturedTree(1);

        C_Out =
            GetCapturedTree(2);

        D_Out =
            GetCapturedTree(3);

        E_Out =
            GetCapturedTree(4);


    }


    private GH_Structure<IGH_Goo> GetCapturedTree(
        int relativeIndex)
    {
        CapturedInputRecord record =
            capturedInputs.FirstOrDefault(
                item =>
                    item.RelativeIndex ==
                    relativeIndex
            );

        if (
            record == null ||
            record.Data == null)
        {
            return
                new GH_Structure<IGH_Goo>();
        }

        /*
         * Output another duplicate so downstream components never
         * receive direct access to the internally stored snapshot.
         */
        return DuplicateStructure(
            record.Data
        );
    }


    private GH_Structure<IGH_Goo> DuplicateStructure(
        GH_Structure<IGH_Goo> source)
    {
        GH_Structure<IGH_Goo> result =
            new GH_Structure<IGH_Goo>();

        if (source == null)
        {
            return result;
        }

        for (
            int branchIndex = 0;
            branchIndex < source.PathCount;
            branchIndex++)
        {
            GH_Path sourcePath =
                source.get_Path(
                    branchIndex
                );

            GH_Path copiedPath =
                new GH_Path(
                    sourcePath.Indices
                );

            IList branch =
                source.get_Branch(
                    branchIndex
                );

            result.EnsurePath(
                copiedPath
            );

            if (branch == null)
            {
                continue;
            }

            for (
                int itemIndex = 0;
                itemIndex < branch.Count;
                itemIndex++)
            {
                IGH_Goo goo =
                    branch[itemIndex] as IGH_Goo;

                result.Append(
                    goo == null
                    ? null
                    : goo.Duplicate(),
                    copiedPath
                );
            }
        }

        return result;
    }


    //============================================================
    // TYPE AND STRUCTURE HELPERS
    //============================================================

    private string GetStructureName(
        int pathCount,
        int itemCount)
    {
        if (itemCount == 0)
        {
            return "Empty";
        }

        if (pathCount <= 1)
        {
            return
                itemCount == 1
                ? "Item"
                : "List";
        }

        return
            "Tree (" +
            pathCount +
            " branches)";
    }


    private string GetFriendlyTypeName(
        IGH_Goo goo)
    {
        if (goo == null)
        {
            return "";
        }

        if (goo is GH_Point)
            return "Points";

        if (goo is GH_Vector)
            return "Vectors";

        if (goo is GH_Line)
            return "Lines";

        if (goo is GH_Circle)
            return "Circles";

        if (goo is GH_Arc)
            return "Arcs";

        if (goo is GH_Curve)
            return "Curves";

        if (goo is GH_Mesh)
            return "Meshes";

        if (goo is GH_Brep)
            return "Breps";

        if (goo is GH_Surface)
            return "Surfaces";

        if (goo is GH_Plane)
            return "Planes";

        if (goo is GH_Number)
            return "Numbers";

        if (goo is GH_Integer)
            return "Integers";

        if (goo is GH_Boolean)
            return "Booleans";

        if (goo is GH_String)
            return "Text";

        if (goo is GH_Colour)
            return "Colours";

        return
            string.IsNullOrWhiteSpace(
                goo.TypeName
            )
            ? goo.GetType().Name
            : goo.TypeName;
    }


    private string GetAlphabeticName(
        int zeroBasedIndex)
    {
        int value =
            zeroBasedIndex;

        string result =
            "";

        do
        {
            result =
                (char)(
                    'A' +
                    value % 26
                ) +
                result;

            value =
                value / 26 -
                1;
        }
        while (value >= 0);

        return result;
    }


    //============================================================
    // INTERNAL RECORD
    //============================================================

    private class CapturedInputRecord
    {
        public string Key;
        public int RelativeIndex;

        public GH_Structure<IGH_Goo> Data;

        public bool IsConnected;

        public int PathCount;
        public int ItemCount;

        public string Summary;
    }
}
# ---------- end c_script_7 ----------
panel_50 = Panel(c_script_7.CapturedEventId)
panel_51 = Panel(c_script_7.HasCapturedData)
panel_52 = Panel(c_script_7.InputSummary)
panel_53 = Panel(c_script_7.Status)

# ---- group: Design Output Index & Write Pulse Generator
reset_counter_2 = Button()
c_script_8 = CSharpScript(
    EventId=c_script_6.ProcessedEventId,
    PathAvailable=c_script_6.PathAvailable,
    SessionName=c_script_4.Session,
    SessionFolder=c_script_6.SessionFolder,
    ResetEventState=reset,
    ResetCounter=reset_counter_2,
    StartIndex="1")  # -> OutputIndex, IndexedEventId, IndexAvailable, CurrentSession, NextIndex, Synchronized, Status; inputs EventId: Int64, PathAvailable: Boolean, SessionName: String, SessionFolder: String, ResetEventState: Boolean, ResetCounter: Boolean, StartIndex: Int32
#   port EventId: Casts source data to object
# ---------- c_script_8: C# ----------
// Grasshopper Script Instance

#region Usings
using System;
using System.Globalization;
using System.IO;

using Rhino;
using Rhino.Geometry;

using Grasshopper;
using Grasshopper.Kernel;
using Grasshopper.Kernel.Data;
using Grasshopper.Kernel.Types;
#endregion


public class Script_Instance : GH_ScriptInstance
{
    // ============================================================
    // RESET EDGE STATE
    // ============================================================

    private bool previousResetEventState = false;
    private bool previousResetCounter = false;


    // ============================================================
    // EVENT STATE
    // ============================================================

    private long lastIndexedEventId = 0;
    private bool indexAvailable = false;


    // ============================================================
    // COUNTER STATE
    // ============================================================

    private bool initialized = false;

    private string activeSession = "";

    private long currentOutputIndex = 1;
    private long nextOutputIndex = 1;

    private bool synchronized = false;

    private string lastStatus =
        "Waiting for a valid session and event.";


    // ============================================================
    // MAIN
    // ============================================================

    private void RunScript(
		long EventId,
		bool PathAvailable,
		string SessionName,
		string SessionFolder,
		bool ResetEventState,
		bool ResetCounter,
		int StartIndex,
		ref object OutputIndex,
		ref object IndexedEventId,
		ref object IndexAvailable,
		ref object CurrentSession,
		ref object NextIndex,
		ref object Synchronized,
		ref object Status)
    {
        try
        {
            // ----------------------------------------------------
            // Normalize configuration
            // ----------------------------------------------------

            long normalizedStartIndex =
                Math.Max(
                    1L,
                    (long) StartIndex
                );

            string normalizedSessionName =
                NormalizeSessionName(
                    SessionName
                );

            string folderSessionName =
                ExtractSessionFolderName(
                    SessionFolder
                );


            // ----------------------------------------------------
            // Initialize once
            // ----------------------------------------------------

            if (!initialized)
            {
                currentOutputIndex =
                    normalizedStartIndex;

                nextOutputIndex =
                    normalizedStartIndex;

                initialized =
                    true;
            }


            // ----------------------------------------------------
            // Reset edge detection
            // ----------------------------------------------------

            bool resetEventStatePulse =
                ResetEventState &&
                !previousResetEventState;

            bool resetCounterPulse =
                ResetCounter &&
                !previousResetCounter;

            previousResetEventState =
                ResetEventState;

            previousResetCounter =
                ResetCounter;


            // ----------------------------------------------------
            // Session synchronization
            // ----------------------------------------------------

            synchronized =
                !string.IsNullOrWhiteSpace(
                    normalizedSessionName
                ) &&
                !string.IsNullOrWhiteSpace(
                    folderSessionName
                ) &&
                string.Equals(
                    normalizedSessionName,
                    folderSessionName,
                    StringComparison.OrdinalIgnoreCase
                );


            // ----------------------------------------------------
            // Manual counter reset
            //
            // This intentionally restarts numbering inside the
            // current session.
            // ----------------------------------------------------

            if (resetCounterPulse)
            {
                ResetCounterState(
                    normalizedStartIndex
                );

                lastStatus =
                    "Output counter manually reset to " +
                    normalizedStartIndex.ToString(
                        CultureInfo.InvariantCulture
                    ) +
                    ".";

                SetOutputs(
                    ref OutputIndex,
                    ref IndexedEventId,
                    ref IndexAvailable,
                    ref CurrentSession,
                    ref NextIndex,
                    ref Synchronized,
                    ref Status
                );

                return;
            }


            // ----------------------------------------------------
            // Workflow event reset
            //
            // Connected to the Solution Tracker Reset.
            //
            // This clears only event-processing state.
            // It does not restart the output counter.
            // ----------------------------------------------------

            if (resetEventStatePulse)
            {
                ResetEventProcessingState();

                lastStatus =
                    "Event-processing state reset. " +
                    "The output counter remains at " +
                    nextOutputIndex.ToString(
                        CultureInfo.InvariantCulture
                    ) +
                    " for session '" +
                    activeSession +
                    "'.";

                SetOutputs(
                    ref OutputIndex,
                    ref IndexedEventId,
                    ref IndexAvailable,
                    ref CurrentSession,
                    ref NextIndex,
                    ref Synchronized,
                    ref Status
                );

                return;
            }


            // ----------------------------------------------------
            // Validate EventId
            // ----------------------------------------------------

            if (EventId <= 0)
            {
                if (
                    string.IsNullOrWhiteSpace(
                        normalizedSessionName
                    ))
                {
                    lastStatus =
                        "Waiting for SessionName.";
                }
                else if (
                    string.IsNullOrWhiteSpace(
                        folderSessionName
                    ))
                {
                    lastStatus =
                        "Waiting for SessionFolder.";
                }
                else if (!synchronized)
                {
                    lastStatus =
                        BuildSessionMismatchStatus(
                            normalizedSessionName,
                            folderSessionName
                        );
                }
                else if (
                    !string.IsNullOrWhiteSpace(
                        activeSession
                    ))
                {
                    lastStatus =
                        "Waiting for the first valid EventId. " +
                        "The next output index is " +
                        nextOutputIndex.ToString(
                            CultureInfo.InvariantCulture
                        ) +
                        ".";
                }
                else
                {
                    lastStatus =
                        "Waiting for the first valid EventId.";
                }

                SetOutputs(
                    ref OutputIndex,
                    ref IndexedEventId,
                    ref IndexAvailable,
                    ref CurrentSession,
                    ref NextIndex,
                    ref Synchronized,
                    ref Status
                );

                return;
            }


            // ----------------------------------------------------
            // Validate SessionName
            // ----------------------------------------------------

            if (
                string.IsNullOrWhiteSpace(
                    normalizedSessionName
                ))
            {
                lastStatus =
                    "Output index request rejected: " +
                    "SessionName is empty.";

                SetOutputs(
                    ref OutputIndex,
                    ref IndexedEventId,
                    ref IndexAvailable,
                    ref CurrentSession,
                    ref NextIndex,
                    ref Synchronized,
                    ref Status
                );

                return;
            }


            // ----------------------------------------------------
            // Validate SessionFolder
            // ----------------------------------------------------

            if (
                string.IsNullOrWhiteSpace(
                    folderSessionName
                ))
            {
                lastStatus =
                    "Output index request rejected: " +
                    "SessionFolder is empty or invalid.";

                SetOutputs(
                    ref OutputIndex,
                    ref IndexedEventId,
                    ref IndexAvailable,
                    ref CurrentSession,
                    ref NextIndex,
                    ref Synchronized,
                    ref Status
                );

                return;
            }


            // ----------------------------------------------------
            // Validate synchronization
            // ----------------------------------------------------

            if (!synchronized)
            {
                lastStatus =
                    "Output index request rejected: " +
                    "SessionName '" +
                    normalizedSessionName +
                    "' does not match folder session '" +
                    folderSessionName +
                    "'.";

                SetOutputs(
                    ref OutputIndex,
                    ref IndexedEventId,
                    ref IndexAvailable,
                    ref CurrentSession,
                    ref NextIndex,
                    ref Synchronized,
                    ref Status
                );

                return;
            }


            // ----------------------------------------------------
            // Path availability gate
            // ----------------------------------------------------

            if (!PathAvailable)
            {
                if (EventId > lastIndexedEventId)
                {
                    lastStatus =
                        "Event #" +
                        EventId.ToString(
                            CultureInfo.InvariantCulture
                        ) +
                        " is waiting because PathAvailable is false.";
                }
                else if (indexAvailable)
                {
                    lastStatus =
                        "Holding output index " +
                        currentOutputIndex.ToString(
                            CultureInfo.InvariantCulture
                        ) +
                        " for indexed event #" +
                        lastIndexedEventId.ToString(
                            CultureInfo.InvariantCulture
                        ) +
                        ".";
                }
                else
                {
                    lastStatus =
                        "Waiting for the upload session path.";
                }

                SetOutputs(
                    ref OutputIndex,
                    ref IndexedEventId,
                    ref IndexAvailable,
                    ref CurrentSession,
                    ref NextIndex,
                    ref Synchronized,
                    ref Status
                );

                return;
            }


            // ----------------------------------------------------
            // Detect session change
            //
            // Every new session automatically restarts numbering
            // from StartIndex.
            // ----------------------------------------------------

            bool sessionChanged =
                !string.Equals(
                    activeSession,
                    normalizedSessionName,
                    StringComparison.OrdinalIgnoreCase
                );

            if (sessionChanged)
            {
                BeginNewSession(
                    normalizedSessionName,
                    normalizedStartIndex
                );
            }


            // ----------------------------------------------------
            // Reject an older EventId
            // ----------------------------------------------------

            if (EventId < lastIndexedEventId)
            {
                lastStatus =
                    "Older EventId ignored. Event #" +
                    EventId.ToString(
                        CultureInfo.InvariantCulture
                    ) +
                    " is older than indexed event #" +
                    lastIndexedEventId.ToString(
                        CultureInfo.InvariantCulture
                    ) +
                    ". Reset the Solution Tracker event state " +
                    "before restarting its event counter.";

                SetOutputs(
                    ref OutputIndex,
                    ref IndexedEventId,
                    ref IndexAvailable,
                    ref CurrentSession,
                    ref NextIndex,
                    ref Synchronized,
                    ref Status
                );

                return;
            }


            // ----------------------------------------------------
            // Event already processed
            // ----------------------------------------------------

            if (EventId == lastIndexedEventId)
            {
                if (indexAvailable)
                {
                    lastStatus =
                        "Holding output index " +
                        currentOutputIndex.ToString(
                            CultureInfo.InvariantCulture
                        ) +
                        " for event #" +
                        lastIndexedEventId.ToString(
                            CultureInfo.InvariantCulture
                        ) +
                        " in session '" +
                        activeSession +
                        "'.";
                }
                else
                {
                    lastStatus =
                        "Waiting for a new event.";
                }

                SetOutputs(
                    ref OutputIndex,
                    ref IndexedEventId,
                    ref IndexAvailable,
                    ref CurrentSession,
                    ref NextIndex,
                    ref Synchronized,
                    ref Status
                );

                return;
            }


            // ----------------------------------------------------
            // Persistent event condition
            // ----------------------------------------------------

            bool shouldIssueIndex =
                PathAvailable &&
                EventId > lastIndexedEventId;

            if (!shouldIssueIndex)
            {
                lastStatus =
                    "Waiting for a new output event.";

                SetOutputs(
                    ref OutputIndex,
                    ref IndexedEventId,
                    ref IndexAvailable,
                    ref CurrentSession,
                    ref NextIndex,
                    ref Synchronized,
                    ref Status
                );

                return;
            }


            // ----------------------------------------------------
            // Issue the next output index
            // ----------------------------------------------------

            long issuedIndex =
                nextOutputIndex;


            // ----------------------------------------------------
            // Commit successful event
            // ----------------------------------------------------

            currentOutputIndex =
                issuedIndex;

            nextOutputIndex =
                issuedIndex + 1L;

            lastIndexedEventId =
                EventId;

            indexAvailable =
                true;


            // ----------------------------------------------------
            // Status
            // ----------------------------------------------------

            lastStatus =
                (
                    sessionChanged
                    ? "New session detected. Counter restarted. "
                    : ""
                ) +
                "Issued output index " +
                issuedIndex.ToString(
                    CultureInfo.InvariantCulture
                ) +
                " for event #" +
                EventId.ToString(
                    CultureInfo.InvariantCulture
                ) +
                " in session '" +
                activeSession +
                "'.";


            SetOutputs(
                ref OutputIndex,
                ref IndexedEventId,
                ref IndexAvailable,
                ref CurrentSession,
                ref NextIndex,
                ref Synchronized,
                ref Status
            );
        }
        catch (Exception exception)
        {
            lastStatus =
                "Output Index Generator failed: " +
                exception.Message;

            SetOutputs(
                ref OutputIndex,
                ref IndexedEventId,
                ref IndexAvailable,
                ref CurrentSession,
                ref NextIndex,
                ref Synchronized,
                ref Status
            );
        }
    }


    // ============================================================
    // SESSION STATE
    // ============================================================

    private void BeginNewSession(
        string sessionName,
        long startIndex)
    {
        activeSession =
            sessionName;

        currentOutputIndex =
            startIndex;

        nextOutputIndex =
            startIndex;

        lastIndexedEventId =
            0;

        indexAvailable =
            false;
    }


    // ============================================================
    // EVENT RESET
    // ============================================================

    private void ResetEventProcessingState()
    {
        lastIndexedEventId =
            0;

        indexAvailable =
            false;
    }


    // ============================================================
    // COUNTER RESET
    // ============================================================

    private void ResetCounterState(
        long startIndex)
    {
        currentOutputIndex =
            startIndex;

        nextOutputIndex =
            startIndex;

        lastIndexedEventId =
            0;

        indexAvailable =
            false;

        /*
         * activeSession is intentionally preserved.
         *
         * ResetCounter means:
         * restart numbering inside the current session.
         */
    }


    // ============================================================
    // OUTPUTS
    // ============================================================

    private void SetOutputs(
        ref object OutputIndex,
        ref object IndexedEventId,
        ref object IndexAvailable,
        ref object CurrentSession,
        ref object NextIndex,
        ref object Synchronized,
        ref object Status)
    {
        OutputIndex =
            currentOutputIndex;

        IndexedEventId =
            lastIndexedEventId;

        IndexAvailable =
            indexAvailable;

        CurrentSession =
            activeSession;

        NextIndex =
            nextOutputIndex;

        Synchronized =
            synchronized;

        Status =
            lastStatus;
    }


    // ============================================================
    // SESSION HELPERS
    // ============================================================

    private string NormalizeSessionName(
        string value)
    {
        if (
            string.IsNullOrWhiteSpace(
                value
            ))
        {
            return "";
        }

        return value.Trim();
    }


    private string ExtractSessionFolderName(
        string sessionFolder)
    {
        if (
            string.IsNullOrWhiteSpace(
                sessionFolder
            ))
        {
            return "";
        }

        try
        {
            string normalizedPath =
                sessionFolder
                    .Trim()
                    .TrimEnd(
                        Path.DirectorySeparatorChar,
                        Path.AltDirectorySeparatorChar
                    );

            if (
                string.IsNullOrWhiteSpace(
                    normalizedPath
                ))
            {
                return "";
            }

            return Path.GetFileName(
                normalizedPath
            );
        }
        catch
        {
            return "";
        }
    }


    private string BuildSessionMismatchStatus(
        string normalizedSessionName,
        string folderSessionName)
    {
        return
            "Session mismatch. SessionName is '" +
            normalizedSessionName +
            "', but SessionFolder resolves to '" +
            folderSessionName +
            "'.";
    }
}
# ---------- end c_script_8 ----------
panel_54 = Panel(c_script_8.OutputIndex)
panel_55 = Panel(c_script_8.IndexAvailable)
panel_56 = Panel(c_script_8.CurrentSession)
panel_57 = Panel(c_script_8.Status)
panel_58 = Panel(c_script_8.IndexedEventId)
panel_59 = Panel(c_script_8.NextIndex)
panel_60 = Panel(c_script_8.Synchronized)

# ---- group: Local Design Data Saver
panel_61 = Panel("01")
c_script_9 = CSharpScript(
    Directory=c_script_6.SessionFolder,
    FileName="ghdata",
    Session=c_script_4.Session,
    Domain="design",
    OutputIndex=c_script_8.OutputIndex,
    EventId=c_script_8.IndexedEventId,
    IndexAvailable=c_script_8.IndexAvailable,
    ResetEventState=reset,
    A=c_script_7.A_Out)  # -> OutputPath, InputSummary, ReadyEvent, SolutionIndex, Status; inputs Directory: String, FileName: String, Session: String, Domain: String, OutputIndex: Int32, EventId: Int64, IndexAvailable: Boolean, ResetEventState: Boolean, A: tree, B: tree, C: tree
#   port EventId: Casts source data to object
# ---------- c_script_9: C# ----------
// Grasshopper C# Script Instance
#region Usings
using System;
using System.Collections;
using System.Collections.Generic;
using System.Globalization;
using System.IO;
using System.Linq;
using System.Net.Sockets;
using System.Text;

using GH_IO.Serialization;

using Grasshopper;
using Grasshopper.Kernel;
using Grasshopper.Kernel.Data;
using Grasshopper.Kernel.Types;
#endregion

public class Script_Instance : GH_ScriptInstance
{
    // Fixed inputs:
    // 0 Directory
    // 1 FileName
    // 2 Session
    // 3 Domain
    // 4 OutputIndex
    // 5 EventId
    // 6 IndexAvailable
    // 7 ResetEventState
    //
    // Arbitrary data inputs begin at index 8.
    private const int FirstDataInputIndex = 8;

    private const string GhAgentHost = "127.0.0.1";
    private const int GhAgentPort = 6005;
    private const int MessageHeaderSize = 8;

    private long lastWrittenEventId = 0;
    private bool previousResetEventState = false;
    private bool inputSettingsUpdateScheduled = false;

    private int lastSolutionIndex = 0;

    private string lastOutputPath = "";
    private string lastReadyEvent = "";
    private string lastStatus = "Ready.";

    private void RunScript(
		string Directory,
		string FileName,
		string Session,
		string Domain,
		int OutputIndex,
		long EventId,
		bool IndexAvailable,
		bool ResetEventState,
		DataTree<object> A,
		DataTree<object> B,
		DataTree<object> C,
		ref object OutputPath,
		ref object InputSummary,
		ref object ReadyEvent,
		ref object SolutionIndex,
		ref object Status)
    {
        List<string> summaries =
            new List<string>();

        bool resetEventStatePulse =
            ResetEventState &&
            !previousResetEventState;

        previousResetEventState =
            ResetEventState;

        try
        {
            /*
             * This applies Tree access and Optional=true to every generic
             * input after the current solution finishes.
             *
             * The first solution after adding a new input may cause one
             * additional recomputation.
             */
            EnsureDataInputSettings();

            List<DataInputRecord> inputRecords =
                CollectInputRecords();

            summaries = inputRecords
                .Select(record => record.Summary)
                .ToList();

            if (resetEventStatePulse)
            {
                lastWrittenEventId = 0;

                lastStatus =
                    "Local write event state reset. " +
                    "The existing output path and ReadyEvent are preserved.";

                SetOutputs(
                    summaries,
                    ref OutputPath,
                    ref InputSummary,
                    ref ReadyEvent,
                    ref SolutionIndex,
                    ref Status
                );

                return;
            }

            string validationError =
                ValidateSettings(
                    Directory,
                    FileName,
                    Session,
                    Domain,
                    OutputIndex
                );

            if (!string.IsNullOrWhiteSpace(validationError))
            {
                lastStatus = validationError;

                SetOutputs(
                    summaries,
                    ref OutputPath,
                    ref InputSummary,
                    ref ReadyEvent,
                    ref SolutionIndex,
                    ref Status
                );

                return;
            }

            string normalizedDomain =
                NormalizeName(
                    Domain,
                    "output"
                );

            lastSolutionIndex =
                OutputIndex;

            string resolvedFileName =
                BuildFileName(
                    FileName,
                    normalizedDomain,
                    OutputIndex
                );

            lastOutputPath =
                Path.GetFullPath(
                    Path.Combine(
                        Directory.Trim(),
                        resolvedFileName
                    )
                );

            int connectedCount =
                inputRecords.Count(
                    record => record.IsConnected
                );

            int populatedCount =
                inputRecords.Count(
                    record => record.ItemCount > 0
                );

            if (!IndexAvailable)
            {
                lastStatus =
                    "Waiting because IndexAvailable is false. " +
                    connectedCount +
                    " input(s) connected; " +
                    populatedCount +
                    " input(s) contain data.";

                SetOutputs(
                    summaries,
                    ref OutputPath,
                    ref InputSummary,
                    ref ReadyEvent,
                    ref SolutionIndex,
                    ref Status
                );

                return;
            }

            if (EventId <= 0)
            {
                lastStatus =
                    "Waiting for a valid indexed EventId.";

                SetOutputs(
                    summaries,
                    ref OutputPath,
                    ref InputSummary,
                    ref ReadyEvent,
                    ref SolutionIndex,
                    ref Status
                );

                return;
            }

            if (EventId < lastWrittenEventId)
            {
                lastStatus =
                    "Older EventId ignored. Event #" +
                    EventId.ToString(
                        CultureInfo.InvariantCulture
                    ) +
                    " is older than written event #" +
                    lastWrittenEventId.ToString(
                        CultureInfo.InvariantCulture
                    ) +
                    ".";

                SetOutputs(
                    summaries,
                    ref OutputPath,
                    ref InputSummary,
                    ref ReadyEvent,
                    ref SolutionIndex,
                    ref Status
                );

                return;
            }

            if (EventId == lastWrittenEventId)
            {
                lastStatus =
                    "Holding the successfully written output for event #" +
                    lastWrittenEventId.ToString(
                        CultureInfo.InvariantCulture
                    ) +
                    ".";

                SetOutputs(
                    summaries,
                    ref OutputPath,
                    ref InputSummary,
                    ref ReadyEvent,
                    ref SolutionIndex,
                    ref Status
                );

                return;
            }

            if (connectedCount == 0)
            {
                lastStatus =
                    "Write rejected: no data inputs are connected.";

                SetOutputs(
                    summaries,
                    ref OutputPath,
                    ref InputSummary,
                    ref ReadyEvent,
                    ref SolutionIndex,
                    ref Status
                );

                return;
            }

            if (populatedCount == 0)
            {
                lastStatus =
                    "Write rejected: connected inputs contain no data.";

                SetOutputs(
                    summaries,
                    ref OutputPath,
                    ref InputSummary,
                    ref ReadyEvent,
                    ref SolutionIndex,
                    ref Status
                );

                return;
            }

            string outputDirectory =
                Path.GetDirectoryName(lastOutputPath);

            if (string.IsNullOrWhiteSpace(outputDirectory))
            {
                throw new InvalidOperationException(
                    "Could not resolve the output directory."
                );
            }

            System.IO.Directory.CreateDirectory(
                outputDirectory
            );

            WriteGhDataArchive(
                lastOutputPath,
                Session.Trim(),
                normalizedDomain,
                OutputIndex,
                inputRecords
            );

            if (!File.Exists(lastOutputPath))
            {
                throw new IOException(
                    "Grasshopper archive write completed, but the file " +
                    "does not exist: " +
                    lastOutputPath
                );
            }

            string registrationResponse =
                RegisterLocalUpload(
                    Session.Trim(),
                    normalizedDomain,
                    OutputIndex,
                    lastOutputPath
                );

            string registrationStatus =
                ExtractJsonValue(
                    registrationResponse,
                    "status"
                );

            if (
                !string.Equals(
                    registrationStatus,
                    "ok",
                    StringComparison.OrdinalIgnoreCase
                ))
            {
                string registrationMessage =
                    ExtractJsonValue(
                        registrationResponse,
                        "message"
                    );

                throw new InvalidOperationException(
                    "The .ghdata file was written, but local registration " +
                    "failed: " +
                    (
                        string.IsNullOrWhiteSpace(registrationMessage)
                        ? registrationResponse
                        : registrationMessage
                    )
                );
            }

            string eventId =
                Guid.NewGuid().ToString();

            string createdAt =
                DateTime.UtcNow.ToString(
                    "o",
                    CultureInfo.InvariantCulture
                );

            lastReadyEvent =
                BuildReadyEvent(
                    eventId,
                    createdAt,
                    Session.Trim(),
                    normalizedDomain,
                    OutputIndex,
                    lastOutputPath,
                    connectedCount,
                    populatedCount,
                    summaries
                );

            lastWrittenEventId =
                EventId;

            lastStatus =
                "The .ghdata file was written and registered successfully " +
                "for event #" +
                EventId.ToString(
                    CultureInfo.InvariantCulture
                ) +
                ".";

            SetOutputs(
                summaries,
                ref OutputPath,
                ref InputSummary,
                ref ReadyEvent,
                ref SolutionIndex,
                ref Status
            );
        }
        catch (Exception exception)
        {
            lastStatus =
                "Managed Data Output failed: " +
                exception.Message;

            SetOutputs(
                summaries,
                ref OutputPath,
                ref InputSummary,
                ref ReadyEvent,
                ref SolutionIndex,
                ref Status
            );
        }
    }

    // ============================================================
    // PARAMETER SETTINGS
    // ============================================================

    private void EnsureDataInputSettings()
    {
        bool updateRequired = false;

        for (
            int inputIndex = FirstDataInputIndex;
            inputIndex < Component.Params.Input.Count;
            inputIndex++)
        {
            IGH_Param parameter =
                Component.Params.Input[inputIndex];

            if (parameter == null)
                continue;

            if (
                parameter.Access != GH_ParamAccess.tree ||
                !parameter.Optional)
            {
                updateRequired = true;
                break;
            }
        }

        if (
            !updateRequired ||
            inputSettingsUpdateScheduled)
        {
            return;
        }

        GH_Document document =
            Component.OnPingDocument();

        if (document == null)
            return;

        inputSettingsUpdateScheduled = true;

        document.ScheduleSolution(
            1,
            scheduledDocument =>
            {
                try
                {
                    for (
                        int inputIndex = FirstDataInputIndex;
                        inputIndex < Component.Params.Input.Count;
                        inputIndex++)
                    {
                        IGH_Param parameter =
                            Component.Params.Input[inputIndex];

                        if (parameter == null)
                            continue;

                        parameter.Access =
                            GH_ParamAccess.tree;

                        parameter.Optional = true;
                    }

                    Component.Params.OnParametersChanged();
                }
                finally
                {
                    inputSettingsUpdateScheduled = false;
                }

                Component.ExpireSolution(true);
            }
        );
    }

    // ============================================================
    // INPUT COLLECTION
    // ============================================================

    private List<DataInputRecord> CollectInputRecords()
    {
        List<DataInputRecord> records =
            new List<DataInputRecord>();

        int dataInputCount =
            Math.Max(
                0,
                Component.Params.Input.Count -
                FirstDataInputIndex
            );

        for (
            int relativeIndex = 0;
            relativeIndex < dataInputCount;
            relativeIndex++)
        {
            int inputIndex =
                FirstDataInputIndex +
                relativeIndex;

            IGH_Param parameter =
                Component.Params.Input[inputIndex];

            string key =
                GetAlphabeticName(relativeIndex);

            DataInputRecord record =
                DescribeInput(
                    key,
                    relativeIndex,
                    parameter
                );

            records.Add(record);
        }

        return records;
    }

    private DataInputRecord DescribeInput(
        string key,
        int relativeIndex,
        IGH_Param parameter)
    {
        DataInputRecord record =
            new DataInputRecord();

        record.Key = key;
        record.RelativeIndex = relativeIndex;
        record.Parameter = parameter;

        if (parameter == null)
        {
            record.TypeName = "No Data";
            record.StructureName = "Empty";
            record.ItemCount = 0;
            record.PathCount = 0;
            record.IsConnected = false;
            record.Summary =
                key +
                " : No Data | Empty | Count: 0";

            return record;
        }

        record.IsConnected =
            parameter.SourceCount > 0;

        HashSet<string> detectedTypes =
            new HashSet<string>(
                StringComparer.OrdinalIgnoreCase
            );

        int itemCount = 0;
        int pathCount = 0;

        if (
            parameter.VolatileData != null &&
            !parameter.VolatileData.IsEmpty)
        {
            pathCount =
                parameter.VolatileData.PathCount;

            foreach (
                IGH_Goo goo
                in parameter.VolatileData.AllData(true))
            {
                if (goo == null)
                    continue;

                itemCount++;

                string friendlyType =
                    GetFriendlyTypeName(goo);

                if (
                    !string.IsNullOrWhiteSpace(
                        friendlyType
                    ))
                {
                    detectedTypes.Add(
                        friendlyType
                    );
                }
            }
        }

        string typeName;

        if (detectedTypes.Count == 0)
        {
            typeName =
                record.IsConnected
                ? DetectSourceType(parameter)
                : "No Data";
        }
        else if (detectedTypes.Count == 1)
        {
            typeName =
                detectedTypes.First();
        }
        else
        {
            typeName = "Mixed";
        }

        record.TypeName = typeName;
        record.ItemCount = itemCount;
        record.PathCount = pathCount;
        record.StructureName =
            GetStructureName(
                pathCount,
                itemCount
            );

        record.Summary =
            key +
            " : " +
            record.TypeName +
            " | " +
            record.StructureName +
            " | Count: " +
            record.ItemCount;

        return record;
    }

    // ============================================================
    // GHDATA SERIALIZATION
    // ============================================================

    private void WriteGhDataArchive(
        string outputPath,
        string session,
        string domain,
        int outputIndex,
        List<DataInputRecord> inputRecords)
    {
        string temporaryPath =
            outputPath + ".writing";

        if (File.Exists(temporaryPath))
        {
            File.Delete(temporaryPath);
        }

        GH_Archive archive =
            new GH_Archive();

        GH_IWriter root =
            archive.CreateTopLevelNode(
                "DECO2_Managed_Data"
            );

        root.SetString(
            "Format",
            "DECO2_MANAGED_GHDATA"
        );

        root.SetInt32(
            "FormatVersion",
            1
        );

        root.SetString(
            "CreatedAt",
            DateTime.UtcNow.ToString(
                "o",
                CultureInfo.InvariantCulture
            )
        );

        root.SetString(
            "Session",
            session
        );

        root.SetString(
            "Domain",
            domain
        );

        root.SetInt32(
            "OutputIndex",
            outputIndex
        );

        root.SetInt32(
            "InputCount",
            inputRecords.Count
        );

        foreach (
            DataInputRecord record
            in inputRecords)
        {
            GH_IWriter inputChunk =
                root.CreateChunk(
                    "Input",
                    record.RelativeIndex
                );

            inputChunk.SetString(
                "Key",
                record.Key
            );

            inputChunk.SetString(
                "TypeName",
                record.TypeName ?? ""
            );

            inputChunk.SetString(
                "StructureName",
                record.StructureName ?? ""
            );

            inputChunk.SetBoolean(
                "IsConnected",
                record.IsConnected
            );

            inputChunk.SetInt32(
                "PathCount",
                record.PathCount
            );

            inputChunk.SetInt32(
                "ItemCount",
                record.ItemCount
            );

            if (
                record.Parameter == null ||
                record.Parameter.VolatileData == null ||
                record.Parameter.VolatileData.IsEmpty)
            {
                continue;
            }

            WriteParameterData(
                inputChunk,
                record.Parameter
            );
        }

        byte[] archiveBytes =
            archive.Serialize_Binary();

        if (
            archiveBytes == null ||
            archiveBytes.Length == 0)
        {
            throw new IOException(
                "Grasshopper archive serialization returned no data."
            );
        }

        File.WriteAllBytes(
            temporaryPath,
            archiveBytes
        );

        if (!File.Exists(temporaryPath))
        {
            throw new IOException(
                "Temporary Grasshopper archive was not created."
            );
        }

        if (File.Exists(outputPath))
        {
            File.Delete(outputPath);
        }

        File.Move(
            temporaryPath,
            outputPath
        );
    }

    private void WriteParameterData(
        GH_IWriter inputChunk,
        IGH_Param parameter)
    {
        int globalItemIndex = 0;

        for (
            int branchIndex = 0;
            branchIndex < parameter.VolatileData.PathCount;
            branchIndex++)
        {
            GH_Path path =
                parameter.VolatileData.get_Path(
                    branchIndex
                );

            IList branch =
                parameter.VolatileData.get_Branch(
                    branchIndex
                );

            GH_IWriter branchChunk =
                inputChunk.CreateChunk(
                    "Branch",
                    branchIndex
                );

            GH_IWriter pathChunk =
                branchChunk.CreateChunk(
                    "Path"
                );

            if (!path.Write(pathChunk))
            {
                throw new InvalidOperationException(
                    "Could not serialize Grasshopper path " +
                    path.ToString() +
                    "."
                );
            }

            int branchItemCount =
                branch == null
                ? 0
                : branch.Count;

            branchChunk.SetInt32(
                "ItemCount",
                branchItemCount
            );

            if (branch == null)
                continue;

            for (
                int itemIndex = 0;
                itemIndex < branch.Count;
                itemIndex++)
            {
                IGH_Goo goo =
                    branch[itemIndex] as IGH_Goo;

                GH_IWriter itemChunk =
                    branchChunk.CreateChunk(
                        "Item",
                        itemIndex
                    );

                itemChunk.SetInt32(
                    "GlobalIndex",
                    globalItemIndex
                );

                globalItemIndex++;

                if (goo == null)
                {
                    itemChunk.SetBoolean(
                        "IsNull",
                        true
                    );

                    continue;
                }

                itemChunk.SetBoolean(
                    "IsNull",
                    false
                );

                Type runtimeType =
                    goo.GetType();

                itemChunk.SetString(
                    "RuntimeType",
                    runtimeType.AssemblyQualifiedName ?? ""
                );

                itemChunk.SetString(
                    "TypeName",
                    goo.TypeName ?? runtimeType.Name
                );

                itemChunk.SetString(
                    "TypeDescription",
                    goo.TypeDescription ?? ""
                );

                GH_IWriter gooChunk =
                    itemChunk.CreateChunk(
                        "Goo"
                    );

                bool gooWritten =
                    goo.Write(gooChunk);

                if (!gooWritten)
                {
                    throw new InvalidOperationException(
                        "Could not serialize item " +
                        itemIndex +
                        " in input " +
                        parameter.NickName +
                        ". Type: " +
                        runtimeType.FullName
                    );
                }
            }
        }
    }

    // ============================================================
    // LOCAL GH AGENT REGISTRATION
    // ============================================================

    private string RegisterLocalUpload(
        string session,
        string domain,
        int outputIndex,
        string localPath)
    {
        StringBuilder payload =
            new StringBuilder();

        payload.Append("{");
        payload.Append(
            "\"command\":\"register_local_upload\","
        );
        payload.Append(
            "\"session\":\"" +
            EscapeJson(session) +
            "\","
        );
        payload.Append(
            "\"local_path\":\"" +
            EscapeJson(localPath) +
            "\","
        );
        payload.Append(
            "\"domain\":\"" +
            EscapeJson(domain) +
            "\","
        );
        payload.Append(
            "\"category\":\"ghdata\","
        );

        if (
            string.Equals(
                domain,
                "design",
                StringComparison.OrdinalIgnoreCase
            ))
        {
            payload.Append(
                "\"design_output_index\":" +
                outputIndex.ToString(
                    CultureInfo.InvariantCulture
                ) +
                ","
            );
        }
        else if (
            string.Equals(
                domain,
                "motion",
                StringComparison.OrdinalIgnoreCase
            ))
        {
            payload.Append(
                "\"motion_output_index\":" +
                outputIndex.ToString(
                    CultureInfo.InvariantCulture
                ) +
                ","
            );
        }

        payload.Append(
            "\"upload_status\":\"pending\""
        );

        payload.Append("}");

        string response =
            SendCommand(
                payload.ToString()
            );

        if (response.StartsWith("ERROR:"))
        {
            throw new InvalidOperationException(
                response
            );
        }

        return response;
    }

    private string SendCommand(
        string command)
    {
        try
        {
            using (
                TcpClient client =
                    new TcpClient())
            {
                IAsyncResult connection =
                    client.BeginConnect(
                        GhAgentHost,
                        GhAgentPort,
                        null,
                        null
                    );

                bool connected =
                    connection.AsyncWaitHandle.WaitOne(
                        TimeSpan.FromMilliseconds(
                            500
                        )
                    );

                if (!connected)
                {
                    return
                        "ERROR: GH Agent connection timeout.";
                }

                client.EndConnect(connection);

                using (
                    NetworkStream stream =
                        client.GetStream())
                {
                    byte[] payload =
                        Encoding.UTF8.GetBytes(
                            command
                        );

                    byte[] header =
                        BuildHeader(
                            payload.Length
                        );

                    stream.Write(
                        header,
                        0,
                        header.Length
                    );

                    stream.Write(
                        payload,
                        0,
                        payload.Length
                    );

                    byte[] responseHeader =
                        ReadExact(
                            stream,
                            MessageHeaderSize
                        );

                    ulong responseSize =
                        ParseHeader(
                            responseHeader
                        );

                    if (responseSize > int.MaxValue)
                    {
                        return
                            "ERROR: GH Agent response is too large.";
                    }

                    byte[] responsePayload =
                        ReadExact(
                            stream,
                            (int)responseSize
                        );

                    return Encoding.UTF8.GetString(
                        responsePayload
                    );
                }
            }
        }
        catch (Exception exception)
        {
            return
                "ERROR: " +
                exception.Message;
        }
    }

    private byte[] BuildHeader(
        int payloadSize)
    {
        byte[] header =
            new byte[MessageHeaderSize];

        ulong size =
            (ulong)payloadSize;

        for (
            int index = 0;
            index < MessageHeaderSize;
            index++)
        {
            header[
                MessageHeaderSize - 1 - index
            ] = (byte)(size & 0xFF);

            size >>= 8;
        }

        return header;
    }

    private ulong ParseHeader(
        byte[] header)
    {
        ulong size = 0;

        for (
            int index = 0;
            index < header.Length;
            index++)
        {
            size =
                (size << 8) +
                header[index];
        }

        return size;
    }

    private byte[] ReadExact(
        NetworkStream stream,
        int size)
    {
        byte[] data =
            new byte[size];

        int offset = 0;

        while (offset < size)
        {
            int read =
                stream.Read(
                    data,
                    offset,
                    size - offset
                );

            if (read == 0)
            {
                throw new IOException(
                    "Connection closed before the response was complete."
                );
            }

            offset += read;
        }

        return data;
    }

    // ============================================================
    // PATHS AND VALIDATION
    // ============================================================

    private string ValidateSettings(
        string directory,
        string fileName,
        string session,
        string domain,
        int outputIndex)
    {
        if (string.IsNullOrWhiteSpace(directory))
        {
            return "Directory cannot be empty.";
        }

        string trimmedDirectory =
            directory.Trim();

        if (!Path.IsPathRooted(trimmedDirectory))
        {
            return "Directory must be an absolute path.";
        }

        if (
            !System.IO.Directory.Exists(
                trimmedDirectory
            ))
        {
            return
                "Directory does not exist: " +
                trimmedDirectory;
        }

        if (string.IsNullOrWhiteSpace(session))
        {
            return "Session cannot be empty.";
        }

        string trimmedSession =
            session.Trim();

        if (
            Path.GetFileName(trimmedSession) !=
            trimmedSession)
        {
            return
                "Session must be a folder name, not a path.";
        }

        if (string.IsNullOrWhiteSpace(domain))
        {
            return "Domain cannot be empty.";
        }

        string normalizedDomain =
            NormalizeName(
                domain,
                ""
            );

        if (
            normalizedDomain != "design" &&
            normalizedDomain != "motion")
        {
            return
                "Domain must currently be 'design' or 'motion'.";
        }

        if (outputIndex < 1)
        {
            return "OutputIndex must be at least 1.";
        }

        if (!string.IsNullOrWhiteSpace(fileName))
        {
            string trimmedFileName =
                fileName.Trim();

            if (
                Path.GetFileName(trimmedFileName) !=
                trimmedFileName)
            {
                return
                    "FileName must be a filename, not a path.";
            }

            foreach (
                char invalidCharacter
                in Path.GetInvalidFileNameChars())
            {
                if (
                    trimmedFileName.IndexOf(
                        invalidCharacter
                    ) >= 0)
                {
                    return
                        "FileName contains an invalid character.";
                }
            }
        }

        return "";
    }

    private string BuildFileName(
        string requestedFileName,
        string normalizedDomain,
        int outputIndex)
    {
        string extension = ".ghdata";

        /*
        * Optional FileName now represents the category.
        *
        * Examples:
        *
        * empty / "ghdata"
        *     -> design_ghdata_05.ghdata
        *
        * "geometry"
        *     -> design_geometry_05.ghdata
        */
        string category =
            string.IsNullOrWhiteSpace(requestedFileName)
            ? "ghdata"
            : Path.GetFileNameWithoutExtension(
                requestedFileName.Trim()
            );

        category =
            NormalizeName(
                category,
                "ghdata"
            );

        return
            normalizedDomain +
            "_" +
            category +
            "_" +
            outputIndex.ToString(
                "00",
                CultureInfo.InvariantCulture
            ) +
            extension;
    }

    private string NormalizeName(
        string value,
        string fallback)
    {
        string raw =
            string.IsNullOrWhiteSpace(value)
            ? fallback
            : value
                .Trim()
                .ToLowerInvariant();

        StringBuilder cleaned =
            new StringBuilder();

        foreach (char character in raw)
        {
            cleaned.Append(
                char.IsLetterOrDigit(character)
                ? character
                : '_'
            );
        }

        string result =
            cleaned.ToString();

        while (result.Contains("__"))
        {
            result =
                result.Replace(
                    "__",
                    "_"
                );
        }

        result =
            result.Trim('_');

        return
            string.IsNullOrWhiteSpace(result)
            ? fallback
            : result;
    }

    // ============================================================
    // READY EVENT
    // ============================================================

    private string BuildReadyEvent(
        string eventId,
        string createdAt,
        string session,
        string domain,
        int outputIndex,
        string outputPath,
        int connectedInputCount,
        int populatedInputCount,
        List<string> summaries)
    {
        List<string> escapedSummaries =
            summaries
                .Select(
                    summary =>
                        "\"" +
                        EscapeJson(summary) +
                        "\""
                )
                .ToList();

        return
            "{" +
            "\"event_id\":\"" +
            EscapeJson(eventId) +
            "\"," +
            "\"event\":\"local_output_ready\"," +
            "\"status\":\"ready\"," +
            "\"created_at\":\"" +
            EscapeJson(createdAt) +
            "\"," +
            "\"session\":\"" +
            EscapeJson(session) +
            "\"," +
            "\"domain\":\"" +
            EscapeJson(domain) +
            "\"," +
            "\"output_index\":" +
            outputIndex.ToString(
                CultureInfo.InvariantCulture
            ) +
            "," +
            "\"local_path\":\"" +
            EscapeJson(outputPath) +
            "\"," +
            "\"category\":\"ghdata\"," +
            "\"connected_input_count\":" +
            connectedInputCount.ToString(
                CultureInfo.InvariantCulture
            ) +
            "," +
            "\"populated_input_count\":" +
            populatedInputCount.ToString(
                CultureInfo.InvariantCulture
            ) +
            "," +
            "\"input_summary\":[" +
            string.Join(
                ",",
                escapedSummaries
            ) +
            "]" +
            "}";
    }

    // ============================================================
    // TYPE AND STRUCTURE HELPERS
    // ============================================================

    private string DetectSourceType(
        IGH_Param parameter)
    {
        HashSet<string> sourceTypes =
            new HashSet<string>(
                StringComparer.OrdinalIgnoreCase
            );

        foreach (
            IGH_Param source
            in parameter.Sources)
        {
            if (source == null)
                continue;

            string rawType =
                !string.IsNullOrWhiteSpace(
                    source.TypeName
                )
                ? source.TypeName
                : source.Name;

            string normalized =
                NormalizeTypeText(
                    rawType
                );

            if (
                !string.IsNullOrWhiteSpace(
                    normalized
                ))
            {
                sourceTypes.Add(
                    normalized
                );
            }
        }

        if (sourceTypes.Count == 1)
            return sourceTypes.First();

        if (sourceTypes.Count > 1)
            return "Mixed";

        return "No Data";
    }

    private string GetStructureName(
        int pathCount,
        int itemCount)
    {
        if (itemCount == 0)
            return "Empty";

        if (pathCount <= 1)
        {
            return
                itemCount == 1
                ? "Item"
                : "List";
        }

        return
            "Tree (" +
            pathCount +
            " branches)";
    }

    private string GetFriendlyTypeName(
        IGH_Goo goo)
    {
        if (goo == null)
            return "";

        if (goo is GH_Point)
            return "Points";

        if (goo is GH_Vector)
            return "Vectors";

        if (goo is GH_Line)
            return "Lines";

        if (goo is GH_Circle)
            return "Circles";

        if (goo is GH_Arc)
            return "Arcs";

        if (goo is GH_Curve)
            return "Curves";

        if (goo is GH_Mesh)
            return "Meshes";

        if (goo is GH_Brep)
            return "Breps";

        if (goo is GH_Surface)
            return "Surfaces";

        if (goo is GH_Plane)
            return "Planes";

        if (goo is GH_Number)
            return "Numbers";

        if (goo is GH_Integer)
            return "Integers";

        if (goo is GH_Boolean)
            return "Booleans";

        if (goo is GH_String)
            return "Text";

        if (goo is GH_Colour)
            return "Colours";

        string typeName =
            goo.TypeName;

        return
            string.IsNullOrWhiteSpace(typeName)
            ? goo.GetType().Name
            : NormalizeTypeText(typeName);
    }

    private string NormalizeTypeText(
        string value)
    {
        if (string.IsNullOrWhiteSpace(value))
            return "";

        string normalized =
            value
                .Trim()
                .Replace(
                    "GH_",
                    ""
                )
                .Replace(
                    "_",
                    " "
                );

        switch (
            normalized.ToLowerInvariant())
        {
            case "point":
            case "point3d":
                return "Points";

            case "vector":
            case "vector3d":
                return "Vectors";

            case "line":
                return "Lines";

            case "circle":
                return "Circles";

            case "arc":
                return "Arcs";

            case "curve":
                return "Curves";

            case "mesh":
                return "Meshes";

            case "brep":
                return "Breps";

            case "surface":
                return "Surfaces";

            case "plane":
                return "Planes";

            case "number":
            case "double":
            case "floating point":
                return "Numbers";

            case "integer":
            case "int32":
                return "Integers";

            case "boolean":
            case "bool":
                return "Booleans";

            case "string":
            case "text":
                return "Text";

            case "colour":
            case "color":
                return "Colours";
        }

        return normalized;
    }

    private string GetAlphabeticName(
        int zeroBasedIndex)
    {
        int value =
            zeroBasedIndex;

        string result =
            "";

        do
        {
            result =
                (char)(
                    'A' +
                    value % 26
                ) +
                result;

            value =
                value / 26 -
                1;
        }
        while (value >= 0);

        return result;
    }

    // ============================================================
    // JSON HELPERS
    // ============================================================

    private string EscapeJson(
        string value)
    {
        if (value == null)
            return "";

        return value
            .Replace(
                "\\",
                "\\\\"
            )
            .Replace(
                "\"",
                "\\\""
            )
            .Replace(
                "\r",
                "\\r"
            )
            .Replace(
                "\n",
                "\\n"
            )
            .Replace(
                "\t",
                "\\t"
            );
    }

    private string ExtractJsonValue(
        string json,
        string key)
    {
        if (string.IsNullOrWhiteSpace(json))
            return "";

        string pattern =
            "\"" +
            key +
            "\":";

        int start =
            json.IndexOf(
                pattern,
                StringComparison.Ordinal
            );

        if (start < 0)
            return "";

        start +=
            pattern.Length;

        while (
            start < json.Length &&
            char.IsWhiteSpace(json[start]))
        {
            start++;
        }

        if (start >= json.Length)
            return "";

        if (json[start] == '"')
        {
            start++;

            StringBuilder value =
                new StringBuilder();

            bool escaped = false;

            for (
                int index = start;
                index < json.Length;
                index++)
            {
                char character =
                    json[index];

                if (escaped)
                {
                    switch (character)
                    {
                        case 'n':
                            value.Append('\n');
                            break;

                        case 'r':
                            value.Append('\r');
                            break;

                        case 't':
                            value.Append('\t');
                            break;

                        case '\\':
                            value.Append('\\');
                            break;

                        case '"':
                            value.Append('"');
                            break;

                        default:
                            value.Append(character);
                            break;
                    }

                    escaped = false;
                    continue;
                }

                if (character == '\\')
                {
                    escaped = true;
                    continue;
                }

                if (character == '"')
                {
                    return value.ToString();
                }

                value.Append(character);
            }

            return "";
        }

        int end =
            start;

        while (
            end < json.Length &&
            json[end] != ',' &&
            json[end] != '}')
        {
            end++;
        }

        return json
            .Substring(
                start,
                end - start
            )
            .Trim();
    }

    // ============================================================
    // OUTPUTS
    // ============================================================

    private void SetOutputs(
        List<string> summaries,
        ref object OutputPath,
        ref object InputSummary,
        ref object ReadyEvent,
        ref object SolutionIndex,
        ref object Status)
    {
        OutputPath =
            lastOutputPath;

        InputSummary =
            summaries;

        ReadyEvent =
            lastReadyEvent;

        SolutionIndex =
            lastSolutionIndex > 0
            ? (object)lastSolutionIndex
            : null;

        Status =
            lastStatus;
    }

    private class DataInputRecord
    {
        public string Key;
        public int RelativeIndex;
        public IGH_Param Parameter;

        public string TypeName;
        public string StructureName;

        public int ItemCount;
        public int PathCount;

        public bool IsConnected;

        public string Summary;
    }
}
# ---------- end c_script_9 ----------
panel_62 = Panel(c_script_9.OutputPath)
panel_63 = Panel(c_script_9.InputSummary)
panel_64 = Panel(c_script_9.ReadyEvent)
panel_65 = Panel(c_script_9.Status)

# ----
rec_2 = DataRecorder(crv_3, DataLimit=-10, RecordData=True)
rec_3 = DataRecorder(bool_2, DataLimit=-10, RecordData=True)
panel_66 = Panel(rec_2)
panel_67 = Panel(rec_3)

# ---- group: Design Data Uploader to Master
panel_68 = Panel("1")
c_script_10 = CSharpScript(
    ConnectButton=connect,
    ReadyEvent=c_script_9.ReadyEvent,
    SourceOutputIndex=c_script_4.SourceIndex,
    SolutionIndex=c_script_9.SolutionIndex,
    CreatedBy="design_pc",
    UploadMessage="Design solution ready",
    AutoPoll=refresh_status)  # -> State, Status, Message, UploadJobId, Progress, Session, OutputIndex, MasterResponse; inputs ConnectButton: Boolean, ReadyEvent: String, SourceOutputIndex: Int32, SolutionIndex: Int32, CreatedBy: String, UploadMessage: String, AutoPoll: Boolean
# ---------- c_script_10: C# ----------
// Grasshopper C# Script Instance
#region Usings
using System;
using System.Globalization;
using System.Net.Sockets;
using System.Text;

using Grasshopper;
using Grasshopper.Kernel;
#endregion

public class Script_Instance : GH_ScriptInstance
{
    // ============================================================
    // CONFIGURATION
    // ============================================================

    private const string GhAgentHost = "127.0.0.1";
    private const int GhAgentPort = 6005;
    private const int MessageHeaderSize = 8;
    private const int PollIntervalMilliseconds = 500;

    // ============================================================
    // COMPONENT STATE
    // ============================================================

    private bool isConnected = false;
    private bool triedConnection = false;
    private bool pollScheduled = false;

    private string lastProcessedEventId = "";

    private string activeUploadJobId = "";
    private string activeSession = "";
    private string activeDomain = "";
    private int activeOutputIndex = 0;

    private string lastState = "Idle";
    private string lastStatus = "Disconnected";
    private string lastMessage = "Enable ConnectButton.";
    private int lastProgress = 0;
    private string lastMasterResponse = "";

    // ============================================================
    // MAIN
    // ============================================================

    private void RunScript(
		bool ConnectButton,
		string ReadyEvent,
		int SourceOutputIndex,
		int SolutionIndex,
		string CreatedBy,
		string UploadMessage,
		bool AutoPoll,
		ref object State,
		ref object Status,
		ref object Message,
		ref object UploadJobId,
		ref object Progress,
		ref object Session,
		ref object OutputIndex,
		ref object MasterResponse)
    {
        try
        {
            // ----------------------------------------------------
            // Connection disabled
            // ----------------------------------------------------

            if (!ConnectButton)
            {
                isConnected = false;
                triedConnection = false;
                pollScheduled = false;

                lastState = "Idle";
                lastStatus = "Disconnected";
                lastMessage = "Connection toggle is off.";

                SetOutputs(
                    ref State,
                    ref Status,
                    ref Message,
                    ref UploadJobId,
                    ref Progress,
                    ref Session,
                    ref OutputIndex,
                    ref MasterResponse
                );

                return;
            }

            // ----------------------------------------------------
            // Connect to GH Agent
            // ----------------------------------------------------

            if (!isConnected && !triedConnection)
            {
                triedConnection = true;

                string pingResponse =
                    SendCommand(
                        "{\"command\":\"ping\"}"
                    );

                if (pingResponse.StartsWith("ERROR:"))
                {
                    isConnected = false;
                    lastState = "Connection error";
                    lastStatus = "Connection failed";
                    lastMessage = pingResponse;

                    SetOutputs(
                        ref State,
                        ref Status,
                        ref Message,
                        ref UploadJobId,
                        ref Progress,
                        ref Session,
                        ref OutputIndex,
                        ref MasterResponse
                    );

                    return;
                }

                string pingStatus =
                    ExtractJsonValue(
                        pingResponse,
                        "status"
                    );

                if (
                    !string.Equals(
                        pingStatus,
                        "ok",
                        StringComparison.OrdinalIgnoreCase))
                {
                    isConnected = false;
                    lastState = "Connection error";
                    lastStatus = "Connection failed";
                    lastMessage =
                        GetResponseMessage(
                            pingResponse,
                            "GH Agent ping failed."
                        );

                    SetOutputs(
                        ref State,
                        ref Status,
                        ref Message,
                        ref UploadJobId,
                        ref Progress,
                        ref Session,
                        ref OutputIndex,
                        ref MasterResponse
                    );

                    return;
                }

                isConnected = true;
                lastState = "Ready";
                lastStatus = "Connected";
                lastMessage =
                    GetResponseMessage(
                        pingResponse,
                        "Connected to GH Agent."
                    );
            }

            if (!isConnected)
            {
                SetOutputs(
                    ref State,
                    ref Status,
                    ref Message,
                    ref UploadJobId,
                    ref Progress,
                    ref Session,
                    ref OutputIndex,
                    ref MasterResponse
                );

                return;
            }

            // ----------------------------------------------------
            // Detect a new ready event
            // ----------------------------------------------------

            if (!string.IsNullOrWhiteSpace(ReadyEvent))
            {
                ReadyEventData eventData =
                    ParseReadyEvent(
                        ReadyEvent
                    );

                if (
                    eventData != null &&
                    !string.IsNullOrWhiteSpace(
                        eventData.EventId) &&
                    !string.Equals(
                        eventData.EventId,
                        lastProcessedEventId,
                        StringComparison.Ordinal))
                {
                    SubmitReadyEvent(
                        eventData,
                        SourceOutputIndex,
                        SolutionIndex,
                        CreatedBy,
                        UploadMessage
                    );
                }
            }

            // ----------------------------------------------------
            // Poll active upload job
            // ----------------------------------------------------

            if (
                IsUploadActive() &&
                AutoPoll)
            {
                PollUploadJob();

                if (IsUploadActive())
                {
                    ScheduleNextPoll();
                }
            }

            SetOutputs(
                ref State,
                ref Status,
                ref Message,
                ref UploadJobId,
                ref Progress,
                ref Session,
                ref OutputIndex,
                ref MasterResponse
            );
        }
        catch (Exception exception)
        {
            lastState = "Failed";
            lastStatus = "Component error";
            lastMessage = exception.Message;

            SetOutputs(
                ref State,
                ref Status,
                ref Message,
                ref UploadJobId,
                ref Progress,
                ref Session,
                ref OutputIndex,
                ref MasterResponse
            );
        }
    }

    // ============================================================
    // READY EVENT SUBMISSION
    // ============================================================

    private void SubmitReadyEvent(
        ReadyEventData eventData,
        int sourceOutputIndex,
        int solutionIndex,
        string createdBy,
        string uploadMessage)
    {
        ValidateReadyEvent(eventData);

        if (solutionIndex < 1)
        {
            throw new ArgumentException(
                "SolutionIndex must be at least 1."
            );
        }

        bool isDesign =
            string.Equals(
                eventData.Domain,
                "design",
                StringComparison.OrdinalIgnoreCase
            );

        bool isMotion =
            string.Equals(
                eventData.Domain,
                "motion",
                StringComparison.OrdinalIgnoreCase
            );

        if (!isDesign && !isMotion)
        {
            throw new InvalidOperationException(
                "Unsupported output domain: '" +
                eventData.Domain +
                "'. Expected 'design' or 'motion'."
            );
        }

        int safeSourceOutputIndex =
            Math.Max(
                1,
                sourceOutputIndex
            );

        string command;
        string outputIndexField;
        string sourceIndexField;
        string defaultCreatedBy;
        string defaultUploadMessage;
        string submissionMessage;
        string submittedMessage;

        if (isDesign)
        {
            command =
                "upload_design_output";

            outputIndexField =
                "design_output_index";

            sourceIndexField =
                "source_processing_output_index";

            defaultCreatedBy =
                "design_pc";

            defaultUploadMessage =
                "Design solution ready.";

            submissionMessage =
                "Submitting registered design output to GH Agent.";

            submittedMessage =
                "Design upload job submitted.";
        }
        else
        {
            command =
                "upload_motion_output";

            outputIndexField =
                "motion_output_index";

            sourceIndexField =
                "source_design_output_index";

            defaultCreatedBy =
                "motion_pc";

            defaultUploadMessage =
                "Motion solution ready.";

            submissionMessage =
                "Submitting registered motion output to GH Agent.";

            submittedMessage =
                "Motion upload job submitted.";
        }

        string safeCreatedBy =
            string.IsNullOrWhiteSpace(
                createdBy
            )
            ? defaultCreatedBy
            : createdBy.Trim();

        string safeUploadMessage =
            string.IsNullOrWhiteSpace(
                uploadMessage
            )
            ? defaultUploadMessage
            : uploadMessage.Trim();

        string payload =
            "{" +
            "\"command\":\"" +
            EscapeJson(command) +
            "\"," +
            "\"session\":\"" +
            EscapeJson(eventData.Session) +
            "\"," +
            "\"" +
            outputIndexField +
            "\":" +
            eventData.OutputIndex.ToString(
                CultureInfo.InvariantCulture
            ) +
            "," +
            "\"" +
            sourceIndexField +
            "\":" +
            safeSourceOutputIndex.ToString(
                CultureInfo.InvariantCulture
            ) +
            "," +
            "\"solution_index\":" +
            solutionIndex.ToString(
                CultureInfo.InvariantCulture
            ) +
            "," +
            "\"created_by\":\"" +
            EscapeJson(safeCreatedBy) +
            "\"," +
            "\"message\":\"" +
            EscapeJson(safeUploadMessage) +
            "\"" +
            "}";

        lastState =
            "Submitting";

        lastStatus =
            "Submitting upload";

        lastMessage =
            submissionMessage;

        string response =
            SendCommand(
                payload
            );

        if (
            response.StartsWith(
                "ERROR:",
                StringComparison.Ordinal
            )
        )
        {
            ConnectionFailure(
                response
            );

            return;
        }

        string responseStatus =
            ExtractJsonValue(
                response,
                "status"
            );

        if (
            !string.Equals(
                responseStatus,
                "ok",
                StringComparison.OrdinalIgnoreCase
            )
        )
        {
            lastState =
                "Failed";

            lastStatus =
                "Upload submission failed";

            lastMessage =
                GetResponseMessage(
                    response,
                    response
                );

            /*
            * Do not consume the event when submission fails.
            * A later Grasshopper solution may retry it.
            */
            return;
        }

        string jobId =
            ExtractJsonValue(
                response,
                "job_id"
            );

        if (
            string.IsNullOrWhiteSpace(
                jobId
            )
        )
        {
            lastState =
                "Failed";

            lastStatus =
                "Upload submission failed";

            lastMessage =
                "GH Agent returned success without an upload job ID.";

            return;
        }

        /*
        * Consume the event only after GH Agent successfully
        * accepted the upload job.
        */
        lastProcessedEventId =
            eventData.EventId;

        activeUploadJobId =
            jobId;

        activeSession =
            eventData.Session;

        activeDomain =
            eventData.Domain;

        activeOutputIndex =
            eventData.OutputIndex;

        lastProgress =
            0;

        lastMasterResponse =
            "";

        lastState =
            "Upload queued";

        lastStatus =
            ExtractJsonValue(
                response,
                "latest_status"
            );

        if (
            string.IsNullOrWhiteSpace(
                lastStatus
            )
        )
        {
            lastStatus =
                "upload_queued";
        }

        lastMessage =
            GetResponseMessage(
                response,
                submittedMessage
            );

        ScheduleNextPoll();
    }

    // ============================================================
    // JOB POLLING
    // ============================================================

    private void PollUploadJob()
    {
        if (string.IsNullOrWhiteSpace(
            activeUploadJobId))
        {
            return;
        }

        string payload =
            "{" +
            "\"command\":\"get_job_status\"," +
            "\"job_id\":\"" +
            EscapeJson(activeUploadJobId) +
            "\"" +
            "}";

        string response =
            SendCommand(payload);

        if (response.StartsWith("ERROR:"))
        {
            ConnectionFailure(response);
            return;
        }

        string outerStatus =
            ExtractJsonValue(
                response,
                "status"
            );

        if (
            !string.Equals(
                outerStatus,
                "ok",
                StringComparison.OrdinalIgnoreCase))
        {
            lastState = "Polling error";
            lastStatus = "Upload status request failed";
            lastMessage =
                GetResponseMessage(
                    response,
                    response
                );

            return;
        }

        string jobJson =
            ExtractJsonObject(
                response,
                "job"
            );

        if (string.IsNullOrWhiteSpace(jobJson))
        {
            lastState = "Polling error";
            lastStatus = "Upload status unavailable";
            lastMessage =
                "GH Agent response did not contain a job object.";

            return;
        }

        string jobStatus =
            NormalizeStatus(
                ExtractJsonValue(
                    jobJson,
                    "status"
                )
            );

        string jobMessage =
            ExtractJsonValue(
                jobJson,
                "message"
            );

        string jobError =
            ExtractJsonValue(
                jobJson,
                "error"
            );

        lastProgress =
            ParseInteger(
                ExtractJsonValue(
                    jobJson,
                    "progress"
                ),
                lastProgress
            );

        if (!string.IsNullOrWhiteSpace(jobMessage))
        {
            lastMessage = jobMessage;
        }

        lastStatus =
            string.IsNullOrWhiteSpace(jobStatus)
            ? "unknown"
            : jobStatus;

        if (
            jobStatus == "upload_queued" ||
            jobStatus == "queued")
        {
            lastState = "Upload queued";
            return;
        }

        if (
            jobStatus == "upload_running" ||
            jobStatus == "running")
        {
            lastState = "Uploading";
            return;
        }

        if (
            jobStatus == "upload_finished" ||
            jobStatus == "finished")
        {
            string resultJson =
                ExtractJsonObject(
                    jobJson,
                    "result"
                );

            lastMasterResponse =
                ExtractMasterResponse(
                    resultJson
                );

            string completionMessage =
                GetActiveDomainLabel() +
                " output uploaded successfully.";

            bool actionCompleted =
                FinishLocalProjectAction(
                    "completed",
                    completionMessage,
                    "",
                    ""
                );

            lastProgress = 100;

            if (actionCompleted)
            {
                lastState =
                    "Finished";

                lastStatus =
                    "upload_finished";

                lastMessage =
                    completionMessage;
            }
            else
            {
                /*
                * The output upload has already succeeded.
                * Only the local current_action.json update failed.
                */
                lastState =
                    "Finished with local action error";

                lastStatus =
                    "local_completion_failed";

                /*
                * Do not replace lastMessage here.
                * FinishLocalProjectAction already stored the exact
                * error response from the GH Agent.
                */
            }

            return;
        }

        if (
            jobStatus == "upload_failed" ||
            jobStatus == "failed" ||
            jobStatus == "error")
        {
            string failureMessage;

            if (!string.IsNullOrWhiteSpace(jobError))
            {
                failureMessage = jobError;
            }
            else if (!string.IsNullOrWhiteSpace(jobMessage))
            {
                failureMessage = jobMessage;
            }
            else
            {
                failureMessage =
                    GetActiveDomainLabel() +
                    " upload failed.";
            }

            bool actionFailed =
                FinishLocalProjectAction(
                    "failed",
                    failureMessage,
                    "",
                    failureMessage
                );

            lastProgress = 100;
            lastMessage = failureMessage;

            if (actionFailed)
            {
                lastState = "Failed";
                lastStatus = "upload_failed";
            }
            else
            {
                lastState =
                    "Failed with local action error";

                lastStatus =
                    "local_completion_failed";
            }

            return;
        }

        if (jobStatus == "cancelled")
        {
            string cancellationMessage =
                string.IsNullOrWhiteSpace(jobMessage)
                ? GetActiveDomainLabel() +
                " upload was cancelled."
                : jobMessage;

            bool actionCancelled =
                FinishLocalProjectAction(
                    "cancelled",
                    cancellationMessage,
                    "",
                    ""
                );

            lastProgress = 100;
            lastMessage = cancellationMessage;

            if (actionCancelled)
            {
                lastState = "Cancelled";
                lastStatus = "cancelled";
            }
            else
            {
                lastState =
                    "Cancelled with local action error";

                lastStatus =
                    "local_completion_failed";
            }

            return;
        }

        lastState = "Upload status unknown";
    }

    private bool FinishLocalProjectAction(
        string terminalStatus,
        string terminalMessage,
        string resultJson,
        string errorMessage)
    {
        string payload =
            "{" +
            "\"command\":\"finish_local_project_action\"," +
            "\"action_status\":\"" +
            EscapeJson(terminalStatus) +
            "\"," +
            "\"message\":\"" +
            EscapeJson(terminalMessage) +
            "\"";

        if (!string.IsNullOrWhiteSpace(resultJson))
        {
            payload +=
                ",\"result\":" +
                resultJson;
        }

        if (!string.IsNullOrWhiteSpace(errorMessage))
        {
            payload +=
                ",\"error\":\"" +
                EscapeJson(errorMessage) +
                "\"";
        }

        payload += "}";

        string response =
            SendCommand(payload);

        if (
            response.StartsWith(
                "ERROR:",
                StringComparison.Ordinal
            )
        )
        {
            lastMessage =
                terminalMessage +
                " Local project-action update failed: " +
                response;

            return false;
        }

        string responseStatus =
            ExtractJsonValue(
                response,
                "status"
            );

        if (
            !string.Equals(
                responseStatus,
                "ok",
                StringComparison.OrdinalIgnoreCase
            )
        )
        {
            lastMessage =
                terminalMessage +
                " Local project-action update failed: " +
                GetResponseMessage(
                    response,
                    response
                );

            return false;
        }

        return true;
    }

    private bool IsUploadActive()
    {
        string normalized =
            NormalizeStatus(
                lastStatus
            );

        return (
            !string.IsNullOrWhiteSpace(
                activeUploadJobId
            ) &&
            normalized != "upload_finished" &&
            normalized != "finished" &&
            normalized != "upload_failed" &&
            normalized != "failed" &&
            normalized != "error" &&
            normalized != "cancelled" &&
            normalized != "local_completion_failed"
        );
    }

    // ============================================================
    // AUTOMATIC POLLING
    // ============================================================

    private void ScheduleNextPoll()
    {
        if (pollScheduled)
            return;

        GH_Document document =
            Component.OnPingDocument();

        if (document == null)
            return;

        pollScheduled = true;

        document.ScheduleSolution(
            PollIntervalMilliseconds,
            scheduledDocument =>
            {
                pollScheduled = false;

                if (Component != null)
                {
                    Component.ExpireSolution(
                        false
                    );
                }
            }
        );
    }

    // ============================================================
    // READY EVENT PARSING
    // ============================================================

    private ReadyEventData ParseReadyEvent(
        string readyEvent)
    {
        string eventName =
            ExtractJsonValue(
                readyEvent,
                "event"
            );

        string eventStatus =
            NormalizeStatus(
                ExtractJsonValue(
                    readyEvent,
                    "status"
                )
            );

        if (
            !string.Equals(
                eventName,
                "local_output_ready",
                StringComparison.OrdinalIgnoreCase))
        {
            return null;
        }

        if (eventStatus != "ready")
        {
            return null;
        }

        ReadyEventData result =
            new ReadyEventData();

        result.EventId =
            ExtractJsonValue(
                readyEvent,
                "event_id"
            );

        result.Session =
            ExtractJsonValue(
                readyEvent,
                "session"
            );

        result.Domain =
            NormalizeStatus(
                ExtractJsonValue(
                    readyEvent,
                    "domain"
                )
            );

        result.OutputIndex =
            ParseInteger(
                ExtractJsonValue(
                    readyEvent,
                    "output_index"
                ),
                0
            );
        
        // result.SolutionIndex =
        //     ParseInteger(
        //         ExtractJsonValue(
        //             readyEvent,
        //             "solution_index"
        //         ),
        //         0
        //     );

        result.LocalPath =
            ExtractJsonValue(
                readyEvent,
                "local_path"
            );

        result.Category =
            ExtractJsonValue(
                readyEvent,
                "category"
            );

        return result;
    }

    private void ValidateReadyEvent(
        ReadyEventData eventData)
    {
        if (eventData == null)
        {
            throw new ArgumentException(
                "ReadyEvent could not be parsed."
            );
        }

        if (string.IsNullOrWhiteSpace(
            eventData.EventId))
        {
            throw new ArgumentException(
                "ReadyEvent is missing event_id."
            );
        }

        if (string.IsNullOrWhiteSpace(
            eventData.Session))
        {
            throw new ArgumentException(
                "ReadyEvent is missing session."
            );
        }

        if (string.IsNullOrWhiteSpace(
            eventData.Domain))
        {
            throw new ArgumentException(
                "ReadyEvent is missing domain."
            );
        }

        if (eventData.OutputIndex < 1)
        {
            throw new ArgumentException(
                "ReadyEvent output_index must be at least 1."
            );
        }

        // if (eventData.SolutionIndex < 1)
        // {
        //     throw new ArgumentException(
        //         "ReadyEvent solution_index must be at least 1."
        //     );
        // }

        if (string.IsNullOrWhiteSpace(
            eventData.LocalPath))
        {
            throw new ArgumentException(
                "ReadyEvent is missing local_path."
            );
        }
    }

    // ============================================================
    // CONNECTION
    // ============================================================

    private void ConnectionFailure(
        string message)
    {
        isConnected = false;
        triedConnection = true;

        lastState = "Connection error";
        lastStatus = "connection_failed";
        lastMessage = message;
    }

    private string SendCommand(
        string command)
    {
        try
        {
            using (
                TcpClient client =
                    new TcpClient())
            {
                IAsyncResult connection =
                    client.BeginConnect(
                        GhAgentHost,
                        GhAgentPort,
                        null,
                        null
                    );

                bool connected =
                    connection.AsyncWaitHandle.WaitOne(
                        TimeSpan.FromMilliseconds(
                            500
                        )
                    );

                if (!connected)
                {
                    return
                        "ERROR: GH Agent connection timeout.";
                }

                client.EndConnect(connection);

                using (
                    NetworkStream stream =
                        client.GetStream())
                {
                    byte[] payload =
                        Encoding.UTF8.GetBytes(
                            command
                        );

                    byte[] header =
                        BuildHeader(
                            payload.Length
                        );

                    stream.Write(
                        header,
                        0,
                        header.Length
                    );

                    stream.Write(
                        payload,
                        0,
                        payload.Length
                    );

                    byte[] responseHeader =
                        ReadExact(
                            stream,
                            MessageHeaderSize
                        );

                    ulong responseSize =
                        ParseHeader(
                            responseHeader
                        );

                    if (responseSize > int.MaxValue)
                    {
                        return
                            "ERROR: GH Agent response is too large.";
                    }

                    byte[] responsePayload =
                        ReadExact(
                            stream,
                            (int)responseSize
                        );

                    return Encoding.UTF8.GetString(
                        responsePayload
                    );
                }
            }
        }
        catch (Exception exception)
        {
            return
                "ERROR: " +
                exception.Message;
        }
    }

    private byte[] BuildHeader(
        int payloadSize)
    {
        byte[] header =
            new byte[MessageHeaderSize];

        ulong size =
            (ulong)payloadSize;

        for (
            int index = 0;
            index < MessageHeaderSize;
            index++)
        {
            header[
                MessageHeaderSize - 1 - index
            ] = (byte)(size & 0xFF);

            size >>= 8;
        }

        return header;
    }

    private ulong ParseHeader(
        byte[] header)
    {
        ulong size = 0;

        for (
            int index = 0;
            index < header.Length;
            index++)
        {
            size =
                (size << 8) +
                header[index];
        }

        return size;
    }

    private byte[] ReadExact(
        NetworkStream stream,
        int size)
    {
        byte[] data =
            new byte[size];

        int offset = 0;

        while (offset < size)
        {
            int read =
                stream.Read(
                    data,
                    offset,
                    size - offset
                );

            if (read == 0)
            {
                throw new InvalidOperationException(
                    "Connection closed before the response was complete."
                );
            }

            offset += read;
        }

        return data;
    }

    // ============================================================
    // JSON HELPERS
    // ============================================================

    private string ExtractMasterResponse(
        string resultJson)
    {
        if (string.IsNullOrWhiteSpace(resultJson))
        {
            return "";
        }

        string masterResponse =
            ExtractJsonObject(
                resultJson,
                "master_response"
            );

        return string.IsNullOrWhiteSpace(
            masterResponse)
            ? resultJson
            : masterResponse;
    }

    private string GetResponseMessage(
        string json,
        string fallback)
    {
        string message =
            ExtractJsonValue(
                json,
                "message"
            );

        return string.IsNullOrWhiteSpace(message)
            ? fallback
            : message;
    }

    private string NormalizeStatus(
        string value)
    {
        return string.IsNullOrWhiteSpace(value)
            ? ""
            : value.Trim().ToLowerInvariant();
    }

    private int ParseInteger(
        string value,
        int fallback)
    {
        int parsedInteger;

        if (
            int.TryParse(
                value,
                NumberStyles.Integer,
                CultureInfo.InvariantCulture,
                out parsedInteger))
        {
            return parsedInteger;
        }

        double parsedDouble;

        if (
            double.TryParse(
                value,
                NumberStyles.Float,
                CultureInfo.InvariantCulture,
                out parsedDouble))
        {
            return (int)Math.Round(parsedDouble);
        }

        return fallback;
    }

    private string EscapeJson(
        string value)
    {
        if (value == null)
            return "";

        return value
            .Replace("\\", "\\\\")
            .Replace("\"", "\\\"")
            .Replace("\r", "\\r")
            .Replace("\n", "\\n")
            .Replace("\t", "\\t");
    }

    private string ExtractJsonValue(
        string json,
        string key)
    {
        if (string.IsNullOrWhiteSpace(json))
            return "";

        string pattern =
            "\"" + key + "\":";

        int start =
            json.IndexOf(
                pattern,
                StringComparison.Ordinal
            );

        if (start < 0)
            return "";

        start += pattern.Length;

        while (
            start < json.Length &&
            char.IsWhiteSpace(json[start]))
        {
            start++;
        }

        if (start >= json.Length)
            return "";

        if (json[start] == '"')
        {
            start++;

            StringBuilder value =
                new StringBuilder();

            bool escaped = false;

            for (
                int index = start;
                index < json.Length;
                index++)
            {
                char character =
                    json[index];

                if (escaped)
                {
                    switch (character)
                    {
                        case 'n':
                            value.Append('\n');
                            break;

                        case 'r':
                            value.Append('\r');
                            break;

                        case 't':
                            value.Append('\t');
                            break;

                        case '\\':
                            value.Append('\\');
                            break;

                        case '"':
                            value.Append('"');
                            break;

                        default:
                            value.Append(character);
                            break;
                    }

                    escaped = false;
                    continue;
                }

                if (character == '\\')
                {
                    escaped = true;
                    continue;
                }

                if (character == '"')
                {
                    return value.ToString();
                }

                value.Append(character);
            }

            return "";
        }

        if (
            json.Substring(start)
                .StartsWith(
                    "null",
                    StringComparison.Ordinal))
        {
            return "";
        }

        int end = start;

        while (
            end < json.Length &&
            json[end] != ',' &&
            json[end] != '}')
        {
            end++;
        }

        return json
            .Substring(
                start,
                end - start
            )
            .Trim();
    }

    private string ExtractJsonObject(
        string json,
        string key)
    {
        if (string.IsNullOrWhiteSpace(json))
            return "";

        string pattern =
            "\"" + key + "\":";

        int keyIndex =
            json.IndexOf(
                pattern,
                StringComparison.Ordinal
            );

        if (keyIndex < 0)
            return "";

        int start =
            keyIndex +
            pattern.Length;

        while (
            start < json.Length &&
            char.IsWhiteSpace(json[start]))
        {
            start++;
        }

        if (
            start >= json.Length ||
            json[start] != '{')
        {
            return "";
        }

        int depth = 0;
        bool insideString = false;
        bool escaped = false;

        for (
            int index = start;
            index < json.Length;
            index++)
        {
            char character =
                json[index];

            if (insideString)
            {
                if (escaped)
                {
                    escaped = false;
                }
                else if (character == '\\')
                {
                    escaped = true;
                }
                else if (character == '"')
                {
                    insideString = false;
                }

                continue;
            }

            if (character == '"')
            {
                insideString = true;
                continue;
            }

            if (character == '{')
            {
                depth++;
            }
            else if (character == '}')
            {
                depth--;

                if (depth == 0)
                {
                    return json.Substring(
                        start,
                        index - start + 1
                    );
                }
            }
        }

        return "";
    }

    private string GetActiveDomainLabel()
    {
        if (
            string.Equals(
                activeDomain,
                "motion",
                StringComparison.OrdinalIgnoreCase
            )
        )
        {
            return "Motion";
        }

        if (
            string.Equals(
                activeDomain,
                "design",
                StringComparison.OrdinalIgnoreCase
            )
        )
        {
            return "Design";
        }

        return "Output";
    }

    // ============================================================
    // OUTPUTS
    // ============================================================

    private void SetOutputs(
        ref object State,
        ref object Status,
        ref object Message,
        ref object UploadJobId,
        ref object Progress,
        ref object Session,
        ref object OutputIndex,
        ref object MasterResponse)
    {
        State = lastState;
        Status = lastStatus;
        Message = lastMessage;
        UploadJobId = activeUploadJobId;
        Progress = lastProgress;
        Session = activeSession;
        OutputIndex = activeOutputIndex;
        MasterResponse = lastMasterResponse;
    }

    private class ReadyEventData
    {
        public string EventId;
        public string Session;
        public string Domain;
        public int OutputIndex;
        // public int SolutionIndex;
        public string LocalPath;
        public string Category;
    }
}
# ---------- end c_script_10 ----------
panel_69 = Panel(c_script_10.Message)
panel_70 = Panel(c_script_10.State)
panel_71 = Panel(c_script_10.Status)
panel_72 = Panel(c_script_10.UploadJobId)
panel_73 = Panel(c_script_10.Progress)
panel_74 = Panel(c_script_10.Session)
panel_75 = Panel(c_script_10.OutputIndex)
panel_76 = Panel(c_script_10.MasterResponse)
