# Grasshopper definition communication_Motion_00.gh (Grasshopper 1.0.8)

# ---- group: Communication for Motion
trigger = Trigger(Interval=1000, TimerInterval=1000, Target=[c_script_7, c_script_8, c_script_6, c_script_2, c_script])  # disabled

# ---- group: Communication for Motion / Lister for Run Motion
connect = BooleanToggle(False)
refresh_status = BooleanToggle(False)
c_script = CSharpScript(ConnectButton=connect, RefreshStatus=refresh_status, ExpectedAction="run_motion", Host="127.0.0.1", Port="6006")  # -> Trigger, Connected, State, Action, Session, SourceIndex, ActionId, LocalStatus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; inputs ConnectButton: Boolean, RefreshStatus: Boolean, ExpectedAction: String, Host: String, Port: Int32
# ---------- c_script: C# ----------
// Grasshopper Script Instance

#region Usings
using System;
using System.Text;
using System.Net.Sockets;
using System.Globalization;

using Rhino;
using Rhino.Geometry;

using Grasshopper;
using Grasshopper.Kernel;
using Grasshopper.Kernel.Data;
using Grasshopper.Kernel.Types;
#endregion


public class Script_Instance : GH_ScriptInstance
{
    // ============================================================
    // CONNECTION STATE
    // ============================================================

    private bool isConnected = false;
    private bool triedConnect = false;


    // ============================================================
    // EDGE DETECTION
    // ============================================================

    private bool previousRefreshStatus = false;


    // ============================================================
    // COMPONENT STATE
    // ============================================================

    private bool triggerPulse = false;

    private string lastState =
        "Disconnected";

    private string lastAction = "";
    private string lastSession = "";
    private int lastSourceIndex = -1;
    private string lastActionId = "";
    private string lastLocalStatus = "";
    private string lastTarget = "";

    private string lastMessage =
        "Enable ConnectButton.";

    private string lastRawResponse = "";


    // ============================================================
    // MAIN
    // ============================================================

    private void RunScript(
		bool ConnectButton,
		bool RefreshStatus,
		string ExpectedAction,
		string Host,
		int Port,
		ref object Trigger,
		ref object Connected,
		ref object State,
		ref object Action,
		ref object Session,
		ref object SourceIndex,
		ref object ActionId,
		ref object LocalStatus,
		ref object Target,
		ref object Message,
		ref object RawResponse)
    {
        // Trigger is always a one-solution pulse.
        triggerPulse = false;

        bool refreshPulse =
            // RefreshStatus &&
            // !previousRefreshStatus;
            RefreshStatus;

        previousRefreshStatus =
            RefreshStatus;


        // --------------------------------------------------------
        // Normalize configuration
        // --------------------------------------------------------

        string normalizedHost =
            string.IsNullOrWhiteSpace(
                Host
            )
            ? "127.0.0.1"
            : Host.Trim();

        int normalizedPort =
            Port > 0
            ? Port
            : 6005;

        string normalizedExpectedAction =
            NormalizeAction(
                ExpectedAction
            );


        // --------------------------------------------------------
        // Connection toggle off
        // --------------------------------------------------------

        if (!ConnectButton)
        {
            isConnected = false;
            triedConnect = false;

            lastState = "Disconnected";

            lastMessage =
                "Connection toggle is off.";

            lastRawResponse = "";

            ClearActionOutputs();

            SetOutputs(
                ref Trigger,
                ref Connected,
                ref State,
                ref Action,
                ref Session,
                ref SourceIndex,
                ref ActionId,
                ref LocalStatus,
                ref Target,
                ref Message,
                ref RawResponse
            );

            return;
        }


        // --------------------------------------------------------
        // Initial connection attempt
        // --------------------------------------------------------

        if (
            ConnectButton &&
            !isConnected &&
            !triedConnect
        )
        {
            triedConnect = true;

            string pingResponse =
                SendCommand(
                    normalizedHost,
                    normalizedPort,
                    "{\"command\":\"ping\"}"
                );

            lastRawResponse =
                pingResponse;

            if (
                pingResponse.StartsWith(
                    "ERROR:",
                    StringComparison.Ordinal
                )
            )
            {
                isConnected = false;

                lastState =
                    "Connection failed";

                lastMessage =
                    pingResponse;
            }
            else
            {
                string responseStatus =
                    ExtractJsonValue(
                        pingResponse,
                        "status"
                    );

                string responseMessage =
                    ExtractJsonValue(
                        pingResponse,
                        "message"
                    );

                if (
                    string.Equals(
                        responseStatus,
                        "ok",
                        StringComparison.OrdinalIgnoreCase
                    )
                )
                {
                    isConnected = true;

                    lastState =
                        "Connected";

                    lastMessage =
                        string.IsNullOrWhiteSpace(
                            responseMessage
                        )
                        ? "Connected to the local GH Agent."
                        : responseMessage;
                }
                else
                {
                    isConnected = false;

                    lastState =
                        "Connection failed";

                    lastMessage =
                        string.IsNullOrWhiteSpace(
                            responseMessage
                        )
                        ? pingResponse
                        : responseMessage;
                }
            }
        }


        // --------------------------------------------------------
        // Remain disconnected until user retries
        // --------------------------------------------------------

        if (!isConnected)
        {
            SetOutputs(
                ref Trigger,
                ref Connected,
                ref State,
                ref Action,
                ref Session,
                ref SourceIndex,
                ref ActionId,
                ref LocalStatus,
                ref Target,
                ref Message,
                ref RawResponse
            );

            return;
        }


        // --------------------------------------------------------
        // Validate expected action
        // --------------------------------------------------------

        if (
            string.IsNullOrWhiteSpace(
                normalizedExpectedAction
            )
        )
        {
            lastState =
                "Configuration error";

            lastMessage =
                "ExpectedAction cannot be empty.";

            SetOutputs(
                ref Trigger,
                ref Connected,
                ref State,
                ref Action,
                ref Session,
                ref SourceIndex,
                ref ActionId,
                ref LocalStatus,
                ref Target,
                ref Message,
                ref RawResponse
            );

            return;
        }


        // --------------------------------------------------------
        // Wait for controlled refresh pulse
        // --------------------------------------------------------

        if (!refreshPulse)
        {
            if (
                lastState == "Connected" ||
                lastState == "Waiting"
            )
            {
                lastState =
                    "Waiting";

                lastMessage =
                    "Waiting for RefreshStatus pulse.";
            }

            SetOutputs(
                ref Trigger,
                ref Connected,
                ref State,
                ref Action,
                ref Session,
                ref SourceIndex,
                ref ActionId,
                ref LocalStatus,
                ref Target,
                ref Message,
                ref RawResponse
            );

            return;
        }


        // --------------------------------------------------------
        // Inspect the current local action
        // --------------------------------------------------------

        string inspectResponse =
            SendCommand(
                normalizedHost,
                normalizedPort,
                "{" +
                "\"command\":" +
                "\"get_local_project_action\"" +
                "}"
            );

        lastRawResponse =
            inspectResponse;

        if (
            inspectResponse.StartsWith(
                "ERROR:",
                StringComparison.Ordinal
            )
        )
        {
            HandleConnectionFailure(
                inspectResponse
            );

            SetOutputs(
                ref Trigger,
                ref Connected,
                ref State,
                ref Action,
                ref Session,
                ref SourceIndex,
                ref ActionId,
                ref LocalStatus,
                ref Target,
                ref Message,
                ref RawResponse
            );

            return;
        }


        string inspectStatus =
            ExtractJsonValue(
                inspectResponse,
                "status"
            );

        string inspectMessage =
            ExtractJsonValue(
                inspectResponse,
                "message"
            );

        lastTarget =
            ExtractJsonValue(
                inspectResponse,
                "target"
            );

        if (
            !string.Equals(
                inspectStatus,
                "ok",
                StringComparison.OrdinalIgnoreCase
            )
        )
        {
            lastState =
                "Action inspection failed";

            lastMessage =
                string.IsNullOrWhiteSpace(
                    inspectMessage
                )
                ? inspectResponse
                : inspectMessage;

            SetOutputs(
                ref Trigger,
                ref Connected,
                ref State,
                ref Action,
                ref Session,
                ref SourceIndex,
                ref ActionId,
                ref LocalStatus,
                ref Target,
                ref Message,
                ref RawResponse
            );

            return;
        }


        string actionJson =
            ExtractJsonObject(
                inspectResponse,
                "action"
            );


        // --------------------------------------------------------
        // No local action
        // --------------------------------------------------------

        if (
            string.IsNullOrWhiteSpace(
                actionJson
            )
        )
        {
            ClearActionOutputs();

            lastTarget =
                ExtractJsonValue(
                    inspectResponse,
                    "target"
                );

            lastState =
                "Waiting for action";

            lastMessage =
                string.IsNullOrWhiteSpace(
                    inspectMessage
                )
                ? "No active local project action."
                : inspectMessage;

            SetOutputs(
                ref Trigger,
                ref Connected,
                ref State,
                ref Action,
                ref Session,
                ref SourceIndex,
                ref ActionId,
                ref LocalStatus,
                ref Target,
                ref Message,
                ref RawResponse
            );

            return;
        }


        // --------------------------------------------------------
        // Read local action
        // --------------------------------------------------------

        lastAction =
            NormalizeAction(
                ExtractJsonValue(
                    actionJson,
                    "action"
                )
            );

        lastSession =
            ExtractJsonValue(
                actionJson,
                "session"
            );

        lastActionId =
            ExtractJsonValue(
                actionJson,
                "action_id"
            );

        lastLocalStatus =
            NormalizeStatus(
                ExtractJsonValue(
                    actionJson,
                    "local_status"
                )
            );

        lastTarget =
            ExtractJsonValue(
                actionJson,
                "target"
            );

        lastSourceIndex =
            ParseInteger(
                ExtractJsonValue(
                    actionJson,
                    "source_output_index"
                ),
                -1
            );


        // --------------------------------------------------------
        // Safety validation
        // --------------------------------------------------------

        if (
            string.IsNullOrWhiteSpace(
                lastActionId
            )
        )
        {
            lastState =
                "Invalid local action";

            lastMessage =
                "The local action is missing action_id.";

            SetOutputs(
                ref Trigger,
                ref Connected,
                ref State,
                ref Action,
                ref Session,
                ref SourceIndex,
                ref ActionId,
                ref LocalStatus,
                ref Target,
                ref Message,
                ref RawResponse
            );

            return;
        }

        if (
            string.IsNullOrWhiteSpace(
                lastSession
            )
        )
        {
            lastState =
                "Invalid local action";

            lastMessage =
                "The local action is missing session.";

            SetOutputs(
                ref Trigger,
                ref Connected,
                ref State,
                ref Action,
                ref Session,
                ref SourceIndex,
                ref ActionId,
                ref LocalStatus,
                ref Target,
                ref Message,
                ref RawResponse
            );

            return;
        }

        if (lastSourceIndex < 1)
        {
            lastState =
                "Invalid local action";

            lastMessage =
                "The local action is missing a valid " +
                "source_output_index.";

            SetOutputs(
                ref Trigger,
                ref Connected,
                ref State,
                ref Action,
                ref Session,
                ref SourceIndex,
                ref ActionId,
                ref LocalStatus,
                ref Target,
                ref Message,
                ref RawResponse
            );

            return;
        }


        // --------------------------------------------------------
        // Compare received and expected actions
        // --------------------------------------------------------

        if (
            !string.Equals(
                lastAction,
                normalizedExpectedAction,
                StringComparison.OrdinalIgnoreCase
            )
        )
        {
            lastState =
                "Action mismatch";

            lastMessage =
                "Expected action '" +
                normalizedExpectedAction +
                "', but received '" +
                (
                    string.IsNullOrWhiteSpace(
                        lastAction
                    )
                    ? "(empty)"
                    : lastAction
                ) +
                "'. The action was not consumed.";

            SetOutputs(
                ref Trigger,
                ref Connected,
                ref State,
                ref Action,
                ref Session,
                ref SourceIndex,
                ref ActionId,
                ref LocalStatus,
                ref Target,
                ref Message,
                ref RawResponse
            );

            return;
        }


        // --------------------------------------------------------
        // Do not consume an already handled action
        // --------------------------------------------------------

        if (
            !string.Equals(
                lastLocalStatus,
                "claimed",
                StringComparison.OrdinalIgnoreCase
            )
        )
        {
            lastState =
                "Action already handled";

            lastMessage =
                "Action '" +
                lastAction +
                "' has local status '" +
                (
                    string.IsNullOrWhiteSpace(
                        lastLocalStatus
                    )
                    ? "(unknown)"
                    : lastLocalStatus
                ) +
                "'. No trigger was generated.";

            SetOutputs(
                ref Trigger,
                ref Connected,
                ref State,
                ref Action,
                ref Session,
                ref SourceIndex,
                ref ActionId,
                ref LocalStatus,
                ref Target,
                ref Message,
                ref RawResponse
            );

            return;
        }


        // --------------------------------------------------------
        // Consume matching claimed action
        // --------------------------------------------------------

        string consumeResponse =
            SendCommand(
                normalizedHost,
                normalizedPort,
                "{" +
                "\"command\":" +
                "\"consume_local_project_action\"" +
                "}"
            );

        lastRawResponse =
            consumeResponse;

        if (
            consumeResponse.StartsWith(
                "ERROR:",
                StringComparison.Ordinal
            )
        )
        {
            HandleConnectionFailure(
                consumeResponse
            );

            SetOutputs(
                ref Trigger,
                ref Connected,
                ref State,
                ref Action,
                ref Session,
                ref SourceIndex,
                ref ActionId,
                ref LocalStatus,
                ref Target,
                ref Message,
                ref RawResponse
            );

            return;
        }


        string consumeStatus =
            ExtractJsonValue(
                consumeResponse,
                "status"
            );

        string consumeMessage =
            ExtractJsonValue(
                consumeResponse,
                "message"
            );

        bool receivedTrigger =
            ParseBoolean(
                ExtractJsonValue(
                    consumeResponse,
                    "trigger"
                )
            );

        string consumedActionJson =
            ExtractJsonObject(
                consumeResponse,
                "action"
            );


        // --------------------------------------------------------
        // Consume rejected
        // --------------------------------------------------------

        if (
            !string.Equals(
                consumeStatus,
                "ok",
                StringComparison.OrdinalIgnoreCase
            )
        )
        {
            triggerPulse = false;

            lastState =
                "Action consumption failed";

            lastMessage =
                string.IsNullOrWhiteSpace(
                    consumeMessage
                )
                ? consumeResponse
                : consumeMessage;

            SetOutputs(
                ref Trigger,
                ref Connected,
                ref State,
                ref Action,
                ref Session,
                ref SourceIndex,
                ref ActionId,
                ref LocalStatus,
                ref Target,
                ref Message,
                ref RawResponse
            );

            return;
        }


        // --------------------------------------------------------
        // Refresh outputs from consumed action
        // --------------------------------------------------------

        if (
            !string.IsNullOrWhiteSpace(
                consumedActionJson
            )
        )
        {
            lastAction =
                NormalizeAction(
                    ExtractJsonValue(
                        consumedActionJson,
                        "action"
                    )
                );

            lastSession =
                ExtractJsonValue(
                    consumedActionJson,
                    "session"
                );

            lastActionId =
                ExtractJsonValue(
                    consumedActionJson,
                    "action_id"
                );

            lastLocalStatus =
                NormalizeStatus(
                    ExtractJsonValue(
                        consumedActionJson,
                        "local_status"
                    )
                );

            lastTarget =
                ExtractJsonValue(
                    consumedActionJson,
                    "target"
                );

            lastSourceIndex =
                ParseInteger(
                    ExtractJsonValue(
                        consumedActionJson,
                        "source_output_index"
                    ),
                    lastSourceIndex
                );
        }


        // --------------------------------------------------------
        // Emit the one-solution trigger
        // --------------------------------------------------------

        triggerPulse =
            receivedTrigger;

        if (triggerPulse)
        {
            lastState =
                "Action triggered";

            lastMessage =
                string.IsNullOrWhiteSpace(
                    consumeMessage
                )
                ? (
                    "Action '" +
                    lastAction +
                    "' was consumed and triggered."
                )
                : consumeMessage;

            AddRuntimeMessage(
                GH_RuntimeMessageLevel.Remark,
                "Triggered '" +
                lastAction +
                "' for session '" +
                lastSession +
                "'."
            );
        }
        else
        {
            lastState =
                "No trigger";

            lastMessage =
                string.IsNullOrWhiteSpace(
                    consumeMessage
                )
                ? "The action did not produce a trigger."
                : consumeMessage;
        }


        SetOutputs(
            ref Trigger,
            ref Connected,
            ref State,
            ref Action,
            ref Session,
            ref SourceIndex,
            ref ActionId,
            ref LocalStatus,
            ref Target,
            ref Message,
            ref RawResponse
        );
    }


    // ============================================================
    // OUTPUTS
    // ============================================================

    private void SetOutputs(
        ref object Trigger,
        ref object Connected,
        ref object State,
        ref object Action,
        ref object Session,
        ref object SourceIndex,
        ref object ActionId,
        ref object LocalStatus,
        ref object Target,
        ref object Message,
        ref object RawResponse)
    {
        Trigger =
            triggerPulse;

        Connected =
            isConnected;

        State =
            lastState;

        Action =
            lastAction;

        Session =
            lastSession;

        SourceIndex =
            lastSourceIndex >= 0
            ? (object)lastSourceIndex
            : null;

        ActionId =
            lastActionId;

        LocalStatus =
            lastLocalStatus;

        Target =
            lastTarget;

        Message =
            lastMessage;

        RawResponse =
            lastRawResponse;
    }


    private void ClearActionOutputs()
    {
        lastAction = "";
        lastSession = "";
        lastSourceIndex = -1;
        lastActionId = "";
        lastLocalStatus = "";
        lastTarget = "";
    }


    // ============================================================
    // CONNECTION FAILURE
    // ============================================================

    private void HandleConnectionFailure(
        string message)
    {
        isConnected = false;
        triedConnect = true;

        triggerPulse = false;

        lastState =
            "Connection lost";

        lastMessage =
            message;
    }


    // ============================================================
    // NORMALIZATION
    // ============================================================

    private string NormalizeAction(
        string value)
    {
        if (
            string.IsNullOrWhiteSpace(
                value
            )
        )
        {
            return "";
        }

        string normalized =
            value
                .Trim()
                .ToLowerInvariant()
                .Replace(" ", "_")
                .Replace("-", "_");

        while (
            normalized.Contains("__")
        )
        {
            normalized =
                normalized.Replace(
                    "__",
                    "_"
                );
        }

        return normalized.Trim('_');
    }


    private string NormalizeStatus(
        string value)
    {
        return string.IsNullOrWhiteSpace(
            value
        )
            ? ""
            : value
                .Trim()
                .ToLowerInvariant();
    }


    // ============================================================
    // TCP
    // ============================================================

    private string SendCommand(
        string host,
        int port,
        string command)
    {
        const int headerSize = 8;

        try
        {
            using (
                TcpClient client =
                    new TcpClient()
            )
            {
                IAsyncResult result =
                    client.BeginConnect(
                        host,
                        port,
                        null,
                        null
                    );

                bool success =
                    result.AsyncWaitHandle.WaitOne(
                        TimeSpan.FromMilliseconds(
                            300
                        )
                    );

                if (!success)
                {
                    return
                        "ERROR: GH Agent connection timeout.";
                }

                client.EndConnect(
                    result
                );

                client.ReceiveTimeout = 5000;
                client.SendTimeout = 5000;

                using (
                    NetworkStream stream =
                        client.GetStream()
                )
                {
                    byte[] payload =
                        Encoding.UTF8.GetBytes(
                            command
                        );

                    byte[] header =
                        new byte[headerSize];

                    ulong size =
                        (ulong)payload.Length;

                    for (
                        int index = 0;
                        index < headerSize;
                        index++
                    )
                    {
                        header[
                            headerSize - 1 - index
                        ] = (byte)(
                            size & 0xFF
                        );

                        size >>= 8;
                    }

                    stream.Write(
                        header,
                        0,
                        header.Length
                    );

                    stream.Write(
                        payload,
                        0,
                        payload.Length
                    );

                    byte[] responseHeader =
                        ReadExact(
                            stream,
                            headerSize
                        );

                    ulong responseSize = 0;

                    for (
                        int index = 0;
                        index < headerSize;
                        index++
                    )
                    {
                        responseSize =
                            (
                                responseSize << 8
                            ) +
                            responseHeader[index];
                    }

                    if (
                        responseSize >
                        int.MaxValue
                    )
                    {
                        return
                            "ERROR: Agent response is too large.";
                    }

                    byte[] responsePayload =
                        ReadExact(
                            stream,
                            (int)responseSize
                        );

                    return
                        Encoding.UTF8.GetString(
                            responsePayload
                        );
                }
            }
        }
        catch (Exception exception)
        {
            return
                "ERROR: " +
                exception.Message;
        }
    }


    private byte[] ReadExact(
        NetworkStream stream,
        int size)
    {
        byte[] data =
            new byte[size];

        int offset = 0;

        while (offset < size)
        {
            int read =
                stream.Read(
                    data,
                    offset,
                    size - offset
                );

            if (read == 0)
            {
                throw new Exception(
                    "Connection closed."
                );
            }

            offset += read;
        }

        return data;
    }


    // ============================================================
    // JSON HELPERS
    // ============================================================

    private string ExtractJsonValue(
        string json,
        string key)
    {
        if (
            string.IsNullOrWhiteSpace(
                json
            )
        )
        {
            return "";
        }

        string pattern =
            "\"" +
            key +
            "\":";

        int start =
            json.IndexOf(
                pattern,
                StringComparison.Ordinal
            );

        if (start < 0)
        {
            return "";
        }

        start +=
            pattern.Length;

        while (
            start < json.Length &&
            char.IsWhiteSpace(
                json[start]
            )
        )
        {
            start++;
        }

        if (
            start >= json.Length
        )
        {
            return "";
        }

        if (
            json[start] == '"'
        )
        {
            start++;

            StringBuilder value =
                new StringBuilder();

            bool escaped = false;

            for (
                int index = start;
                index < json.Length;
                index++
            )
            {
                char character =
                    json[index];

                if (escaped)
                {
                    switch (character)
                    {
                        case 'n':
                            value.Append('\n');
                            break;

                        case 'r':
                            value.Append('\r');
                            break;

                        case 't':
                            value.Append('\t');
                            break;

                        case '\\':
                            value.Append('\\');
                            break;

                        case '"':
                            value.Append('"');
                            break;

                        default:
                            value.Append(
                                character
                            );
                            break;
                    }

                    escaped = false;
                    continue;
                }

                if (
                    character == '\\'
                )
                {
                    escaped = true;
                    continue;
                }

                if (
                    character == '"'
                )
                {
                    return
                        value.ToString();
                }

                value.Append(
                    character
                );
            }

            return "";
        }

        if (
            json.Substring(
                start
            ).StartsWith(
                "null",
                StringComparison.Ordinal
            )
        )
        {
            return "";
        }

        int end =
            start;

        while (
            end < json.Length &&
            json[end] != ',' &&
            json[end] != '}'
        )
        {
            end++;
        }

        return json
            .Substring(
                start,
                end - start
            )
            .Trim();
    }


    private string ExtractJsonObject(
        string json,
        string key)
    {
        if (
            string.IsNullOrWhiteSpace(
                json
            )
        )
        {
            return "";
        }

        string pattern =
            "\"" +
            key +
            "\":";

        int keyIndex =
            json.IndexOf(
                pattern,
                StringComparison.Ordinal
            );

        if (keyIndex < 0)
        {
            return "";
        }

        int start =
            keyIndex +
            pattern.Length;

        while (
            start < json.Length &&
            char.IsWhiteSpace(
                json[start]
            )
        )
        {
            start++;
        }

        if (
            start >= json.Length ||
            json[start] != '{'
        )
        {
            return "";
        }

        int depth = 0;
        bool insideString = false;
        bool escaped = false;

        for (
            int index = start;
            index < json.Length;
            index++
        )
        {
            char character =
                json[index];

            if (insideString)
            {
                if (escaped)
                {
                    escaped = false;
                }
                else if (
                    character == '\\'
                )
                {
                    escaped = true;
                }
                else if (
                    character == '"'
                )
                {
                    insideString = false;
                }

                continue;
            }

            if (
                character == '"'
            )
            {
                insideString = true;
                continue;
            }

            if (
                character == '{'
            )
            {
                depth++;
            }
            else if (
                character == '}'
            )
            {
                depth--;

                if (
                    depth == 0
                )
                {
                    return json.Substring(
                        start,
                        index - start + 1
                    );
                }
            }
        }

        return "";
    }


    private bool ParseBoolean(
        string value)
    {
        bool parsedBoolean;

        if (
            bool.TryParse(
                value,
                out parsedBoolean
            )
        )
        {
            return parsedBoolean;
        }

        int parsedInteger;

        if (
            int.TryParse(
                value,
                NumberStyles.Integer,
                CultureInfo.InvariantCulture,
                out parsedInteger
            )
        )
        {
            return
                parsedInteger != 0;
        }

        return false;
    }


    private int ParseInteger(
        string value,
        int fallback)
    {
        int parsed;

        if (
            int.TryParse(
                value,
                NumberStyles.Integer,
                CultureInfo.InvariantCulture,
                out parsed
            )
        )
        {
            return parsed;
        }

        double parsedDouble;

        if (
            double.TryParse(
                value,
                NumberStyles.Float,
                CultureInfo.InvariantCulture,
                out parsedDouble
            )
        )
        {
            return
                (int)Math.Round(
                    parsedDouble
                );
        }

        return fallback;
    }
}
# ---------- end c_script ----------
panel = Panel(c_script.State)
panel_2 = Panel(c_script.Session)
panel_3 = Panel(c_script.Message)
panel_4 = Panel(c_script.RawResponse)
panel_5 = Panel(c_script.Trigger)
panel_6 = Panel(c_script.Connected)
panel_7 = Panel(c_script.Action)
panel_8 = Panel(c_script.SourceIndex)
panel_9 = Panel(c_script.ActionId)
panel_10 = Panel(c_script.LocalStatus)
panel_11 = Panel(c_script.Target)

# ---- group: Communication for Motion / Design Data Downloader for Motion
connect_2 = BooleanToggle(False)
download = Button()
output_index = ValueList({"1", "2", "3", "4", "5", "6", "7", "8", "9", "10"}, selected="1")
refresh_status_2 = BooleanToggle(False)
panel_12 = Panel("EOB_test03")
c_script_2 = CSharpScript(
    ConnectButton=connect,
    DownloadButton=c_script.Trigger,
    SessionName=c_script.Session,
    DesignOutputIndex=c_script.SourceIndex,
    AutoPoll=refresh_status)  # -> State, Status, Message, FilePath, DownloadJobId, Progress, DownloadReady; inputs ConnectButton: Boolean, DownloadButton: Boolean, SessionName: String, DesignOutputIndex: Int32, AutoPoll: Boolean
# ---------- c_script_2: C# ----------
// Grasshopper C# Script Instance
#region Usings
using System;
using System.Globalization;
using System.Net.Sockets;
using System.Text;

using Grasshopper;
using Grasshopper.Kernel;
#endregion

public class Script_Instance : GH_ScriptInstance
{
    // ============================================================
    // CONFIGURATION
    // ============================================================

    private const string GhAgentHost =
        "127.0.0.1";

    private const int GhAgentPort =
        6006;

    private const int MessageHeaderSize =
        8;

    private const int PollIntervalMilliseconds =
        500;

    // ============================================================
    // COMPONENT STATE
    // ============================================================

    private bool previousDownloadButton =
        false;

    private bool isConnected =
        false;

    private bool triedConnection =
        false;

    private bool pollScheduled =
        false;

    private bool downloadReadyPulse =
        false;

    private string activeJobId =
        "";

    private string activeSession =
        "";

    private int activeDesignOutputIndex =
        0;

    private string lastState =
        "Idle";

    private string lastStatus =
        "Disconnected";

    private string lastMessage =
        "Enable ConnectButton.";

    private string lastFilePath =
        "";

    private int lastProgress =
        0;

    // ============================================================
    // MAIN
    // ============================================================

    private void RunScript(
		bool ConnectButton,
		bool DownloadButton,
		string SessionName,
		int DesignOutputIndex,
		bool AutoPoll,
		ref object State,
		ref object Status,
		ref object Message,
		ref object FilePath,
		ref object DownloadJobId,
		ref object Progress,
		ref object DownloadReady)
    {
        // DownloadReady is an event pulse.
        // It is false by default for every Grasshopper solution.
        downloadReadyPulse =
            false;

        bool downloadPulse =
            DownloadButton &&
            !previousDownloadButton;

        previousDownloadButton =
            DownloadButton;

        try
        {
            // ----------------------------------------------------
            // Connection disabled
            // ----------------------------------------------------

            if (!ConnectButton)
            {
                isConnected =
                    false;

                triedConnection =
                    false;

                pollScheduled =
                    false;

                lastState =
                    "Idle";

                lastStatus =
                    "Disconnected";

                lastMessage =
                    "Connection toggle is off.";

                SetOutputs(
                    ref State,
                    ref Status,
                    ref Message,
                    ref FilePath,
                    ref DownloadJobId,
                    ref Progress,
                    ref DownloadReady
                );

                return;
            }

            // ----------------------------------------------------
            // Connect to the local GH Agent
            // ----------------------------------------------------

            if (
                !isConnected &&
                !triedConnection
            )
            {
                triedConnection =
                    true;

                string pingResponse =
                    SendCommand(
                        "{\"command\":\"ping\"}"
                    );

                if (
                    pingResponse.StartsWith(
                        "ERROR:",
                        StringComparison.Ordinal
                    )
                )
                {
                    ConnectionFailure(
                        pingResponse
                    );

                    SetOutputs(
                        ref State,
                        ref Status,
                        ref Message,
                        ref FilePath,
                        ref DownloadJobId,
                        ref Progress,
                        ref DownloadReady
                    );

                    return;
                }

                string pingStatus =
                    ExtractJsonValue(
                        pingResponse,
                        "status"
                    );

                if (
                    !string.Equals(
                        pingStatus,
                        "ok",
                        StringComparison.OrdinalIgnoreCase
                    )
                )
                {
                    isConnected =
                        false;

                    lastState =
                        "Connection error";

                    lastStatus =
                        "Connection failed";

                    lastMessage =
                        GetResponseMessage(
                            pingResponse,
                            "GH Agent ping failed."
                        );

                    SetOutputs(
                        ref State,
                        ref Status,
                        ref Message,
                        ref FilePath,
                        ref DownloadJobId,
                        ref Progress,
                        ref DownloadReady
                    );

                    return;
                }

                isConnected =
                    true;

                lastState =
                    "Ready";

                lastStatus =
                    "Connected";

                lastMessage =
                    GetResponseMessage(
                        pingResponse,
                        "Connected to GH Agent."
                    );
            }

            if (!isConnected)
            {
                SetOutputs(
                    ref State,
                    ref Status,
                    ref Message,
                    ref FilePath,
                    ref DownloadJobId,
                    ref Progress,
                    ref DownloadReady
                );

                return;
            }

            // ----------------------------------------------------
            // Submit design download
            // ----------------------------------------------------

            if (downloadPulse)
            {
                SubmitDownload(
                    SessionName,
                    DesignOutputIndex
                );
            }

            // ----------------------------------------------------
            // Poll active download
            // ----------------------------------------------------

            if (
                IsDownloadActive() &&
                AutoPoll
            )
            {
                PollDownloadJob();

                if (IsDownloadActive())
                {
                    ScheduleNextPoll();
                }
            }

            SetOutputs(
                ref State,
                ref Status,
                ref Message,
                ref FilePath,
                ref DownloadJobId,
                ref Progress,
                ref DownloadReady
            );
        }
        catch (Exception exception)
        {
            lastState =
                "Failed";

            lastStatus =
                "Component error";

            lastMessage =
                exception.Message;

            SetOutputs(
                ref State,
                ref Status,
                ref Message,
                ref FilePath,
                ref DownloadJobId,
                ref Progress,
                ref DownloadReady
            );
        }
    }

    // ============================================================
    // DOWNLOAD SUBMISSION
    // ============================================================

    private void SubmitDownload(
        string sessionName,
        int designOutputIndex)
    {
        string session =
            string.IsNullOrWhiteSpace(
                sessionName
            )
            ? ""
            : sessionName.Trim();

        if (
            string.IsNullOrWhiteSpace(
                session
            )
        )
        {
            throw new ArgumentException(
                "SessionName cannot be empty."
            );
        }

        if (designOutputIndex < 1)
        {
            throw new ArgumentException(
                "DesignOutputIndex must be at least 1."
            );
        }

        string payload =
            "{" +
            "\"command\":\"download_design_output\"," +
            "\"session\":\"" +
            EscapeJson(session) +
            "\"," +
            "\"design_output_index\":" +
            designOutputIndex.ToString(
                CultureInfo.InvariantCulture
            ) +
            "," +
            "\"category\":\"ghdata\"" +
            "}";

        lastState =
            "Submitting";

        lastStatus =
            "Submitting download";

        lastMessage =
            "Requesting design output from GH Agent.";

        string response =
            SendCommand(
                payload
            );

        if (
            response.StartsWith(
                "ERROR:",
                StringComparison.Ordinal
            )
        )
        {
            ConnectionFailure(
                response
            );

            return;
        }

        string responseStatus =
            ExtractJsonValue(
                response,
                "status"
            );

        if (
            !string.Equals(
                responseStatus,
                "ok",
                StringComparison.OrdinalIgnoreCase
            )
        )
        {
            lastState =
                "Failed";

            lastStatus =
                "Download submission failed";

            lastMessage =
                GetResponseMessage(
                    response,
                    response
                );

            return;
        }

        string jobId =
            ExtractJsonValue(
                response,
                "job_id"
            );

        if (
            string.IsNullOrWhiteSpace(
                jobId
            )
        )
        {
            lastState =
                "Failed";

            lastStatus =
                "Download submission failed";

            lastMessage =
                "GH Agent returned success without a job ID.";

            return;
        }

        activeJobId =
            jobId;

        activeSession =
            session;

        activeDesignOutputIndex =
            designOutputIndex;

        lastFilePath =
            "";

        lastProgress =
            0;

        lastState =
            "Download queued";

        lastStatus =
            ExtractJsonValue(
                response,
                "latest_status"
            );

        if (
            string.IsNullOrWhiteSpace(
                lastStatus
            )
        )
        {
            lastStatus =
                "download_queued";
        }

        lastMessage =
            GetResponseMessage(
                response,
                "Design download job submitted."
            );

        ScheduleNextPoll();
    }

    // ============================================================
    // JOB POLLING
    // ============================================================

    private void PollDownloadJob()
    {
        if (
            string.IsNullOrWhiteSpace(
                activeJobId
            )
        )
        {
            return;
        }

        string payload =
            "{" +
            "\"command\":\"get_job_status\"," +
            "\"job_id\":\"" +
            EscapeJson(activeJobId) +
            "\"" +
            "}";

        string response =
            SendCommand(
                payload
            );

        if (
            response.StartsWith(
                "ERROR:",
                StringComparison.Ordinal
            )
        )
        {
            ConnectionFailure(
                response
            );

            return;
        }

        string outerStatus =
            ExtractJsonValue(
                response,
                "status"
            );

        if (
            !string.Equals(
                outerStatus,
                "ok",
                StringComparison.OrdinalIgnoreCase
            )
        )
        {
            lastState =
                "Polling error";

            lastStatus =
                "Download status request failed";

            lastMessage =
                GetResponseMessage(
                    response,
                    response
                );

            return;
        }

        string jobJson =
            ExtractJsonObject(
                response,
                "job"
            );

        if (
            string.IsNullOrWhiteSpace(
                jobJson
            )
        )
        {
            lastState =
                "Polling error";

            lastStatus =
                "Download status unavailable";

            lastMessage =
                "GH Agent response did not contain a job object.";

            return;
        }

        string jobStatus =
            NormalizeStatus(
                ExtractJsonValue(
                    jobJson,
                    "status"
                )
            );

        string jobMessage =
            ExtractJsonValue(
                jobJson,
                "message"
            );

        string jobError =
            ExtractJsonValue(
                jobJson,
                "error"
            );

        lastProgress =
            ParseInteger(
                ExtractJsonValue(
                    jobJson,
                    "progress"
                ),
                lastProgress
            );

        if (
            !string.IsNullOrWhiteSpace(
                jobMessage
            )
        )
        {
            lastMessage =
                jobMessage;
        }

        lastStatus =
            string.IsNullOrWhiteSpace(
                jobStatus
            )
            ? "unknown"
            : jobStatus;

        if (
            jobStatus == "download_queued" ||
            jobStatus == "queued"
        )
        {
            lastState =
                "Download queued";

            return;
        }

        if (
            jobStatus == "download_running" ||
            jobStatus == "running"
        )
        {
            lastState =
                "Downloading";

            return;
        }

        if (
            jobStatus == "download_finished" ||
            jobStatus == "finished"
        )
        {
            lastState =
                "Finished";

            lastStatus =
                "download_finished";

            lastProgress =
                100;

            string resultJson =
                ExtractJsonObject(
                    jobJson,
                    "result"
                );

            lastFilePath =
                ExtractJsonValue(
                    resultJson,
                    "file_path"
                );

            if (
                string.IsNullOrWhiteSpace(
                    lastFilePath
                )
            )
            {
                /*
                 * Compatibility fallback in case file_path
                 * is nested inside the local file record.
                 */
                string fileJson =
                    ExtractJsonObject(
                        resultJson,
                        "file"
                    );

                lastFilePath =
                    ExtractJsonValue(
                        fileJson,
                        "local_path"
                    );
            }

            if (
                string.IsNullOrWhiteSpace(
                    lastFilePath
                )
            )
            {
                lastState =
                    "Finished with error";

                lastStatus =
                    "download_result_invalid";

                lastMessage =
                    "Download finished, but the result did not " +
                    "contain file_path or file.local_path.";

                return;
            }

            // A newly completed download with a valid path
            // emits one event pulse. It does not depend on whether
            // this path is identical to a previous download path.
            downloadReadyPulse =
                true;

            if (
                string.IsNullOrWhiteSpace(
                    lastMessage
                )
            )
            {
                lastMessage =
                    "Design output downloaded successfully.";
            }

            return;
        }

        if (
            jobStatus == "download_failed" ||
            jobStatus == "failed" ||
            jobStatus == "error"
        )
        {
            lastState =
                "Failed";

            lastStatus =
                "download_failed";

            lastProgress =
                100;

            if (
                !string.IsNullOrWhiteSpace(
                    jobError
                )
            )
            {
                lastMessage =
                    jobError;
            }
            else if (
                string.IsNullOrWhiteSpace(
                    lastMessage
                )
            )
            {
                lastMessage =
                    "Design output download failed.";
            }

            return;
        }

        if (jobStatus == "cancelled")
        {
            lastState =
                "Cancelled";

            lastStatus =
                "cancelled";

            lastProgress =
                100;

            if (
                string.IsNullOrWhiteSpace(
                    lastMessage
                )
            )
            {
                lastMessage =
                    "Design output download was cancelled.";
            }

            return;
        }

        lastState =
            "Download status unknown";
    }

    private bool IsDownloadActive()
    {
        string normalized =
            NormalizeStatus(
                lastStatus
            );

        return
            !string.IsNullOrWhiteSpace(
                activeJobId
            ) &&
            normalized != "download_finished" &&
            normalized != "finished" &&
            normalized != "download_failed" &&
            normalized != "failed" &&
            normalized != "error" &&
            normalized != "cancelled" &&
            normalized != "download_result_invalid";
    }

    // ============================================================
    // AUTOMATIC POLLING
    // ============================================================

    private void ScheduleNextPoll()
    {
        if (pollScheduled)
            return;

        GH_Document document =
            Component.OnPingDocument();

        if (document == null)
            return;

        pollScheduled =
            true;

        document.ScheduleSolution(
            PollIntervalMilliseconds,
            scheduledDocument =>
            {
                pollScheduled =
                    false;

                if (Component != null)
                {
                    Component.ExpireSolution(
                        false
                    );
                }
            }
        );
    }

    // ============================================================
    // CONNECTION
    // ============================================================

    private void ConnectionFailure(
        string message)
    {
        isConnected =
            false;

        triedConnection =
            true;

        lastState =
            "Connection error";

        lastStatus =
            "connection_failed";

        lastMessage =
            message;
    }

    private string SendCommand(
        string command)
    {
        try
        {
            using (
                TcpClient client =
                    new TcpClient()
            )
            {
                IAsyncResult connection =
                    client.BeginConnect(
                        GhAgentHost,
                        GhAgentPort,
                        null,
                        null
                    );

                bool connected =
                    connection.AsyncWaitHandle.WaitOne(
                        TimeSpan.FromMilliseconds(
                            500
                        )
                    );

                if (!connected)
                {
                    return
                        "ERROR: GH Agent connection timeout.";
                }

                client.EndConnect(
                    connection
                );

                using (
                    NetworkStream stream =
                        client.GetStream()
                )
                {
                    byte[] payload =
                        Encoding.UTF8.GetBytes(
                            command
                        );

                    byte[] header =
                        BuildHeader(
                            payload.Length
                        );

                    stream.Write(
                        header,
                        0,
                        header.Length
                    );

                    stream.Write(
                        payload,
                        0,
                        payload.Length
                    );

                    byte[] responseHeader =
                        ReadExact(
                            stream,
                            MessageHeaderSize
                        );

                    ulong responseSize =
                        ParseHeader(
                            responseHeader
                        );

                    if (
                        responseSize >
                        int.MaxValue
                    )
                    {
                        return
                            "ERROR: GH Agent response is too large.";
                    }

                    byte[] responsePayload =
                        ReadExact(
                            stream,
                            (int)responseSize
                        );

                    return
                        Encoding.UTF8.GetString(
                            responsePayload
                        );
                }
            }
        }
        catch (Exception exception)
        {
            return
                "ERROR: " +
                exception.Message;
        }
    }

    private byte[] BuildHeader(
        int payloadSize)
    {
        byte[] header =
            new byte[
                MessageHeaderSize
            ];

        ulong size =
            (ulong)payloadSize;

        for (
            int index = 0;
            index < MessageHeaderSize;
            index++
        )
        {
            header[
                MessageHeaderSize -
                1 -
                index
            ] =
                (byte)(
                    size &
                    0xFF
                );

            size >>=
                8;
        }

        return header;
    }

    private ulong ParseHeader(
        byte[] header)
    {
        ulong size =
            0;

        for (
            int index = 0;
            index < header.Length;
            index++
        )
        {
            size =
                (
                    size <<
                    8
                ) +
                header[index];
        }

        return size;
    }

    private byte[] ReadExact(
        NetworkStream stream,
        int size)
    {
        byte[] data =
            new byte[size];

        int offset =
            0;

        while (offset < size)
        {
            int read =
                stream.Read(
                    data,
                    offset,
                    size - offset
                );

            if (read == 0)
            {
                throw new InvalidOperationException(
                    "Connection closed before the response " +
                    "was complete."
                );
            }

            offset +=
                read;
        }

        return data;
    }

    // ============================================================
    // JSON HELPERS
    // ============================================================

    private string GetResponseMessage(
        string json,
        string fallback)
    {
        string message =
            ExtractJsonValue(
                json,
                "message"
            );

        return
            string.IsNullOrWhiteSpace(
                message
            )
            ? fallback
            : message;
    }

    private string NormalizeStatus(
        string value)
    {
        return
            string.IsNullOrWhiteSpace(
                value
            )
            ? ""
            : value
                .Trim()
                .ToLowerInvariant();
    }

    private int ParseInteger(
        string value,
        int fallback)
    {
        int integerValue;

        if (
            int.TryParse(
                value,
                NumberStyles.Integer,
                CultureInfo.InvariantCulture,
                out integerValue
            )
        )
        {
            return integerValue;
        }

        double doubleValue;

        if (
            double.TryParse(
                value,
                NumberStyles.Float,
                CultureInfo.InvariantCulture,
                out doubleValue
            )
        )
        {
            return
                (int)Math.Round(
                    doubleValue
                );
        }

        return fallback;
    }

    private string EscapeJson(
        string value)
    {
        if (value == null)
            return "";

        return value
            .Replace(
                "\\",
                "\\\\"
            )
            .Replace(
                "\"",
                "\\\""
            )
            .Replace(
                "\r",
                "\\r"
            )
            .Replace(
                "\n",
                "\\n"
            )
            .Replace(
                "\t",
                "\\t"
            );
    }

    private string ExtractJsonValue(
        string json,
        string key)
    {
        if (
            string.IsNullOrWhiteSpace(
                json
            )
        )
        {
            return "";
        }

        string pattern =
            "\"" +
            key +
            "\":";

        int start =
            json.IndexOf(
                pattern,
                StringComparison.Ordinal
            );

        if (start < 0)
            return "";

        start +=
            pattern.Length;

        while (
            start < json.Length &&
            char.IsWhiteSpace(
                json[start]
            )
        )
        {
            start++;
        }

        if (start >= json.Length)
            return "";

        if (json[start] == '"')
        {
            start++;

            StringBuilder value =
                new StringBuilder();

            bool escaped =
                false;

            for (
                int index = start;
                index < json.Length;
                index++
            )
            {
                char character =
                    json[index];

                if (escaped)
                {
                    switch (character)
                    {
                        case 'n':
                            value.Append('\n');
                            break;

                        case 'r':
                            value.Append('\r');
                            break;

                        case 't':
                            value.Append('\t');
                            break;

                        case '\\':
                            value.Append('\\');
                            break;

                        case '"':
                            value.Append('"');
                            break;

                        default:
                            value.Append(
                                character
                            );
                            break;
                    }

                    escaped =
                        false;

                    continue;
                }

                if (character == '\\')
                {
                    escaped =
                        true;

                    continue;
                }

                if (character == '"')
                {
                    return
                        value.ToString();
                }

                value.Append(
                    character
                );
            }

            return "";
        }

        if (
            json.Substring(start)
                .StartsWith(
                    "null",
                    StringComparison.Ordinal
                )
        )
        {
            return "";
        }

        int end =
            start;

        while (
            end < json.Length &&
            json[end] != ',' &&
            json[end] != '}'
        )
        {
            end++;
        }

        return
            json
                .Substring(
                    start,
                    end - start
                )
                .Trim();
    }

    private string ExtractJsonObject(
        string json,
        string key)
    {
        if (
            string.IsNullOrWhiteSpace(
                json
            )
        )
        {
            return "";
        }

        string pattern =
            "\"" +
            key +
            "\":";

        int keyIndex =
            json.IndexOf(
                pattern,
                StringComparison.Ordinal
            );

        if (keyIndex < 0)
            return "";

        int start =
            keyIndex +
            pattern.Length;

        while (
            start < json.Length &&
            char.IsWhiteSpace(
                json[start]
            )
        )
        {
            start++;
        }

        if (
            start >= json.Length ||
            json[start] != '{'
        )
        {
            return "";
        }

        int depth =
            0;

        bool insideString =
            false;

        bool escaped =
            false;

        for (
            int index = start;
            index < json.Length;
            index++
        )
        {
            char character =
                json[index];

            if (insideString)
            {
                if (escaped)
                {
                    escaped =
                        false;
                }
                else if (character == '\\')
                {
                    escaped =
                        true;
                }
                else if (character == '"')
                {
                    insideString =
                        false;
                }

                continue;
            }

            if (character == '"')
            {
                insideString =
                    true;

                continue;
            }

            if (character == '{')
            {
                depth++;
            }
            else if (character == '}')
            {
                depth--;

                if (depth == 0)
                {
                    return
                        json.Substring(
                            start,
                            index - start + 1
                        );
                }
            }
        }

        return "";
    }

    // ============================================================
    // OUTPUTS
    // ============================================================

    private void SetOutputs(
        ref object State,
        ref object Status,
        ref object Message,
        ref object FilePath,
        ref object DownloadJobId,
        ref object Progress,
        ref object DownloadReady)
    {
        State =
            lastState;

        Status =
            lastStatus;

        Message =
            lastMessage;

        FilePath =
            lastFilePath;

        DownloadJobId =
            activeJobId;

        Progress =
            lastProgress;

        DownloadReady =
            downloadReadyPulse;
    }
}
# ---------- end c_script_2 ----------
panel_13 = Panel(c_script_2.State)
panel_14 = Panel(c_script_2.Status)
panel_15 = Panel(c_script_2.Message)
panel_16 = Panel(c_script_2.DownloadJobId)
panel_17 = Panel(c_script_2.Progress)
panel_18 = Panel(c_script_2.DownloadReady)
panel_19 = Panel(c_script_2.FilePath)

# ---- group: Communication for Motion / Design Data Reader for Motion
read = Button()
c_script_3 = CSharpScript(FilePath=c_script_2.FilePath, Read=c_script_2.DownloadReady)  # -> Metadata, Keys, InputSummary, Data, Status; inputs FilePath: String, Read: Boolean
# ---------- c_script_3: C# ----------
// Grasshopper C# Script Instance
#region Usings
using System;
using System.Collections.Generic;
using System.Globalization;
using System.IO;
using System.Reflection;

using GH_IO.Serialization;

using Grasshopper;
using Grasshopper.Kernel;
using Grasshopper.Kernel.Data;
using Grasshopper.Kernel.Types;
#endregion

public class Script_Instance : GH_ScriptInstance
{
    // ============================================================
    // COMPONENT STATE
    // ============================================================

    private bool previousRead = false;

    private List<string> lastMetadata =
        new List<string>();

    private List<string> lastKeys =
        new List<string>();

    private List<string> lastInputSummary =
        new List<string>();

    private GH_Structure<IGH_Goo> lastCombinedTree =
        new GH_Structure<IGH_Goo>();

    private string lastStatus = "Ready.";

    // ============================================================
    // MAIN
    // ============================================================

    private void RunScript(
		string FilePath,
		bool Read,
		ref object Metadata,
		ref object Keys,
		ref object InputSummary,
		ref object Data,
		ref object Status)
    {
        bool readPulse =
            Read &&
            !previousRead;

        previousRead = Read;

        try
        {
            if (readPulse)
            {
                ReadManagedArchive(
                    FilePath
                );
            }

            SetOutputs(
                ref Metadata,
                ref Keys,
                ref InputSummary,
                ref Data,
                ref Status
            );
        }
        catch (Exception exception)
        {
            lastStatus =
                "Managed Data Input failed: " +
                exception.Message;

            SetOutputs(
                ref Metadata,
                ref Keys,
                ref InputSummary,
                ref Data,
                ref Status
            );
        }
    }

    // ============================================================
    // ARCHIVE READING
    // ============================================================

    private void ReadManagedArchive(
        string filePath)
    {
        string validatedPath =
            ValidateFilePath(
                filePath
            );

        byte[] archiveBytes =
            File.ReadAllBytes(
                validatedPath
            );

        if (
            archiveBytes == null ||
            archiveBytes.Length == 0)
        {
            throw new IOException(
                "The selected file is empty."
            );
        }

        GH_Archive archive =
            new GH_Archive();

        bool deserialized =
            archive.Deserialize_Binary(
                archiveBytes
            );

        if (!deserialized)
        {
            throw new InvalidDataException(
                "The file could not be deserialized as a " +
                "Grasshopper binary archive."
            );
        }

        GH_IReader archiveRoot =
            archive.GetRootNode;

        if (archiveRoot == null)
        {
            throw new InvalidDataException(
                "The archive does not contain a root node."
            );
        }

        GH_IReader managedRoot =
            archiveRoot.FindChunk(
                "DECO2_Managed_Data"
            );

        if (managedRoot == null)
        {
            throw new InvalidDataException(
                "The archive does not contain the expected " +
                "DECO2_Managed_Data chunk."
            );
        }

        ValidateArchiveFormat(
            managedRoot
        );

        int inputCount =
            managedRoot.GetInt32(
                "InputCount"
            );

        GH_Structure<IGH_Goo> combinedTree =
            new GH_Structure<IGH_Goo>();

        List<string> keys =
            new List<string>();

        List<string> summaries =
            new List<string>();

        int totalReconstructedItems = 0;
        int totalReconstructedBranches = 0;

        for (
            int inputIndex = 0;
            inputIndex < inputCount;
            inputIndex++)
        {
            GH_IReader inputChunk =
                managedRoot.FindChunk(
                    "Input",
                    inputIndex
                );

            string fallbackKey =
                GetAlphabeticName(
                    inputIndex
                );

            if (inputChunk == null)
            {
                keys.Add(fallbackKey);

                summaries.Add(
                    fallbackKey +
                    " : Missing input chunk"
                );

                continue;
            }

            string key =
                GetStringOrDefault(
                    inputChunk,
                    "Key",
                    fallbackKey
                );

            keys.Add(key);

            InputReadResult result =
                ReadInputIntoCombinedTree(
                    inputChunk,
                    inputIndex,
                    combinedTree
                );

            totalReconstructedItems +=
                result.ItemCount;

            totalReconstructedBranches +=
                result.BranchCount;

            summaries.Add(
                BuildInputSummary(
                    inputChunk,
                    inputIndex,
                    result
                )
            );
        }

        lastCombinedTree =
            combinedTree;

        lastKeys =
            keys;

        lastInputSummary =
            summaries;

        lastMetadata =
            BuildMetadata(
                validatedPath,
                managedRoot,
                inputCount
            );

        lastStatus =
            "Archive loaded successfully. " +
            inputCount.ToString(
                CultureInfo.InvariantCulture
            ) +
            " input(s), " +
            totalReconstructedBranches.ToString(
                CultureInfo.InvariantCulture
            ) +
            " branch(es), and " +
            totalReconstructedItems.ToString(
                CultureInfo.InvariantCulture
            ) +
            " item(s) reconstructed.";
    }

    // ============================================================
    // COMBINED TREE RECONSTRUCTION
    // ============================================================

    private InputReadResult ReadInputIntoCombinedTree(
        GH_IReader inputChunk,
        int inputIndex,
        GH_Structure<IGH_Goo> combinedTree)
    {
        InputReadResult result =
            new InputReadResult();

        int expectedPathCount =
            GetInt32OrDefault(
                inputChunk,
                "PathCount",
                0
            );

        for (
            int branchIndex = 0;
            branchIndex < expectedPathCount;
            branchIndex++)
        {
            GH_IReader branchChunk =
                inputChunk.FindChunk(
                    "Branch",
                    branchIndex
                );

            if (branchChunk == null)
            {
                throw new InvalidDataException(
                    "Input " +
                    GetAlphabeticName(inputIndex) +
                    " is missing branch chunk " +
                    branchIndex.ToString(
                        CultureInfo.InvariantCulture
                    ) +
                    "."
                );
            }

            GH_Path originalPath =
                ReadPath(
                    branchChunk,
                    inputIndex,
                    branchIndex
                );

            GH_Path combinedPath =
                PrefixPath(
                    inputIndex,
                    originalPath
                );

            /*
             * Preserve empty branches.
             */
            combinedTree.EnsurePath(
                combinedPath
            );

            result.BranchCount++;

            int itemCount =
                GetInt32OrDefault(
                    branchChunk,
                    "ItemCount",
                    0
                );

            for (
                int itemIndex = 0;
                itemIndex < itemCount;
                itemIndex++)
            {
                GH_IReader itemChunk =
                    branchChunk.FindChunk(
                        "Item",
                        itemIndex
                    );

                if (itemChunk == null)
                {
                    throw new InvalidDataException(
                        "Input " +
                        GetAlphabeticName(inputIndex) +
                        ", branch " +
                        branchIndex.ToString(
                            CultureInfo.InvariantCulture
                        ) +
                        " is missing item chunk " +
                        itemIndex.ToString(
                            CultureInfo.InvariantCulture
                        ) +
                        "."
                    );
                }

                bool isNull =
                    GetBooleanOrDefault(
                        itemChunk,
                        "IsNull",
                        false
                    );

                if (isNull)
                {
                    combinedTree.Append(
                        null,
                        combinedPath
                    );

                    result.ItemCount++;
                    continue;
                }

                IGH_Goo goo =
                    ReadGoo(
                        itemChunk,
                        inputIndex,
                        branchIndex,
                        itemIndex
                    );

                combinedTree.Append(
                    goo,
                    combinedPath
                );

                result.ItemCount++;
            }
        }

        return result;
    }

    private GH_Path PrefixPath(
        int inputIndex,
        GH_Path originalPath)
    {
        int originalLength =
            originalPath == null
            ? 0
            : originalPath.Length;

        int[] combinedIndices =
            new int[
                originalLength + 1
            ];

        combinedIndices[0] =
            inputIndex;

        if (originalPath != null)
        {
            for (
                int index = 0;
                index < originalLength;
                index++)
            {
                combinedIndices[
                    index + 1
                ] = originalPath[index];
            }
        }

        return new GH_Path(
            combinedIndices
        );
    }

    private GH_Path ReadPath(
        GH_IReader branchChunk,
        int inputIndex,
        int branchIndex)
    {
        GH_IReader pathChunk =
            branchChunk.FindChunk(
                "Path"
            );

        if (pathChunk == null)
        {
            throw new InvalidDataException(
                "Input " +
                GetAlphabeticName(inputIndex) +
                ", branch " +
                branchIndex.ToString(
                    CultureInfo.InvariantCulture
                ) +
                " is missing its Path chunk."
            );
        }

        GH_Path path =
            new GH_Path();

        bool pathRead =
            path.Read(
                pathChunk
            );

        if (!pathRead)
        {
            throw new InvalidDataException(
                "Could not reconstruct the path for input " +
                GetAlphabeticName(inputIndex) +
                ", branch " +
                branchIndex.ToString(
                    CultureInfo.InvariantCulture
                ) +
                "."
            );
        }

        return path;
    }

    // ============================================================
    // GOO RECONSTRUCTION
    // ============================================================

    private IGH_Goo ReadGoo(
        GH_IReader itemChunk,
        int inputIndex,
        int branchIndex,
        int itemIndex)
    {
        string runtimeTypeName =
            GetStringOrDefault(
                itemChunk,
                "RuntimeType",
                ""
            );

        if (string.IsNullOrWhiteSpace(
            runtimeTypeName))
        {
            throw new InvalidDataException(
                BuildItemLocation(
                    inputIndex,
                    branchIndex,
                    itemIndex
                ) +
                " has no RuntimeType."
            );
        }

        Type runtimeType =
            ResolveRuntimeType(
                runtimeTypeName
            );

        if (runtimeType == null)
        {
            throw new TypeLoadException(
                BuildItemLocation(
                    inputIndex,
                    branchIndex,
                    itemIndex
                ) +
                " uses an unavailable type: " +
                runtimeTypeName
            );
        }

        if (
            !typeof(IGH_Goo).IsAssignableFrom(
                runtimeType
            ))
        {
            throw new InvalidDataException(
                BuildItemLocation(
                    inputIndex,
                    branchIndex,
                    itemIndex
                ) +
                " does not implement IGH_Goo: " +
                runtimeType.FullName
            );
        }

        object instance;

        try
        {
            instance =
                Activator.CreateInstance(
                    runtimeType
                );
        }
        catch (Exception exception)
        {
            throw new InvalidOperationException(
                BuildItemLocation(
                    inputIndex,
                    branchIndex,
                    itemIndex
                ) +
                " could not create type " +
                runtimeType.FullName +
                ". A public parameterless constructor is required.",
                exception
            );
        }

        IGH_Goo goo =
            instance as IGH_Goo;

        if (goo == null)
        {
            throw new InvalidOperationException(
                BuildItemLocation(
                    inputIndex,
                    branchIndex,
                    itemIndex
                ) +
                " could not be converted to IGH_Goo."
            );
        }

        GH_IReader gooChunk =
            itemChunk.FindChunk(
                "Goo"
            );

        if (gooChunk == null)
        {
            throw new InvalidDataException(
                BuildItemLocation(
                    inputIndex,
                    branchIndex,
                    itemIndex
                ) +
                " is missing its Goo chunk."
            );
        }

        bool gooRead =
            goo.Read(
                gooChunk
            );

        if (!gooRead)
        {
            throw new InvalidDataException(
                BuildItemLocation(
                    inputIndex,
                    branchIndex,
                    itemIndex
                ) +
                " could not deserialize type " +
                runtimeType.FullName +
                "."
            );
        }

        return goo;
    }

    private Type ResolveRuntimeType(
        string assemblyQualifiedName)
    {
        Type resolvedType =
            Type.GetType(
                assemblyQualifiedName,
                false
            );

        if (resolvedType != null)
        {
            return resolvedType;
        }

        /*
         * Fallback when assembly versions differ but the same full
         * runtime type exists in a loaded assembly.
         */
        string fullTypeName =
            assemblyQualifiedName
                .Split(',')[0]
                .Trim();

        foreach (
            Assembly assembly
            in AppDomain.CurrentDomain
                .GetAssemblies())
        {
            try
            {
                resolvedType =
                    assembly.GetType(
                        fullTypeName,
                        false
                    );

                if (resolvedType != null)
                {
                    return resolvedType;
                }
            }
            catch
            {
                /*
                 * Ignore assemblies that cannot expose the type.
                 */
            }
        }

        return null;
    }

    private string BuildItemLocation(
        int inputIndex,
        int branchIndex,
        int itemIndex)
    {
        return
            "Input " +
            GetAlphabeticName(inputIndex) +
            ", branch " +
            branchIndex.ToString(
                CultureInfo.InvariantCulture
            ) +
            ", item " +
            itemIndex.ToString(
                CultureInfo.InvariantCulture
            );
    }

    // ============================================================
    // METADATA AND SUMMARIES
    // ============================================================

    private List<string> BuildMetadata(
        string validatedPath,
        GH_IReader managedRoot,
        int inputCount)
    {
        List<string> metadata =
            new List<string>();

        metadata.Add(
            "File: " +
            validatedPath
        );

        metadata.Add(
            "Format: " +
            GetStringOrDefault(
                managedRoot,
                "Format",
                "Unknown"
            )
        );

        metadata.Add(
            "Format Version: " +
            GetInt32OrDefault(
                managedRoot,
                "FormatVersion",
                0
            ).ToString(
                CultureInfo.InvariantCulture
            )
        );

        metadata.Add(
            "Created At: " +
            GetStringOrDefault(
                managedRoot,
                "CreatedAt",
                ""
            )
        );

        metadata.Add(
            "Session: " +
            GetStringOrDefault(
                managedRoot,
                "Session",
                ""
            )
        );

        metadata.Add(
            "Domain: " +
            GetStringOrDefault(
                managedRoot,
                "Domain",
                ""
            )
        );

        metadata.Add(
            "Output Index: " +
            GetInt32OrDefault(
                managedRoot,
                "OutputIndex",
                0
            ).ToString(
                CultureInfo.InvariantCulture
            )
        );

        metadata.Add(
            "Stored Inputs: " +
            inputCount.ToString(
                CultureInfo.InvariantCulture
            )
        );

        metadata.Add(
            "Combined path format: " +
            "{input_index; original_path...}"
        );

        return metadata;
    }

    private string BuildInputSummary(
        GH_IReader inputChunk,
        int inputIndex,
        InputReadResult result)
    {
        string key =
            GetStringOrDefault(
                inputChunk,
                "Key",
                GetAlphabeticName(inputIndex)
            );

        string typeName =
            GetStringOrDefault(
                inputChunk,
                "TypeName",
                "Unknown"
            );

        string structureName =
            GetStringOrDefault(
                inputChunk,
                "StructureName",
                "Unknown"
            );

        return
            inputIndex.ToString(
                CultureInfo.InvariantCulture
            ) +
            " → " +
            key +
            " : " +
            typeName +
            " | " +
            structureName +
            " | Reconstructed items: " +
            result.ItemCount.ToString(
                CultureInfo.InvariantCulture
            ) +
            " | Branches: " +
            result.BranchCount.ToString(
                CultureInfo.InvariantCulture
            );
    }

    // ============================================================
    // FORMAT VALIDATION
    // ============================================================

    private void ValidateArchiveFormat(
        GH_IReader managedRoot)
    {
        string format =
            GetStringOrDefault(
                managedRoot,
                "Format",
                ""
            );

        if (
            !string.Equals(
                format,
                "DECO2_MANAGED_GHDATA",
                StringComparison.Ordinal
            ))
        {
            throw new InvalidDataException(
                "Unsupported archive format: " +
                format
            );
        }

        int formatVersion =
            GetInt32OrDefault(
                managedRoot,
                "FormatVersion",
                0
            );

        if (formatVersion != 1)
        {
            throw new InvalidDataException(
                "Unsupported archive format version: " +
                formatVersion.ToString(
                    CultureInfo.InvariantCulture
                )
            );
        }

        if (
            !managedRoot.ItemExists(
                "InputCount"
            ))
        {
            throw new InvalidDataException(
                "The archive is missing its InputCount field."
            );
        }
    }

    // ============================================================
    // FILE VALIDATION
    // ============================================================

    private string ValidateFilePath(
        string filePath)
    {
        if (string.IsNullOrWhiteSpace(
            filePath))
        {
            throw new ArgumentException(
                "FilePath cannot be empty."
            );
        }

        string resolvedPath =
            Path.GetFullPath(
                filePath.Trim()
            );

        if (!File.Exists(resolvedPath))
        {
            throw new FileNotFoundException(
                "The .ghdata file does not exist.",
                resolvedPath
            );
        }

        string extension =
            Path.GetExtension(
                resolvedPath
            );

        if (
            !string.Equals(
                extension,
                ".ghdata",
                StringComparison.OrdinalIgnoreCase
            ))
        {
            throw new ArgumentException(
                "The selected file must use the .ghdata extension."
            );
        }

        return resolvedPath;
    }

    // ============================================================
    // SAFE READER HELPERS
    // ============================================================

    private string GetStringOrDefault(
        GH_IReader reader,
        string itemName,
        string fallback)
    {
        if (
            reader == null ||
            !reader.ItemExists(itemName))
        {
            return fallback;
        }

        return reader.GetString(
            itemName
        );
    }

    private int GetInt32OrDefault(
        GH_IReader reader,
        string itemName,
        int fallback)
    {
        if (
            reader == null ||
            !reader.ItemExists(itemName))
        {
            return fallback;
        }

        return reader.GetInt32(
            itemName
        );
    }

    private bool GetBooleanOrDefault(
        GH_IReader reader,
        string itemName,
        bool fallback)
    {
        if (
            reader == null ||
            !reader.ItemExists(itemName))
        {
            return fallback;
        }

        return reader.GetBoolean(
            itemName
        );
    }

    // ============================================================
    // GENERAL HELPERS
    // ============================================================

    private string GetAlphabeticName(
        int zeroBasedIndex)
    {
        int value =
            zeroBasedIndex;

        string result =
            "";

        do
        {
            result =
                (char)(
                    'A' +
                    value % 26
                ) +
                result;

            value =
                value / 26 -
                1;
        }
        while (value >= 0);

        return result;
    }

    // ============================================================
    // OUTPUTS
    // ============================================================

    private void SetOutputs(
        ref object Metadata,
        ref object Keys,
        ref object InputSummary,
        ref object Data,
        ref object Status)
    {
        Metadata =
            lastMetadata;

        Keys =
            lastKeys;

        InputSummary =
            lastInputSummary;

        Data =
            lastCombinedTree;

        Status =
            lastStatus;
    }

    private class InputReadResult
    {
        public int BranchCount;
        public int ItemCount;
    }
}
# ---------- end c_script_3 ----------
panel_20 = Panel(c_script_3.Metadata)
panel_21 = Panel(c_script_3.Keys)
panel_22 = Panel(c_script_3.InputSummary)
panel_23 = Panel(c_script_3.Status)
data = Data(c_script_3.Data)
panel_24 = Panel(data)
c_script_4 = CSharpScript(Data=data)  # -> A, B, C, D, E, Status; inputs Data: tree
# ---------- c_script_4: C# ----------
// Grasshopper C# Script Instance
#region Usings
using System;
using System.Collections;
using System.Collections.Generic;

using Grasshopper;
using Grasshopper.Kernel;
using Grasshopper.Kernel.Data;
using Grasshopper.Kernel.Types;
#endregion

public class Script_Instance : GH_ScriptInstance
{
    private void RunScript(
		DataTree<object> Data,
		ref object A,
		ref object B,
		ref object C,
		ref object D,
		ref object E,
		ref object Status)
    {
        GH_Structure<IGH_Goo> treeA =
            new GH_Structure<IGH_Goo>();

        GH_Structure<IGH_Goo> treeB =
            new GH_Structure<IGH_Goo>();

        GH_Structure<IGH_Goo> treeC =
            new GH_Structure<IGH_Goo>();

        GH_Structure<IGH_Goo> treeD =
            new GH_Structure<IGH_Goo>();

        GH_Structure<IGH_Goo> treeE =
            new GH_Structure<IGH_Goo>();

        try
        {
            IGH_Structure sourceTree =
                GetInputTree();

            if (sourceTree == null)
            {
                Status =
                    "No input data tree was provided.";

                SetOutputs(
                    treeA,
                    treeB,
                    treeC,
                    treeD,
                    treeE,
                    ref A,
                    ref B,
                    ref C,
                    ref D,
                    ref E
                );

                return;
            }

            int mappedBranchCount = 0;
            int mappedItemCount = 0;
            int ignoredBranchCount = 0;

            for (
                int branchIndex = 0;
                branchIndex < sourceTree.PathCount;
                branchIndex++)
            {
                GH_Path combinedPath =
                    sourceTree.get_Path(
                        branchIndex
                    );

                if (
                    combinedPath == null ||
                    combinedPath.Length == 0)
                {
                    ignoredBranchCount++;
                    continue;
                }

                int outputIndex =
                    combinedPath[0];

                GH_Structure<IGH_Goo> targetTree =
                    GetTargetTree(
                        outputIndex,
                        treeA,
                        treeB,
                        treeC,
                        treeD,
                        treeE
                    );

                if (targetTree == null)
                {
                    ignoredBranchCount++;
                    continue;
                }

                GH_Path restoredPath =
                    RemoveFirstPathIndex(
                        combinedPath
                    );

                /*
                 * Keep empty branches from the source tree.
                 */
                targetTree.EnsurePath(
                    restoredPath
                );

                IList branch =
                    sourceTree.get_Branch(
                        branchIndex
                    );

                if (branch != null)
                {
                    for (
                        int itemIndex = 0;
                        itemIndex < branch.Count;
                        itemIndex++)
                    {
                        IGH_Goo goo =
                            branch[itemIndex]
                            as IGH_Goo;

                        targetTree.Append(
                            goo,
                            restoredPath
                        );

                        mappedItemCount++;
                    }
                }

                mappedBranchCount++;
            }

            SetOutputs(
                treeA,
                treeB,
                treeC,
                treeD,
                treeE,
                ref A,
                ref B,
                ref C,
                ref D,
                ref E
            );

            Status =
                "Remapped " +
                mappedBranchCount +
                " branch(es) and " +
                mappedItemCount +
                " item(s) into outputs A–E.";

            if (ignoredBranchCount > 0)
            {
                Status =
                    Status +
                    " Ignored " +
                    ignoredBranchCount +
                    " branch(es) outside output range A–E.";
            }
        }
        catch (Exception exception)
        {
            SetOutputs(
                treeA,
                treeB,
                treeC,
                treeD,
                treeE,
                ref A,
                ref B,
                ref C,
                ref D,
                ref E
            );

            Status =
                "Data remapping failed: " +
                exception.Message;
        }
    }

    // ============================================================
    // INPUT TREE
    // ============================================================

    private IGH_Structure GetInputTree()
    {
        /*
         * Data is the only component input and should use Tree access.
         * Reading Component.Params.Input[0].VolatileData avoids relying
         * on the RunScript object wrapper.
         */
        if (
            Component.Params.Input.Count == 0)
        {
            return null;
        }

        IGH_Param inputParameter =
            Component.Params.Input[0];

        if (
            inputParameter == null ||
            inputParameter.VolatileData == null ||
            inputParameter.VolatileData.IsEmpty)
        {
            return null;
        }

        return inputParameter.VolatileData;
    }

    // ============================================================
    // PATH RESTORATION
    // ============================================================

    private GH_Path RemoveFirstPathIndex(
        GH_Path combinedPath)
    {
        if (
            combinedPath == null ||
            combinedPath.Length <= 1)
        {
            /*
             * A path containing only the input index, such as {0},
             * maps back to the default Grasshopper path {0}.
             */
            return new GH_Path(0);
        }

        int[] restoredIndices =
            new int[
                combinedPath.Length - 1
            ];

        for (
            int index = 1;
            index < combinedPath.Length;
            index++)
        {
            restoredIndices[
                index - 1
            ] = combinedPath[index];
        }

        return new GH_Path(
            restoredIndices
        );
    }

    // ============================================================
    // OUTPUT SELECTION
    // ============================================================

    private GH_Structure<IGH_Goo> GetTargetTree(
        int outputIndex,
        GH_Structure<IGH_Goo> treeA,
        GH_Structure<IGH_Goo> treeB,
        GH_Structure<IGH_Goo> treeC,
        GH_Structure<IGH_Goo> treeD,
        GH_Structure<IGH_Goo> treeE)
    {
        switch (outputIndex)
        {
            case 0:
                return treeA;

            case 1:
                return treeB;

            case 2:
                return treeC;

            case 3:
                return treeD;

            case 4:
                return treeE;

            default:
                return null;
        }
    }

    // ============================================================
    // OUTPUT ASSIGNMENT
    // ============================================================

    private void SetOutputs(
        GH_Structure<IGH_Goo> treeA,
        GH_Structure<IGH_Goo> treeB,
        GH_Structure<IGH_Goo> treeC,
        GH_Structure<IGH_Goo> treeD,
        GH_Structure<IGH_Goo> treeE,
        ref object A,
        ref object B,
        ref object C,
        ref object D,
        ref object E)
    {
        A = treeA;
        B = treeB;
        C = treeC;
        D = treeD;
        E = treeE;
    }
}
# ---------- end c_script_4 ----------
panel_25 = Panel(c_script_4.Status)
data_2 = Data(c_script_4.A)
data_3 = Data(c_script_4.B)
data_4 = Data(c_script_4.C)

# ---- group: Communication for Motion / Motion Planning Checker
c_script_5 = CSharpScript(CycleTrigger=c_script_2.DownloadReady)  # -> ReadyPulse, Ready, Status; inputs CycleTrigger: Boolean, Code: String, Errors: String
# ---------- c_script_5: C# ----------
// Grasshopper Script Instance

#region Usings
using System;

using Rhino;
using Rhino.Geometry;

using Grasshopper;
using Grasshopper.Kernel;
using Grasshopper.Kernel.Data;
using Grasshopper.Kernel.Types;
#endregion


public class Script_Instance : GH_ScriptInstance
{
    // ============================================================
    // EDGE-DETECTION STATE
    // ============================================================

    private bool previousCycleTrigger = false;


    // ============================================================
    // CYCLE STATE
    // ============================================================

    private bool cycleArmed = false;
    private bool cycleCompleted = false;

    private string codeAtCycleStart = "";
    private string errorsAtCycleStart = "";

    private bool readyPulse = false;
    private bool ready = false;

    private string lastStatus =
        "Waiting for a motion-planning cycle.";


    // ============================================================
    // MAIN
    // ============================================================

    private void RunScript(
		bool CycleTrigger,
		string Code,
		string Errors,
		ref object ReadyPulse,
		ref object Ready,
		ref object Status)
    {
        // --------------------------------------------------------
        // ReadyPulse is always a one-solution event.
        // --------------------------------------------------------

        readyPulse = false;


        // --------------------------------------------------------
        // Normalize text inputs.
        // --------------------------------------------------------

        string normalizedCode =
            NormalizeText(
                Code
            );

        string normalizedErrors =
            NormalizeText(
                Errors
            );


        // --------------------------------------------------------
        // Rising-edge detection for a new planning cycle.
        // --------------------------------------------------------

        bool cyclePulse =
            CycleTrigger &&
            !previousCycleTrigger;

        previousCycleTrigger =
            CycleTrigger;


        // --------------------------------------------------------
        // Arm a new cycle.
        //
        // Store the currently retained outputs so they cannot be
        // mistaken for newly generated results.
        // --------------------------------------------------------

        if (cyclePulse)
        {
            cycleArmed = true;
            cycleCompleted = false;

            ready = false;
            readyPulse = false;

            codeAtCycleStart =
                normalizedCode;

            errorsAtCycleStart =
                normalizedErrors;

            lastStatus =
                "Motion-planning cycle armed. " +
                "Waiting for new Code or Errors output.";

            SetOutputs(
                ref ReadyPulse,
                ref Ready,
                ref Status
            );

            return;
        }


        // --------------------------------------------------------
        // No active cycle.
        // --------------------------------------------------------

        if (!cycleArmed)
        {
            ready = false;

            lastStatus =
                "Waiting for CycleTrigger.";

            SetOutputs(
                ref ReadyPulse,
                ref Ready,
                ref Status
            );

            return;
        }


        // --------------------------------------------------------
        // A completed cycle must not pulse again.
        // --------------------------------------------------------

        if (cycleCompleted)
        {
            ready = true;

            lastStatus =
                "Motion code is ready. " +
                "Waiting for the next CycleTrigger.";

            SetOutputs(
                ref ReadyPulse,
                ref Ready,
                ref Status
            );

            return;
        }


        // --------------------------------------------------------
        // Detect whether planner outputs changed after arming.
        // --------------------------------------------------------

        bool codeChanged =
            !string.Equals(
                normalizedCode,
                codeAtCycleStart,
                StringComparison.Ordinal
            );

        bool errorsChanged =
            !string.Equals(
                normalizedErrors,
                errorsAtCycleStart,
                StringComparison.Ordinal
            );

        bool plannerOutputChanged =
            codeChanged ||
            errorsChanged;


        // --------------------------------------------------------
        // Ignore retained values from the previous cycle.
        // --------------------------------------------------------

        if (!plannerOutputChanged)
        {
            ready = false;

            lastStatus =
                "Waiting for the motion planner to update.";

            SetOutputs(
                ref ReadyPulse,
                ref Ready,
                ref Status
            );

            return;
        }


        // --------------------------------------------------------
        // Failure condition.
        // --------------------------------------------------------

        if (
            string.IsNullOrWhiteSpace(
                normalizedCode
            ) &&
            !string.IsNullOrWhiteSpace(
                normalizedErrors
            )
        )
        {
            ready = false;
            cycleCompleted = false;

            lastStatus =
                "Motion planning failed: " +
                normalizedErrors;

            SetOutputs(
                ref ReadyPulse,
                ref Ready,
                ref Status
            );

            return;
        }


        // --------------------------------------------------------
        // Conflicting condition.
        //
        // Do not accept generated code when Robots also reports
        // an error.
        // --------------------------------------------------------

        if (
            !string.IsNullOrWhiteSpace(
                normalizedCode
            ) &&
            !string.IsNullOrWhiteSpace(
                normalizedErrors
            )
        )
        {
            ready = false;
            cycleCompleted = false;

            lastStatus =
                "Motion planner returned both Code and Errors. " +
                "The result was rejected.";

            SetOutputs(
                ref ReadyPulse,
                ref Ready,
                ref Status
            );

            return;
        }


        // --------------------------------------------------------
        // Successful planning result.
        // --------------------------------------------------------

        if (
            !string.IsNullOrWhiteSpace(
                normalizedCode
            ) &&
            string.IsNullOrWhiteSpace(
                normalizedErrors
            )
        )
        {
            ready = true;
            readyPulse = true;

            cycleCompleted = true;
            cycleArmed = false;

            lastStatus =
                "Motion code generated successfully.";

            SetOutputs(
                ref ReadyPulse,
                ref Ready,
                ref Status
            );

            return;
        }


        // --------------------------------------------------------
        // Outputs changed, but neither success nor error is final.
        // --------------------------------------------------------

        ready = false;

        lastStatus =
            "Motion planner output changed, " +
            "but no final result is available yet.";

        SetOutputs(
            ref ReadyPulse,
            ref Ready,
            ref Status
        );
    }


    // ============================================================
    // OUTPUTS
    // ============================================================

    private void SetOutputs(
        ref object ReadyPulse,
        ref object Ready,
        ref object Status)
    {
        ReadyPulse =
            readyPulse;

        Ready =
            ready;

        Status =
            lastStatus;
    }


    // ============================================================
    // TEXT NORMALIZATION
    // ============================================================

    private string NormalizeText(
        string value)
    {
        return value == null
            ? ""
            : value.Trim();
    }
}
# ---------- end c_script_5 ----------
panel_26 = Panel(c_script_5.ReadyPulse)
panel_27 = Panel(c_script_5.Ready)
panel_28 = Panel(c_script_5.Status)

# ---- group: Communication for Motion / Local Path Generator for Motion Data
connect_3 = BooleanToggle(False)
c_script_6 = CSharpScript(ConnectButton=connect, RefreshStatus=c_script_5.ReadyPulse, SessionName=c_script.Session)  # -> Status, Message, SessionFolder, ManifestPath, PathReady; inputs ConnectButton: Boolean, RefreshStatus: Boolean, SessionName: String
# ---------- c_script_6: C# ----------
// Grasshopper Script Instance
#region Usings
using System;
using System.Text;
using System.Net.Sockets;

using Rhino;
using Rhino.Geometry;

using Grasshopper;
using Grasshopper.Kernel;
using Grasshopper.Kernel.Data;
using Grasshopper.Kernel.Types;
#endregion

public class Script_Instance : GH_ScriptInstance
{
    private bool previousRefreshStatus = false;

    private bool isConnected = false;
    private bool triedConnect = false;

    private string lastStatus = "Disconnected";
    private string lastMessage = "Enable ConnectButton.";

    private string lastSessionFolder = "";
    private string lastManifestPath = "";

    // One-solution event pulse.
    private bool pathReadyPulse = false;

    private void RunScript(
		bool ConnectButton,
		bool RefreshStatus,
		string SessionName,
		ref object Status,
		ref object Message,
		ref object SessionFolder,
		ref object ManifestPath,
		ref object PathReady)
    {
        const string host = "127.0.0.1";
        const int port = 6006;

        // PathReady is false by default for every GH solution.
        // It becomes true only after a new successful path request.
        pathReadyPulse = false;

        bool refreshPulse =
            RefreshStatus &&
            !previousRefreshStatus;

        previousRefreshStatus = RefreshStatus;

        if (!ConnectButton)
        {
            isConnected = false;
            triedConnect = false;

            lastStatus = "Disconnected";
            lastMessage = "Connection toggle is off.";

            SetOutputs(
                ref Status,
                ref Message,
                ref SessionFolder,
                ref ManifestPath,
                ref PathReady
            );

            return;
        }

        if (
            ConnectButton &&
            !isConnected &&
            !triedConnect)
        {
            triedConnect = true;

            string response = SendCommand(
                host,
                port,
                "{\"command\":\"ping\"}"
            );

            if (response.StartsWith("ERROR:"))
            {
                isConnected = false;
                lastStatus = "Connection failed";
                lastMessage = response;
            }
            else
            {
                string responseStatus =
                    ExtractJsonValue(
                        response,
                        "status"
                    );

                if (
                    string.Equals(
                        responseStatus,
                        "ok",
                        StringComparison.OrdinalIgnoreCase
                    ))
                {
                    isConnected = true;
                    lastStatus = "Connected";

                    string responseMessage =
                        ExtractJsonValue(
                            response,
                            "message"
                        );

                    lastMessage =
                        string.IsNullOrWhiteSpace(
                            responseMessage
                        )
                        ? response
                        : responseMessage;
                }
                else
                {
                    isConnected = false;
                    lastStatus = "Connection failed";
                    lastMessage = response;
                }
            }
        }

        if (!isConnected)
        {
            SetOutputs(
                ref Status,
                ref Message,
                ref SessionFolder,
                ref ManifestPath,
                ref PathReady
            );

            return;
        }

        if (refreshPulse)
        {
            string session =
                string.IsNullOrWhiteSpace(
                    SessionName
                )
                ? "RQC_Capture_Session"
                : SessionName.Trim();

            string payload =
                "{" +
                "\"command\":\"get_upload_session_path\"," +
                "\"session\":\"" +
                EscapeJson(session) +
                "\"" +
                "}";

            string response =
                SendCommand(
                    host,
                    port,
                    payload
                );

            if (response.StartsWith("ERROR:"))
            {
                isConnected = false;
                triedConnect = true;

                lastStatus = "Connection lost";
                lastMessage = response;
            }
            else
            {
                string responseStatus =
                    ExtractJsonValue(
                        response,
                        "status"
                    );

                if (
                    !string.Equals(
                        responseStatus,
                        "ok",
                        StringComparison.OrdinalIgnoreCase
                    ))
                {
                    lastStatus =
                        "Upload path request failed";

                    string responseMessage =
                        ExtractJsonValue(
                            response,
                            "message"
                        );

                    lastMessage =
                        string.IsNullOrWhiteSpace(
                            responseMessage
                        )
                        ? response
                        : responseMessage;
                }
                else
                {
                    lastSessionFolder =
                        ExtractJsonValue(
                            response,
                            "session_folder"
                        );

                    lastManifestPath =
                        ExtractJsonValue(
                            response,
                            "manifest_path"
                        );

                    if (
                        !string.IsNullOrWhiteSpace(
                            lastSessionFolder
                        ) &&
                        !string.IsNullOrWhiteSpace(
                            lastManifestPath
                        ))
                    {
                        // This is based on a new successful request,
                        // not on whether the path text changed.
                        pathReadyPulse = true;

                        lastStatus =
                            "Upload session ready";

                        lastMessage =
                            "The local upload session folder " +
                            "and manifest are ready.";
                    }
                    else
                    {
                        pathReadyPulse = false;

                        lastStatus =
                            "Upload path response invalid";

                        lastMessage =
                            "The GH Agent returned success, but " +
                            "the session folder or manifest path " +
                            "was empty.";
                    }
                }
            }
        }

        SetOutputs(
            ref Status,
            ref Message,
            ref SessionFolder,
            ref ManifestPath,
            ref PathReady
        );
    }

    private void SetOutputs(
        ref object Status,
        ref object Message,
        ref object SessionFolder,
        ref object ManifestPath,
        ref object PathReady)
    {
        Status = lastStatus;
        Message = lastMessage;
        SessionFolder = lastSessionFolder;
        ManifestPath = lastManifestPath;
        PathReady = pathReadyPulse;
    }

    private string SendCommand(
        string host,
        int port,
        string command)
    {
        const int headerSize = 8;

        try
        {
            using (
                TcpClient client =
                    new TcpClient())
            {
                IAsyncResult result =
                    client.BeginConnect(
                        host,
                        port,
                        null,
                        null
                    );

                bool success =
                    result.AsyncWaitHandle.WaitOne(
                        TimeSpan.FromMilliseconds(300)
                    );

                if (!success)
                {
                    return
                        "ERROR: GH Agent connection timeout.";
                }

                client.EndConnect(result);

                using (
                    NetworkStream stream =
                        client.GetStream())
                {
                    byte[] payload =
                        Encoding.UTF8.GetBytes(
                            command
                        );

                    byte[] header =
                        new byte[headerSize];

                    ulong size =
                        (ulong)payload.Length;

                    for (
                        int index = 0;
                        index < headerSize;
                        index++)
                    {
                        header[
                            headerSize - 1 - index
                        ] = (byte)(size & 0xFF);

                        size >>= 8;
                    }

                    stream.Write(
                        header,
                        0,
                        header.Length
                    );

                    stream.Write(
                        payload,
                        0,
                        payload.Length
                    );

                    byte[] responseHeader =
                        ReadExact(
                            stream,
                            headerSize
                        );

                    ulong responseSize = 0;

                    for (
                        int index = 0;
                        index < headerSize;
                        index++)
                    {
                        responseSize =
                            (responseSize << 8) +
                            responseHeader[index];
                    }

                    if (responseSize > int.MaxValue)
                    {
                        return
                            "ERROR: Agent response is too large.";
                    }

                    byte[] responsePayload =
                        ReadExact(
                            stream,
                            (int)responseSize
                        );

                    return Encoding.UTF8.GetString(
                        responsePayload
                    );
                }
            }
        }
        catch (Exception exception)
        {
            return "ERROR: " + exception.Message;
        }
    }

    private byte[] ReadExact(
        NetworkStream stream,
        int size)
    {
        byte[] data = new byte[size];
        int offset = 0;

        while (offset < size)
        {
            int read = stream.Read(
                data,
                offset,
                size - offset
            );

            if (read == 0)
            {
                throw new Exception(
                    "Connection closed."
                );
            }

            offset += read;
        }

        return data;
    }

    private string EscapeJson(string value)
    {
        if (value == null)
            return "";

        return value
            .Replace("\\", "\\\\")
            .Replace("\"", "\\\"")
            .Replace("\r", "\\r")
            .Replace("\n", "\\n")
            .Replace("\t", "\\t");
    }

    private string ExtractJsonValue(
        string json,
        string key)
    {
        if (string.IsNullOrWhiteSpace(json))
            return "";

        string pattern =
            "\"" + key + "\":";

        int start = json.IndexOf(
            pattern,
            StringComparison.Ordinal
        );

        if (start < 0)
            return "";

        start += pattern.Length;

        while (
            start < json.Length &&
            char.IsWhiteSpace(json[start]))
        {
            start++;
        }

        if (
            start >= json.Length ||
            json[start] != '"')
        {
            return "";
        }

        start++;

        StringBuilder value =
            new StringBuilder();

        bool escaped = false;

        for (
            int index = start;
            index < json.Length;
            index++)
        {
            char character = json[index];

            if (escaped)
            {
                switch (character)
                {
                    case 'n':
                        value.Append('\n');
                        break;

                    case 'r':
                        value.Append('\r');
                        break;

                    case 't':
                        value.Append('\t');
                        break;

                    case '\\':
                        value.Append('\\');
                        break;

                    case '"':
                        value.Append('"');
                        break;

                    default:
                        value.Append(character);
                        break;
                }

                escaped = false;
                continue;
            }

            if (character == '\\')
            {
                escaped = true;
                continue;
            }

            if (character == '"')
            {
                return value.ToString();
            }

            value.Append(character);
        }

        return "";
    }
}
# ---------- end c_script_6 ----------
panel_30 = Panel(c_script_6.Status)
panel_31 = Panel(c_script_6.Message)
panel_32 = Panel(c_script_6.SessionFolder)
panel_33 = Panel(c_script_6.ManifestPath)
panel_34 = Panel(c_script_6.PathReady)

# ---- group: Communication for Motion / Local Motion Data Uploder
write = Button()
c_script_7 = CSharpScript(
    Directory=c_script_6.SessionFolder,
    FileName="script",
    Session=c_script.Session,
    OutputIndex=c_script.SourceIndex,
    Write=c_script_6.PathReady,
    ProgramData="first test for motion")  # -> OutputPath, ProgramSummary, ReadyEvent, Status; inputs Directory: String, FileName: String, Session: String, OutputIndex: Int32, Write: Boolean, ProgramData: tree
# ---------- c_script_7: C# ----------
// Grasshopper C# Script Instance
#region Usings
using System;
using System.Collections;
using System.Collections.Generic;
using System.Globalization;
using System.IO;
using System.Linq;
using System.Net.Sockets;
using System.Text;

using Grasshopper;
using Grasshopper.Kernel;
using Grasshopper.Kernel.Data;
using Grasshopper.Kernel.Types;
#endregion

public class Script_Instance : GH_ScriptInstance
{
    // ============================================================
    // CONFIGURATION
    // ============================================================

    private const string GhAgentHost =
        "127.0.0.1";

    private const int GhAgentPort =
        6006;

    private const int MessageHeaderSize =
        8;

    private const string OutputDomain =
        "motion";

    private const string DefaultCategory =
        "program";

    private const string DefaultExtension =
        ".txt";

    // ============================================================
    // COMPONENT STATE
    // ============================================================

    private bool previousWrite =
        false;

    private string lastOutputPath =
        "";

    private string lastReadyEvent =
        "";

    private string lastStatus =
        "Ready.";

    private string lastProgramSummary =
        "No program data.";

    // ============================================================
    // MAIN
    // ============================================================

    private void RunScript(
		string Directory,
		string FileName,
		string Session,
		int OutputIndex,
		bool Write,
		DataTree<object> ProgramData,
		ref object OutputPath,
		ref object ProgramSummary,
		ref object ReadyEvent,
		ref object Status)
    {
        bool writePulse =
            Write &&
            !previousWrite;

        previousWrite =
            Write;

        try
        {
            ProgramContent program =
                CollectProgramContent(
                    ProgramData
                );

            lastProgramSummary =
                program.Summary;

            string validationError =
                ValidateSettings(
                    Directory,
                    FileName,
                    Session,
                    OutputIndex
                );

            if (
                !string.IsNullOrWhiteSpace(
                    validationError
                )
            )
            {
                lastStatus =
                    validationError;

                SetOutputs(
                    ref OutputPath,
                    ref ProgramSummary,
                    ref ReadyEvent,
                    ref Status
                );

                return;
            }

            string fileType =
                NormalizeFileType(
                    FileName
                );

            string extension =
                "." +
                fileType;

            string resolvedFileName =
                BuildFileName(
                    fileType,
                    OutputIndex
                );

            lastOutputPath =
                Path.GetFullPath(
                    Path.Combine(
                        Directory.Trim(),
                        resolvedFileName
                    )
                );

            if (!writePulse)
            {
                lastStatus =
                    program.HasContent
                    ? (
                        "Ready. Program contains " +
                        program.LineCount +
                        " line(s) and " +
                        program.CharacterCount +
                        " character(s)."
                    )
                    : "Ready. No program data.";

                SetOutputs(
                    ref OutputPath,
                    ref ProgramSummary,
                    ref ReadyEvent,
                    ref Status
                );

                return;
            }

            if (!program.HasContent)
            {
                lastStatus =
                    "Write rejected: ProgramData contains no text.";

                SetOutputs(
                    ref OutputPath,
                    ref ProgramSummary,
                    ref ReadyEvent,
                    ref Status
                );

                return;
            }

            string outputDirectory =
                Path.GetDirectoryName(
                    lastOutputPath
                );

            if (
                string.IsNullOrWhiteSpace(
                    outputDirectory
                )
            )
            {
                throw new InvalidOperationException(
                    "Could not resolve the output directory."
                );
            }

            System.IO.Directory.CreateDirectory(
                outputDirectory
            );

            WriteProgramFile(
                lastOutputPath,
                program.Text
            );

            if (!File.Exists(lastOutputPath))
            {
                throw new IOException(
                    "Program write completed, but the file " +
                    "does not exist: " +
                    lastOutputPath
                );
            }

            string registrationResponse =
                RegisterLocalUpload(
                    Session.Trim(),
                    OutputIndex,
                    fileType,
                    lastOutputPath
                );

            string registrationStatus =
                ExtractJsonValue(
                    registrationResponse,
                    "status"
                );

            if (
                !string.Equals(
                    registrationStatus,
                    "ok",
                    StringComparison.OrdinalIgnoreCase
                )
            )
            {
                string registrationMessage =
                    ExtractJsonValue(
                        registrationResponse,
                        "message"
                    );

                throw new InvalidOperationException(
                    "The robot program was written, but local " +
                    "registration failed: " +
                    (
                        string.IsNullOrWhiteSpace(
                            registrationMessage
                        )
                        ? registrationResponse
                        : registrationMessage
                    )
                );
            }

            string eventId =
                Guid.NewGuid().ToString();

            string createdAt =
                DateTime.UtcNow.ToString(
                    "o",
                    CultureInfo.InvariantCulture
                );

            lastReadyEvent =
                BuildReadyEvent(
                    eventId,
                    createdAt,
                    Session.Trim(),
                    OutputIndex,
                    lastOutputPath,
                    fileType,
                    extension,
                    program
                );

            lastStatus =
                "Robot program was written and " +
                "registered successfully.";

            SetOutputs(
                ref OutputPath,
                ref ProgramSummary,
                ref ReadyEvent,
                ref Status
            );
        }
        catch (Exception exception)
        {
            lastStatus =
                "Motion Program Output failed: " +
                exception.Message;

            SetOutputs(
                ref OutputPath,
                ref ProgramSummary,
                ref ReadyEvent,
                ref Status
            );
        }
    }

    // ============================================================
    // PROGRAM DATA COLLECTION
    // ============================================================

    private ProgramContent CollectProgramContent(
        DataTree<object> programData)
    {
        List<string> lines =
            new List<string>();

        int branchCount =
            0;

        int itemCount =
            0;

        if (programData != null)
        {
            branchCount =
                programData.BranchCount;

            for (
                int branchIndex = 0;
                branchIndex < programData.BranchCount;
                branchIndex++)
            {
                IList<object> branch =
                    programData.Branch(
                        branchIndex
                    );

                if (branch == null)
                    continue;

                for (
                    int itemIndex = 0;
                    itemIndex < branch.Count;
                    itemIndex++)
                {
                    object item =
                        branch[itemIndex];

                    List<string> itemLines =
                        ConvertItemToLines(
                            item
                        );

                    foreach (
                        string line
                        in itemLines
                    )
                    {
                        lines.Add(
                            line ?? ""
                        );
                    }

                    itemCount++;
                }
            }
        }

        string text =
            string.Join(
                Environment.NewLine,
                lines
            );

        bool hasContent =
            !string.IsNullOrWhiteSpace(
                text
            );

        int characterCount =
            text.Length;

        int lineCount =
            lines.Count;

        string summary =
            "Robot Program" +
            " | Branches: " +
            branchCount +
            " | Items: " +
            itemCount +
            " | Lines: " +
            lineCount +
            " | Characters: " +
            characterCount +
            " | Has Content: " +
            hasContent;

        return new ProgramContent(
            text,
            hasContent,
            branchCount,
            itemCount,
            lineCount,
            characterCount,
            summary
        );
    }

    private List<string> ConvertItemToLines(
        object item)
    {
        List<string> lines =
            new List<string>();

        if (item == null)
            return lines;

        GH_String ghString =
            item as GH_String;

        if (ghString != null)
        {
            AddTextLines(
                lines,
                ghString.Value
            );

            return lines;
        }

        IGH_Goo goo =
            item as IGH_Goo;

        if (goo != null)
        {
            object scriptValue =
                goo.ScriptVariable();

            if (
                scriptValue != null &&
                !ReferenceEquals(
                    scriptValue,
                    item
                )
            )
            {
                return ConvertItemToLines(
                    scriptValue
                );
            }

            AddTextLines(
                lines,
                goo.ToString()
            );

            return lines;
        }

        string stringValue =
            item as string;

        if (stringValue != null)
        {
            AddTextLines(
                lines,
                stringValue
            );

            return lines;
        }

        IEnumerable enumerable =
            item as IEnumerable;

        if (
            enumerable != null &&
            !(item is string)
        )
        {
            foreach (
                object child
                in enumerable
            )
            {
                lines.AddRange(
                    ConvertItemToLines(
                        child
                    )
                );
            }

            return lines;
        }

        AddTextLines(
            lines,
            Convert.ToString(
                item,
                CultureInfo.InvariantCulture
            )
        );

        return lines;
    }

    private void AddTextLines(
        List<string> target,
        string value)
    {
        if (value == null)
            return;

        string normalized =
            value
                .Replace(
                    "\r\n",
                    "\n"
                )
                .Replace(
                    "\r",
                    "\n"
                );

        string[] split =
            normalized.Split(
                new char[] { '\n' },
                StringSplitOptions.None
            );

        target.AddRange(
            split
        );
    }

    // ============================================================
    // FILE WRITING
    // ============================================================

    private void WriteProgramFile(
        string outputPath,
        string programText)
    {
        string temporaryPath =
            outputPath +
            ".writing";

        if (File.Exists(temporaryPath))
        {
            File.Delete(
                temporaryPath
            );
        }

        UTF8Encoding utf8WithoutBom =
            new UTF8Encoding(
                false
            );

        File.WriteAllText(
            temporaryPath,
            programText,
            utf8WithoutBom
        );

        if (!File.Exists(temporaryPath))
        {
            throw new IOException(
                "Temporary robot program file was not created."
            );
        }

        if (File.Exists(outputPath))
        {
            File.Delete(
                outputPath
            );
        }

        File.Move(
            temporaryPath,
            outputPath
        );
    }

    // ============================================================
    // LOCAL GH AGENT REGISTRATION
    // ============================================================

    private string RegisterLocalUpload(
        string session,
        int outputIndex,
        string category,
        string localPath)
    {
        string payload =
            "{" +
            "\"command\":\"register_local_upload\"," +
            "\"session\":\"" +
            EscapeJson(session) +
            "\"," +
            "\"local_path\":\"" +
            EscapeJson(localPath) +
            "\"," +
            "\"domain\":\"motion\"," +
            "\"category\":\"" +
            EscapeJson(category) +
            "\"," +
            "\"motion_output_index\":" +
            outputIndex.ToString(
                CultureInfo.InvariantCulture
            ) +
            "," +
            "\"upload_status\":\"pending\"" +
            "}";

        string response =
            SendCommand(
                payload
            );

        if (
            response.StartsWith(
                "ERROR:",
                StringComparison.Ordinal
            )
        )
        {
            throw new InvalidOperationException(
                response
            );
        }

        return response;
    }

    // ============================================================
    // PATHS AND VALIDATION
    // ============================================================

    private string ValidateSettings(
        string directory,
        string fileName,
        string session,
        int outputIndex)
    {
        if (string.IsNullOrWhiteSpace(directory))
        {
            return "Directory cannot be empty.";
        }

        string trimmedDirectory =
            directory.Trim();

        if (!Path.IsPathRooted(trimmedDirectory))
        {
            return "Directory must be an absolute path.";
        }

        if (
            !System.IO.Directory.Exists(
                trimmedDirectory
            )
        )
        {
            return
                "Directory does not exist: " +
                trimmedDirectory;
        }

        if (string.IsNullOrWhiteSpace(fileName))
        {
            return
                "FileName cannot be empty. " +
                "Examples: script, mod, modx, urp.";
        }

        string trimmedFileName =
            fileName
                .Trim()
                .TrimStart('.');

        if (string.IsNullOrWhiteSpace(trimmedFileName))
        {
            return "FileName is invalid.";
        }

        foreach (char character in trimmedFileName)
        {
            if (!char.IsLetterOrDigit(character))
            {
                return
                    "FileName may contain only letters " +
                    "and numbers. Examples: script, mod, modx, urp.";
            }
        }

        if (string.IsNullOrWhiteSpace(session))
        {
            return "Session cannot be empty.";
        }

        string trimmedSession =
            session.Trim();

        if (
            Path.GetFileName(trimmedSession) !=
            trimmedSession
        )
        {
            return
                "Session must be a folder name, not a path.";
        }

        if (outputIndex < 1)
        {
            return
                "OutputIndex must be at least 1.";
        }

        return "";
    }

    private string NormalizeFileType(
        string value)
    {
        string fileType =
            string.IsNullOrWhiteSpace(value)
            ? "txt"
            : value
                .Trim()
                .TrimStart('.')
                .ToLowerInvariant();

        StringBuilder cleaned =
            new StringBuilder();

        foreach (char character in fileType)
        {
            if (char.IsLetterOrDigit(character))
            {
                cleaned.Append(character);
            }
        }

        string result =
            cleaned.ToString();

        if (string.IsNullOrWhiteSpace(result))
        {
            throw new ArgumentException(
                "FileName is invalid."
            );
        }

        return result;
    }

    private string BuildFileName(
        string fileType,
        int outputIndex)
    {
        return
            "motion_" +
            fileType +
            "_" +
            outputIndex.ToString(
                "00",
                CultureInfo.InvariantCulture
            ) +
            "." +
            fileType;
    }

    private string NormalizeName(
        string value,
        string fallback)
    {
        string raw =
            string.IsNullOrWhiteSpace(
                value
            )
            ? fallback
            : value
                .Trim()
                .ToLowerInvariant();

        StringBuilder cleaned =
            new StringBuilder();

        foreach (
            char character
            in raw
        )
        {
            cleaned.Append(
                char.IsLetterOrDigit(
                    character
                )
                ? character
                : '_'
            );
        }

        string result =
            cleaned.ToString();

        while (
            result.Contains(
                "__"
            )
        )
        {
            result =
                result.Replace(
                    "__",
                    "_"
                );
        }

        result =
            result.Trim('_');

        return
            string.IsNullOrWhiteSpace(
                result
            )
            ? fallback
            : result;
    }

    // ============================================================
    // READY EVENT
    // ============================================================

    private string BuildReadyEvent(
        string eventId,
        string createdAt,
        string session,
        int outputIndex,
        string outputPath,
        string category,
        string extension,
        ProgramContent program)
    {
        string summary =
            EscapeJson(
                program.Summary
            );

        return
            "{" +
            "\"event_id\":\"" +
            EscapeJson(eventId) +
            "\"," +
            "\"event\":\"local_output_ready\"," +
            "\"status\":\"ready\"," +
            "\"created_at\":\"" +
            EscapeJson(createdAt) +
            "\"," +
            "\"session\":\"" +
            EscapeJson(session) +
            "\"," +
            "\"domain\":\"motion\"," +
            "\"output_index\":" +
            outputIndex.ToString(
                CultureInfo.InvariantCulture
            ) +
            "," +
            "\"local_path\":\"" +
            EscapeJson(outputPath) +
            "\"," +
            "\"category\":\"" +
            EscapeJson(category) +
            "\"," +
            "\"file_extension\":\"" +
            EscapeJson(extension) +
            "\"," +
            "\"connected_input_count\":1," +
            "\"populated_input_count\":" +
            (
                program.HasContent
                ? "1"
                : "0"
            ) +
            "," +
            "\"input_summary\":[" +
            "\"" +
            summary +
            "\"" +
            "]" +
            "}";
    }

    // ============================================================
    // GH AGENT CONNECTION
    // ============================================================

    private string SendCommand(
        string command)
    {
        try
        {
            using (
                TcpClient client =
                    new TcpClient()
            )
            {
                IAsyncResult connection =
                    client.BeginConnect(
                        GhAgentHost,
                        GhAgentPort,
                        null,
                        null
                    );

                bool connected =
                    connection.AsyncWaitHandle.WaitOne(
                        TimeSpan.FromMilliseconds(
                            500
                        )
                    );

                if (!connected)
                {
                    return
                        "ERROR: GH Agent connection timeout.";
                }

                client.EndConnect(
                    connection
                );

                using (
                    NetworkStream stream =
                        client.GetStream()
                )
                {
                    byte[] payload =
                        Encoding.UTF8.GetBytes(
                            command
                        );

                    byte[] header =
                        BuildHeader(
                            payload.Length
                        );

                    stream.Write(
                        header,
                        0,
                        header.Length
                    );

                    stream.Write(
                        payload,
                        0,
                        payload.Length
                    );

                    byte[] responseHeader =
                        ReadExact(
                            stream,
                            MessageHeaderSize
                        );

                    ulong responseSize =
                        ParseHeader(
                            responseHeader
                        );

                    if (responseSize > int.MaxValue)
                    {
                        return
                            "ERROR: GH Agent response is too large.";
                    }

                    byte[] responsePayload =
                        ReadExact(
                            stream,
                            (int)responseSize
                        );

                    return
                        Encoding.UTF8.GetString(
                            responsePayload
                        );
                }
            }
        }
        catch (Exception exception)
        {
            return
                "ERROR: " +
                exception.Message;
        }
    }

    private byte[] BuildHeader(
        int payloadSize)
    {
        byte[] header =
            new byte[
                MessageHeaderSize
            ];

        ulong size =
            (ulong)payloadSize;

        for (
            int index = 0;
            index < MessageHeaderSize;
            index++
        )
        {
            header[
                MessageHeaderSize -
                1 -
                index
            ] =
                (byte)(
                    size &
                    0xFF
                );

            size >>=
                8;
        }

        return header;
    }

    private ulong ParseHeader(
        byte[] header)
    {
        ulong size =
            0;

        for (
            int index = 0;
            index < header.Length;
            index++
        )
        {
            size =
                (
                    size <<
                    8
                ) +
                header[index];
        }

        return size;
    }

    private byte[] ReadExact(
        NetworkStream stream,
        int size)
    {
        byte[] data =
            new byte[size];

        int offset =
            0;

        while (offset < size)
        {
            int read =
                stream.Read(
                    data,
                    offset,
                    size - offset
                );

            if (read == 0)
            {
                throw new IOException(
                    "Connection closed before the response " +
                    "was complete."
                );
            }

            offset +=
                read;
        }

        return data;
    }

    // ============================================================
    // JSON HELPERS
    // ============================================================

    private string EscapeJson(
        string value)
    {
        if (value == null)
            return "";

        return value
            .Replace(
                "\\",
                "\\\\"
            )
            .Replace(
                "\"",
                "\\\""
            )
            .Replace(
                "\r",
                "\\r"
            )
            .Replace(
                "\n",
                "\\n"
            )
            .Replace(
                "\t",
                "\\t"
            );
    }

    private string ExtractJsonValue(
        string json,
        string key)
    {
        if (
            string.IsNullOrWhiteSpace(
                json
            )
        )
        {
            return "";
        }

        string pattern =
            "\"" +
            key +
            "\":";

        int start =
            json.IndexOf(
                pattern,
                StringComparison.Ordinal
            );

        if (start < 0)
            return "";

        start +=
            pattern.Length;

        while (
            start < json.Length &&
            char.IsWhiteSpace(
                json[start]
            )
        )
        {
            start++;
        }

        if (start >= json.Length)
            return "";

        if (json[start] == '"')
        {
            start++;

            StringBuilder value =
                new StringBuilder();

            bool escaped =
                false;

            for (
                int index = start;
                index < json.Length;
                index++
            )
            {
                char character =
                    json[index];

                if (escaped)
                {
                    switch (character)
                    {
                        case 'n':
                            value.Append('\n');
                            break;

                        case 'r':
                            value.Append('\r');
                            break;

                        case 't':
                            value.Append('\t');
                            break;

                        case '\\':
                            value.Append('\\');
                            break;

                        case '"':
                            value.Append('"');
                            break;

                        default:
                            value.Append(
                                character
                            );
                            break;
                    }

                    escaped =
                        false;

                    continue;
                }

                if (character == '\\')
                {
                    escaped =
                        true;

                    continue;
                }

                if (character == '"')
                {
                    return
                        value.ToString();
                }

                value.Append(
                    character
                );
            }

            return "";
        }

        int end =
            start;

        while (
            end < json.Length &&
            json[end] != ',' &&
            json[end] != '}'
        )
        {
            end++;
        }

        return
            json
                .Substring(
                    start,
                    end - start
                )
                .Trim();
    }

    // ============================================================
    // OUTPUTS
    // ============================================================

    private void SetOutputs(
        ref object OutputPath,
        ref object ProgramSummary,
        ref object ReadyEvent,
        ref object Status)
    {
        OutputPath =
            lastOutputPath;

        ProgramSummary =
            lastProgramSummary;

        ReadyEvent =
            lastReadyEvent;

        Status =
            lastStatus;
    }

    private class ProgramContent
    {
        public string Text;
        public bool HasContent;

        public int BranchCount;
        public int ItemCount;
        public int LineCount;
        public int CharacterCount;

        public string Summary;

        public ProgramContent(
            string text,
            bool hasContent,
            int branchCount,
            int itemCount,
            int lineCount,
            int characterCount,
            string summary)
        {
            Text =
                text;

            HasContent =
                hasContent;

            BranchCount =
                branchCount;

            ItemCount =
                itemCount;

            LineCount =
                lineCount;

            CharacterCount =
                characterCount;

            Summary =
                summary;
        }
    }
}
# ---------- end c_script_7 ----------
panel_35 = Panel(c_script_7.OutputPath)
panel_36 = Panel(c_script_7.ProgramSummary)
panel_37 = Panel(c_script_7.Status)

# ---- group: Communication for Motion / Motion Data Uploader to Master
c_script_8 = CSharpScript(
    ConnectButton=connect,
    ReadyEvent=c_script_7.ReadyEvent,
    SourceOutputIndex=c_script.SourceIndex,
    CreatedBy="motion_pc",
    UploadMessage="Motion solution ready",
    AutoPoll=refresh_status)  # -> State, Status, Message, UploadJobId, Progress, Session, OutputIndex, MasterResponse; inputs ConnectButton: Boolean, ReadyEvent: String, SourceOutputIndex: Int32, CreatedBy: String, UploadMessage: String, AutoPoll: Boolean
# ---------- c_script_8: C# ----------
// Grasshopper C# Script Instance
#region Usings
using System;
using System.Globalization;
using System.Net.Sockets;
using System.Text;

using Grasshopper;
using Grasshopper.Kernel;
#endregion

public class Script_Instance : GH_ScriptInstance
{
    // ============================================================
    // CONFIGURATION
    // ============================================================

    private const string GhAgentHost = "127.0.0.1";
    private const int GhAgentPort = 6006;
    private const int MessageHeaderSize = 8;
    private const int PollIntervalMilliseconds = 500;

    // ============================================================
    // COMPONENT STATE
    // ============================================================

    private bool isConnected = false;
    private bool triedConnection = false;
    private bool pollScheduled = false;

    private string lastProcessedEventId = "";

    private string activeUploadJobId = "";
    private string activeSession = "";
    private string activeDomain = "";
    private int activeOutputIndex = 0;

    private string lastState = "Idle";
    private string lastStatus = "Disconnected";
    private string lastMessage = "Enable ConnectButton.";
    private int lastProgress = 0;
    private string lastMasterResponse = "";

    // ============================================================
    // MAIN
    // ============================================================

    private void RunScript(
		bool ConnectButton,
		string ReadyEvent,
		int SourceOutputIndex,
		string CreatedBy,
		string UploadMessage,
		bool AutoPoll,
		ref object State,
		ref object Status,
		ref object Message,
		ref object UploadJobId,
		ref object Progress,
		ref object Session,
		ref object OutputIndex,
		ref object MasterResponse)
    {
        try
        {
            // ----------------------------------------------------
            // Connection disabled
            // ----------------------------------------------------

            if (!ConnectButton)
            {
                isConnected = false;
                triedConnection = false;
                pollScheduled = false;

                lastState = "Idle";
                lastStatus = "Disconnected";
                lastMessage = "Connection toggle is off.";

                SetOutputs(
                    ref State,
                    ref Status,
                    ref Message,
                    ref UploadJobId,
                    ref Progress,
                    ref Session,
                    ref OutputIndex,
                    ref MasterResponse
                );

                return;
            }

            // ----------------------------------------------------
            // Connect to GH Agent
            // ----------------------------------------------------

            if (!isConnected && !triedConnection)
            {
                triedConnection = true;

                string pingResponse =
                    SendCommand(
                        "{\"command\":\"ping\"}"
                    );

                if (pingResponse.StartsWith("ERROR:"))
                {
                    isConnected = false;
                    lastState = "Connection error";
                    lastStatus = "Connection failed";
                    lastMessage = pingResponse;

                    SetOutputs(
                        ref State,
                        ref Status,
                        ref Message,
                        ref UploadJobId,
                        ref Progress,
                        ref Session,
                        ref OutputIndex,
                        ref MasterResponse
                    );

                    return;
                }

                string pingStatus =
                    ExtractJsonValue(
                        pingResponse,
                        "status"
                    );

                if (
                    !string.Equals(
                        pingStatus,
                        "ok",
                        StringComparison.OrdinalIgnoreCase))
                {
                    isConnected = false;
                    lastState = "Connection error";
                    lastStatus = "Connection failed";
                    lastMessage =
                        GetResponseMessage(
                            pingResponse,
                            "GH Agent ping failed."
                        );

                    SetOutputs(
                        ref State,
                        ref Status,
                        ref Message,
                        ref UploadJobId,
                        ref Progress,
                        ref Session,
                        ref OutputIndex,
                        ref MasterResponse
                    );

                    return;
                }

                isConnected = true;
                lastState = "Ready";
                lastStatus = "Connected";
                lastMessage =
                    GetResponseMessage(
                        pingResponse,
                        "Connected to GH Agent."
                    );
            }

            if (!isConnected)
            {
                SetOutputs(
                    ref State,
                    ref Status,
                    ref Message,
                    ref UploadJobId,
                    ref Progress,
                    ref Session,
                    ref OutputIndex,
                    ref MasterResponse
                );

                return;
            }

            // ----------------------------------------------------
            // Detect a new ready event
            // ----------------------------------------------------

            if (!string.IsNullOrWhiteSpace(ReadyEvent))
            {
                ReadyEventData eventData =
                    ParseReadyEvent(
                        ReadyEvent
                    );

                if (
                    eventData != null &&
                    !string.IsNullOrWhiteSpace(
                        eventData.EventId) &&
                    !string.Equals(
                        eventData.EventId,
                        lastProcessedEventId,
                        StringComparison.Ordinal))
                {
                    SubmitReadyEvent(
                        eventData,
                        SourceOutputIndex,
                        CreatedBy,
                        UploadMessage
                    );
                }
            }

            // ----------------------------------------------------
            // Poll active upload job
            // ----------------------------------------------------

            if (
                IsUploadActive() &&
                AutoPoll)
            {
                PollUploadJob();

                if (IsUploadActive())
                {
                    ScheduleNextPoll();
                }
            }

            SetOutputs(
                ref State,
                ref Status,
                ref Message,
                ref UploadJobId,
                ref Progress,
                ref Session,
                ref OutputIndex,
                ref MasterResponse
            );
        }
        catch (Exception exception)
        {
            lastState = "Failed";
            lastStatus = "Component error";
            lastMessage = exception.Message;

            SetOutputs(
                ref State,
                ref Status,
                ref Message,
                ref UploadJobId,
                ref Progress,
                ref Session,
                ref OutputIndex,
                ref MasterResponse
            );
        }
    }

    // ============================================================
    // READY EVENT SUBMISSION
    // ============================================================

    private void SubmitReadyEvent(
        ReadyEventData eventData,
        int sourceOutputIndex,
        string createdBy,
        string uploadMessage)
    {
        ValidateReadyEvent(eventData);

        bool isDesign =
            string.Equals(
                eventData.Domain,
                "design",
                StringComparison.OrdinalIgnoreCase
            );

        bool isMotion =
            string.Equals(
                eventData.Domain,
                "motion",
                StringComparison.OrdinalIgnoreCase
            );

        if (!isDesign && !isMotion)
        {
            throw new InvalidOperationException(
                "Unsupported output domain: '" +
                eventData.Domain +
                "'. Expected 'design' or 'motion'."
            );
        }

        int safeSourceOutputIndex =
            Math.Max(
                1,
                sourceOutputIndex
            );

        string command;
        string outputIndexField;
        string sourceIndexField;
        string defaultCreatedBy;
        string defaultUploadMessage;
        string submissionMessage;
        string submittedMessage;

        if (isDesign)
        {
            command =
                "upload_design_output";

            outputIndexField =
                "design_output_index";

            sourceIndexField =
                "source_processing_output_index";

            defaultCreatedBy =
                "design_pc";

            defaultUploadMessage =
                "Design solution ready.";

            submissionMessage =
                "Submitting registered design output to GH Agent.";

            submittedMessage =
                "Design upload job submitted.";
        }
        else
        {
            command =
                "upload_motion_output";

            outputIndexField =
                "motion_output_index";

            sourceIndexField =
                "source_design_output_index";

            defaultCreatedBy =
                "motion_pc";

            defaultUploadMessage =
                "Motion solution ready.";

            submissionMessage =
                "Submitting registered motion output to GH Agent.";

            submittedMessage =
                "Motion upload job submitted.";
        }

        string safeCreatedBy =
            string.IsNullOrWhiteSpace(
                createdBy
            )
            ? defaultCreatedBy
            : createdBy.Trim();

        string safeUploadMessage =
            string.IsNullOrWhiteSpace(
                uploadMessage
            )
            ? defaultUploadMessage
            : uploadMessage.Trim();

        string payload =
            "{" +
            "\"command\":\"" +
            EscapeJson(command) +
            "\"," +
            "\"session\":\"" +
            EscapeJson(eventData.Session) +
            "\"," +
            "\"" +
            outputIndexField +
            "\":" +
            eventData.OutputIndex.ToString(
                CultureInfo.InvariantCulture
            ) +
            "," +
            "\"" +
            sourceIndexField +
            "\":" +
            safeSourceOutputIndex.ToString(
                CultureInfo.InvariantCulture
            ) +
            "," +
            "\"created_by\":\"" +
            EscapeJson(safeCreatedBy) +
            "\"," +
            "\"message\":\"" +
            EscapeJson(safeUploadMessage) +
            "\"" +
            "}";

        lastState =
            "Submitting";

        lastStatus =
            "Submitting upload";

        lastMessage =
            submissionMessage;

        string response =
            SendCommand(
                payload
            );

        if (
            response.StartsWith(
                "ERROR:",
                StringComparison.Ordinal
            )
        )
        {
            ConnectionFailure(
                response
            );

            return;
        }

        string responseStatus =
            ExtractJsonValue(
                response,
                "status"
            );

        if (
            !string.Equals(
                responseStatus,
                "ok",
                StringComparison.OrdinalIgnoreCase
            )
        )
        {
            lastState =
                "Failed";

            lastStatus =
                "Upload submission failed";

            lastMessage =
                GetResponseMessage(
                    response,
                    response
                );

            /*
            * Do not consume the event when submission fails.
            * A later Grasshopper solution may retry it.
            */
            return;
        }

        string jobId =
            ExtractJsonValue(
                response,
                "job_id"
            );

        if (
            string.IsNullOrWhiteSpace(
                jobId
            )
        )
        {
            lastState =
                "Failed";

            lastStatus =
                "Upload submission failed";

            lastMessage =
                "GH Agent returned success without an upload job ID.";

            return;
        }

        /*
        * Consume the event only after GH Agent successfully
        * accepted the upload job.
        */
        lastProcessedEventId =
            eventData.EventId;

        activeUploadJobId =
            jobId;

        activeSession =
            eventData.Session;

        activeDomain =
            eventData.Domain;

        activeOutputIndex =
            eventData.OutputIndex;

        lastProgress =
            0;

        lastMasterResponse =
            "";

        lastState =
            "Upload queued";

        lastStatus =
            ExtractJsonValue(
                response,
                "latest_status"
            );

        if (
            string.IsNullOrWhiteSpace(
                lastStatus
            )
        )
        {
            lastStatus =
                "upload_queued";
        }

        lastMessage =
            GetResponseMessage(
                response,
                submittedMessage
            );

        ScheduleNextPoll();
    }

    // ============================================================
    // JOB POLLING
    // ============================================================

    private void PollUploadJob()
    {
        if (string.IsNullOrWhiteSpace(
            activeUploadJobId))
        {
            return;
        }

        string payload =
            "{" +
            "\"command\":\"get_job_status\"," +
            "\"job_id\":\"" +
            EscapeJson(activeUploadJobId) +
            "\"" +
            "}";

        string response =
            SendCommand(payload);

        if (response.StartsWith("ERROR:"))
        {
            ConnectionFailure(response);
            return;
        }

        string outerStatus =
            ExtractJsonValue(
                response,
                "status"
            );

        if (
            !string.Equals(
                outerStatus,
                "ok",
                StringComparison.OrdinalIgnoreCase))
        {
            lastState = "Polling error";
            lastStatus = "Upload status request failed";
            lastMessage =
                GetResponseMessage(
                    response,
                    response
                );

            return;
        }

        string jobJson =
            ExtractJsonObject(
                response,
                "job"
            );

        if (string.IsNullOrWhiteSpace(jobJson))
        {
            lastState = "Polling error";
            lastStatus = "Upload status unavailable";
            lastMessage =
                "GH Agent response did not contain a job object.";

            return;
        }

        string jobStatus =
            NormalizeStatus(
                ExtractJsonValue(
                    jobJson,
                    "status"
                )
            );

        string jobMessage =
            ExtractJsonValue(
                jobJson,
                "message"
            );

        string jobError =
            ExtractJsonValue(
                jobJson,
                "error"
            );

        lastProgress =
            ParseInteger(
                ExtractJsonValue(
                    jobJson,
                    "progress"
                ),
                lastProgress
            );

        if (!string.IsNullOrWhiteSpace(jobMessage))
        {
            lastMessage = jobMessage;
        }

        lastStatus =
            string.IsNullOrWhiteSpace(jobStatus)
            ? "unknown"
            : jobStatus;

        if (
            jobStatus == "upload_queued" ||
            jobStatus == "queued")
        {
            lastState = "Upload queued";
            return;
        }

        if (
            jobStatus == "upload_running" ||
            jobStatus == "running")
        {
            lastState = "Uploading";
            return;
        }

        if (
            jobStatus == "upload_finished" ||
            jobStatus == "finished")
        {
            lastState = "Finished";
            lastStatus = "upload_finished";
            lastProgress = 100;

            string resultJson =
                ExtractJsonObject(
                    jobJson,
                    "result"
                );

            lastMasterResponse =
                ExtractMasterResponse(
                    resultJson
                );

            if (string.IsNullOrWhiteSpace(lastMessage))
            {
                lastMessage =
                    "output uploaded to the Python master.";
            }

            return;
        }

        if (
            jobStatus == "upload_failed" ||
            jobStatus == "failed" ||
            jobStatus == "error")
        {
            lastState = "Failed";
            lastStatus = "upload_failed";
            lastProgress = 100;

            if (!string.IsNullOrWhiteSpace(jobError))
            {
                lastMessage = jobError;
            }
            else if (string.IsNullOrWhiteSpace(lastMessage))
            {
                lastMessage = "upload failed.";
            }

            return;
        }

        if (jobStatus == "cancelled")
        {
            lastState = "Cancelled";
            lastStatus = "cancelled";
            lastProgress = 100;

            if (string.IsNullOrWhiteSpace(lastMessage))
            {
                lastMessage =
                    "upload was cancelled.";
            }

            return;
        }

        lastState = "Upload status unknown";
    }

    private bool IsUploadActive()
    {
        string normalized =
            NormalizeStatus(
                lastStatus
            );

        return (
            !string.IsNullOrWhiteSpace(
                activeUploadJobId) &&
            normalized != "upload_finished" &&
            normalized != "finished" &&
            normalized != "upload_failed" &&
            normalized != "failed" &&
            normalized != "error" &&
            normalized != "cancelled"
        );
    }

    // ============================================================
    // AUTOMATIC POLLING
    // ============================================================

    private void ScheduleNextPoll()
    {
        if (pollScheduled)
            return;

        GH_Document document =
            Component.OnPingDocument();

        if (document == null)
            return;

        pollScheduled = true;

        document.ScheduleSolution(
            PollIntervalMilliseconds,
            scheduledDocument =>
            {
                pollScheduled = false;

                if (Component != null)
                {
                    Component.ExpireSolution(
                        false
                    );
                }
            }
        );
    }

    // ============================================================
    // READY EVENT PARSING
    // ============================================================

    private ReadyEventData ParseReadyEvent(
        string readyEvent)
    {
        string eventName =
            ExtractJsonValue(
                readyEvent,
                "event"
            );

        string eventStatus =
            NormalizeStatus(
                ExtractJsonValue(
                    readyEvent,
                    "status"
                )
            );

        if (
            !string.Equals(
                eventName,
                "local_output_ready",
                StringComparison.OrdinalIgnoreCase))
        {
            return null;
        }

        if (eventStatus != "ready")
        {
            return null;
        }

        ReadyEventData result =
            new ReadyEventData();

        result.EventId =
            ExtractJsonValue(
                readyEvent,
                "event_id"
            );

        result.Session =
            ExtractJsonValue(
                readyEvent,
                "session"
            );

        result.Domain =
            NormalizeStatus(
                ExtractJsonValue(
                    readyEvent,
                    "domain"
                )
            );

        result.OutputIndex =
            ParseInteger(
                ExtractJsonValue(
                    readyEvent,
                    "output_index"
                ),
                0
            );

        result.LocalPath =
            ExtractJsonValue(
                readyEvent,
                "local_path"
            );

        result.Category =
            ExtractJsonValue(
                readyEvent,
                "category"
            );

        return result;
    }

    private void ValidateReadyEvent(
        ReadyEventData eventData)
    {
        if (eventData == null)
        {
            throw new ArgumentException(
                "ReadyEvent could not be parsed."
            );
        }

        if (string.IsNullOrWhiteSpace(
            eventData.EventId))
        {
            throw new ArgumentException(
                "ReadyEvent is missing event_id."
            );
        }

        if (string.IsNullOrWhiteSpace(
            eventData.Session))
        {
            throw new ArgumentException(
                "ReadyEvent is missing session."
            );
        }

        if (string.IsNullOrWhiteSpace(
            eventData.Domain))
        {
            throw new ArgumentException(
                "ReadyEvent is missing domain."
            );
        }

        if (eventData.OutputIndex < 1)
        {
            throw new ArgumentException(
                "ReadyEvent output_index must be at least 1."
            );
        }

        if (string.IsNullOrWhiteSpace(
            eventData.LocalPath))
        {
            throw new ArgumentException(
                "ReadyEvent is missing local_path."
            );
        }
    }

    // ============================================================
    // CONNECTION
    // ============================================================

    private void ConnectionFailure(
        string message)
    {
        isConnected = false;
        triedConnection = true;

        lastState = "Connection error";
        lastStatus = "connection_failed";
        lastMessage = message;
    }

    private string SendCommand(
        string command)
    {
        try
        {
            using (
                TcpClient client =
                    new TcpClient())
            {
                IAsyncResult connection =
                    client.BeginConnect(
                        GhAgentHost,
                        GhAgentPort,
                        null,
                        null
                    );

                bool connected =
                    connection.AsyncWaitHandle.WaitOne(
                        TimeSpan.FromMilliseconds(
                            500
                        )
                    );

                if (!connected)
                {
                    return
                        "ERROR: GH Agent connection timeout.";
                }

                client.EndConnect(connection);

                using (
                    NetworkStream stream =
                        client.GetStream())
                {
                    byte[] payload =
                        Encoding.UTF8.GetBytes(
                            command
                        );

                    byte[] header =
                        BuildHeader(
                            payload.Length
                        );

                    stream.Write(
                        header,
                        0,
                        header.Length
                    );

                    stream.Write(
                        payload,
                        0,
                        payload.Length
                    );

                    byte[] responseHeader =
                        ReadExact(
                            stream,
                            MessageHeaderSize
                        );

                    ulong responseSize =
                        ParseHeader(
                            responseHeader
                        );

                    if (responseSize > int.MaxValue)
                    {
                        return
                            "ERROR: GH Agent response is too large.";
                    }

                    byte[] responsePayload =
                        ReadExact(
                            stream,
                            (int)responseSize
                        );

                    return Encoding.UTF8.GetString(
                        responsePayload
                    );
                }
            }
        }
        catch (Exception exception)
        {
            return
                "ERROR: " +
                exception.Message;
        }
    }

    private byte[] BuildHeader(
        int payloadSize)
    {
        byte[] header =
            new byte[MessageHeaderSize];

        ulong size =
            (ulong)payloadSize;

        for (
            int index = 0;
            index < MessageHeaderSize;
            index++)
        {
            header[
                MessageHeaderSize - 1 - index
            ] = (byte)(size & 0xFF);

            size >>= 8;
        }

        return header;
    }

    private ulong ParseHeader(
        byte[] header)
    {
        ulong size = 0;

        for (
            int index = 0;
            index < header.Length;
            index++)
        {
            size =
                (size << 8) +
                header[index];
        }

        return size;
    }

    private byte[] ReadExact(
        NetworkStream stream,
        int size)
    {
        byte[] data =
            new byte[size];

        int offset = 0;

        while (offset < size)
        {
            int read =
                stream.Read(
                    data,
                    offset,
                    size - offset
                );

            if (read == 0)
            {
                throw new InvalidOperationException(
                    "Connection closed before the response was complete."
                );
            }

            offset += read;
        }

        return data;
    }

    // ============================================================
    // JSON HELPERS
    // ============================================================

    private string ExtractMasterResponse(
        string resultJson)
    {
        if (string.IsNullOrWhiteSpace(resultJson))
        {
            return "";
        }

        string masterResponse =
            ExtractJsonObject(
                resultJson,
                "master_response"
            );

        return string.IsNullOrWhiteSpace(
            masterResponse)
            ? resultJson
            : masterResponse;
    }

    private string GetResponseMessage(
        string json,
        string fallback)
    {
        string message =
            ExtractJsonValue(
                json,
                "message"
            );

        return string.IsNullOrWhiteSpace(message)
            ? fallback
            : message;
    }

    private string NormalizeStatus(
        string value)
    {
        return string.IsNullOrWhiteSpace(value)
            ? ""
            : value.Trim().ToLowerInvariant();
    }

    private int ParseInteger(
        string value,
        int fallback)
    {
        int parsedInteger;

        if (
            int.TryParse(
                value,
                NumberStyles.Integer,
                CultureInfo.InvariantCulture,
                out parsedInteger))
        {
            return parsedInteger;
        }

        double parsedDouble;

        if (
            double.TryParse(
                value,
                NumberStyles.Float,
                CultureInfo.InvariantCulture,
                out parsedDouble))
        {
            return (int)Math.Round(parsedDouble);
        }

        return fallback;
    }

    private string EscapeJson(
        string value)
    {
        if (value == null)
            return "";

        return value
            .Replace("\\", "\\\\")
            .Replace("\"", "\\\"")
            .Replace("\r", "\\r")
            .Replace("\n", "\\n")
            .Replace("\t", "\\t");
    }

    private string ExtractJsonValue(
        string json,
        string key)
    {
        if (string.IsNullOrWhiteSpace(json))
            return "";

        string pattern =
            "\"" + key + "\":";

        int start =
            json.IndexOf(
                pattern,
                StringComparison.Ordinal
            );

        if (start < 0)
            return "";

        start += pattern.Length;

        while (
            start < json.Length &&
            char.IsWhiteSpace(json[start]))
        {
            start++;
        }

        if (start >= json.Length)
            return "";

        if (json[start] == '"')
        {
            start++;

            StringBuilder value =
                new StringBuilder();

            bool escaped = false;

            for (
                int index = start;
                index < json.Length;
                index++)
            {
                char character =
                    json[index];

                if (escaped)
                {
                    switch (character)
                    {
                        case 'n':
                            value.Append('\n');
                            break;

                        case 'r':
                            value.Append('\r');
                            break;

                        case 't':
                            value.Append('\t');
                            break;

                        case '\\':
                            value.Append('\\');
                            break;

                        case '"':
                            value.Append('"');
                            break;

                        default:
                            value.Append(character);
                            break;
                    }

                    escaped = false;
                    continue;
                }

                if (character == '\\')
                {
                    escaped = true;
                    continue;
                }

                if (character == '"')
                {
                    return value.ToString();
                }

                value.Append(character);
            }

            return "";
        }

        if (
            json.Substring(start)
                .StartsWith(
                    "null",
                    StringComparison.Ordinal))
        {
            return "";
        }

        int end = start;

        while (
            end < json.Length &&
            json[end] != ',' &&
            json[end] != '}')
        {
            end++;
        }

        return json
            .Substring(
                start,
                end - start
            )
            .Trim();
    }

    private string ExtractJsonObject(
        string json,
        string key)
    {
        if (string.IsNullOrWhiteSpace(json))
            return "";

        string pattern =
            "\"" + key + "\":";

        int keyIndex =
            json.IndexOf(
                pattern,
                StringComparison.Ordinal
            );

        if (keyIndex < 0)
            return "";

        int start =
            keyIndex +
            pattern.Length;

        while (
            start < json.Length &&
            char.IsWhiteSpace(json[start]))
        {
            start++;
        }

        if (
            start >= json.Length ||
            json[start] != '{')
        {
            return "";
        }

        int depth = 0;
        bool insideString = false;
        bool escaped = false;

        for (
            int index = start;
            index < json.Length;
            index++)
        {
            char character =
                json[index];

            if (insideString)
            {
                if (escaped)
                {
                    escaped = false;
                }
                else if (character == '\\')
                {
                    escaped = true;
                }
                else if (character == '"')
                {
                    insideString = false;
                }

                continue;
            }

            if (character == '"')
            {
                insideString = true;
                continue;
            }

            if (character == '{')
            {
                depth++;
            }
            else if (character == '}')
            {
                depth--;

                if (depth == 0)
                {
                    return json.Substring(
                        start,
                        index - start + 1
                    );
                }
            }
        }

        return "";
    }

    private string GetActiveDomainLabel()
    {
        if (
            string.Equals(
                activeDomain,
                "motion",
                StringComparison.OrdinalIgnoreCase
            )
        )
        {
            return "Motion";
        }

        if (
            string.Equals(
                activeDomain,
                "design",
                StringComparison.OrdinalIgnoreCase
            )
        )
        {
            return "Design";
        }

        return "Output";
    }

    // ============================================================
    // OUTPUTS
    // ============================================================

    private void SetOutputs(
        ref object State,
        ref object Status,
        ref object Message,
        ref object UploadJobId,
        ref object Progress,
        ref object Session,
        ref object OutputIndex,
        ref object MasterResponse)
    {
        State = lastState;
        Status = lastStatus;
        Message = lastMessage;
        UploadJobId = activeUploadJobId;
        Progress = lastProgress;
        Session = activeSession;
        OutputIndex = activeOutputIndex;
        MasterResponse = lastMasterResponse;
    }

    private class ReadyEventData
    {
        public string EventId;
        public string Session;
        public string Domain;
        public int OutputIndex;
        public string LocalPath;
        public string Category;
    }
}
# ---------- end c_script_8 ----------
panel_38 = Panel(c_script_8.State)
panel_39 = Panel(c_script_8.Status)
panel_40 = Panel(c_script_8.Message)
panel_41 = Panel(c_script_8.UploadJobId)
panel_42 = Panel(c_script_8.Progress)
panel_43 = Panel(c_script_8.Session)
panel_44 = Panel(c_script_8.OutputIndex)
panel_45 = Panel(c_script_8.MasterResponse)
