# Grasshopper definition communication_test_00.gh (Grasshopper 1.0.8)

panel = Panel("{\"command\":\"forward\",\"payload\":{\"command\":\"get_status\",\"job_id\":\"862623f2-a384-43f4-99bf-61f6c8c0335b\"}}")

panel_2 = Panel("base")
panel_3 = Panel("1")
panel_5 = Panel("all")
panel_6 = Panel("eye_to_base")
panel_7 = Panel("2")
panel_8 = Panel("8")

pt = ConstructPoint(XCoordinate=0, YCoordinate=0, ZCoordinate=0)
pt_2 = ConstructPoint(XCoordinate=Slider(100, range=0..100), YCoordinate=0, ZCoordinate=0)

connect = BooleanToggle(False)
submit_workflow = Button()
sequence = ValueList({"capture_transform_process_download", "transform_process_download"}, selected="transform_process_download")
refresh_status = BooleanToggle(False)
c_script = CSharpScript(ConnectButton=connect, SubmitWorkflow=submit_workflow, Sequence=sequence, RefreshStatus=refresh_status)  # -> CaptureTrigger, TransformTrigger, ProcessTrigger, DownloadTrigger, WorkflowState, Status, Message; inputs ConnectButton: Boolean, SubmitWorkflow: Boolean, Sequence: String, RefreshStatus: Boolean
# ---------- c_script: C# ----------
// Grasshopper Script Instance
#region Usings
using System;
using System.Text;
using System.Net.Sockets;
using System.Collections.Generic;
using System.Linq;

using Rhino;
using Rhino.Geometry;

using Grasshopper;
using Grasshopper.Kernel;
using Grasshopper.Kernel.Data;
using Grasshopper.Kernel.Types;
#endregion

public class Script_Instance : GH_ScriptInstance
{
    // ------------------------------------------------------------
    // Connection state
    // ------------------------------------------------------------

    private bool isConnected = false;
    private bool triedConnect = false;

    private string lastStatus = "Disconnected";
    private string lastMessage = "Enable ConnectButton.";

    // ------------------------------------------------------------
    // Input edge detection
    // ------------------------------------------------------------

    private bool previousSubmitWorkflow = false;

    // ------------------------------------------------------------
    // Workflow state
    // ------------------------------------------------------------

    private enum WorkflowStage
    {
        Idle,
        Capture,
        Transform,
        Process,
        Download,
        Finished,
        Failed
    }

    private WorkflowStage currentStage =
        WorkflowStage.Idle;

    private List<WorkflowStage> activeSequence =
        new List<WorkflowStage>();

    private int sequencePosition = -1;

    /*
     * Prevents a stale "finished" status from the previous stage
     * from immediately completing the newly triggered stage.
     */
    private bool currentStageHasStarted = false;

    /*
     * The latest global job ID observed before triggering the
     * current stage. A new stage should produce a different job ID.
     */
    private string stagePreviousJobId = "";

    private string currentObservedJobId = "";
    private string currentObservedStatus = "";
    private string currentObservedMessage = "";

    private void RunScript(
		bool ConnectButton,
		bool SubmitWorkflow,
		string Sequence,
		bool RefreshStatus,
		ref object CaptureTrigger,
		ref object TransformTrigger,
		ref object ProcessTrigger,
		ref object DownloadTrigger,
		ref object WorkflowState,
		ref object Status,
		ref object Message)
    {
        string host = "127.0.0.1";
        int port = 6005;

        // Triggers are pulses and must reset every solution.
        bool capturePulse = false;
        bool transformPulse = false;
        bool processPulse = false;
        bool downloadPulse = false;

        bool submitPulse =
            SubmitWorkflow &&
            !previousSubmitWorkflow;

        previousSubmitWorkflow =
            SubmitWorkflow;

        // --------------------------------------------------------
        // Connection handling
        // --------------------------------------------------------

        if (!ConnectButton)
        {
            isConnected = false;
            triedConnect = false;

            lastStatus = "Disconnected";
            lastMessage = "Connection toggle is off.";

            CaptureTrigger = false;
            TransformTrigger = false;
            ProcessTrigger = false;
            DownloadTrigger = false;

            WorkflowState = BuildWorkflowStateText();
            Status = lastStatus;
            Message = lastMessage;
            return;
        }

        if (
            ConnectButton &&
            !isConnected &&
            !triedConnect)
        {
            triedConnect = true;

            string response = SendCommand(
                host,
                port,
                "{\"command\":\"ping\"}"
            );

            if (response.StartsWith("ERROR:"))
            {
                isConnected = false;
                lastStatus = "Connection failed";
                lastMessage = response;
            }
            else
            {
                isConnected = true;
                lastStatus = "Connected";
                lastMessage = ExtractJsonValue(
                    response,
                    "message"
                );

                if (string.IsNullOrWhiteSpace(lastMessage))
                    lastMessage = response;
            }
        }

        if (!isConnected)
        {
            CaptureTrigger = false;
            TransformTrigger = false;
            ProcessTrigger = false;
            DownloadTrigger = false;

            WorkflowState = BuildWorkflowStateText();
            Status = lastStatus;
            Message = lastMessage;
            return;
        }

        // --------------------------------------------------------
        // Submit a new workflow
        // --------------------------------------------------------

        if (submitPulse)
        {
            activeSequence = BuildSequence(
                Sequence
            );

            if (activeSequence.Count == 0)
            {
                currentStage = WorkflowStage.Failed;
                sequencePosition = -1;
                currentStageHasStarted = false;

                lastStatus = "Workflow rejected";
                lastMessage =
                    "Unknown workflow sequence: " +
                    Sequence;
            }
            else
            {
                sequencePosition = 0;
                currentStage =
                    activeSequence[sequencePosition];

                currentStageHasStarted = false;

                /*
                 * Remember the currently known global job ID.
                 * The newly triggered component should submit a new
                 * job and replace it.
                 */
                stagePreviousJobId =
                    currentObservedJobId;

                EmitTriggerForStage(
                    currentStage,
                    ref capturePulse,
                    ref transformPulse,
                    ref processPulse,
                    ref downloadPulse
                );

                lastStatus = "Workflow started";
                lastMessage =
                    "Triggered stage: " +
                    currentStage.ToString();
            }
        }

        // --------------------------------------------------------
        // Poll the global GH-Agent status
        // --------------------------------------------------------

        if (RefreshStatus)
        {
            string statusResponse = SendCommand(
                host,
                port,
                "{\"command\":\"get_latest_status\"}"
            );

            if (statusResponse.StartsWith("ERROR:"))
            {
                isConnected = false;
                triedConnect = true;

                lastStatus = "Connection lost";
                lastMessage = statusResponse;
            }
            else
            {
                string outerStatus = ExtractJsonValue(
                    statusResponse,
                    "status"
                );

                if (
                    !string.Equals(
                        outerStatus,
                        "ok",
                        StringComparison.OrdinalIgnoreCase
                    )
                )
                {
                    lastStatus = "Status request failed";

                    string errorMessage =
                        ExtractJsonValue(
                            statusResponse,
                            "message"
                        );

                    lastMessage =
                        string.IsNullOrWhiteSpace(errorMessage)
                        ? statusResponse
                        : errorMessage;
                }
                else
                {
                    currentObservedJobId =
                        ExtractJsonValue(
                            statusResponse,
                            "latest_job_id"
                        );

                    currentObservedStatus =
                        NormalizeStatus(
                            ExtractJsonValue(
                                statusResponse,
                                "latest_job_status"
                            )
                        );

                    currentObservedMessage =
                        ExtractJsonValue(
                            statusResponse,
                            "latest_message"
                        );

                    lastStatus =
                        string.IsNullOrWhiteSpace(
                            currentObservedStatus
                        )
                        ? "Connected"
                        : currentObservedStatus;

                    lastMessage =
                        string.IsNullOrWhiteSpace(
                            currentObservedMessage
                        )
                        ? statusResponse
                        : currentObservedMessage;

                    if (IsWorkflowRunning())
                    {
                        EvaluateWorkflowStatus(
                            ref capturePulse,
                            ref transformPulse,
                            ref processPulse,
                            ref downloadPulse
                        );
                    }
                }
            }
        }

        CaptureTrigger = capturePulse;
        TransformTrigger = transformPulse;
        ProcessTrigger = processPulse;
        DownloadTrigger = downloadPulse;

        WorkflowState = BuildWorkflowStateText();
        Status = lastStatus;
        Message = lastMessage;
    }

    // ------------------------------------------------------------
    // Workflow evaluation
    // ------------------------------------------------------------

    private void EvaluateWorkflowStatus(
        ref bool capturePulse,
        ref bool transformPulse,
        ref bool processPulse,
        ref bool downloadPulse)
    {
        /*
         * Do not treat the old stage's job as the newly triggered
         * stage. A new job should have a different job ID.
         */
        bool newJobObserved =
            !string.IsNullOrWhiteSpace(
                currentObservedJobId
            ) &&
            !string.Equals(
                currentObservedJobId,
                stagePreviousJobId,
                StringComparison.OrdinalIgnoreCase
            );

        if (!currentStageHasStarted)
        {
            if (
                newJobObserved &&
                IsStartedStatus(
                    currentObservedStatus,
                    currentStage
                )
            )
            {
                currentStageHasStarted = true;
            }

            /*
             * Very fast jobs may move directly from submission to
             * finished before the manager observes running.
             * A changed job ID confirms that it belongs to this stage.
             */
            else if (
                newJobObserved &&
                IsFinishedStatus(
                    currentObservedStatus,
                    currentStage
                )
            )
            {
                currentStageHasStarted = true;

                AdvanceWorkflow(
                    ref capturePulse,
                    ref transformPulse,
                    ref processPulse,
                    ref downloadPulse
                );
            }

            else if (
                newJobObserved &&
                IsFailureStatus(
                    currentObservedStatus
                )
            )
            {
                FailWorkflow();
            }

            return;
        }

        if (
            IsFailureStatus(
                currentObservedStatus
            )
        )
        {
            FailWorkflow();
            return;
        }

        if (
            IsFinishedStatus(
                currentObservedStatus,
                currentStage
            )
        )
        {
            AdvanceWorkflow(
                ref capturePulse,
                ref transformPulse,
                ref processPulse,
                ref downloadPulse
            );
        }
    }

    private void AdvanceWorkflow(
        ref bool capturePulse,
        ref bool transformPulse,
        ref bool processPulse,
        ref bool downloadPulse)
    {
        sequencePosition++;

        if (
            sequencePosition >=
            activeSequence.Count)
        {
            currentStage =
                WorkflowStage.Finished;

            currentStageHasStarted = false;

            lastStatus = "Workflow finished";
            lastMessage =
                "All requested workflow stages completed.";

            return;
        }

        currentStage =
            activeSequence[sequencePosition];

        currentStageHasStarted = false;

        /*
         * The current global job ID belongs to the completed stage.
         * The next trigger should create a different one.
         */
        stagePreviousJobId =
            currentObservedJobId;

        EmitTriggerForStage(
            currentStage,
            ref capturePulse,
            ref transformPulse,
            ref processPulse,
            ref downloadPulse
        );

        lastStatus = "Stage triggered";
        lastMessage =
            "Triggered stage: " +
            currentStage.ToString();
    }

    private void FailWorkflow()
    {
        currentStage =
            WorkflowStage.Failed;

        currentStageHasStarted = false;

        lastStatus = "Workflow failed";

        lastMessage =
            string.IsNullOrWhiteSpace(
                currentObservedMessage
            )
            ? (
                "Stage failed: " +
                currentObservedStatus
            )
            : currentObservedMessage;
    }

    // ------------------------------------------------------------
    // Trigger generation
    // ------------------------------------------------------------

    private void EmitTriggerForStage(
        WorkflowStage stage,
        ref bool capturePulse,
        ref bool transformPulse,
        ref bool processPulse,
        ref bool downloadPulse)
    {
        switch (stage)
        {
            case WorkflowStage.Capture:
                capturePulse = true;
                break;

            case WorkflowStage.Transform:
                transformPulse = true;
                break;

            case WorkflowStage.Process:
                processPulse = true;
                break;

            case WorkflowStage.Download:
                downloadPulse = true;
                break;
        }
    }

    // ------------------------------------------------------------
    // Sequence selection
    // ------------------------------------------------------------

    private List<WorkflowStage> BuildSequence(
        string sequence)
    {
        string normalized =
            string.IsNullOrWhiteSpace(sequence)
            ? "capture_transform_process_download"
            : sequence
                .Trim()
                .ToLowerInvariant()
                .Replace(" ", "_")
                .Replace("-", "_")
                .Replace(">", "_")
                .Replace(",", "_");

        while (normalized.Contains("__"))
        {
            normalized =
                normalized.Replace("__", "_");
        }

        if (
            normalized == "full" ||
            normalized ==
            "capture_transform_process_download")
        {
            return new List<WorkflowStage>
            {
                WorkflowStage.Capture,
                WorkflowStage.Transform,
                WorkflowStage.Process,
                WorkflowStage.Download
            };
        }

        if (
            normalized == "skip_capture" ||
            normalized ==
            "transform_process_download")
        {
            return new List<WorkflowStage>
            {
                WorkflowStage.Transform,
                WorkflowStage.Process,
                WorkflowStage.Download
            };
        }

        return new List<WorkflowStage>();
    }

    // ------------------------------------------------------------
    // Status interpretation
    // ------------------------------------------------------------

    private string NormalizeStatus(
        string status)
    {
        return string.IsNullOrWhiteSpace(status)
            ? ""
            : status.Trim().ToLowerInvariant();
    }

    private bool IsStartedStatus(
        string status,
        WorkflowStage stage)
    {
        if (stage == WorkflowStage.Download)
        {
            return (
                status == "download_queued" ||
                status == "download_running"
            );
        }

        return (
            status == "submitted" ||
            status == "queued" ||
            status == "running"
        );
    }

    private bool IsFinishedStatus(
        string status,
        WorkflowStage stage)
    {
        if (stage == WorkflowStage.Download)
        {
            return status ==
                "download_finished";
        }

        return status == "finished";
    }

    private bool IsFailureStatus(
        string status)
    {
        return (
            status == "failed" ||
            status == "error" ||
            status == "cancelled" ||
            status == "download_failed"
        );
    }

    private bool IsWorkflowRunning()
    {
        return (
            currentStage == WorkflowStage.Capture ||
            currentStage == WorkflowStage.Transform ||
            currentStage == WorkflowStage.Process ||
            currentStage == WorkflowStage.Download
        );
    }

    // ------------------------------------------------------------
    // Workflow-state output
    // ------------------------------------------------------------

    private string BuildWorkflowStateText()
    {
        if (currentStage == WorkflowStage.Idle)
        {
            return "Idle";
        }

        if (currentStage == WorkflowStage.Finished)
        {
            return "Finished";
        }

        if (currentStage == WorkflowStage.Failed)
        {
            return (
                "Failed | Stage: " +
                GetCurrentSequenceStageName()
            );
        }

        string phase =
            currentStageHasStarted
            ? "Running"
            : "Waiting for stage start";

        return (
            phase +
            " | Stage: " +
            currentStage.ToString() +
            " | Step: " +
            (sequencePosition + 1).ToString() +
            "/" +
            activeSequence.Count.ToString() +
            " | Job: " +
            (
                string.IsNullOrWhiteSpace(
                    currentObservedJobId
                )
                ? "(none)"
                : currentObservedJobId
            )
        );
    }

    private string GetCurrentSequenceStageName()
    {
        if (
            sequencePosition >= 0 &&
            sequencePosition <
            activeSequence.Count)
        {
            return activeSequence[
                sequencePosition
            ].ToString();
        }

        return currentStage.ToString();
    }

    // ------------------------------------------------------------
    // TCP communication
    // ------------------------------------------------------------

    private string SendCommand(
        string host,
        int port,
        string command)
    {
        const int headerSize = 8;

        try
        {
            using (
                TcpClient client =
                    new TcpClient())
            {
                IAsyncResult result =
                    client.BeginConnect(
                        host,
                        port,
                        null,
                        null
                    );

                bool success =
                    result.AsyncWaitHandle.WaitOne(
                        TimeSpan.FromMilliseconds(
                            300
                        )
                    );

                if (!success)
                {
                    return
                        "ERROR: GH Agent connection timeout.";
                }

                client.EndConnect(result);

                using (
                    NetworkStream stream =
                        client.GetStream())
                {
                    byte[] payload =
                        Encoding.UTF8.GetBytes(
                            command
                        );

                    byte[] header =
                        new byte[headerSize];

                    ulong size =
                        (ulong)payload.Length;

                    for (
                        int i = 0;
                        i < headerSize;
                        i++)
                    {
                        header[
                            headerSize - 1 - i
                        ] = (byte)(
                            size & 0xFF
                        );

                        size >>= 8;
                    }

                    stream.Write(
                        header,
                        0,
                        header.Length
                    );

                    stream.Write(
                        payload,
                        0,
                        payload.Length
                    );

                    byte[] responseHeader =
                        ReadExact(
                            stream,
                            headerSize
                        );

                    ulong responseSize = 0;

                    for (
                        int i = 0;
                        i < headerSize;
                        i++)
                    {
                        responseSize =
                            (
                                responseSize << 8
                            ) +
                            responseHeader[i];
                    }

                    if (
                        responseSize >
                        int.MaxValue)
                    {
                        return
                            "ERROR: Agent response is too large.";
                    }

                    byte[] responsePayload =
                        ReadExact(
                            stream,
                            (int)responseSize
                        );

                    return Encoding.UTF8.GetString(
                        responsePayload
                    );
                }
            }
        }
        catch (Exception exception)
        {
            return (
                "ERROR: " +
                exception.Message
            );
        }
    }

    private byte[] ReadExact(
        NetworkStream stream,
        int size)
    {
        byte[] data =
            new byte[size];

        int offset = 0;

        while (offset < size)
        {
            int read = stream.Read(
                data,
                offset,
                size - offset
            );

            if (read == 0)
            {
                throw new Exception(
                    "Connection closed."
                );
            }

            offset += read;
        }

        return data;
    }

    // ------------------------------------------------------------
    // JSON helpers
    // ------------------------------------------------------------

    private string ExtractJsonValue(
        string json,
        string key)
    {
        if (string.IsNullOrWhiteSpace(json))
            return "";

        string pattern =
            "\"" + key + "\":";

        int start = json.IndexOf(
            pattern,
            StringComparison.Ordinal
        );

        if (start < 0)
            return "";

        start += pattern.Length;

        while (
            start < json.Length &&
            char.IsWhiteSpace(json[start]))
        {
            start++;
        }

        if (start >= json.Length)
            return "";

        if (json[start] == '"')
        {
            start++;

            StringBuilder value =
                new StringBuilder();

            bool escaped = false;

            for (
                int i = start;
                i < json.Length;
                i++)
            {
                char character = json[i];

                if (escaped)
                {
                    switch (character)
                    {
                        case 'n':
                            value.Append('\n');
                            break;

                        case 'r':
                            value.Append('\r');
                            break;

                        case 't':
                            value.Append('\t');
                            break;

                        case '\\':
                            value.Append('\\');
                            break;

                        case '"':
                            value.Append('"');
                            break;

                        default:
                            value.Append(character);
                            break;
                    }

                    escaped = false;
                    continue;
                }

                if (character == '\\')
                {
                    escaped = true;
                    continue;
                }

                if (character == '"')
                {
                    return value.ToString();
                }

                value.Append(character);
            }

            return "";
        }

        int end = start;

        while (
            end < json.Length &&
            json[end] != ',' &&
            json[end] != '}')
        {
            end++;
        }

        return json.Substring(
            start,
            end - start
        ).Trim();
    }
}
# ---------- end c_script ----------
trigger = Trigger(Interval=1000, TimerInterval=1000, Target=[c_script_17, c_script_18, c_script])  # disabled
panel_9 = Panel(c_script.Status)
panel_10 = Panel(c_script.Message)
panel_11 = Panel(c_script.WorkflowState)

# ---- group: Capture & Transform
connect_2 = BooleanToggle(False)
capture = Button()
transform = Button()
capture_index = ValueList({"1", "2", "3", "4", "5"}, selected="2")
mode = ValueList({"pointcloud", "image", "depth", "all"}, selected="all")
pipeline = ValueList({"base", "ref_cam", "eye_to_base"}, selected="eye_to_base")
eye_to_base_index = ValueList({"1", "2", "3"}, selected="1")
reference_index = ValueList({"1", "2", "3"}, selected="2")
output_index = ValueList({"1", "2", "3", "4", "5", "6", "7", "8", "9", "10"}, selected="2")
refresh_status_2 = BooleanToggle(False)
panel_12 = Panel("RT_Test_00")
c_script_2 = CSharpScript(
    ConnectButton=connect_2,
    CaptureButton=capture,
    TransformButton=transform,
    SessionName=panel_12,
    CaptureIndex=capture_index,
    Mode=mode,
    Pipeline=pipeline,
    EyeToBaseIndex=eye_to_base_index,
    ReferenceIndex=reference_index,
    OutputIndex=output_index,
    RefreshStatus=refresh_status_2)  # -> Status, Message; inputs ConnectButton: Boolean, CaptureButton: Boolean, TransformButton: Boolean, SessionName: String, CaptureIndex: Int32, Mode: String, Pipeline: String, EyeToBaseIndex: Int32, ReferenceIndex: Int32, OutputIndex: Int32, RefreshStatus: Boolean
# ---------- c_script_2: C# ----------
// Grasshopper Script Instance
#region Usings
using System;
using System.Text;
using System.Net.Sockets;
using System.Linq;
using System.Collections;
using System.Collections.Generic;
using System.Drawing;

using Rhino;
using Rhino.Geometry;

using Grasshopper;
using Grasshopper.Kernel;
using Grasshopper.Kernel.Data;
using Grasshopper.Kernel.Types;
#endregion

public class Script_Instance : GH_ScriptInstance
{
    private bool previousCaptureButton = false;
    private bool previousTransformButton = false;

    private bool isConnected = false;
    private bool triedConnect = false;

    private string lastStatus = "Disconnected";
    private string lastMessage = "Click Connect first.";

    private void RunScript(
		bool ConnectButton,
		bool CaptureButton,
		bool TransformButton,
		string SessionName,
		int CaptureIndex,
		string Mode,
		string Pipeline,
		int EyeToBaseIndex,
		int ReferenceIndex,
		int OutputIndex,
		bool RefreshStatus,
		ref object Status,
		ref object Message)
    {
        string host = "127.0.0.1";
        int port = 6005;

        bool triggerCapture = CaptureButton && !previousCaptureButton;
        previousCaptureButton = CaptureButton;

        bool triggerTransform = TransformButton && !previousTransformButton;
        previousTransformButton = TransformButton;

        if (!ConnectButton)
        {
            isConnected = false;
            triedConnect = false;
            lastStatus = "Disconnected";
            lastMessage = "Connection toggle is off.";
            Status = lastStatus;
            Message = lastMessage;
            return;
        }

        if (ConnectButton && !isConnected && !triedConnect)
        {
            triedConnect = true;

            string response = SendCommand(
                host,
                port,
                "{\"command\":\"ping\"}"
            );

            if (response.StartsWith("ERROR:"))
            {
                isConnected = false;
                lastStatus = "Connection failed";
                lastMessage = response;
            }
            else
            {
                isConnected = true;
                lastStatus = "Connected";
                lastMessage = response;
            }
        }

        if (!isConnected)
        {
            Status = lastStatus;
            Message = lastMessage;
            return;
        }

        if (triggerCapture)
        {
            string session = string.IsNullOrWhiteSpace(SessionName)
                ? "RQC_Capture_Session"
                : SessionName;

            string mode = string.IsNullOrWhiteSpace(Mode)
                ? "all"
                : Mode;

            string capturePayload =
                "{\"command\":\"forward\",\"payload\":{" +
                "\"command\":\"capture\"," +
                "\"session\":\"" + EscapeJson(session) + "\"," +
                "\"camera_index\":0," +
                "\"capture_index\":" + CaptureIndex.ToString() + "," +
                "\"mode\":\"" + EscapeJson(mode) + "\"" +
                "}}";

            string response = SendCommand(host, port, capturePayload);

            if (response.StartsWith("ERROR:"))
            {
                lastStatus = "Capture submit failed";
                lastMessage = response;
            }
            else
            {
                lastStatus = "Capture submitted";
                lastMessage = response;
            }
        }

        if (triggerTransform)
        {
            string session = string.IsNullOrWhiteSpace(SessionName)
                ? "RQC_Capture_Session"
                : SessionName;

            string pipeline = string.IsNullOrWhiteSpace(Pipeline)
                ? "eye_to_base"
                : Pipeline;

            string transformPayload =
                "{\"command\":\"forward\",\"payload\":{" +
                "\"command\":\"transform\"," +
                "\"session\":\"" + EscapeJson(session) + "\"," +
                "\"pipeline\":\"" + EscapeJson(pipeline) + "\"," +
                "\"eye_to_base_index\":" + EyeToBaseIndex.ToString() + "," +
                "\"reference_index\":" + ReferenceIndex.ToString() + "," +
                "\"output_index\":" + OutputIndex.ToString() +
                "}}";

            string response = SendCommand(host, port, transformPayload);

            if (response.StartsWith("ERROR:"))
            {
                lastStatus = "Transform submit failed";
                lastMessage = response;
            }
            else
            {
                lastStatus = "Transform submitted";
                lastMessage = response;
            }
        }

        if (RefreshStatus)
        {
            string statusPayload = "{\"command\":\"get_latest_status\"}";
            string response = SendCommand(host, port, statusPayload);

            if (response.StartsWith("ERROR:"))
            {
                isConnected = false;
                triedConnect = true;
                lastStatus = "Connection lost";
                lastMessage = response;
            }
            else
            {
                string status = ExtractJsonValue(response, "latest_job_status");
                string message = ExtractJsonValue(response, "latest_message");

                lastStatus = string.IsNullOrWhiteSpace(status)
                    ? "Connected"
                    : status;

                lastMessage = string.IsNullOrWhiteSpace(message)
                    ? response
                    : message;
            }
        }

        Status = lastStatus;
        Message = lastMessage;
    }

    private string SendCommand(string host, int port, string command)
    {
        int headerSize = 8;

        try
        {
            using (TcpClient client = new TcpClient())
            {
                IAsyncResult result = client.BeginConnect(host, port, null, null);

                bool success = result.AsyncWaitHandle.WaitOne(
                    TimeSpan.FromMilliseconds(300)
                );

                if (!success)
                    return "ERROR: GH Agent connection timeout.";

                client.EndConnect(result);

                using (NetworkStream stream = client.GetStream())
                {
                    byte[] payload = Encoding.UTF8.GetBytes(command);

                    byte[] header = new byte[headerSize];
                    ulong size = (ulong)payload.Length;

                    for (int i = 0; i < headerSize; i++)
                    {
                        header[headerSize - 1 - i] = (byte)(size & 0xFF);
                        size >>= 8;
                    }

                    stream.Write(header, 0, header.Length);
                    stream.Write(payload, 0, payload.Length);

                    byte[] responseHeader = ReadExact(stream, headerSize);

                    ulong responseSize = 0;
                    for (int i = 0; i < headerSize; i++)
                    {
                        responseSize = (responseSize << 8) + responseHeader[i];
                    }

                    byte[] responsePayload = ReadExact(stream, (int)responseSize);
                    return Encoding.UTF8.GetString(responsePayload);
                }
            }
        }
        catch (Exception e)
        {
            return "ERROR: " + e.Message;
        }
    }

    private byte[] ReadExact(NetworkStream stream, int size)
    {
        byte[] data = new byte[size];
        int offset = 0;

        while (offset < size)
        {
            int read = stream.Read(data, offset, size - offset);

            if (read == 0)
                throw new Exception("Connection closed.");

            offset += read;
        }

        return data;
    }

    private string EscapeJson(string value)
    {
        if (value == null)
            return "";

        return value
            .Replace("\\", "\\\\")
            .Replace("\"", "\\\"");
    }

    private string ExtractJsonValue(string json, string key)
    {
        string pattern = "\"" + key + "\":";
        int start = json.IndexOf(pattern);

        if (start < 0)
            return "";

        start += pattern.Length;

        while (start < json.Length && char.IsWhiteSpace(json[start]))
            start++;

        if (start >= json.Length)
            return "";

        if (json[start] == '"')
        {
            start++;
            int end = json.IndexOf("\"", start);

            if (end < 0)
                return "";

            return json.Substring(start, end - start);
        }
        else
        {
            int end = start;

            while (
                end < json.Length &&
                json[end] != ',' &&
                json[end] != '}')
            {
                end++;
            }

            return json.Substring(start, end - start).Trim();
        }
    }
}
# ---------- end c_script_2 ----------
trigger_2 = Trigger(Interval=1000, TimerInterval=1000, Target=[c_script_2, c_script_11])  # disabled
panel_13 = Panel(c_script_2.Status)
panel_14 = Panel(c_script_2.Message)

# ----
download = Button()
file_types = ValueList({"pointcloud", "image", "json"}, selected="pointcloud")

# ---- group: Capture, Transform & Processing
connect_3 = BooleanToggle(False)
capture_2 = Button()
transform_2 = Button()
process = Button()
panel_15 = Panel("EOB_test03")
capture_index_2 = ValueList({"1", "2", "3", "4", "5"}, selected="1")
mode_2 = ValueList({"pointcloud", "image", "depth", "all"}, selected="all")
pipeline_2 = ValueList({"base", "ref_cam", "eye_to_base"}, selected="eye_to_base")
eye_to_base_index_2 = ValueList({"1", "2", "3"}, selected="1")
reference_index_2 = ValueList({"1", "2", "3"}, selected="2")
output_index_2 = ValueList({"1", "2", "3", "4", "5", "6", "7", "8", "9", "10"}, selected="4")
processing_input_kind = ValueList({"merged", "eye_to_base"}, selected="eye_to_base")
show_processing_preview = BooleanToggle(True)
processing_preview_time = Slider(1, range=0..5)
color_grouping_method = ValueList({"gmm_bic", "dbscan", "reference"}, selected="gmm_bic")
max_color_groups = Slider(1, range=1..5)
gmm_merge_distance = Slider(6, range=0..20)
refresh_status_3 = BooleanToggle(False)
c_script_3 = CSharpScript(
    ConnectButton=connect_3,
    CaptureButton=capture_2,
    TransformButton=transform_2,
    ProcessButton=process,
    SessionName=panel_15,
    CaptureIndex=capture_index_2,
    Mode=mode_2,
    Pipeline=pipeline_2,
    EyeToBaseIndex=eye_to_base_index_2,
    ReferenceIndex=reference_index_2,
    OutputIndex=output_index_2,
    ProcessingInputKind=processing_input_kind,
    ShowProcessingPreview=show_processing_preview,
    ProcessingPreviewTime=processing_preview_time,
    ColorGroupingMethod=color_grouping_method,
    MaxColorGroups=max_color_groups,
    GmmMergeDistance=gmm_merge_distance,
    RefreshStatus=refresh_status_3)  # -> Status, Message; inputs ConnectButton: Boolean, CaptureButton: Boolean, TransformButton: Boolean, ProcessButton: Boolean, SessionName: String, CaptureIndex: Int32, Mode: String, Pipeline: String, EyeToBaseIndex: Int32, ReferenceIndex: Int32, OutputIndex: Int32, ProcessingInputKind: String, ShowProcessingPreview: Boolean, ProcessingPreviewTime: Double, ColorGroupingMethod: String, MaxColorGroups: Int32, GmmMergeDistance: Double, RefreshStatus: Boolean
# ---------- c_script_3: C# ----------
// Grasshopper Script Instance
#region Usings
using System;
using System.Text;
using System.Net.Sockets;
using System.Linq;
using System.Collections;
using System.Collections.Generic;
using System.Drawing;
using System.Globalization;

using Rhino;
using Rhino.Geometry;

using Grasshopper;
using Grasshopper.Kernel;
using Grasshopper.Kernel.Data;
using Grasshopper.Kernel.Types;
#endregion

public class Script_Instance : GH_ScriptInstance
{
    private bool previousCaptureButton = false;
    private bool previousTransformButton = false;

    // Added only for processing-button edge detection.
    private bool previousProcessButton = false;

    private bool isConnected = false;
    private bool triedConnect = false;

    private string lastStatus = "Disconnected";
    private string lastMessage = "Click Connect first.";
    private string lastJobId = "";

    private void RunScript(
		bool ConnectButton,
		bool CaptureButton,
		bool TransformButton,
		bool ProcessButton,
		string SessionName,
		int CaptureIndex,
		string Mode,
		string Pipeline,
		int EyeToBaseIndex,
		int ReferenceIndex,
		int OutputIndex,
		string ProcessingInputKind,
		bool ShowProcessingPreview,
		double ProcessingPreviewTime,
		string ColorGroupingMethod,
		int MaxColorGroups,
		double GmmMergeDistance,
		bool RefreshStatus,
		ref object Status,
		ref object Message)
    {
        string host = "127.0.0.1";
        int port = 6005;

        // Existing capture trigger.
        bool triggerCapture =
            CaptureButton &&
            !previousCaptureButton;

        previousCaptureButton = CaptureButton;

        // Existing transform trigger.
        bool triggerTransform =
            TransformButton &&
            !previousTransformButton;

        previousTransformButton = TransformButton;

        // New processing trigger.
        bool triggerProcess =
            ProcessButton &&
            !previousProcessButton;

        previousProcessButton = ProcessButton;

        // ---------------------------------------------------------
        // Existing connection handling
        // ---------------------------------------------------------

        if (!ConnectButton)
        {
            isConnected = false;
            triedConnect = false;

            lastStatus = "Disconnected";
            lastMessage = "Connection toggle is off.";

            Status = lastStatus;
            Message = lastMessage;
            return;
        }

        if (
            ConnectButton &&
            !isConnected &&
            !triedConnect)
        {
            triedConnect = true;

            string response = SendCommand(
                host,
                port,
                "{\"command\":\"ping\"}"
            );

            if (response.StartsWith("ERROR:"))
            {
                isConnected = false;
                lastStatus = "Connection failed";
                lastMessage = response;
            }
            else
            {
                isConnected = true;
                lastStatus = "Connected";
                lastMessage = response;
            }
        }

        if (!isConnected)
        {
            Status = lastStatus;
            Message = lastMessage;
            return;
        }

        // ---------------------------------------------------------
        // Existing capture workflow
        // ---------------------------------------------------------

        if (triggerCapture)
        {
            string session =
                string.IsNullOrWhiteSpace(SessionName)
                ? "RQC_Capture_Session"
                : SessionName;

            string mode =
                string.IsNullOrWhiteSpace(Mode)
                ? "all"
                : Mode;

            string capturePayload =
                "{\"command\":\"forward\",\"payload\":{" +
                "\"command\":\"capture\"," +
                "\"session\":\"" +
                EscapeJson(session) +
                "\"," +
                "\"camera_index\":0," +
                "\"capture_index\":" +
                CaptureIndex.ToString() +
                "," +
                "\"mode\":\"" +
                EscapeJson(mode) +
                "\"" +
                "}}";

            string response = SendCommand(
                host,
                port,
                capturePayload
            );

            if (response.StartsWith("ERROR:"))
            {
                lastStatus = "Capture submit failed";
                lastMessage = response;
            }
            else
            {
                lastStatus = "Capture submitted";
                lastMessage = response;
                lastJobId = ExtractJsonValue(
                    response,
                    "job_id"
                );
            }
        }

        // ---------------------------------------------------------
        // Existing transform workflow
        // ---------------------------------------------------------

        if (triggerTransform)
        {
            string session =
                string.IsNullOrWhiteSpace(SessionName)
                ? "RQC_Capture_Session"
                : SessionName;

            string pipeline =
                string.IsNullOrWhiteSpace(Pipeline)
                ? "eye_to_base"
                : Pipeline;

            string transformPayload =
                "{\"command\":\"forward\",\"payload\":{" +
                "\"command\":\"transform\"," +
                "\"session\":\"" +
                EscapeJson(session) +
                "\"," +
                "\"pipeline\":\"" +
                EscapeJson(pipeline) +
                "\"," +
                "\"eye_to_base_index\":" +
                EyeToBaseIndex.ToString() +
                "," +
                "\"reference_index\":" +
                ReferenceIndex.ToString() +
                "," +
                "\"output_index\":" +
                OutputIndex.ToString() +
                "}}";

            string response = SendCommand(
                host,
                port,
                transformPayload
            );

            if (response.StartsWith("ERROR:"))
            {
                lastStatus = "Transform submit failed";
                lastMessage = response;
            }
            else
            {
                lastStatus = "Transform submitted";
                lastMessage = response;
                lastJobId = ExtractJsonValue(
                    response,
                    "job_id"
                );
            }
        }

        // ---------------------------------------------------------
        // New processing workflow
        // ---------------------------------------------------------

        if (triggerProcess)
        {
            string session =
                string.IsNullOrWhiteSpace(SessionName)
                ? "RQC_Capture_Session"
                : SessionName;

            string inputKind =
                NormalizeProcessingInputKind(
                    ProcessingInputKind
                );

            string groupingMethod =
                NormalizeColorGroupingMethod(
                    ColorGroupingMethod
                );

            int maxGroups = Math.Max(
                1,
                MaxColorGroups
            );

            double mergeDistance = Math.Max(
                0.0,
                GmmMergeDistance
            );

            /*
             * Preview behavior:
             *
             * ShowProcessingPreview = false
             *     show_preview = false
             *     preview_time_sec = null
             *
             * ShowProcessingPreview = true
             * ProcessingPreviewTime <= 0
             *     show_preview = true
             *     preview_time_sec = null
             *     previews remain open until manually closed
             *
             * ShowProcessingPreview = true
             * ProcessingPreviewTime > 0
             *     show_preview = true
             *     preview_time_sec = supplied number
             */

            string previewTimeJson = "null";

            if (
                ShowProcessingPreview &&
                ProcessingPreviewTime > 0.0)
            {
                previewTimeJson =
                    ProcessingPreviewTime.ToString(
                        "0.########",
                        CultureInfo.InvariantCulture
                    );
            }

            string processPayload =
                "{\"command\":\"forward\",\"payload\":{" +

                "\"command\":\"process\"," +

                "\"session\":\"" +
                EscapeJson(session) +
                "\"," +

                "\"output_index\":" +
                OutputIndex.ToString(
                    CultureInfo.InvariantCulture
                ) +
                "," +

                "\"input_kind\":\"" +
                EscapeJson(inputKind) +
                "\"," +

                "\"show_preview\":" +
                BoolToJson(
                    ShowProcessingPreview
                ) +
                "," +

                "\"preview_time_sec\":" +
                previewTimeJson +
                "," +

                "\"color_grouping_method\":\"" +
                EscapeJson(groupingMethod) +
                "\"," +

                "\"gmm_max_groups\":" +
                maxGroups.ToString(
                    CultureInfo.InvariantCulture
                ) +
                "," +

                "\"gmm_merge_distance\":" +
                mergeDistance.ToString(
                    "0.########",
                    CultureInfo.InvariantCulture
                ) +

                "}}";

            string response = SendCommand(
                host,
                port,
                processPayload
            );

            if (response.StartsWith("ERROR:"))
            {
                lastStatus =
                    "Processing submit failed";

                lastMessage = response;
            }
            else
            {
                lastStatus =
                    "Processing submitted";

                lastMessage = response;
                lastJobId = ExtractJsonValue(
                    response,
                    "job_id"
                );
            }
        }

        // ---------------------------------------------------------
        // Existing status refresh
        // ---------------------------------------------------------

        if (RefreshStatus)
        {
            if (string.IsNullOrWhiteSpace(lastJobId))
            {
                Status = lastStatus;
                Message = lastMessage;
                return;
            }

            string statusPayload =
                "{\"command\":\"get_job_status\"," +
                "\"job_id\":\"" +
                EscapeJson(lastJobId) +
                "\"}";

            string response = SendCommand(
                host,
                port,
                statusPayload
            );

            if (response.StartsWith("ERROR:"))
            {
                isConnected = false;
                triedConnect = true;

                lastStatus = "Connection lost";
                lastMessage = response;
            }
            else
            {
                string outerStatus = ExtractJsonValue(
                    response,
                    "status"
                );

                if (
                    !string.Equals(
                        outerStatus,
                        "ok",
                        StringComparison.OrdinalIgnoreCase
                    )
                )
                {
                    lastStatus = "Status request failed";

                    string errorMessage = ExtractJsonValue(
                        response,
                        "message"
                    );

                    lastMessage =
                        string.IsNullOrWhiteSpace(errorMessage)
                        ? response
                        : errorMessage;
                }
                else
                {
                    string jobJson = ExtractJsonObject(
                        response,
                        "job"
                    );

                    string jobStatus = ExtractJsonValue(
                        jobJson,
                        "status"
                    );

                    string jobMessage = ExtractJsonValue(
                        jobJson,
                        "message"
                    );

                    lastStatus =
                        string.IsNullOrWhiteSpace(jobStatus)
                        ? "Unknown"
                        : jobStatus;

                    lastMessage =
                        string.IsNullOrWhiteSpace(jobMessage)
                        ? response
                        : jobMessage;
                }
            }
        }

        Status = lastStatus;
        Message = lastMessage;
        }
    

    // -------------------------------------------------------------
    // New processing input validation helpers
    // -------------------------------------------------------------

    private string NormalizeProcessingInputKind(
        string value)
    {
        string normalized =
            string.IsNullOrWhiteSpace(value)
            ? "eye_to_base"
            : value.Trim().ToLowerInvariant();

        if (
            normalized != "eye_to_base" &&
            normalized != "merged" &&
            normalized != "initial")
        {
            return "eye_to_base";
        }

        return normalized;
    }

    private string NormalizeColorGroupingMethod(
        string value)
    {
        string normalized =
            string.IsNullOrWhiteSpace(value)
            ? "gmm_bic"
            : value.Trim().ToLowerInvariant();

        if (
            normalized != "gmm_bic" &&
            normalized != "dbscan" &&
            normalized != "reference")
        {
            return "gmm_bic";
        }

        return normalized;
    }

    private string BoolToJson(bool value)
    {
        return value
            ? "true"
            : "false";
    }

    // -------------------------------------------------------------
    // Existing TCP helper
    // -------------------------------------------------------------

    private string SendCommand(
        string host,
        int port,
        string command)
    {
        int headerSize = 8;

        try
        {
            using (TcpClient client = new TcpClient())
            {
                IAsyncResult result =
                    client.BeginConnect(
                        host,
                        port,
                        null,
                        null
                    );

                bool success =
                    result.AsyncWaitHandle.WaitOne(
                        TimeSpan.FromMilliseconds(300)
                    );

                if (!success)
                {
                    return
                        "ERROR: GH Agent connection timeout.";
                }

                client.EndConnect(result);

                using (
                    NetworkStream stream =
                        client.GetStream())
                {
                    byte[] payload =
                        Encoding.UTF8.GetBytes(
                            command
                        );

                    byte[] header =
                        new byte[headerSize];

                    ulong size =
                        (ulong)payload.Length;

                    for (
                        int i = 0;
                        i < headerSize;
                        i++)
                    {
                        header[
                            headerSize - 1 - i
                        ] = (byte)(
                            size & 0xFF
                        );

                        size >>= 8;
                    }

                    stream.Write(
                        header,
                        0,
                        header.Length
                    );

                    stream.Write(
                        payload,
                        0,
                        payload.Length
                    );

                    byte[] responseHeader =
                        ReadExact(
                            stream,
                            headerSize
                        );

                    ulong responseSize = 0;

                    for (
                        int i = 0;
                        i < headerSize;
                        i++)
                    {
                        responseSize =
                            (responseSize << 8) +
                            responseHeader[i];
                    }

                    if (
                        responseSize >
                        int.MaxValue)
                    {
                        return
                            "ERROR: Agent response is too large.";
                    }

                    byte[] responsePayload =
                        ReadExact(
                            stream,
                            (int)responseSize
                        );

                    return Encoding.UTF8.GetString(
                        responsePayload
                    );
                }
            }
        }
        catch (Exception e)
        {
            return "ERROR: " + e.Message;
        }
    }

    private byte[] ReadExact(
        NetworkStream stream,
        int size)
    {
        byte[] data = new byte[size];
        int offset = 0;

        while (offset < size)
        {
            int read = stream.Read(
                data,
                offset,
                size - offset
            );

            if (read == 0)
            {
                throw new Exception(
                    "Connection closed."
                );
            }

            offset += read;
        }

        return data;
    }

    private string EscapeJson(string value)
    {
        if (value == null)
            return "";

        return value
            .Replace("\\", "\\\\")
            .Replace("\"", "\\\"")
            .Replace("\r", "\\r")
            .Replace("\n", "\\n")
            .Replace("\t", "\\t");
    }

    private string ExtractJsonValue(
        string json,
        string key)
    {
        string pattern =
            "\"" + key + "\":";

        int start =
            json.IndexOf(
                pattern,
                StringComparison.Ordinal
            );

        if (start < 0)
            return "";

        start += pattern.Length;

        while (
            start < json.Length &&
            char.IsWhiteSpace(json[start]))
        {
            start++;
        }

        if (start >= json.Length)
            return "";

        if (json[start] == '"')
        {
            start++;

            StringBuilder value =
                new StringBuilder();

            bool escaped = false;

            for (
                int i = start;
                i < json.Length;
                i++)
            {
                char character = json[i];

                if (escaped)
                {
                    switch (character)
                    {
                        case 'n':
                            value.Append('\n');
                            break;

                        case 'r':
                            value.Append('\r');
                            break;

                        case 't':
                            value.Append('\t');
                            break;

                        case '\\':
                            value.Append('\\');
                            break;

                        case '"':
                            value.Append('"');
                            break;

                        default:
                            value.Append(character);
                            break;
                    }

                    escaped = false;
                    continue;
                }

                if (character == '\\')
                {
                    escaped = true;
                    continue;
                }

                if (character == '"')
                {
                    return value.ToString();
                }

                value.Append(character);
            }

            return "";
        }
        else
        {
            int end = start;

            while (
                end < json.Length &&
                json[end] != ',' &&
                json[end] != '}')
            {
                end++;
            }

            return json
                .Substring(
                    start,
                    end - start
                )
                .Trim();
        }
    }

    private string ExtractJsonObject(
        string json,
        string key)
    {
        if (string.IsNullOrWhiteSpace(json))
            return "";

        string pattern =
            "\"" + key + "\":";

        int keyIndex = json.IndexOf(
            pattern,
            StringComparison.Ordinal
        );

        if (keyIndex < 0)
            return "";

        int start = keyIndex + pattern.Length;

        while (
            start < json.Length &&
            char.IsWhiteSpace(json[start]))
        {
            start++;
        }

        if (
            start >= json.Length ||
            json[start] != '{')
        {
            return "";
        }

        int depth = 0;
        bool insideString = false;
        bool escaped = false;

        for (int i = start; i < json.Length; i++)
        {
            char c = json[i];

            if (insideString)
            {
                if (escaped)
                {
                    escaped = false;
                }
                else if (c == '\\')
                {
                    escaped = true;
                }
                else if (c == '"')
                {
                    insideString = false;
                }

                continue;
            }

            if (c == '"')
            {
                insideString = true;
                continue;
            }

            if (c == '{')
            {
                depth++;
            }
            else if (c == '}')
            {
                depth--;

                if (depth == 0)
                {
                    return json.Substring(
                        start,
                        i - start + 1
                    );
                }
            }
        }

        return "";
    }
}
# ---------- end c_script_3 ----------
trigger_3 = Trigger(Interval=1000, TimerInterval=1000, Target=[c_script_3, c_script_4])  # disabled
panel_16 = Panel(c_script_3.Status)
panel_17 = Panel(c_script_3.Message)

# ---- group: Download
download_2 = Button()
file_types_2 = ValueList({"pointcloud", "image", "json"}, selected="json")
category = ValueList({"all": "", "initial_pointcloud", "merged_pointcloud", "eye_to_base_pointcloud", "initial_rgb", "initial_depth", "initial_depth_rendered", "stitched_rgb", "stitched_height", "eye_to_base_rgb", "eye_to_base_height", "processed_clusters", "processing_params", "processing_report"}, selected="processed_clusters")
c_script_4 = CSharpScript(
    ConnectButton=connect_3,
    DownloadButton=download_2,
    SessionName=panel_15,
    OutputIndex=output_index_2,
    FileTypes=file_types_2,
    Category=category,
    RefreshStatus=refresh_status_3)  # -> Status, Message, PointCloudPaths, ImagePaths, JsonPaths; inputs ConnectButton: Boolean, DownloadButton: Boolean, SessionName: String, OutputIndex: Int32, FileTypes: String, Category: String, RefreshStatus: Boolean
# ---------- c_script_4: C# ----------
// Grasshopper Script Instance
#region Usings
using System;
using System.Text;
using System.Net.Sockets;
using System.Linq;
using System.Collections;
using System.Collections.Generic;
using System.Drawing;

using Rhino;
using Rhino.Geometry;

using Grasshopper;
using Grasshopper.Kernel;
using Grasshopper.Kernel.Data;
using Grasshopper.Kernel.Types;
#endregion

public class Script_Instance : GH_ScriptInstance
{
    private bool previousDownloadButton = false;

    private bool isConnected = false;
    private bool triedConnect = false;

    private string lastStatus = "Disconnected";
    private string lastMessage = "Click Connect first.";
    private string lastJobId = "";

    private List<string> lastPointCloudPaths = new List<string>();
    private List<string> lastImagePaths = new List<string>();
    private List<string> lastJsonPaths = new List<string>();

    private void RunScript(
		bool ConnectButton,
		bool DownloadButton,
		string SessionName,
		int OutputIndex,
		string FileTypes,
		string Category,
		bool RefreshStatus,
		ref object Status,
		ref object Message,
		ref object PointCloudPaths,
		ref object ImagePaths,
		ref object JsonPaths)
    {
        string host = "127.0.0.1";
        int port = 6005;

        bool triggerDownload = DownloadButton && !previousDownloadButton;
        previousDownloadButton = DownloadButton;

        if (!ConnectButton)
        {
            isConnected = false;
            triedConnect = false;
            lastStatus = "Disconnected";
            lastMessage = "Connection toggle is off.";
            Status = lastStatus;
            Message = lastMessage;
            PointCloudPaths = lastPointCloudPaths;
            ImagePaths = lastImagePaths;
            JsonPaths = lastJsonPaths;
            return;
        }

        if (ConnectButton && !isConnected && !triedConnect)
        {
            triedConnect = true;

            string response = SendCommand(
                host,
                port,
                "{\"command\":\"ping\"}"
            );

            if (response.StartsWith("ERROR:"))
            {
                isConnected = false;
                lastStatus = "Connection failed";
                lastMessage = response;
            }
            else
            {
                isConnected = true;
                lastStatus = "Connected";
                lastMessage = response;
            }
        }

        if (!isConnected)
        {
            Status = lastStatus;
            Message = lastMessage;
            PointCloudPaths = lastPointCloudPaths;
            ImagePaths = lastImagePaths;
            JsonPaths = lastJsonPaths;
            return;
        }

        if (triggerDownload)
        {
            string session = string.IsNullOrWhiteSpace(SessionName)
                ? "RQC_Capture_Session"
                : SessionName;

            string fileTypesJson = BuildFileTypesArray(FileTypes);

            string downloadPayload =
                "{\"command\":\"downloadable_outputs\"," +
                "\"session\":\"" + EscapeJson(session) + "\"," +
                "\"output_index\":" + OutputIndex.ToString() + "," +
                "\"file_types\":" + fileTypesJson +
                "}";

            string response = SendCommand(host, port, downloadPayload);

            if (response.StartsWith("ERROR:"))
            {
                lastStatus = "Download failed";
                lastMessage = response;
            }
            else
            {
                lastStatus = "Download requested";
                lastMessage = response;

                lastJobId = ExtractJsonValue(
                    response,
                    "job_id"
                );

                if (string.IsNullOrWhiteSpace(lastJobId))
                {
                    lastStatus = "Download submission error";
                    lastMessage =
                        "The download was submitted, but no job_id " +
                        "was returned.\n" +
                        response;
                }
            }
        }

        if (RefreshStatus)
        {
            string session = string.IsNullOrWhiteSpace(SessionName)
                ? "RQC_Capture_Session"
                : SessionName;

            // ---------------------------------------------------------
            // 1. Read this component's own download-job status
            // ---------------------------------------------------------

            if (!string.IsNullOrWhiteSpace(lastJobId))
            {
                string statusPayload =
                    "{\"command\":\"get_job_status\"," +
                    "\"job_id\":\"" +
                    EscapeJson(lastJobId) +
                    "\"}";

                string statusResponse = SendCommand(
                    host,
                    port,
                    statusPayload
                );

                if (statusResponse.StartsWith("ERROR:"))
                {
                    isConnected = false;
                    triedConnect = true;

                    lastStatus = "Connection lost";
                    lastMessage = statusResponse;
                }
                else
                {
                    string outerStatus = ExtractJsonValue(
                        statusResponse,
                        "status"
                    );

                    if (
                        !string.Equals(
                            outerStatus,
                            "ok",
                            StringComparison.OrdinalIgnoreCase
                        )
                    )
                    {
                        lastStatus = "Status request failed";

                        string errorMessage = ExtractJsonValue(
                            statusResponse,
                            "message"
                        );

                        lastMessage =
                            string.IsNullOrWhiteSpace(errorMessage)
                            ? statusResponse
                            : errorMessage;
                    }
                    else
                    {
                        string jobJson = ExtractJsonObject(
                            statusResponse,
                            "job"
                        );

                        string jobStatus = ExtractJsonValue(
                            jobJson,
                            "status"
                        );

                        string jobMessage = ExtractJsonValue(
                            jobJson,
                            "message"
                        );

                        lastStatus =
                            string.IsNullOrWhiteSpace(jobStatus)
                            ? "Unknown"
                            : jobStatus;

                        lastMessage =
                            string.IsNullOrWhiteSpace(jobMessage)
                            ? statusResponse
                            : jobMessage;
                    }
                }
            }

                // -----------------------------------------------------
                // 2. Read paths from the persistent session manifest
                // -----------------------------------------------------

                string fileTypesJson =
                    BuildFileTypesArray(FileTypes);

                string categoriesJson =
                    BuildCategoriesArray(Category);

                string localFilesPayload =
                    "{\"command\":\"list_local_downloads\"," +
                    "\"session\":\"" +
                    EscapeJson(session) +
                    "\"," +
                    "\"output_index\":" +
                    OutputIndex.ToString() +
                    "," +
                    "\"file_types\":" +
                    fileTypesJson +
                    "," +
                    "\"categories\":" +
                    categoriesJson +
                    "}";

                string localFilesResponse = SendCommand(
                    host,
                    port,
                    localFilesPayload
                );

                if (localFilesResponse.StartsWith("ERROR:"))
                {
                    // Preserve the previously displayed paths.
                    lastMessage =
                        lastMessage +
                        Environment.NewLine +
                        "Local manifest read failed: " +
                        localFilesResponse;
                }
                else
                {
                    // Replace the displayed paths with the manifest result
                    // for the currently selected session, output and category.
                    lastPointCloudPaths =
                        ExtractLocalPathsByCategory(
                            localFilesResponse,
                            "pointclouds"
                        );

                    lastImagePaths =
                        ExtractLocalPathsByCategory(
                            localFilesResponse,
                            "images"
                        );

                    lastJsonPaths =
                        ExtractLocalPathsByCategory(
                            localFilesResponse,
                            "json"
                        );
                }
            }
        

        Status = lastStatus;
        Message = lastMessage;
        PointCloudPaths = lastPointCloudPaths;
        ImagePaths = lastImagePaths;
        JsonPaths = lastJsonPaths;
    }

    private string BuildFileTypesArray(string fileTypes)
    {
        if (string.IsNullOrWhiteSpace(fileTypes))
            return "[\"pointcloud\",\"image\",\"json\"]";

        string[] parts = fileTypes.Split(',');

        List<string> cleaned = new List<string>();

        foreach (string part in parts)
        {
            string value = part.Trim().ToLower();

            if (value == "pointcloud" || value == "pointclouds" || value == "pcd" || value == "ply")
                cleaned.Add("\"pointcloud\"");

            else if (value == "image" || value == "images" || value == "img" || value == "png")
                cleaned.Add("\"image\"");

            else if (value == "json")
                cleaned.Add("\"json\"");
        }

        if (cleaned.Count == 0)
            return "[\"pointcloud\",\"image\",\"json\"]";

        return "[" + string.Join(",", cleaned) + "]";
    }

    private string BuildCategoriesArray(string categories)
    {
        /*
        * Blank means no category filtering.
        * The GH Agent will return all stored files for the selected
        * file types, session and output index.
        */
        if (string.IsNullOrWhiteSpace(categories))
            return "[]";

        string[] parts = categories.Split(',');

        List<string> cleaned =
            new List<string>();

        HashSet<string> unique =
            new HashSet<string>(
                StringComparer.OrdinalIgnoreCase
            );

        foreach (string part in parts)
        {
            string value = part
                .Trim()
                .ToLowerInvariant();

            if (string.IsNullOrWhiteSpace(value))
                continue;

            if (unique.Add(value))
            {
                cleaned.Add(
                    "\"" +
                    EscapeJson(value) +
                    "\""
                );
            }
        }

        return "[" +
            string.Join(",", cleaned) +
            "]";
    }


   private List<string> ExtractLocalPathsByCategory(string json, string category)
    {
        HashSet<string> uniquePaths = new HashSet<string>();
        List<string> paths = new List<string>();

        int searchStart = 0;

        while (true)
        {
            int localPathIndex = json.IndexOf("\"local_path\":", searchStart);
            if (localPathIndex < 0)
                break;

            string path = ExtractJsonStringAt(
                json,
                localPathIndex + "\"local_path\":".Length
            );

            if (!string.IsNullOrWhiteSpace(path))
            {
                string normalized = path.Replace("/", "\\").ToLower();
                string categoryFolder = "\\" + category.ToLower() + "\\";

                if (normalized.Contains(categoryFolder))
                {
                    string key = normalized.Trim();

                    if (!uniquePaths.Contains(key))
                    {
                        uniquePaths.Add(key);
                        paths.Add(path);
                    }
                }
            }

            searchStart = localPathIndex + 1;
        }

        return paths;
    }
    

    private string ExtractJsonStringAt(string json, int start)
    {
        while (start < json.Length && char.IsWhiteSpace(json[start]))
            start++;

        if (start >= json.Length || json[start] != '"')
            return "";

        start++;

        StringBuilder sb = new StringBuilder();
        bool escape = false;

        for (int i = start; i < json.Length; i++)
        {
            char c = json[i];

            if (escape)
            {
                if (c == '\\') sb.Append('\\');
                else if (c == '"') sb.Append('"');
                else if (c == 'n') sb.Append('\n');
                else if (c == 'r') sb.Append('\r');
                else if (c == 't') sb.Append('\t');
                else sb.Append(c);

                escape = false;
            }
            else
            {
                if (c == '\\')
                    escape = true;
                else if (c == '"')
                    break;
                else
                    sb.Append(c);
            }
        }

        return sb.ToString();
    }

    private string SendCommand(string host, int port, string command)
    {
        int headerSize = 8;

        try
        {
            using (TcpClient client = new TcpClient())
            {
                IAsyncResult result = client.BeginConnect(host, port, null, null);

                bool success = result.AsyncWaitHandle.WaitOne(
                    TimeSpan.FromMilliseconds(300)
                );

                if (!success)
                    return "ERROR: GH Agent connection timeout.";

                client.EndConnect(result);

                using (NetworkStream stream = client.GetStream())
                {
                    byte[] payload = Encoding.UTF8.GetBytes(command);

                    byte[] header = new byte[headerSize];
                    ulong size = (ulong)payload.Length;

                    for (int i = 0; i < headerSize; i++)
                    {
                        header[headerSize - 1 - i] = (byte)(size & 0xFF);
                        size >>= 8;
                    }

                    stream.Write(header, 0, header.Length);
                    stream.Write(payload, 0, payload.Length);

                    byte[] responseHeader = ReadExact(stream, headerSize);

                    ulong responseSize = 0;
                    for (int i = 0; i < headerSize; i++)
                    {
                        responseSize = (responseSize << 8) + responseHeader[i];
                    }

                    byte[] responsePayload = ReadExact(stream, (int)responseSize);
                    return Encoding.UTF8.GetString(responsePayload);
                }
            }
        }
        catch (Exception e)
        {
            return "ERROR: " + e.Message;
        }
    }

    private byte[] ReadExact(NetworkStream stream, int size)
    {
        byte[] data = new byte[size];
        int offset = 0;

        while (offset < size)
        {
            int read = stream.Read(data, offset, size - offset);

            if (read == 0)
                throw new Exception("Connection closed.");

            offset += read;
        }

        return data;
    }

    private string EscapeJson(string value)
    {
        if (value == null)
            return "";

        return value
            .Replace("\\", "\\\\")
            .Replace("\"", "\\\"");
    }

    private string ExtractJsonValue(string json, string key)
    {
        string pattern = "\"" + key + "\":";
        int start = json.IndexOf(pattern);

        if (start < 0)
            return "";

        start += pattern.Length;

        while (start < json.Length && char.IsWhiteSpace(json[start]))
            start++;

        if (start >= json.Length)
            return "";

        if (json[start] == '"')
        {
            start++;
            int end = json.IndexOf("\"", start);

            if (end < 0)
                return "";

            return json.Substring(start, end - start);
        }
        else
        {
            int end = start;

            while (
                end < json.Length &&
                json[end] != ',' &&
                json[end] != '}')
            {
                end++;
            }

            return json.Substring(start, end - start).Trim();
        }
    }

    private string ExtractJsonObject(
        string json,
        string key)
    {
        if (string.IsNullOrWhiteSpace(json))
            return "";

        string pattern =
            "\"" + key + "\":";

        int keyIndex = json.IndexOf(
            pattern,
            StringComparison.Ordinal
        );

        if (keyIndex < 0)
            return "";

        int start = keyIndex + pattern.Length;

        while (
            start < json.Length &&
            char.IsWhiteSpace(json[start]))
        {
            start++;
        }

        if (
            start >= json.Length ||
            json[start] != '{')
        {
            return "";
        }

        int depth = 0;
        bool insideString = false;
        bool escaped = false;

        for (int i = start; i < json.Length; i++)
        {
            char character = json[i];

            if (insideString)
            {
                if (escaped)
                {
                    escaped = false;
                }
                else if (character == '\\')
                {
                    escaped = true;
                }
                else if (character == '"')
                {
                    insideString = false;
                }

                continue;
            }

            if (character == '"')
            {
                insideString = true;
                continue;
            }

            if (character == '{')
            {
                depth++;
            }
            else if (character == '}')
            {
                depth--;

                if (depth == 0)
                {
                    return json.Substring(
                        start,
                        i - start + 1
                    );
                }
            }
        }

        return "";
    }
}
# ---------- end c_script_4 ----------
panel_18 = Panel(c_script_4.Status)
panel_19 = Panel(c_script_4.Message)
path = FilePath(c_script_4.PointCloudPaths)
import = ImportContent(FilePath=path)  # -> Objects, Layers, Linetypes, HatchPatterns, AnnotationStyles, Materials, BlockDefinitions

# ----
panel_20 = Panel("{\"command\":\"forward\",\"payload\":{\"command\":\"capture\",\"session\":\"RQC_Capture_Session\",\"camera_index\":0,\"capture_index\":1,\"mode\":\"all\"}}")
panel_21 = Panel("{\"command\":\"ping_python\"}")
panel_22 = Panel("{\"command\":\"forward\",\"payload\":{\"command\":\"capture\"}}")
panel_23 = Panel("{\"command\":\"forward\",\"payload\":{\"command\":\"capture\",\"session\":\"0_GH03\",\"camera_index\":0,\"capture_index\":1,\"mode\":\"all\"}}")

# ---- group: Capture
trigger_4 = Trigger(Interval=1000, TimerInterval=1000, Target=c_script_5)  # disabled
c_script_5 = CSharpScript(
    ConnectButton=Toggle(False),
    CaptureButton=Button(),
    SessionName="0_GH02",
    CaptureIndex="1",
    Mode="all",
    RefreshStatus=Toggle(False))  # -> Status, Message; inputs ConnectButton: Boolean, CaptureButton: Boolean, SessionName: String, CaptureIndex: Int32, Mode: String, RefreshStatus: Boolean
# ---------- c_script_5: C# ----------
// Grasshopper Script Instance
#region Usings
using System;
using System.Text;
using System.Net.Sockets;
using System.Linq;
using System.Collections;
using System.Collections.Generic;
using System.Drawing;

using Rhino;
using Rhino.Geometry;

using Grasshopper;
using Grasshopper.Kernel;
using Grasshopper.Kernel.Data;
using Grasshopper.Kernel.Types;
#endregion

public class Script_Instance : GH_ScriptInstance
{
    private bool previousCaptureButton = false;

    private bool isConnected = false;
    private bool triedConnect = false;

    private string lastStatus = "Disconnected";
    private string lastMessage = "Click Connect first.";

    private void RunScript(
		bool ConnectButton,
		bool CaptureButton,
		string SessionName,
		int CaptureIndex,
		string Mode,
		bool RefreshStatus,
		ref object Status,
		ref object Message)
    {
        string host = "127.0.0.1";
        int port = 6005;

        bool triggerCapture = CaptureButton && !previousCaptureButton;
        previousCaptureButton = CaptureButton;

        if (!ConnectButton)
        {
            isConnected = false;
            triedConnect = false;
            lastStatus = "Disconnected";
            lastMessage = "Connection toggle is off.";
            Status = lastStatus;
            Message = lastMessage;
            return;
        }

        if (ConnectButton && !isConnected && !triedConnect)
        {
            triedConnect = true;

            string response = SendCommand(
                host,
                port,
                "{\"command\":\"ping\"}"
            );

            if (response.StartsWith("ERROR:"))
            {
                isConnected = false;
                lastStatus = "Connection failed";
                lastMessage = response;
            }
            else
            {
                isConnected = true;
                lastStatus = "Connected";
                lastMessage = response;
            }
        }

        if (!isConnected)
        {
            Status = lastStatus;
            Message = lastMessage;
            return;
        }

        if (triggerCapture)
        {
            string session = string.IsNullOrWhiteSpace(SessionName)
                ? "RQC_Capture_Session"
                : SessionName;

            string mode = string.IsNullOrWhiteSpace(Mode)
                ? "all"
                : Mode;

            string capturePayload =
                "{\"command\":\"forward\",\"payload\":{" +
                "\"command\":\"capture\"," +
                "\"session\":\"" + EscapeJson(session) + "\"," +
                "\"camera_index\":0," +
                "\"capture_index\":" + CaptureIndex.ToString() + "," +
                "\"mode\":\"" + EscapeJson(mode) + "\"" +
                "}}";

            string response = SendCommand(host, port, capturePayload);

            if (response.StartsWith("ERROR:"))
            {
                lastStatus = "Capture submit failed";
                lastMessage = response;
            }
            else
            {
                lastStatus = "Capture submitted";
                lastMessage = response;
            }
        }

        if (RefreshStatus)
        {
            string statusPayload = "{\"command\":\"get_latest_status\"}";
            string response = SendCommand(host, port, statusPayload);

            if (response.StartsWith("ERROR:"))
            {
                isConnected = false;
                triedConnect = true;
                lastStatus = "Connection lost";
                lastMessage = response;
            }
            else
            {
                string status = ExtractJsonValue(response, "latest_job_status");
                string message = ExtractJsonValue(response, "latest_message");

                lastStatus = string.IsNullOrWhiteSpace(status)
                    ? "Connected"
                    : status;

                lastMessage = string.IsNullOrWhiteSpace(message)
                    ? response
                    : message;
            }
        }

        Status = lastStatus;
        Message = lastMessage;
    }

    private string SendCommand(string host, int port, string command)
    {
        int headerSize = 8;

        try
        {
            using (TcpClient client = new TcpClient())
            {
                IAsyncResult result = client.BeginConnect(host, port, null, null);

                bool success = result.AsyncWaitHandle.WaitOne(
                    TimeSpan.FromMilliseconds(300)
                );

                if (!success)
                    return "ERROR: GH Agent connection timeout.";

                client.EndConnect(result);

                using (NetworkStream stream = client.GetStream())
                {
                    byte[] payload = Encoding.UTF8.GetBytes(command);

                    byte[] header = new byte[headerSize];
                    ulong size = (ulong)payload.Length;

                    for (int i = 0; i < headerSize; i++)
                    {
                        header[headerSize - 1 - i] = (byte)(size & 0xFF);
                        size >>= 8;
                    }

                    stream.Write(header, 0, header.Length);
                    stream.Write(payload, 0, payload.Length);

                    byte[] responseHeader = ReadExact(stream, headerSize);

                    ulong responseSize = 0;
                    for (int i = 0; i < headerSize; i++)
                    {
                        responseSize = (responseSize << 8) + responseHeader[i];
                    }

                    byte[] responsePayload = ReadExact(stream, (int)responseSize);
                    return Encoding.UTF8.GetString(responsePayload);
                }
            }
        }
        catch (Exception e)
        {
            return "ERROR: " + e.Message;
        }
    }

    private byte[] ReadExact(NetworkStream stream, int size)
    {
        byte[] data = new byte[size];
        int offset = 0;

        while (offset < size)
        {
            int read = stream.Read(data, offset, size - offset);

            if (read == 0)
                throw new Exception("Connection closed.");

            offset += read;
        }

        return data;
    }

    private string EscapeJson(string value)
    {
        if (value == null)
            return "";

        return value
            .Replace("\\", "\\\\")
            .Replace("\"", "\\\"");
    }

    private string ExtractJsonValue(string json, string key)
    {
        string pattern = "\"" + key + "\":";
        int start = json.IndexOf(pattern);

        if (start < 0)
            return "";

        start += pattern.Length;

        while (start < json.Length && char.IsWhiteSpace(json[start]))
            start++;

        if (start >= json.Length)
            return "";

        if (json[start] == '"')
        {
            start++;
            int end = json.IndexOf("\"", start);

            if (end < 0)
                return "";

            return json.Substring(start, end - start);
        }
        else
        {
            int end = start;

            while (
                end < json.Length &&
                json[end] != ',' &&
                json[end] != '}')
            {
                end++;
            }

            return json.Substring(start, end - start).Trim();
        }
    }
}
# ---------- end c_script_5 ----------
panel_24 = Panel(c_script_5.Message)
panel_25 = Panel(c_script_5.Status)

# ---- group: Transform
c_script_6 = CSharpScript(
    ConnectButton=Toggle(False),
    TransformButton=Button(),
    SessionName="EOB_test01",
    Pipeline="eye_to_base",
    EyeToBaseIndex="1",
    ReferenceIndex="2",
    RefreshStatus=Toggle(False))  # -> Status, Message; inputs ConnectButton: Boolean, TransformButton: Boolean, SessionName: String, Pipeline: String, EyeToBaseIndex: Int32, ReferenceIndex: Int32, RefreshStatus: Boolean
# ---------- c_script_6: C# ----------
// Grasshopper Script Instance
#region Usings
using System;
using System.Text;
using System.Net.Sockets;
using System.Linq;
using System.Collections;
using System.Collections.Generic;
using System.Drawing;

using Rhino;
using Rhino.Geometry;

using Grasshopper;
using Grasshopper.Kernel;
using Grasshopper.Kernel.Data;
using Grasshopper.Kernel.Types;
#endregion

public class Script_Instance : GH_ScriptInstance
{
    private bool previousTransformButton = false;

    private bool isConnected = false;
    private bool triedConnect = false;

    private string lastStatus = "Disconnected";
    private string lastMessage = "Click Connect first.";

    private void RunScript(
		bool ConnectButton,
		bool TransformButton,
		string SessionName,
		string Pipeline,
		int EyeToBaseIndex,
		int ReferenceIndex,
		bool RefreshStatus,
		ref object Status,
		ref object Message)
    {
        string host = "127.0.0.1";
        int port = 6005;

        bool triggerTransform = TransformButton && !previousTransformButton;
        previousTransformButton = TransformButton;

        if (!ConnectButton)
        {
            isConnected = false;
            triedConnect = false;
            lastStatus = "Disconnected";
            lastMessage = "Connection toggle is off.";
            Status = lastStatus;
            Message = lastMessage;
            return;
        }

        if (ConnectButton && !isConnected && !triedConnect)
        {
            triedConnect = true;

            string response = SendCommand(
                host,
                port,
                "{\"command\":\"ping\"}"
            );

            if (response.StartsWith("ERROR:"))
            {
                isConnected = false;
                lastStatus = "Connection failed";
                lastMessage = response;
            }
            else
            {
                isConnected = true;
                lastStatus = "Connected";
                lastMessage = response;
            }
        }

        if (!isConnected)
        {
            Status = lastStatus;
            Message = lastMessage;
            return;
        }

        if (triggerTransform)
        {
            string session = string.IsNullOrWhiteSpace(SessionName)
                ? "RQC_Capture_Session"
                : SessionName;

            string pipeline = string.IsNullOrWhiteSpace(Pipeline)
                ? "eye_to_base"
                : Pipeline;

            string transformPayload =
                "{\"command\":\"forward\",\"payload\":{" +
                "\"command\":\"transform\"," +
                "\"session\":\"" + EscapeJson(session) + "\"," +
                "\"pipeline\":\"" + EscapeJson(pipeline) + "\"," +
                "\"eye_to_base_index\":" + EyeToBaseIndex.ToString() + "," +
                "\"reference_index\":" + ReferenceIndex.ToString() +
                "}}";

            string response = SendCommand(host, port, transformPayload);

            if (response.StartsWith("ERROR:"))
            {
                lastStatus = "Transform submit failed";
                lastMessage = response;
            }
            else
            {
                lastStatus = "Transform submitted";
                lastMessage = response;
            }
        }

        if (RefreshStatus)
        {
            string statusPayload = "{\"command\":\"get_latest_status\"}";
            string response = SendCommand(host, port, statusPayload);

            if (response.StartsWith("ERROR:"))
            {
                isConnected = false;
                triedConnect = true;
                lastStatus = "Connection lost";
                lastMessage = response;
            }
            else
            {
                string status = ExtractJsonValue(response, "latest_job_status");
                string message = ExtractJsonValue(response, "latest_message");

                lastStatus = string.IsNullOrWhiteSpace(status)
                    ? "Connected"
                    : status;

                lastMessage = string.IsNullOrWhiteSpace(message)
                    ? response
                    : message;
            }
        }

        Status = lastStatus;
        Message = lastMessage;
    }

    private string SendCommand(string host, int port, string command)
    {
        int headerSize = 8;

        try
        {
            using (TcpClient client = new TcpClient())
            {
                IAsyncResult result = client.BeginConnect(host, port, null, null);

                bool success = result.AsyncWaitHandle.WaitOne(
                    TimeSpan.FromMilliseconds(300)
                );

                if (!success)
                    return "ERROR: GH Agent connection timeout.";

                client.EndConnect(result);

                using (NetworkStream stream = client.GetStream())
                {
                    byte[] payload = Encoding.UTF8.GetBytes(command);

                    byte[] header = new byte[headerSize];
                    ulong size = (ulong)payload.Length;

                    for (int i = 0; i < headerSize; i++)
                    {
                        header[headerSize - 1 - i] = (byte)(size & 0xFF);
                        size >>= 8;
                    }

                    stream.Write(header, 0, header.Length);
                    stream.Write(payload, 0, payload.Length);

                    byte[] responseHeader = ReadExact(stream, headerSize);

                    ulong responseSize = 0;
                    for (int i = 0; i < headerSize; i++)
                    {
                        responseSize = (responseSize << 8) + responseHeader[i];
                    }

                    byte[] responsePayload = ReadExact(stream, (int)responseSize);
                    return Encoding.UTF8.GetString(responsePayload);
                }
            }
        }
        catch (Exception e)
        {
            return "ERROR: " + e.Message;
        }
    }

    private byte[] ReadExact(NetworkStream stream, int size)
    {
        byte[] data = new byte[size];
        int offset = 0;

        while (offset < size)
        {
            int read = stream.Read(data, offset, size - offset);

            if (read == 0)
                throw new Exception("Connection closed.");

            offset += read;
        }

        return data;
    }

    private string EscapeJson(string value)
    {
        if (value == null)
            return "";

        return value
            .Replace("\\", "\\\\")
            .Replace("\"", "\\\"");
    }

    private string ExtractJsonValue(string json, string key)
    {
        string pattern = "\"" + key + "\":";
        int start = json.IndexOf(pattern);

        if (start < 0)
            return "";

        start += pattern.Length;

        while (start < json.Length && char.IsWhiteSpace(json[start]))
            start++;

        if (start >= json.Length)
            return "";

        if (json[start] == '"')
        {
            start++;
            int end = json.IndexOf("\"", start);

            if (end < 0)
                return "";

            return json.Substring(start, end - start);
        }
        else
        {
            int end = start;

            while (
                end < json.Length &&
                json[end] != ',' &&
                json[end] != '}')
            {
                end++;
            }

            return json.Substring(start, end - start).Trim();
        }
    }
}
# ---------- end c_script_6 ----------
trigger_5 = Trigger(Interval=1000, TimerInterval=1000, Target=c_script_6)  # disabled
panel_26 = Panel(c_script_6.Message)
panel_27 = Panel(c_script_6.Status)

# ----
ln = Line(StartPoint=pt, EndPoint=pt_2)

c_script_7 = CSharpScript(Signal=Toggle(False))  # -> Pulse, Status; inputs Signal: Boolean
# ---------- c_script_7: C# ----------
// Grasshopper Script Instance

#region Usings
using System;

using Rhino;
using Rhino.Geometry;

using Grasshopper;
using Grasshopper.Kernel;
using Grasshopper.Kernel.Data;
using Grasshopper.Kernel.Types;
#endregion


public class Script_Instance : GH_ScriptInstance
{
    //============================================================
    // Persistent state
    //============================================================

    private bool previousSignal = false;


    //============================================================
    // Main
    //============================================================

    private void RunScript(bool Signal, ref object Pulse, ref object Status)
    {
        bool pulse =
            Signal &&
            !previousSignal;

        previousSignal = Signal;

        Pulse = pulse;

        if (pulse)
        {
            Status =
                "Pulse generated.";
        }
        else if (Signal)
        {
            Status =
                "Waiting for reset.";
        }
        else
        {
            Status =
                "Ready.";
        }
    }
}
# ---------- end c_script_7 ----------
panel_28 = Panel(c_script_7.Pulse)
panel_29 = Panel(c_script_7.Status)

trigger_6 = Trigger(Interval=1000, TimerInterval=1000, Target=[c_script_12, c_script_22])  # disabled
connect_4 = BooleanToggle(False)
refresh_status_4 = BooleanToggle(False)
write = Button()
button = Button()

trigger_7 = Trigger(Interval=1000, TimerInterval=1000, Target=c_script_8)  # disabled
connect_5 = BooleanToggle(False)
refresh_status_5 = BooleanToggle(False)
c_script_8 = CSharpScript(ConnectButton=connect_5, RefreshStatus=refresh_status_5, ExpectedAction="run_motion", Host="127.0.0.1", Port="6005")  # -> Trigger, Connected, State, Action, Session, SourceIndex, ActionId, LocalStatus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; inputs ConnectButton: Boolean, RefreshStatus: Boolean, ExpectedAction: String, Host: String, Port: Int32
# ---------- c_script_8: C# ----------
// Grasshopper Script Instance

#region Usings
using System;
using System.Text;
using System.Net.Sockets;
using System.Globalization;

using Rhino;
using Rhino.Geometry;

using Grasshopper;
using Grasshopper.Kernel;
using Grasshopper.Kernel.Data;
using Grasshopper.Kernel.Types;
#endregion


public class Script_Instance : GH_ScriptInstance
{
    // ============================================================
    // CONNECTION STATE
    // ============================================================

    private bool isConnected = false;
    private bool triedConnect = false;


    // ============================================================
    // EDGE DETECTION
    // ============================================================

    private bool previousRefreshStatus = false;


    // ============================================================
    // COMPONENT STATE
    // ============================================================

    private bool triggerPulse = false;

    private string lastState =
        "Disconnected";

    private string lastAction = "";
    private string lastSession = "";
    private int lastSourceIndex = -1;
    private string lastActionId = "";
    private string lastLocalStatus = "";
    private string lastTarget = "";

    private string lastMessage =
        "Enable ConnectButton.";

    private string lastRawResponse = "";


    // ============================================================
    // MAIN
    // ============================================================

    private void RunScript(
		bool ConnectButton,
		bool RefreshStatus,
		string ExpectedAction,
		string Host,
		int Port,
		ref object Trigger,
		ref object Connected,
		ref object State,
		ref object Action,
		ref object Session,
		ref object SourceIndex,
		ref object ActionId,
		ref object LocalStatus,
		ref object Target,
		ref object Message,
		ref object RawResponse)
    {
        // Trigger is always a one-solution pulse.
        triggerPulse = false;

        bool refreshPulse =
            RefreshStatus &&
            !previousRefreshStatus;

        previousRefreshStatus =
            RefreshStatus;


        // --------------------------------------------------------
        // Normalize configuration
        // --------------------------------------------------------

        string normalizedHost =
            string.IsNullOrWhiteSpace(
                Host
            )
            ? "127.0.0.1"
            : Host.Trim();

        int normalizedPort =
            Port > 0
            ? Port
            : 6005;

        string normalizedExpectedAction =
            NormalizeAction(
                ExpectedAction
            );


        // --------------------------------------------------------
        // Connection toggle off
        // --------------------------------------------------------

        if (!ConnectButton)
        {
            isConnected = false;
            triedConnect = false;

            lastState = "Disconnected";

            lastMessage =
                "Connection toggle is off.";

            lastRawResponse = "";

            ClearActionOutputs();

            SetOutputs(
                ref Trigger,
                ref Connected,
                ref State,
                ref Action,
                ref Session,
                ref SourceIndex,
                ref ActionId,
                ref LocalStatus,
                ref Target,
                ref Message,
                ref RawResponse
            );

            return;
        }


        // --------------------------------------------------------
        // Initial connection attempt
        // --------------------------------------------------------

        if (
            ConnectButton &&
            !isConnected &&
            !triedConnect
        )
        {
            triedConnect = true;

            string pingResponse =
                SendCommand(
                    normalizedHost,
                    normalizedPort,
                    "{\"command\":\"ping\"}"
                );

            lastRawResponse =
                pingResponse;

            if (
                pingResponse.StartsWith(
                    "ERROR:",
                    StringComparison.Ordinal
                )
            )
            {
                isConnected = false;

                lastState =
                    "Connection failed";

                lastMessage =
                    pingResponse;
            }
            else
            {
                string responseStatus =
                    ExtractJsonValue(
                        pingResponse,
                        "status"
                    );

                string responseMessage =
                    ExtractJsonValue(
                        pingResponse,
                        "message"
                    );

                if (
                    string.Equals(
                        responseStatus,
                        "ok",
                        StringComparison.OrdinalIgnoreCase
                    )
                )
                {
                    isConnected = true;

                    lastState =
                        "Connected";

                    lastMessage =
                        string.IsNullOrWhiteSpace(
                            responseMessage
                        )
                        ? "Connected to the local GH Agent."
                        : responseMessage;
                }
                else
                {
                    isConnected = false;

                    lastState =
                        "Connection failed";

                    lastMessage =
                        string.IsNullOrWhiteSpace(
                            responseMessage
                        )
                        ? pingResponse
                        : responseMessage;
                }
            }
        }


        // --------------------------------------------------------
        // Remain disconnected until user retries
        // --------------------------------------------------------

        if (!isConnected)
        {
            SetOutputs(
                ref Trigger,
                ref Connected,
                ref State,
                ref Action,
                ref Session,
                ref SourceIndex,
                ref ActionId,
                ref LocalStatus,
                ref Target,
                ref Message,
                ref RawResponse
            );

            return;
        }


        // --------------------------------------------------------
        // Validate expected action
        // --------------------------------------------------------

        if (
            string.IsNullOrWhiteSpace(
                normalizedExpectedAction
            )
        )
        {
            lastState =
                "Configuration error";

            lastMessage =
                "ExpectedAction cannot be empty.";

            SetOutputs(
                ref Trigger,
                ref Connected,
                ref State,
                ref Action,
                ref Session,
                ref SourceIndex,
                ref ActionId,
                ref LocalStatus,
                ref Target,
                ref Message,
                ref RawResponse
            );

            return;
        }


        // --------------------------------------------------------
        // Wait for controlled refresh pulse
        // --------------------------------------------------------

        if (!refreshPulse)
        {
            if (
                lastState == "Connected" ||
                lastState == "Waiting"
            )
            {
                lastState =
                    "Waiting";

                lastMessage =
                    "Waiting for RefreshStatus pulse.";
            }

            SetOutputs(
                ref Trigger,
                ref Connected,
                ref State,
                ref Action,
                ref Session,
                ref SourceIndex,
                ref ActionId,
                ref LocalStatus,
                ref Target,
                ref Message,
                ref RawResponse
            );

            return;
        }


        // --------------------------------------------------------
        // Inspect the current local action
        // --------------------------------------------------------

        string inspectResponse =
            SendCommand(
                normalizedHost,
                normalizedPort,
                "{" +
                "\"command\":" +
                "\"get_local_project_action\"" +
                "}"
            );

        lastRawResponse =
            inspectResponse;

        if (
            inspectResponse.StartsWith(
                "ERROR:",
                StringComparison.Ordinal
            )
        )
        {
            HandleConnectionFailure(
                inspectResponse
            );

            SetOutputs(
                ref Trigger,
                ref Connected,
                ref State,
                ref Action,
                ref Session,
                ref SourceIndex,
                ref ActionId,
                ref LocalStatus,
                ref Target,
                ref Message,
                ref RawResponse
            );

            return;
        }


        string inspectStatus =
            ExtractJsonValue(
                inspectResponse,
                "status"
            );

        string inspectMessage =
            ExtractJsonValue(
                inspectResponse,
                "message"
            );

        lastTarget =
            ExtractJsonValue(
                inspectResponse,
                "target"
            );

        if (
            !string.Equals(
                inspectStatus,
                "ok",
                StringComparison.OrdinalIgnoreCase
            )
        )
        {
            lastState =
                "Action inspection failed";

            lastMessage =
                string.IsNullOrWhiteSpace(
                    inspectMessage
                )
                ? inspectResponse
                : inspectMessage;

            SetOutputs(
                ref Trigger,
                ref Connected,
                ref State,
                ref Action,
                ref Session,
                ref SourceIndex,
                ref ActionId,
                ref LocalStatus,
                ref Target,
                ref Message,
                ref RawResponse
            );

            return;
        }


        string actionJson =
            ExtractJsonObject(
                inspectResponse,
                "action"
            );


        // --------------------------------------------------------
        // No local action
        // --------------------------------------------------------

        if (
            string.IsNullOrWhiteSpace(
                actionJson
            )
        )
        {
            ClearActionOutputs();

            lastTarget =
                ExtractJsonValue(
                    inspectResponse,
                    "target"
                );

            lastState =
                "Waiting for action";

            lastMessage =
                string.IsNullOrWhiteSpace(
                    inspectMessage
                )
                ? "No active local project action."
                : inspectMessage;

            SetOutputs(
                ref Trigger,
                ref Connected,
                ref State,
                ref Action,
                ref Session,
                ref SourceIndex,
                ref ActionId,
                ref LocalStatus,
                ref Target,
                ref Message,
                ref RawResponse
            );

            return;
        }


        // --------------------------------------------------------
        // Read local action
        // --------------------------------------------------------

        lastAction =
            NormalizeAction(
                ExtractJsonValue(
                    actionJson,
                    "action"
                )
            );

        lastSession =
            ExtractJsonValue(
                actionJson,
                "session"
            );

        lastActionId =
            ExtractJsonValue(
                actionJson,
                "action_id"
            );

        lastLocalStatus =
            NormalizeStatus(
                ExtractJsonValue(
                    actionJson,
                    "local_status"
                )
            );

        lastTarget =
            ExtractJsonValue(
                actionJson,
                "target"
            );

        lastSourceIndex =
            ParseInteger(
                ExtractJsonValue(
                    actionJson,
                    "source_output_index"
                ),
                -1
            );


        // --------------------------------------------------------
        // Safety validation
        // --------------------------------------------------------

        if (
            string.IsNullOrWhiteSpace(
                lastActionId
            )
        )
        {
            lastState =
                "Invalid local action";

            lastMessage =
                "The local action is missing action_id.";

            SetOutputs(
                ref Trigger,
                ref Connected,
                ref State,
                ref Action,
                ref Session,
                ref SourceIndex,
                ref ActionId,
                ref LocalStatus,
                ref Target,
                ref Message,
                ref RawResponse
            );

            return;
        }

        if (
            string.IsNullOrWhiteSpace(
                lastSession
            )
        )
        {
            lastState =
                "Invalid local action";

            lastMessage =
                "The local action is missing session.";

            SetOutputs(
                ref Trigger,
                ref Connected,
                ref State,
                ref Action,
                ref Session,
                ref SourceIndex,
                ref ActionId,
                ref LocalStatus,
                ref Target,
                ref Message,
                ref RawResponse
            );

            return;
        }

        if (lastSourceIndex < 1)
        {
            lastState =
                "Invalid local action";

            lastMessage =
                "The local action is missing a valid " +
                "source_output_index.";

            SetOutputs(
                ref Trigger,
                ref Connected,
                ref State,
                ref Action,
                ref Session,
                ref SourceIndex,
                ref ActionId,
                ref LocalStatus,
                ref Target,
                ref Message,
                ref RawResponse
            );

            return;
        }


        // --------------------------------------------------------
        // Compare received and expected actions
        // --------------------------------------------------------

        if (
            !string.Equals(
                lastAction,
                normalizedExpectedAction,
                StringComparison.OrdinalIgnoreCase
            )
        )
        {
            lastState =
                "Action mismatch";

            lastMessage =
                "Expected action '" +
                normalizedExpectedAction +
                "', but received '" +
                (
                    string.IsNullOrWhiteSpace(
                        lastAction
                    )
                    ? "(empty)"
                    : lastAction
                ) +
                "'. The action was not consumed.";

            SetOutputs(
                ref Trigger,
                ref Connected,
                ref State,
                ref Action,
                ref Session,
                ref SourceIndex,
                ref ActionId,
                ref LocalStatus,
                ref Target,
                ref Message,
                ref RawResponse
            );

            return;
        }


        // --------------------------------------------------------
        // Do not consume an already handled action
        // --------------------------------------------------------

        if (
            !string.Equals(
                lastLocalStatus,
                "claimed",
                StringComparison.OrdinalIgnoreCase
            )
        )
        {
            lastState =
                "Action already handled";

            lastMessage =
                "Action '" +
                lastAction +
                "' has local status '" +
                (
                    string.IsNullOrWhiteSpace(
                        lastLocalStatus
                    )
                    ? "(unknown)"
                    : lastLocalStatus
                ) +
                "'. No trigger was generated.";

            SetOutputs(
                ref Trigger,
                ref Connected,
                ref State,
                ref Action,
                ref Session,
                ref SourceIndex,
                ref ActionId,
                ref LocalStatus,
                ref Target,
                ref Message,
                ref RawResponse
            );

            return;
        }


        // --------------------------------------------------------
        // Consume matching claimed action
        // --------------------------------------------------------

        string consumeResponse =
            SendCommand(
                normalizedHost,
                normalizedPort,
                "{" +
                "\"command\":" +
                "\"consume_local_project_action\"" +
                "}"
            );

        lastRawResponse =
            consumeResponse;

        if (
            consumeResponse.StartsWith(
                "ERROR:",
                StringComparison.Ordinal
            )
        )
        {
            HandleConnectionFailure(
                consumeResponse
            );

            SetOutputs(
                ref Trigger,
                ref Connected,
                ref State,
                ref Action,
                ref Session,
                ref SourceIndex,
                ref ActionId,
                ref LocalStatus,
                ref Target,
                ref Message,
                ref RawResponse
            );

            return;
        }


        string consumeStatus =
            ExtractJsonValue(
                consumeResponse,
                "status"
            );

        string consumeMessage =
            ExtractJsonValue(
                consumeResponse,
                "message"
            );

        bool receivedTrigger =
            ParseBoolean(
                ExtractJsonValue(
                    consumeResponse,
                    "trigger"
                )
            );

        string consumedActionJson =
            ExtractJsonObject(
                consumeResponse,
                "action"
            );


        // --------------------------------------------------------
        // Consume rejected
        // --------------------------------------------------------

        if (
            !string.Equals(
                consumeStatus,
                "ok",
                StringComparison.OrdinalIgnoreCase
            )
        )
        {
            triggerPulse = false;

            lastState =
                "Action consumption failed";

            lastMessage =
                string.IsNullOrWhiteSpace(
                    consumeMessage
                )
                ? consumeResponse
                : consumeMessage;

            SetOutputs(
                ref Trigger,
                ref Connected,
                ref State,
                ref Action,
                ref Session,
                ref SourceIndex,
                ref ActionId,
                ref LocalStatus,
                ref Target,
                ref Message,
                ref RawResponse
            );

            return;
        }


        // --------------------------------------------------------
        // Refresh outputs from consumed action
        // --------------------------------------------------------

        if (
            !string.IsNullOrWhiteSpace(
                consumedActionJson
            )
        )
        {
            lastAction =
                NormalizeAction(
                    ExtractJsonValue(
                        consumedActionJson,
                        "action"
                    )
                );

            lastSession =
                ExtractJsonValue(
                    consumedActionJson,
                    "session"
                );

            lastActionId =
                ExtractJsonValue(
                    consumedActionJson,
                    "action_id"
                );

            lastLocalStatus =
                NormalizeStatus(
                    ExtractJsonValue(
                        consumedActionJson,
                        "local_status"
                    )
                );

            lastTarget =
                ExtractJsonValue(
                    consumedActionJson,
                    "target"
                );

            lastSourceIndex =
                ParseInteger(
                    ExtractJsonValue(
                        consumedActionJson,
                        "source_output_index"
                    ),
                    lastSourceIndex
                );
        }


        // --------------------------------------------------------
        // Emit the one-solution trigger
        // --------------------------------------------------------

        triggerPulse =
            receivedTrigger;

        if (triggerPulse)
        {
            lastState =
                "Action triggered";

            lastMessage =
                string.IsNullOrWhiteSpace(
                    consumeMessage
                )
                ? (
                    "Action '" +
                    lastAction +
                    "' was consumed and triggered."
                )
                : consumeMessage;

            AddRuntimeMessage(
                GH_RuntimeMessageLevel.Remark,
                "Triggered '" +
                lastAction +
                "' for session '" +
                lastSession +
                "'."
            );
        }
        else
        {
            lastState =
                "No trigger";

            lastMessage =
                string.IsNullOrWhiteSpace(
                    consumeMessage
                )
                ? "The action did not produce a trigger."
                : consumeMessage;
        }


        SetOutputs(
            ref Trigger,
            ref Connected,
            ref State,
            ref Action,
            ref Session,
            ref SourceIndex,
            ref ActionId,
            ref LocalStatus,
            ref Target,
            ref Message,
            ref RawResponse
        );
    }


    // ============================================================
    // OUTPUTS
    // ============================================================

    private void SetOutputs(
        ref object Trigger,
        ref object Connected,
        ref object State,
        ref object Action,
        ref object Session,
        ref object SourceIndex,
        ref object ActionId,
        ref object LocalStatus,
        ref object Target,
        ref object Message,
        ref object RawResponse)
    {
        Trigger =
            triggerPulse;

        Connected =
            isConnected;

        State =
            lastState;

        Action =
            lastAction;

        Session =
            lastSession;

        SourceIndex =
            lastSourceIndex >= 0
            ? (object)lastSourceIndex
            : null;

        ActionId =
            lastActionId;

        LocalStatus =
            lastLocalStatus;

        Target =
            lastTarget;

        Message =
            lastMessage;

        RawResponse =
            lastRawResponse;
    }


    private void ClearActionOutputs()
    {
        lastAction = "";
        lastSession = "";
        lastSourceIndex = -1;
        lastActionId = "";
        lastLocalStatus = "";
        lastTarget = "";
    }


    // ============================================================
    // CONNECTION FAILURE
    // ============================================================

    private void HandleConnectionFailure(
        string message)
    {
        isConnected = false;
        triedConnect = true;

        triggerPulse = false;

        lastState =
            "Connection lost";

        lastMessage =
            message;
    }


    // ============================================================
    // NORMALIZATION
    // ============================================================

    private string NormalizeAction(
        string value)
    {
        if (
            string.IsNullOrWhiteSpace(
                value
            )
        )
        {
            return "";
        }

        string normalized =
            value
                .Trim()
                .ToLowerInvariant()
                .Replace(" ", "_")
                .Replace("-", "_");

        while (
            normalized.Contains("__")
        )
        {
            normalized =
                normalized.Replace(
                    "__",
                    "_"
                );
        }

        return normalized.Trim('_');
    }


    private string NormalizeStatus(
        string value)
    {
        return string.IsNullOrWhiteSpace(
            value
        )
            ? ""
            : value
                .Trim()
                .ToLowerInvariant();
    }


    // ============================================================
    // TCP
    // ============================================================

    private string SendCommand(
        string host,
        int port,
        string command)
    {
        const int headerSize = 8;

        try
        {
            using (
                TcpClient client =
                    new TcpClient()
            )
            {
                IAsyncResult result =
                    client.BeginConnect(
                        host,
                        port,
                        null,
                        null
                    );

                bool success =
                    result.AsyncWaitHandle.WaitOne(
                        TimeSpan.FromMilliseconds(
                            300
                        )
                    );

                if (!success)
                {
                    return
                        "ERROR: GH Agent connection timeout.";
                }

                client.EndConnect(
                    result
                );

                client.ReceiveTimeout = 5000;
                client.SendTimeout = 5000;

                using (
                    NetworkStream stream =
                        client.GetStream()
                )
                {
                    byte[] payload =
                        Encoding.UTF8.GetBytes(
                            command
                        );

                    byte[] header =
                        new byte[headerSize];

                    ulong size =
                        (ulong)payload.Length;

                    for (
                        int index = 0;
                        index < headerSize;
                        index++
                    )
                    {
                        header[
                            headerSize - 1 - index
                        ] = (byte)(
                            size & 0xFF
                        );

                        size >>= 8;
                    }

                    stream.Write(
                        header,
                        0,
                        header.Length
                    );

                    stream.Write(
                        payload,
                        0,
                        payload.Length
                    );

                    byte[] responseHeader =
                        ReadExact(
                            stream,
                            headerSize
                        );

                    ulong responseSize = 0;

                    for (
                        int index = 0;
                        index < headerSize;
                        index++
                    )
                    {
                        responseSize =
                            (
                                responseSize << 8
                            ) +
                            responseHeader[index];
                    }

                    if (
                        responseSize >
                        int.MaxValue
                    )
                    {
                        return
                            "ERROR: Agent response is too large.";
                    }

                    byte[] responsePayload =
                        ReadExact(
                            stream,
                            (int)responseSize
                        );

                    return
                        Encoding.UTF8.GetString(
                            responsePayload
                        );
                }
            }
        }
        catch (Exception exception)
        {
            return
                "ERROR: " +
                exception.Message;
        }
    }


    private byte[] ReadExact(
        NetworkStream stream,
        int size)
    {
        byte[] data =
            new byte[size];

        int offset = 0;

        while (offset < size)
        {
            int read =
                stream.Read(
                    data,
                    offset,
                    size - offset
                );

            if (read == 0)
            {
                throw new Exception(
                    "Connection closed."
                );
            }

            offset += read;
        }

        return data;
    }


    // ============================================================
    // JSON HELPERS
    // ============================================================

    private string ExtractJsonValue(
        string json,
        string key)
    {
        if (
            string.IsNullOrWhiteSpace(
                json
            )
        )
        {
            return "";
        }

        string pattern =
            "\"" +
            key +
            "\":";

        int start =
            json.IndexOf(
                pattern,
                StringComparison.Ordinal
            );

        if (start < 0)
        {
            return "";
        }

        start +=
            pattern.Length;

        while (
            start < json.Length &&
            char.IsWhiteSpace(
                json[start]
            )
        )
        {
            start++;
        }

        if (
            start >= json.Length
        )
        {
            return "";
        }

        if (
            json[start] == '"'
        )
        {
            start++;

            StringBuilder value =
                new StringBuilder();

            bool escaped = false;

            for (
                int index = start;
                index < json.Length;
                index++
            )
            {
                char character =
                    json[index];

                if (escaped)
                {
                    switch (character)
                    {
                        case 'n':
                            value.Append('\n');
                            break;

                        case 'r':
                            value.Append('\r');
                            break;

                        case 't':
                            value.Append('\t');
                            break;

                        case '\\':
                            value.Append('\\');
                            break;

                        case '"':
                            value.Append('"');
                            break;

                        default:
                            value.Append(
                                character
                            );
                            break;
                    }

                    escaped = false;
                    continue;
                }

                if (
                    character == '\\'
                )
                {
                    escaped = true;
                    continue;
                }

                if (
                    character == '"'
                )
                {
                    return
                        value.ToString();
                }

                value.Append(
                    character
                );
            }

            return "";
        }

        if (
            json.Substring(
                start
            ).StartsWith(
                "null",
                StringComparison.Ordinal
            )
        )
        {
            return "";
        }

        int end =
            start;

        while (
            end < json.Length &&
            json[end] != ',' &&
            json[end] != '}'
        )
        {
            end++;
        }

        return json
            .Substring(
                start,
                end - start
            )
            .Trim();
    }


    private string ExtractJsonObject(
        string json,
        string key)
    {
        if (
            string.IsNullOrWhiteSpace(
                json
            )
        )
        {
            return "";
        }

        string pattern =
            "\"" +
            key +
            "\":";

        int keyIndex =
            json.IndexOf(
                pattern,
                StringComparison.Ordinal
            );

        if (keyIndex < 0)
        {
            return "";
        }

        int start =
            keyIndex +
            pattern.Length;

        while (
            start < json.Length &&
            char.IsWhiteSpace(
                json[start]
            )
        )
        {
            start++;
        }

        if (
            start >= json.Length ||
            json[start] != '{'
        )
        {
            return "";
        }

        int depth = 0;
        bool insideString = false;
        bool escaped = false;

        for (
            int index = start;
            index < json.Length;
            index++
        )
        {
            char character =
                json[index];

            if (insideString)
            {
                if (escaped)
                {
                    escaped = false;
                }
                else if (
                    character == '\\'
                )
                {
                    escaped = true;
                }
                else if (
                    character == '"'
                )
                {
                    insideString = false;
                }

                continue;
            }

            if (
                character == '"'
            )
            {
                insideString = true;
                continue;
            }

            if (
                character == '{'
            )
            {
                depth++;
            }
            else if (
                character == '}'
            )
            {
                depth--;

                if (
                    depth == 0
                )
                {
                    return json.Substring(
                        start,
                        index - start + 1
                    );
                }
            }
        }

        return "";
    }


    private bool ParseBoolean(
        string value)
    {
        bool parsedBoolean;

        if (
            bool.TryParse(
                value,
                out parsedBoolean
            )
        )
        {
            return parsedBoolean;
        }

        int parsedInteger;

        if (
            int.TryParse(
                value,
                NumberStyles.Integer,
                CultureInfo.InvariantCulture,
                out parsedInteger
            )
        )
        {
            return
                parsedInteger != 0;
        }

        return false;
    }


    private int ParseInteger(
        string value,
        int fallback)
    {
        int parsed;

        if (
            int.TryParse(
                value,
                NumberStyles.Integer,
                CultureInfo.InvariantCulture,
                out parsed
            )
        )
        {
            return parsed;
        }

        double parsedDouble;

        if (
            double.TryParse(
                value,
                NumberStyles.Float,
                CultureInfo.InvariantCulture,
                out parsedDouble
            )
        )
        {
            return
                (int)Math.Round(
                    parsedDouble
                );
        }

        return fallback;
    }
}
# ---------- end c_script_8 ----------
panel_30 = Panel(c_script_8.State)
panel_31 = Panel(c_script_8.Action)
panel_32 = Panel(c_script_8.Session)
panel_33 = Panel(c_script_8.LocalStatus)
panel_34 = Panel(c_script_8.Message)
panel_35 = Panel(c_script_8.RawResponse)
panel_36 = Panel(c_script_8.Trigger)
panel_37 = Panel(c_script_8.Connected)
panel_38 = Panel(c_script_8.SourceIndex)
panel_39 = Panel(c_script_8.ActionId)
panel_40 = Panel(c_script_8.Target)

merge = Merge(Data1=pt, Data2=pt_2)  # -> graft(Result)

trigger_8 = Trigger(Interval=1000, TimerInterval=1000, Target=c_script_9)  # disabled
connect_6 = BooleanToggle(False)
refresh_status_6 = BooleanToggle(False)
c_script_9 = CSharpScript(ConnectButton=connect_6, RefreshStatus=refresh_status_6, ExpectedAction="run_design", Host="127.0.0.1", Port="6005")  # -> Trigger, Connected, State, Action, Session, SourceIndex, ActionId, LocalStatus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; inputs ConnectButton: Boolean, RefreshStatus: Boolean, ExpectedAction: String, Host: String, Port: Int32; same code as c_script_8
panel_41 = Panel(c_script_9.State)
panel_42 = Panel(c_script_9.Session)
panel_43 = Panel(c_script_9.Message)
panel_44 = Panel(c_script_9.RawResponse)
panel_45 = Panel(c_script_9.Trigger)
panel_46 = Panel(c_script_9.Connected)
panel_47 = Panel(c_script_9.Action)
panel_48 = Panel(c_script_9.SourceIndex)
panel_49 = Panel(c_script_9.ActionId)
panel_50 = Panel(c_script_9.LocalStatus)
panel_51 = Panel(c_script_9.Target)

c_script_10 = CSharpScript(Run=Toggle(False), Command=panel_20)  # -> Response; inputs Run: Boolean, Command: String
# ---------- c_script_10: C# ----------
// Grasshopper Script Instance
#region Usings
using System;
using System.Text;
using System.Net.Sockets;
using System.Linq;
using System.Collections;
using System.Collections.Generic;
using System.Drawing;

using Rhino;
using Rhino.Geometry;

using Grasshopper;
using Grasshopper.Kernel;
using Grasshopper.Kernel.Data;
using Grasshopper.Kernel.Types;
#endregion

public class Script_Instance : GH_ScriptInstance
{
    private void RunScript(bool Run, string Command, ref object Response)
    {
        if (!Run)
        {
            Response = "Waiting...";
            return;
        }

        string host = "127.0.0.1";
        int port = 6005;
        int headerSize = 8;

        try
        {
            using (TcpClient client = new TcpClient(host, port))
            using (NetworkStream stream = client.GetStream())
            {
                byte[] payload = Encoding.UTF8.GetBytes(Command);

                byte[] header = new byte[headerSize];
                ulong size = (ulong)payload.Length;

                for (int i = 0; i < headerSize; i++)
                {
                    header[headerSize - 1 - i] = (byte)(size & 0xFF);
                    size >>= 8;
                }

                stream.Write(header, 0, header.Length);
                stream.Write(payload, 0, payload.Length);

                byte[] responseHeader = ReadExact(stream, headerSize);

                ulong responseSize = 0;
                for (int i = 0; i < headerSize; i++)
                {
                    responseSize = (responseSize << 8) + responseHeader[i];
                }

                byte[] responsePayload = ReadExact(stream, (int)responseSize);
                Response = Encoding.UTF8.GetString(responsePayload);
            }
        }
        catch (Exception e)
        {
            Response = "ERROR: " + e.Message;
        }
    }

    private byte[] ReadExact(NetworkStream stream, int size)
    {
        byte[] data = new byte[size];
        int offset = 0;

        while (offset < size)
        {
            int read = stream.Read(data, offset, size - offset);

            if (read == 0)
            {
                throw new Exception("Connection closed.");
            }

            offset += read;
        }

        return data;
    }
}
# ---------- end c_script_10 ----------
xy = XYPlane(Origin=Point(0, 0, 0))
c_script_11 = CSharpScript(
    ConnectButton=connect_2,
    DownloadButton=download,
    SessionName=panel_12,
    OutputIndex=output_index,
    FileTypes=file_types,
    RefreshStatus=refresh_status_2)  # -> Status, Message, PointCloudPaths, ImagePaths, JsonPaths; inputs ConnectButton: Boolean, DownloadButton: Boolean, SessionName: String, OutputIndex: Int32, FileTypes: String, RefreshStatus: Boolean
# ---------- c_script_11: C# ----------
// Grasshopper Script Instance
#region Usings
using System;
using System.Text;
using System.Net.Sockets;
using System.Linq;
using System.Collections;
using System.Collections.Generic;
using System.Drawing;

using Rhino;
using Rhino.Geometry;

using Grasshopper;
using Grasshopper.Kernel;
using Grasshopper.Kernel.Data;
using Grasshopper.Kernel.Types;
#endregion

public class Script_Instance : GH_ScriptInstance
{
    private bool previousDownloadButton = false;

    private bool isConnected = false;
    private bool triedConnect = false;

    private string lastStatus = "Disconnected";
    private string lastMessage = "Click Connect first.";

    private List<string> lastPointCloudPaths = new List<string>();
    private List<string> lastImagePaths = new List<string>();
    private List<string> lastJsonPaths = new List<string>();

    private void RunScript(
		bool ConnectButton,
		bool DownloadButton,
		string SessionName,
		int OutputIndex,
		string FileTypes,
		bool RefreshStatus,
		ref object Status,
		ref object Message,
		ref object PointCloudPaths,
		ref object ImagePaths,
		ref object JsonPaths)
    {
        string host = "127.0.0.1";
        int port = 6005;

        bool triggerDownload = DownloadButton && !previousDownloadButton;
        previousDownloadButton = DownloadButton;

        if (!ConnectButton)
        {
            isConnected = false;
            triedConnect = false;
            lastStatus = "Disconnected";
            lastMessage = "Connection toggle is off.";
            Status = lastStatus;
            Message = lastMessage;
            PointCloudPaths = lastPointCloudPaths;
            ImagePaths = lastImagePaths;
            JsonPaths = lastJsonPaths;
            return;
        }

        if (ConnectButton && !isConnected && !triedConnect)
        {
            triedConnect = true;

            string response = SendCommand(
                host,
                port,
                "{\"command\":\"ping\"}"
            );

            if (response.StartsWith("ERROR:"))
            {
                isConnected = false;
                lastStatus = "Connection failed";
                lastMessage = response;
            }
            else
            {
                isConnected = true;
                lastStatus = "Connected";
                lastMessage = response;
            }
        }

        if (!isConnected)
        {
            Status = lastStatus;
            Message = lastMessage;
            PointCloudPaths = lastPointCloudPaths;
            ImagePaths = lastImagePaths;
            JsonPaths = lastJsonPaths;
            return;
        }

        if (triggerDownload)
        {
            string session = string.IsNullOrWhiteSpace(SessionName)
                ? "RQC_Capture_Session"
                : SessionName;

            string fileTypesJson = BuildFileTypesArray(FileTypes);

            string downloadPayload =
                "{\"command\":\"downloadable_outputs\"," +
                "\"session\":\"" + EscapeJson(session) + "\"," +
                "\"output_index\":" + OutputIndex.ToString() + "," +
                "\"file_types\":" + fileTypesJson +
                "}";

            string response = SendCommand(host, port, downloadPayload);

            if (response.StartsWith("ERROR:"))
            {
                lastStatus = "Download failed";
                lastMessage = response;
            }
            else
            {
                lastStatus = "Download requested";
                lastMessage = response;
            }
        }

        if (RefreshStatus)
        {
            string statusPayload = "{\"command\":\"get_latest_status\"}";
            string response = SendCommand(host, port, statusPayload);

            if (response.StartsWith("ERROR:"))
            {
                isConnected = false;
                triedConnect = true;
                lastStatus = "Connection lost";
                lastMessage = response;
            }
            else
            {
                string status = ExtractJsonValue(response, "latest_job_status");
                string message = ExtractJsonValue(response, "latest_message");

                lastStatus = string.IsNullOrWhiteSpace(status)
                    ? "Connected"
                    : status;

                lastMessage = string.IsNullOrWhiteSpace(message)
                    ? response
                    : message;

                lastPointCloudPaths = ExtractLocalPathsByCategory(response, "pointclouds");
                lastImagePaths = ExtractLocalPathsByCategory(response, "images");
                lastJsonPaths = ExtractLocalPathsByCategory(response, "json");
            }
        }

        Status = lastStatus;
        Message = lastMessage;
        PointCloudPaths = lastPointCloudPaths;
        ImagePaths = lastImagePaths;
        JsonPaths = lastJsonPaths;
    }

    private string BuildFileTypesArray(string fileTypes)
    {
        if (string.IsNullOrWhiteSpace(fileTypes))
            return "[\"pointcloud\",\"image\",\"json\"]";

        string[] parts = fileTypes.Split(',');

        List<string> cleaned = new List<string>();

        foreach (string part in parts)
        {
            string value = part.Trim().ToLower();

            if (value == "pointcloud" || value == "pointclouds" || value == "pcd" || value == "ply")
                cleaned.Add("\"pointcloud\"");

            else if (value == "image" || value == "images" || value == "img" || value == "png")
                cleaned.Add("\"image\"");

            else if (value == "json")
                cleaned.Add("\"json\"");
        }

        if (cleaned.Count == 0)
            return "[\"pointcloud\",\"image\",\"json\"]";

        return "[" + string.Join(",", cleaned) + "]";
    }

   private List<string> ExtractLocalPathsByCategory(string json, string category)
    {
        HashSet<string> uniquePaths = new HashSet<string>();
        List<string> paths = new List<string>();

        int searchStart = 0;

        while (true)
        {
            int localPathIndex = json.IndexOf("\"local_path\":", searchStart);
            if (localPathIndex < 0)
                break;

            string path = ExtractJsonStringAt(
                json,
                localPathIndex + "\"local_path\":".Length
            );

            if (!string.IsNullOrWhiteSpace(path))
            {
                string normalized = path.Replace("/", "\\").ToLower();
                string categoryFolder = "\\" + category.ToLower() + "\\";

                if (normalized.Contains(categoryFolder))
                {
                    string key = normalized.Trim();

                    if (!uniquePaths.Contains(key))
                    {
                        uniquePaths.Add(key);
                        paths.Add(path);
                    }
                }
            }

            searchStart = localPathIndex + 1;
        }

        return paths;
    }
    

    private string ExtractJsonStringAt(string json, int start)
    {
        while (start < json.Length && char.IsWhiteSpace(json[start]))
            start++;

        if (start >= json.Length || json[start] != '"')
            return "";

        start++;

        StringBuilder sb = new StringBuilder();
        bool escape = false;

        for (int i = start; i < json.Length; i++)
        {
            char c = json[i];

            if (escape)
            {
                if (c == '\\') sb.Append('\\');
                else if (c == '"') sb.Append('"');
                else if (c == 'n') sb.Append('\n');
                else if (c == 'r') sb.Append('\r');
                else if (c == 't') sb.Append('\t');
                else sb.Append(c);

                escape = false;
            }
            else
            {
                if (c == '\\')
                    escape = true;
                else if (c == '"')
                    break;
                else
                    sb.Append(c);
            }
        }

        return sb.ToString();
    }

    private string SendCommand(string host, int port, string command)
    {
        int headerSize = 8;

        try
        {
            using (TcpClient client = new TcpClient())
            {
                IAsyncResult result = client.BeginConnect(host, port, null, null);

                bool success = result.AsyncWaitHandle.WaitOne(
                    TimeSpan.FromMilliseconds(300)
                );

                if (!success)
                    return "ERROR: GH Agent connection timeout.";

                client.EndConnect(result);

                using (NetworkStream stream = client.GetStream())
                {
                    byte[] payload = Encoding.UTF8.GetBytes(command);

                    byte[] header = new byte[headerSize];
                    ulong size = (ulong)payload.Length;

                    for (int i = 0; i < headerSize; i++)
                    {
                        header[headerSize - 1 - i] = (byte)(size & 0xFF);
                        size >>= 8;
                    }

                    stream.Write(header, 0, header.Length);
                    stream.Write(payload, 0, payload.Length);

                    byte[] responseHeader = ReadExact(stream, headerSize);

                    ulong responseSize = 0;
                    for (int i = 0; i < headerSize; i++)
                    {
                        responseSize = (responseSize << 8) + responseHeader[i];
                    }

                    byte[] responsePayload = ReadExact(stream, (int)responseSize);
                    return Encoding.UTF8.GetString(responsePayload);
                }
            }
        }
        catch (Exception e)
        {
            return "ERROR: " + e.Message;
        }
    }

    private byte[] ReadExact(NetworkStream stream, int size)
    {
        byte[] data = new byte[size];
        int offset = 0;

        while (offset < size)
        {
            int read = stream.Read(data, offset, size - offset);

            if (read == 0)
                throw new Exception("Connection closed.");

            offset += read;
        }

        return data;
    }

    private string EscapeJson(string value)
    {
        if (value == null)
            return "";

        return value
            .Replace("\\", "\\\\")
            .Replace("\"", "\\\"");
    }

    private string ExtractJsonValue(string json, string key)
    {
        string pattern = "\"" + key + "\":";
        int start = json.IndexOf(pattern);

        if (start < 0)
            return "";

        start += pattern.Length;

        while (start < json.Length && char.IsWhiteSpace(json[start]))
            start++;

        if (start >= json.Length)
            return "";

        if (json[start] == '"')
        {
            start++;
            int end = json.IndexOf("\"", start);

            if (end < 0)
                return "";

            return json.Substring(start, end - start);
        }
        else
        {
            int end = start;

            while (
                end < json.Length &&
                json[end] != ',' &&
                json[end] != '}')
            {
                end++;
            }

            return json.Substring(start, end - start).Trim();
        }
    }
}
# ---------- end c_script_11 ----------
c_script_12 = CSharpScript(ConnectButton=connect_4, RefreshStatus=refresh_status_4, SessionName="EOB_test03")  # -> Status, Message, SessionFolder, ManifestPath; inputs ConnectButton: Boolean, RefreshStatus: Boolean, SessionName: String
# ---------- c_script_12: C# ----------
// Grasshopper Script Instance
#region Usings
using System;
using System.Text;
using System.Net.Sockets;

using Rhino;
using Rhino.Geometry;

using Grasshopper;
using Grasshopper.Kernel;
using Grasshopper.Kernel.Data;
using Grasshopper.Kernel.Types;
#endregion

public class Script_Instance : GH_ScriptInstance
{
    private bool previousRefreshStatus = false;

    private bool isConnected = false;
    private bool triedConnect = false;

    private string lastStatus = "Disconnected";
    private string lastMessage = "Enable ConnectButton.";

    private string lastSessionFolder = "";
    private string lastManifestPath = "";

    private void RunScript(
		bool ConnectButton,
		bool RefreshStatus,
		string SessionName,
		ref object Status,
		ref object Message,
		ref object SessionFolder,
		ref object ManifestPath)
    {
        const string host = "127.0.0.1";
        const int port = 6005;

        bool refreshPulse =
            RefreshStatus &&
            !previousRefreshStatus;

        previousRefreshStatus = RefreshStatus;

        if (!ConnectButton)
        {
            isConnected = false;
            triedConnect = false;

            lastStatus = "Disconnected";
            lastMessage = "Connection toggle is off.";

            SetOutputs(
                ref Status,
                ref Message,
                ref SessionFolder,
                ref ManifestPath
            );

            return;
        }

        if (
            ConnectButton &&
            !isConnected &&
            !triedConnect)
        {
            triedConnect = true;

            string response = SendCommand(
                host,
                port,
                "{\"command\":\"ping\"}"
            );

            if (response.StartsWith("ERROR:"))
            {
                isConnected = false;
                lastStatus = "Connection failed";
                lastMessage = response;
            }
            else
            {
                string responseStatus =
                    ExtractJsonValue(
                        response,
                        "status"
                    );

                if (
                    string.Equals(
                        responseStatus,
                        "ok",
                        StringComparison.OrdinalIgnoreCase
                    ))
                {
                    isConnected = true;
                    lastStatus = "Connected";

                    string responseMessage =
                        ExtractJsonValue(
                            response,
                            "message"
                        );

                    lastMessage =
                        string.IsNullOrWhiteSpace(
                            responseMessage
                        )
                        ? response
                        : responseMessage;
                }
                else
                {
                    isConnected = false;
                    lastStatus = "Connection failed";
                    lastMessage = response;
                }
            }
        }

        if (!isConnected)
        {
            SetOutputs(
                ref Status,
                ref Message,
                ref SessionFolder,
                ref ManifestPath
            );

            return;
        }

        if (refreshPulse)
        {
            string session =
                string.IsNullOrWhiteSpace(
                    SessionName
                )
                ? "RQC_Capture_Session"
                : SessionName.Trim();

            string payload =
                "{" +
                "\"command\":\"get_upload_session_path\"," +
                "\"session\":\"" +
                EscapeJson(session) +
                "\"" +
                "}";

            string response =
                SendCommand(
                    host,
                    port,
                    payload
                );

            if (response.StartsWith("ERROR:"))
            {
                isConnected = false;
                triedConnect = true;

                lastStatus = "Connection lost";
                lastMessage = response;
            }
            else
            {
                string responseStatus =
                    ExtractJsonValue(
                        response,
                        "status"
                    );

                if (
                    !string.Equals(
                        responseStatus,
                        "ok",
                        StringComparison.OrdinalIgnoreCase
                    ))
                {
                    lastStatus =
                        "Upload path request failed";

                    string responseMessage =
                        ExtractJsonValue(
                            response,
                            "message"
                        );

                    lastMessage =
                        string.IsNullOrWhiteSpace(
                            responseMessage
                        )
                        ? response
                        : responseMessage;
                }
                else
                {
                    lastSessionFolder =
                        ExtractJsonValue(
                            response,
                            "session_folder"
                        );

                    lastManifestPath =
                        ExtractJsonValue(
                            response,
                            "manifest_path"
                        );

                    lastStatus =
                        "Upload session ready";

                    lastMessage =
                        "The local upload session folder " +
                        "and manifest are ready.";
                }
            }
        }

        SetOutputs(
            ref Status,
            ref Message,
            ref SessionFolder,
            ref ManifestPath
        );
    }

    private void SetOutputs(
        ref object Status,
        ref object Message,
        ref object SessionFolder,
        ref object ManifestPath)
    {
        Status = lastStatus;
        Message = lastMessage;
        SessionFolder = lastSessionFolder;
        ManifestPath = lastManifestPath;
    }

    private string SendCommand(
        string host,
        int port,
        string command)
    {
        const int headerSize = 8;

        try
        {
            using (
                TcpClient client =
                    new TcpClient())
            {
                IAsyncResult result =
                    client.BeginConnect(
                        host,
                        port,
                        null,
                        null
                    );

                bool success =
                    result.AsyncWaitHandle.WaitOne(
                        TimeSpan.FromMilliseconds(300)
                    );

                if (!success)
                {
                    return
                        "ERROR: GH Agent connection timeout.";
                }

                client.EndConnect(result);

                using (
                    NetworkStream stream =
                        client.GetStream())
                {
                    byte[] payload =
                        Encoding.UTF8.GetBytes(
                            command
                        );

                    byte[] header =
                        new byte[headerSize];

                    ulong size =
                        (ulong)payload.Length;

                    for (
                        int index = 0;
                        index < headerSize;
                        index++)
                    {
                        header[
                            headerSize - 1 - index
                        ] = (byte)(size & 0xFF);

                        size >>= 8;
                    }

                    stream.Write(
                        header,
                        0,
                        header.Length
                    );

                    stream.Write(
                        payload,
                        0,
                        payload.Length
                    );

                    byte[] responseHeader =
                        ReadExact(
                            stream,
                            headerSize
                        );

                    ulong responseSize = 0;

                    for (
                        int index = 0;
                        index < headerSize;
                        index++)
                    {
                        responseSize =
                            (responseSize << 8) +
                            responseHeader[index];
                    }

                    if (responseSize > int.MaxValue)
                    {
                        return
                            "ERROR: Agent response is too large.";
                    }

                    byte[] responsePayload =
                        ReadExact(
                            stream,
                            (int)responseSize
                        );

                    return Encoding.UTF8.GetString(
                        responsePayload
                    );
                }
            }
        }
        catch (Exception exception)
        {
            return "ERROR: " + exception.Message;
        }
    }

    private byte[] ReadExact(
        NetworkStream stream,
        int size)
    {
        byte[] data = new byte[size];
        int offset = 0;

        while (offset < size)
        {
            int read = stream.Read(
                data,
                offset,
                size - offset
            );

            if (read == 0)
            {
                throw new Exception(
                    "Connection closed."
                );
            }

            offset += read;
        }

        return data;
    }

    private string EscapeJson(string value)
    {
        if (value == null)
            return "";

        return value
            .Replace("\\", "\\\\")
            .Replace("\"", "\\\"")
            .Replace("\r", "\\r")
            .Replace("\n", "\\n")
            .Replace("\t", "\\t");
    }

    private string ExtractJsonValue(
        string json,
        string key)
    {
        if (string.IsNullOrWhiteSpace(json))
            return "";

        string pattern =
            "\"" + key + "\":";

        int start = json.IndexOf(
            pattern,
            StringComparison.Ordinal
        );

        if (start < 0)
            return "";

        start += pattern.Length;

        while (
            start < json.Length &&
            char.IsWhiteSpace(json[start]))
        {
            start++;
        }

        if (
            start >= json.Length ||
            json[start] != '"')
        {
            return "";
        }

        start++;

        StringBuilder value =
            new StringBuilder();

        bool escaped = false;

        for (
            int index = start;
            index < json.Length;
            index++)
        {
            char character = json[index];

            if (escaped)
            {
                switch (character)
                {
                    case 'n':
                        value.Append('\n');
                        break;

                    case 'r':
                        value.Append('\r');
                        break;

                    case 't':
                        value.Append('\t');
                        break;

                    case '\\':
                        value.Append('\\');
                        break;

                    case '"':
                        value.Append('"');
                        break;

                    default:
                        value.Append(character);
                        break;
                }

                escaped = false;
                continue;
            }

            if (character == '\\')
            {
                escaped = true;
                continue;
            }

            if (character == '"')
            {
                return value.ToString();
            }

            value.Append(character);
        }

        return "";
    }
}
# ---------- end c_script_12 ----------
c_script_13 = CSharpScript(
    Directory=c_script_12.SessionFolder,
    FileName="ghdata",
    Session="EOB_test03",
    Domain="design",
    OutputIndex="01",
    Write=write,
    A=merge,
    B=ln,
    C=xy)  # -> OutputPath, InputSummary, ReadyEvent, Status; inputs Directory: String, FileName: String, Session: String, Domain: String, OutputIndex: Int32, Write: Boolean, A: tree, B: tree, C: tree
# ---------- c_script_13: C# ----------
// Grasshopper C# Script Instance
#region Usings
using System;
using System.Collections;
using System.Collections.Generic;
using System.Globalization;
using System.IO;
using System.Linq;
using System.Net.Sockets;
using System.Text;

using GH_IO.Serialization;

using Grasshopper;
using Grasshopper.Kernel;
using Grasshopper.Kernel.Data;
using Grasshopper.Kernel.Types;
#endregion

public class Script_Instance : GH_ScriptInstance
{
    // Fixed inputs:
    // 0 Directory
    // 1 FileName
    // 2 Session
    // 3 Domain
    // 4 OutputIndex
    // 5 Write
    //
    // Arbitrary data inputs begin at index 6.
    private const int FirstDataInputIndex = 6;

    private const string GhAgentHost = "127.0.0.1";
    private const int GhAgentPort = 6005;
    private const int MessageHeaderSize = 8;

    private bool previousWrite = false;
    private bool inputSettingsUpdateScheduled = false;

    private string lastOutputPath = "";
    private string lastReadyEvent = "";
    private string lastStatus = "Ready.";

    private void RunScript(
		string Directory,
		string FileName,
		string Session,
		string Domain,
		int OutputIndex,
		bool Write,
		DataTree<object> A,
		DataTree<object> B,
		DataTree<object> C,
		ref object OutputPath,
		ref object InputSummary,
		ref object ReadyEvent,
		ref object Status)
    {
        List<string> summaries =
            new List<string>();

        bool writePulse =
            Write &&
            !previousWrite;

        previousWrite = Write;

        try
        {
            /*
             * This applies Tree access and Optional=true to every generic
             * input after the current solution finishes.
             *
             * The first solution after adding a new input may cause one
             * additional recomputation.
             */
            EnsureDataInputSettings();

            List<DataInputRecord> inputRecords =
                CollectInputRecords();

            summaries = inputRecords
                .Select(record => record.Summary)
                .ToList();

            string validationError =
                ValidateSettings(
                    Directory,
                    FileName,
                    Session,
                    Domain,
                    OutputIndex
                );

            if (!string.IsNullOrWhiteSpace(validationError))
            {
                lastStatus = validationError;

                SetOutputs(
                    summaries,
                    ref OutputPath,
                    ref InputSummary,
                    ref ReadyEvent,
                    ref Status
                );

                return;
            }

            string normalizedDomain =
                NormalizeName(
                    Domain,
                    "output"
                );

            string resolvedFileName =
                BuildFileName(
                    FileName,
                    normalizedDomain,
                    OutputIndex
                );

            lastOutputPath =
                Path.GetFullPath(
                    Path.Combine(
                        Directory.Trim(),
                        resolvedFileName
                    )
                );

            int connectedCount =
                inputRecords.Count(
                    record => record.IsConnected
                );

            int populatedCount =
                inputRecords.Count(
                    record => record.ItemCount > 0
                );

            if (!writePulse)
            {
                lastStatus =
                    "Ready. " +
                    connectedCount +
                    " input(s) connected; " +
                    populatedCount +
                    " input(s) contain data.";

                SetOutputs(
                    summaries,
                    ref OutputPath,
                    ref InputSummary,
                    ref ReadyEvent,
                    ref Status
                );

                return;
            }

            if (connectedCount == 0)
            {
                lastStatus =
                    "Write rejected: no data inputs are connected.";

                SetOutputs(
                    summaries,
                    ref OutputPath,
                    ref InputSummary,
                    ref ReadyEvent,
                    ref Status
                );

                return;
            }

            if (populatedCount == 0)
            {
                lastStatus =
                    "Write rejected: connected inputs contain no data.";

                SetOutputs(
                    summaries,
                    ref OutputPath,
                    ref InputSummary,
                    ref ReadyEvent,
                    ref Status
                );

                return;
            }

            string outputDirectory =
                Path.GetDirectoryName(lastOutputPath);

            if (string.IsNullOrWhiteSpace(outputDirectory))
            {
                throw new InvalidOperationException(
                    "Could not resolve the output directory."
                );
            }

            System.IO.Directory.CreateDirectory(
                outputDirectory
            );

            WriteGhDataArchive(
                lastOutputPath,
                Session.Trim(),
                normalizedDomain,
                OutputIndex,
                inputRecords
            );

            if (!File.Exists(lastOutputPath))
            {
                throw new IOException(
                    "Grasshopper archive write completed, but the file " +
                    "does not exist: " +
                    lastOutputPath
                );
            }

            string registrationResponse =
                RegisterLocalUpload(
                    Session.Trim(),
                    normalizedDomain,
                    OutputIndex,
                    lastOutputPath
                );

            string registrationStatus =
                ExtractJsonValue(
                    registrationResponse,
                    "status"
                );

            if (
                !string.Equals(
                    registrationStatus,
                    "ok",
                    StringComparison.OrdinalIgnoreCase
                ))
            {
                string registrationMessage =
                    ExtractJsonValue(
                        registrationResponse,
                        "message"
                    );

                throw new InvalidOperationException(
                    "The .ghdata file was written, but local registration " +
                    "failed: " +
                    (
                        string.IsNullOrWhiteSpace(registrationMessage)
                        ? registrationResponse
                        : registrationMessage
                    )
                );
            }

            string eventId =
                Guid.NewGuid().ToString();

            string createdAt =
                DateTime.UtcNow.ToString(
                    "o",
                    CultureInfo.InvariantCulture
                );

            lastReadyEvent =
                BuildReadyEvent(
                    eventId,
                    createdAt,
                    Session.Trim(),
                    normalizedDomain,
                    OutputIndex,
                    lastOutputPath,
                    connectedCount,
                    populatedCount,
                    summaries
                );

            lastStatus =
                "The .ghdata file was written and registered successfully.";

            SetOutputs(
                summaries,
                ref OutputPath,
                ref InputSummary,
                ref ReadyEvent,
                ref Status
            );
        }
        catch (Exception exception)
        {
            lastStatus =
                "Managed Data Output failed: " +
                exception.Message;

            SetOutputs(
                summaries,
                ref OutputPath,
                ref InputSummary,
                ref ReadyEvent,
                ref Status
            );
        }
    }

    // ============================================================
    // PARAMETER SETTINGS
    // ============================================================

    private void EnsureDataInputSettings()
    {
        bool updateRequired = false;

        for (
            int inputIndex = FirstDataInputIndex;
            inputIndex < Component.Params.Input.Count;
            inputIndex++)
        {
            IGH_Param parameter =
                Component.Params.Input[inputIndex];

            if (parameter == null)
                continue;

            if (
                parameter.Access != GH_ParamAccess.tree ||
                !parameter.Optional)
            {
                updateRequired = true;
                break;
            }
        }

        if (
            !updateRequired ||
            inputSettingsUpdateScheduled)
        {
            return;
        }

        GH_Document document =
            Component.OnPingDocument();

        if (document == null)
            return;

        inputSettingsUpdateScheduled = true;

        document.ScheduleSolution(
            1,
            scheduledDocument =>
            {
                try
                {
                    for (
                        int inputIndex = FirstDataInputIndex;
                        inputIndex < Component.Params.Input.Count;
                        inputIndex++)
                    {
                        IGH_Param parameter =
                            Component.Params.Input[inputIndex];

                        if (parameter == null)
                            continue;

                        parameter.Access =
                            GH_ParamAccess.tree;

                        parameter.Optional = true;
                    }

                    Component.Params.OnParametersChanged();
                }
                finally
                {
                    inputSettingsUpdateScheduled = false;
                }

                Component.ExpireSolution(true);
            }
        );
    }

    // ============================================================
    // INPUT COLLECTION
    // ============================================================

    private List<DataInputRecord> CollectInputRecords()
    {
        List<DataInputRecord> records =
            new List<DataInputRecord>();

        int dataInputCount =
            Math.Max(
                0,
                Component.Params.Input.Count -
                FirstDataInputIndex
            );

        for (
            int relativeIndex = 0;
            relativeIndex < dataInputCount;
            relativeIndex++)
        {
            int inputIndex =
                FirstDataInputIndex +
                relativeIndex;

            IGH_Param parameter =
                Component.Params.Input[inputIndex];

            string key =
                GetAlphabeticName(relativeIndex);

            DataInputRecord record =
                DescribeInput(
                    key,
                    relativeIndex,
                    parameter
                );

            records.Add(record);
        }

        return records;
    }

    private DataInputRecord DescribeInput(
        string key,
        int relativeIndex,
        IGH_Param parameter)
    {
        DataInputRecord record =
            new DataInputRecord();

        record.Key = key;
        record.RelativeIndex = relativeIndex;
        record.Parameter = parameter;

        if (parameter == null)
        {
            record.TypeName = "No Data";
            record.StructureName = "Empty";
            record.ItemCount = 0;
            record.PathCount = 0;
            record.IsConnected = false;
            record.Summary =
                key +
                " : No Data | Empty | Count: 0";

            return record;
        }

        record.IsConnected =
            parameter.SourceCount > 0;

        HashSet<string> detectedTypes =
            new HashSet<string>(
                StringComparer.OrdinalIgnoreCase
            );

        int itemCount = 0;
        int pathCount = 0;

        if (
            parameter.VolatileData != null &&
            !parameter.VolatileData.IsEmpty)
        {
            pathCount =
                parameter.VolatileData.PathCount;

            foreach (
                IGH_Goo goo
                in parameter.VolatileData.AllData(true))
            {
                if (goo == null)
                    continue;

                itemCount++;

                string friendlyType =
                    GetFriendlyTypeName(goo);

                if (
                    !string.IsNullOrWhiteSpace(
                        friendlyType
                    ))
                {
                    detectedTypes.Add(
                        friendlyType
                    );
                }
            }
        }

        string typeName;

        if (detectedTypes.Count == 0)
        {
            typeName =
                record.IsConnected
                ? DetectSourceType(parameter)
                : "No Data";
        }
        else if (detectedTypes.Count == 1)
        {
            typeName =
                detectedTypes.First();
        }
        else
        {
            typeName = "Mixed";
        }

        record.TypeName = typeName;
        record.ItemCount = itemCount;
        record.PathCount = pathCount;
        record.StructureName =
            GetStructureName(
                pathCount,
                itemCount
            );

        record.Summary =
            key +
            " : " +
            record.TypeName +
            " | " +
            record.StructureName +
            " | Count: " +
            record.ItemCount;

        return record;
    }

    // ============================================================
    // GHDATA SERIALIZATION
    // ============================================================

    private void WriteGhDataArchive(
        string outputPath,
        string session,
        string domain,
        int outputIndex,
        List<DataInputRecord> inputRecords)
    {
        string temporaryPath =
            outputPath + ".writing";

        if (File.Exists(temporaryPath))
        {
            File.Delete(temporaryPath);
        }

        GH_Archive archive =
            new GH_Archive();

        GH_IWriter root =
            archive.CreateTopLevelNode(
                "DECO2_Managed_Data"
            );

        root.SetString(
            "Format",
            "DECO2_MANAGED_GHDATA"
        );

        root.SetInt32(
            "FormatVersion",
            1
        );

        root.SetString(
            "CreatedAt",
            DateTime.UtcNow.ToString(
                "o",
                CultureInfo.InvariantCulture
            )
        );

        root.SetString(
            "Session",
            session
        );

        root.SetString(
            "Domain",
            domain
        );

        root.SetInt32(
            "OutputIndex",
            outputIndex
        );

        root.SetInt32(
            "InputCount",
            inputRecords.Count
        );

        foreach (
            DataInputRecord record
            in inputRecords)
        {
            GH_IWriter inputChunk =
                root.CreateChunk(
                    "Input",
                    record.RelativeIndex
                );

            inputChunk.SetString(
                "Key",
                record.Key
            );

            inputChunk.SetString(
                "TypeName",
                record.TypeName ?? ""
            );

            inputChunk.SetString(
                "StructureName",
                record.StructureName ?? ""
            );

            inputChunk.SetBoolean(
                "IsConnected",
                record.IsConnected
            );

            inputChunk.SetInt32(
                "PathCount",
                record.PathCount
            );

            inputChunk.SetInt32(
                "ItemCount",
                record.ItemCount
            );

            if (
                record.Parameter == null ||
                record.Parameter.VolatileData == null ||
                record.Parameter.VolatileData.IsEmpty)
            {
                continue;
            }

            WriteParameterData(
                inputChunk,
                record.Parameter
            );
        }

        byte[] archiveBytes =
            archive.Serialize_Binary();

        if (
            archiveBytes == null ||
            archiveBytes.Length == 0)
        {
            throw new IOException(
                "Grasshopper archive serialization returned no data."
            );
        }

        File.WriteAllBytes(
            temporaryPath,
            archiveBytes
        );

        if (!File.Exists(temporaryPath))
        {
            throw new IOException(
                "Temporary Grasshopper archive was not created."
            );
        }

        if (File.Exists(outputPath))
        {
            File.Delete(outputPath);
        }

        File.Move(
            temporaryPath,
            outputPath
        );
    }

    private void WriteParameterData(
        GH_IWriter inputChunk,
        IGH_Param parameter)
    {
        int globalItemIndex = 0;

        for (
            int branchIndex = 0;
            branchIndex < parameter.VolatileData.PathCount;
            branchIndex++)
        {
            GH_Path path =
                parameter.VolatileData.get_Path(
                    branchIndex
                );

            IList branch =
                parameter.VolatileData.get_Branch(
                    branchIndex
                );

            GH_IWriter branchChunk =
                inputChunk.CreateChunk(
                    "Branch",
                    branchIndex
                );

            GH_IWriter pathChunk =
                branchChunk.CreateChunk(
                    "Path"
                );

            if (!path.Write(pathChunk))
            {
                throw new InvalidOperationException(
                    "Could not serialize Grasshopper path " +
                    path.ToString() +
                    "."
                );
            }

            int branchItemCount =
                branch == null
                ? 0
                : branch.Count;

            branchChunk.SetInt32(
                "ItemCount",
                branchItemCount
            );

            if (branch == null)
                continue;

            for (
                int itemIndex = 0;
                itemIndex < branch.Count;
                itemIndex++)
            {
                IGH_Goo goo =
                    branch[itemIndex] as IGH_Goo;

                GH_IWriter itemChunk =
                    branchChunk.CreateChunk(
                        "Item",
                        itemIndex
                    );

                itemChunk.SetInt32(
                    "GlobalIndex",
                    globalItemIndex
                );

                globalItemIndex++;

                if (goo == null)
                {
                    itemChunk.SetBoolean(
                        "IsNull",
                        true
                    );

                    continue;
                }

                itemChunk.SetBoolean(
                    "IsNull",
                    false
                );

                Type runtimeType =
                    goo.GetType();

                itemChunk.SetString(
                    "RuntimeType",
                    runtimeType.AssemblyQualifiedName ?? ""
                );

                itemChunk.SetString(
                    "TypeName",
                    goo.TypeName ?? runtimeType.Name
                );

                itemChunk.SetString(
                    "TypeDescription",
                    goo.TypeDescription ?? ""
                );

                GH_IWriter gooChunk =
                    itemChunk.CreateChunk(
                        "Goo"
                    );

                bool gooWritten =
                    goo.Write(gooChunk);

                if (!gooWritten)
                {
                    throw new InvalidOperationException(
                        "Could not serialize item " +
                        itemIndex +
                        " in input " +
                        parameter.NickName +
                        ". Type: " +
                        runtimeType.FullName
                    );
                }
            }
        }
    }

    // ============================================================
    // LOCAL GH AGENT REGISTRATION
    // ============================================================

    private string RegisterLocalUpload(
        string session,
        string domain,
        int outputIndex,
        string localPath)
    {
        StringBuilder payload =
            new StringBuilder();

        payload.Append("{");
        payload.Append(
            "\"command\":\"register_local_upload\","
        );
        payload.Append(
            "\"session\":\"" +
            EscapeJson(session) +
            "\","
        );
        payload.Append(
            "\"local_path\":\"" +
            EscapeJson(localPath) +
            "\","
        );
        payload.Append(
            "\"domain\":\"" +
            EscapeJson(domain) +
            "\","
        );
        payload.Append(
            "\"category\":\"ghdata\","
        );

        if (
            string.Equals(
                domain,
                "design",
                StringComparison.OrdinalIgnoreCase
            ))
        {
            payload.Append(
                "\"design_output_index\":" +
                outputIndex.ToString(
                    CultureInfo.InvariantCulture
                ) +
                ","
            );
        }
        else if (
            string.Equals(
                domain,
                "motion",
                StringComparison.OrdinalIgnoreCase
            ))
        {
            payload.Append(
                "\"motion_output_index\":" +
                outputIndex.ToString(
                    CultureInfo.InvariantCulture
                ) +
                ","
            );
        }

        payload.Append(
            "\"upload_status\":\"pending\""
        );

        payload.Append("}");

        string response =
            SendCommand(
                payload.ToString()
            );

        if (response.StartsWith("ERROR:"))
        {
            throw new InvalidOperationException(
                response
            );
        }

        return response;
    }

    private string SendCommand(
        string command)
    {
        try
        {
            using (
                TcpClient client =
                    new TcpClient())
            {
                IAsyncResult connection =
                    client.BeginConnect(
                        GhAgentHost,
                        GhAgentPort,
                        null,
                        null
                    );

                bool connected =
                    connection.AsyncWaitHandle.WaitOne(
                        TimeSpan.FromMilliseconds(
                            500
                        )
                    );

                if (!connected)
                {
                    return
                        "ERROR: GH Agent connection timeout.";
                }

                client.EndConnect(connection);

                using (
                    NetworkStream stream =
                        client.GetStream())
                {
                    byte[] payload =
                        Encoding.UTF8.GetBytes(
                            command
                        );

                    byte[] header =
                        BuildHeader(
                            payload.Length
                        );

                    stream.Write(
                        header,
                        0,
                        header.Length
                    );

                    stream.Write(
                        payload,
                        0,
                        payload.Length
                    );

                    byte[] responseHeader =
                        ReadExact(
                            stream,
                            MessageHeaderSize
                        );

                    ulong responseSize =
                        ParseHeader(
                            responseHeader
                        );

                    if (responseSize > int.MaxValue)
                    {
                        return
                            "ERROR: GH Agent response is too large.";
                    }

                    byte[] responsePayload =
                        ReadExact(
                            stream,
                            (int)responseSize
                        );

                    return Encoding.UTF8.GetString(
                        responsePayload
                    );
                }
            }
        }
        catch (Exception exception)
        {
            return
                "ERROR: " +
                exception.Message;
        }
    }

    private byte[] BuildHeader(
        int payloadSize)
    {
        byte[] header =
            new byte[MessageHeaderSize];

        ulong size =
            (ulong)payloadSize;

        for (
            int index = 0;
            index < MessageHeaderSize;
            index++)
        {
            header[
                MessageHeaderSize - 1 - index
            ] = (byte)(size & 0xFF);

            size >>= 8;
        }

        return header;
    }

    private ulong ParseHeader(
        byte[] header)
    {
        ulong size = 0;

        for (
            int index = 0;
            index < header.Length;
            index++)
        {
            size =
                (size << 8) +
                header[index];
        }

        return size;
    }

    private byte[] ReadExact(
        NetworkStream stream,
        int size)
    {
        byte[] data =
            new byte[size];

        int offset = 0;

        while (offset < size)
        {
            int read =
                stream.Read(
                    data,
                    offset,
                    size - offset
                );

            if (read == 0)
            {
                throw new IOException(
                    "Connection closed before the response was complete."
                );
            }

            offset += read;
        }

        return data;
    }

    // ============================================================
    // PATHS AND VALIDATION
    // ============================================================

    private string ValidateSettings(
        string directory,
        string fileName,
        string session,
        string domain,
        int outputIndex)
    {
        if (string.IsNullOrWhiteSpace(directory))
        {
            return "Directory cannot be empty.";
        }

        string trimmedDirectory =
            directory.Trim();

        if (!Path.IsPathRooted(trimmedDirectory))
        {
            return "Directory must be an absolute path.";
        }

        if (
            !System.IO.Directory.Exists(
                trimmedDirectory
            ))
        {
            return
                "Directory does not exist: " +
                trimmedDirectory;
        }

        if (string.IsNullOrWhiteSpace(session))
        {
            return "Session cannot be empty.";
        }

        string trimmedSession =
            session.Trim();

        if (
            Path.GetFileName(trimmedSession) !=
            trimmedSession)
        {
            return
                "Session must be a folder name, not a path.";
        }

        if (string.IsNullOrWhiteSpace(domain))
        {
            return "Domain cannot be empty.";
        }

        string normalizedDomain =
            NormalizeName(
                domain,
                ""
            );

        if (
            normalizedDomain != "design" &&
            normalizedDomain != "motion")
        {
            return
                "Domain must currently be 'design' or 'motion'.";
        }

        if (outputIndex < 1)
        {
            return "OutputIndex must be at least 1.";
        }

        if (!string.IsNullOrWhiteSpace(fileName))
        {
            string trimmedFileName =
                fileName.Trim();

            if (
                Path.GetFileName(trimmedFileName) !=
                trimmedFileName)
            {
                return
                    "FileName must be a filename, not a path.";
            }

            foreach (
                char invalidCharacter
                in Path.GetInvalidFileNameChars())
            {
                if (
                    trimmedFileName.IndexOf(
                        invalidCharacter
                    ) >= 0)
                {
                    return
                        "FileName contains an invalid character.";
                }
            }
        }

        return "";
    }

    private string BuildFileName(
        string requestedFileName,
        string normalizedDomain,
        int outputIndex)
    {
        string extension = ".ghdata";

        /*
        * Optional FileName now represents the category.
        *
        * Examples:
        *
        * empty / "ghdata"
        *     -> design_ghdata_05.ghdata
        *
        * "geometry"
        *     -> design_geometry_05.ghdata
        */
        string category =
            string.IsNullOrWhiteSpace(requestedFileName)
            ? "ghdata"
            : Path.GetFileNameWithoutExtension(
                requestedFileName.Trim()
            );

        category =
            NormalizeName(
                category,
                "ghdata"
            );

        return
            normalizedDomain +
            "_" +
            category +
            "_" +
            outputIndex.ToString(
                "00",
                CultureInfo.InvariantCulture
            ) +
            extension;
    }

    private string NormalizeName(
        string value,
        string fallback)
    {
        string raw =
            string.IsNullOrWhiteSpace(value)
            ? fallback
            : value
                .Trim()
                .ToLowerInvariant();

        StringBuilder cleaned =
            new StringBuilder();

        foreach (char character in raw)
        {
            cleaned.Append(
                char.IsLetterOrDigit(character)
                ? character
                : '_'
            );
        }

        string result =
            cleaned.ToString();

        while (result.Contains("__"))
        {
            result =
                result.Replace(
                    "__",
                    "_"
                );
        }

        result =
            result.Trim('_');

        return
            string.IsNullOrWhiteSpace(result)
            ? fallback
            : result;
    }

    // ============================================================
    // READY EVENT
    // ============================================================

    private string BuildReadyEvent(
        string eventId,
        string createdAt,
        string session,
        string domain,
        int outputIndex,
        string outputPath,
        int connectedInputCount,
        int populatedInputCount,
        List<string> summaries)
    {
        List<string> escapedSummaries =
            summaries
                .Select(
                    summary =>
                        "\"" +
                        EscapeJson(summary) +
                        "\""
                )
                .ToList();

        return
            "{" +
            "\"event_id\":\"" +
            EscapeJson(eventId) +
            "\"," +
            "\"event\":\"local_output_ready\"," +
            "\"status\":\"ready\"," +
            "\"created_at\":\"" +
            EscapeJson(createdAt) +
            "\"," +
            "\"session\":\"" +
            EscapeJson(session) +
            "\"," +
            "\"domain\":\"" +
            EscapeJson(domain) +
            "\"," +
            "\"output_index\":" +
            outputIndex.ToString(
                CultureInfo.InvariantCulture
            ) +
            "," +
            "\"local_path\":\"" +
            EscapeJson(outputPath) +
            "\"," +
            "\"category\":\"ghdata\"," +
            "\"connected_input_count\":" +
            connectedInputCount.ToString(
                CultureInfo.InvariantCulture
            ) +
            "," +
            "\"populated_input_count\":" +
            populatedInputCount.ToString(
                CultureInfo.InvariantCulture
            ) +
            "," +
            "\"input_summary\":[" +
            string.Join(
                ",",
                escapedSummaries
            ) +
            "]" +
            "}";
    }

    // ============================================================
    // TYPE AND STRUCTURE HELPERS
    // ============================================================

    private string DetectSourceType(
        IGH_Param parameter)
    {
        HashSet<string> sourceTypes =
            new HashSet<string>(
                StringComparer.OrdinalIgnoreCase
            );

        foreach (
            IGH_Param source
            in parameter.Sources)
        {
            if (source == null)
                continue;

            string rawType =
                !string.IsNullOrWhiteSpace(
                    source.TypeName
                )
                ? source.TypeName
                : source.Name;

            string normalized =
                NormalizeTypeText(
                    rawType
                );

            if (
                !string.IsNullOrWhiteSpace(
                    normalized
                ))
            {
                sourceTypes.Add(
                    normalized
                );
            }
        }

        if (sourceTypes.Count == 1)
            return sourceTypes.First();

        if (sourceTypes.Count > 1)
            return "Mixed";

        return "No Data";
    }

    private string GetStructureName(
        int pathCount,
        int itemCount)
    {
        if (itemCount == 0)
            return "Empty";

        if (pathCount <= 1)
        {
            return
                itemCount == 1
                ? "Item"
                : "List";
        }

        return
            "Tree (" +
            pathCount +
            " branches)";
    }

    private string GetFriendlyTypeName(
        IGH_Goo goo)
    {
        if (goo == null)
            return "";

        if (goo is GH_Point)
            return "Points";

        if (goo is GH_Vector)
            return "Vectors";

        if (goo is GH_Line)
            return "Lines";

        if (goo is GH_Circle)
            return "Circles";

        if (goo is GH_Arc)
            return "Arcs";

        if (goo is GH_Curve)
            return "Curves";

        if (goo is GH_Mesh)
            return "Meshes";

        if (goo is GH_Brep)
            return "Breps";

        if (goo is GH_Surface)
            return "Surfaces";

        if (goo is GH_Plane)
            return "Planes";

        if (goo is GH_Number)
            return "Numbers";

        if (goo is GH_Integer)
            return "Integers";

        if (goo is GH_Boolean)
            return "Booleans";

        if (goo is GH_String)
            return "Text";

        if (goo is GH_Colour)
            return "Colours";

        string typeName =
            goo.TypeName;

        return
            string.IsNullOrWhiteSpace(typeName)
            ? goo.GetType().Name
            : NormalizeTypeText(typeName);
    }

    private string NormalizeTypeText(
        string value)
    {
        if (string.IsNullOrWhiteSpace(value))
            return "";

        string normalized =
            value
                .Trim()
                .Replace(
                    "GH_",
                    ""
                )
                .Replace(
                    "_",
                    " "
                );

        switch (
            normalized.ToLowerInvariant())
        {
            case "point":
            case "point3d":
                return "Points";

            case "vector":
            case "vector3d":
                return "Vectors";

            case "line":
                return "Lines";

            case "circle":
                return "Circles";

            case "arc":
                return "Arcs";

            case "curve":
                return "Curves";

            case "mesh":
                return "Meshes";

            case "brep":
                return "Breps";

            case "surface":
                return "Surfaces";

            case "plane":
                return "Planes";

            case "number":
            case "double":
            case "floating point":
                return "Numbers";

            case "integer":
            case "int32":
                return "Integers";

            case "boolean":
            case "bool":
                return "Booleans";

            case "string":
            case "text":
                return "Text";

            case "colour":
            case "color":
                return "Colours";
        }

        return normalized;
    }

    private string GetAlphabeticName(
        int zeroBasedIndex)
    {
        int value =
            zeroBasedIndex;

        string result =
            "";

        do
        {
            result =
                (char)(
                    'A' +
                    value % 26
                ) +
                result;

            value =
                value / 26 -
                1;
        }
        while (value >= 0);

        return result;
    }

    // ============================================================
    // JSON HELPERS
    // ============================================================

    private string EscapeJson(
        string value)
    {
        if (value == null)
            return "";

        return value
            .Replace(
                "\\",
                "\\\\"
            )
            .Replace(
                "\"",
                "\\\""
            )
            .Replace(
                "\r",
                "\\r"
            )
            .Replace(
                "\n",
                "\\n"
            )
            .Replace(
                "\t",
                "\\t"
            );
    }

    private string ExtractJsonValue(
        string json,
        string key)
    {
        if (string.IsNullOrWhiteSpace(json))
            return "";

        string pattern =
            "\"" +
            key +
            "\":";

        int start =
            json.IndexOf(
                pattern,
                StringComparison.Ordinal
            );

        if (start < 0)
            return "";

        start +=
            pattern.Length;

        while (
            start < json.Length &&
            char.IsWhiteSpace(json[start]))
        {
            start++;
        }

        if (start >= json.Length)
            return "";

        if (json[start] == '"')
        {
            start++;

            StringBuilder value =
                new StringBuilder();

            bool escaped = false;

            for (
                int index = start;
                index < json.Length;
                index++)
            {
                char character =
                    json[index];

                if (escaped)
                {
                    switch (character)
                    {
                        case 'n':
                            value.Append('\n');
                            break;

                        case 'r':
                            value.Append('\r');
                            break;

                        case 't':
                            value.Append('\t');
                            break;

                        case '\\':
                            value.Append('\\');
                            break;

                        case '"':
                            value.Append('"');
                            break;

                        default:
                            value.Append(character);
                            break;
                    }

                    escaped = false;
                    continue;
                }

                if (character == '\\')
                {
                    escaped = true;
                    continue;
                }

                if (character == '"')
                {
                    return value.ToString();
                }

                value.Append(character);
            }

            return "";
        }

        int end =
            start;

        while (
            end < json.Length &&
            json[end] != ',' &&
            json[end] != '}')
        {
            end++;
        }

        return json
            .Substring(
                start,
                end - start
            )
            .Trim();
    }

    // ============================================================
    // OUTPUTS
    // ============================================================

    private void SetOutputs(
        List<string> summaries,
        ref object OutputPath,
        ref object InputSummary,
        ref object ReadyEvent,
        ref object Status)
    {
        OutputPath =
            lastOutputPath;

        InputSummary =
            summaries;

        ReadyEvent =
            lastReadyEvent;

        Status =
            lastStatus;
    }

    private class DataInputRecord
    {
        public string Key;
        public int RelativeIndex;
        public IGH_Param Parameter;

        public string TypeName;
        public string StructureName;

        public int ItemCount;
        public int PathCount;

        public bool IsConnected;

        public string Summary;
    }
}
# ---------- end c_script_13 ----------
panel_52 = Panel(c_script_10)

trigger_9 = Trigger(Interval=1000, TimerInterval=1000, Target=c_script_14)  # disabled
connect_7 = BooleanToggle(False)
c_script_14 = CSharpScript(ConnectButton=connect_7, RefreshStatus=c_script_7.Pulse, SessionName="EOB_test03")  # -> Status, Message, SessionFolder, ManifestPath, PathReady; inputs ConnectButton: Boolean, RefreshStatus: Boolean, SessionName: String
# ---------- c_script_14: C# ----------
// Grasshopper Script Instance
#region Usings
using System;
using System.Text;
using System.Net.Sockets;

using Rhino;
using Rhino.Geometry;

using Grasshopper;
using Grasshopper.Kernel;
using Grasshopper.Kernel.Data;
using Grasshopper.Kernel.Types;
#endregion

public class Script_Instance : GH_ScriptInstance
{
    private bool previousRefreshStatus = false;

    private bool isConnected = false;
    private bool triedConnect = false;

    private string lastStatus = "Disconnected";
    private string lastMessage = "Enable ConnectButton.";

    private string lastSessionFolder = "";
    private string lastManifestPath = "";

    // One-solution event pulse.
    private bool pathReadyPulse = false;

    private void RunScript(
		bool ConnectButton,
		bool RefreshStatus,
		string SessionName,
		ref object Status,
		ref object Message,
		ref object SessionFolder,
		ref object ManifestPath,
		ref object PathReady)
    {
        const string host = "127.0.0.1";
        const int port = 6005;

        // PathReady is false by default for every GH solution.
        // It becomes true only after a new successful path request.
        pathReadyPulse = false;

        bool refreshPulse =
            RefreshStatus &&
            !previousRefreshStatus;

        previousRefreshStatus = RefreshStatus;

        if (!ConnectButton)
        {
            isConnected = false;
            triedConnect = false;

            lastStatus = "Disconnected";
            lastMessage = "Connection toggle is off.";

            SetOutputs(
                ref Status,
                ref Message,
                ref SessionFolder,
                ref ManifestPath,
                ref PathReady
            );

            return;
        }

        if (
            ConnectButton &&
            !isConnected &&
            !triedConnect)
        {
            triedConnect = true;

            string response = SendCommand(
                host,
                port,
                "{\"command\":\"ping\"}"
            );

            if (response.StartsWith("ERROR:"))
            {
                isConnected = false;
                lastStatus = "Connection failed";
                lastMessage = response;
            }
            else
            {
                string responseStatus =
                    ExtractJsonValue(
                        response,
                        "status"
                    );

                if (
                    string.Equals(
                        responseStatus,
                        "ok",
                        StringComparison.OrdinalIgnoreCase
                    ))
                {
                    isConnected = true;
                    lastStatus = "Connected";

                    string responseMessage =
                        ExtractJsonValue(
                            response,
                            "message"
                        );

                    lastMessage =
                        string.IsNullOrWhiteSpace(
                            responseMessage
                        )
                        ? response
                        : responseMessage;
                }
                else
                {
                    isConnected = false;
                    lastStatus = "Connection failed";
                    lastMessage = response;
                }
            }
        }

        if (!isConnected)
        {
            SetOutputs(
                ref Status,
                ref Message,
                ref SessionFolder,
                ref ManifestPath,
                ref PathReady
            );

            return;
        }

        if (refreshPulse)
        {
            string session =
                string.IsNullOrWhiteSpace(
                    SessionName
                )
                ? "RQC_Capture_Session"
                : SessionName.Trim();

            string payload =
                "{" +
                "\"command\":\"get_upload_session_path\"," +
                "\"session\":\"" +
                EscapeJson(session) +
                "\"" +
                "}";

            string response =
                SendCommand(
                    host,
                    port,
                    payload
                );

            if (response.StartsWith("ERROR:"))
            {
                isConnected = false;
                triedConnect = true;

                lastStatus = "Connection lost";
                lastMessage = response;
            }
            else
            {
                string responseStatus =
                    ExtractJsonValue(
                        response,
                        "status"
                    );

                if (
                    !string.Equals(
                        responseStatus,
                        "ok",
                        StringComparison.OrdinalIgnoreCase
                    ))
                {
                    lastStatus =
                        "Upload path request failed";

                    string responseMessage =
                        ExtractJsonValue(
                            response,
                            "message"
                        );

                    lastMessage =
                        string.IsNullOrWhiteSpace(
                            responseMessage
                        )
                        ? response
                        : responseMessage;
                }
                else
                {
                    lastSessionFolder =
                        ExtractJsonValue(
                            response,
                            "session_folder"
                        );

                    lastManifestPath =
                        ExtractJsonValue(
                            response,
                            "manifest_path"
                        );

                    if (
                        !string.IsNullOrWhiteSpace(
                            lastSessionFolder
                        ) &&
                        !string.IsNullOrWhiteSpace(
                            lastManifestPath
                        ))
                    {
                        // This is based on a new successful request,
                        // not on whether the path text changed.
                        pathReadyPulse = true;

                        lastStatus =
                            "Upload session ready";

                        lastMessage =
                            "The local upload session folder " +
                            "and manifest are ready.";
                    }
                    else
                    {
                        pathReadyPulse = false;

                        lastStatus =
                            "Upload path response invalid";

                        lastMessage =
                            "The GH Agent returned success, but " +
                            "the session folder or manifest path " +
                            "was empty.";
                    }
                }
            }
        }

        SetOutputs(
            ref Status,
            ref Message,
            ref SessionFolder,
            ref ManifestPath,
            ref PathReady
        );
    }

    private void SetOutputs(
        ref object Status,
        ref object Message,
        ref object SessionFolder,
        ref object ManifestPath,
        ref object PathReady)
    {
        Status = lastStatus;
        Message = lastMessage;
        SessionFolder = lastSessionFolder;
        ManifestPath = lastManifestPath;
        PathReady = pathReadyPulse;
    }

    private string SendCommand(
        string host,
        int port,
        string command)
    {
        const int headerSize = 8;

        try
        {
            using (
                TcpClient client =
                    new TcpClient())
            {
                IAsyncResult result =
                    client.BeginConnect(
                        host,
                        port,
                        null,
                        null
                    );

                bool success =
                    result.AsyncWaitHandle.WaitOne(
                        TimeSpan.FromMilliseconds(300)
                    );

                if (!success)
                {
                    return
                        "ERROR: GH Agent connection timeout.";
                }

                client.EndConnect(result);

                using (
                    NetworkStream stream =
                        client.GetStream())
                {
                    byte[] payload =
                        Encoding.UTF8.GetBytes(
                            command
                        );

                    byte[] header =
                        new byte[headerSize];

                    ulong size =
                        (ulong)payload.Length;

                    for (
                        int index = 0;
                        index < headerSize;
                        index++)
                    {
                        header[
                            headerSize - 1 - index
                        ] = (byte)(size & 0xFF);

                        size >>= 8;
                    }

                    stream.Write(
                        header,
                        0,
                        header.Length
                    );

                    stream.Write(
                        payload,
                        0,
                        payload.Length
                    );

                    byte[] responseHeader =
                        ReadExact(
                            stream,
                            headerSize
                        );

                    ulong responseSize = 0;

                    for (
                        int index = 0;
                        index < headerSize;
                        index++)
                    {
                        responseSize =
                            (responseSize << 8) +
                            responseHeader[index];
                    }

                    if (responseSize > int.MaxValue)
                    {
                        return
                            "ERROR: Agent response is too large.";
                    }

                    byte[] responsePayload =
                        ReadExact(
                            stream,
                            (int)responseSize
                        );

                    return Encoding.UTF8.GetString(
                        responsePayload
                    );
                }
            }
        }
        catch (Exception exception)
        {
            return "ERROR: " + exception.Message;
        }
    }

    private byte[] ReadExact(
        NetworkStream stream,
        int size)
    {
        byte[] data = new byte[size];
        int offset = 0;

        while (offset < size)
        {
            int read = stream.Read(
                data,
                offset,
                size - offset
            );

            if (read == 0)
            {
                throw new Exception(
                    "Connection closed."
                );
            }

            offset += read;
        }

        return data;
    }

    private string EscapeJson(string value)
    {
        if (value == null)
            return "";

        return value
            .Replace("\\", "\\\\")
            .Replace("\"", "\\\"")
            .Replace("\r", "\\r")
            .Replace("\n", "\\n")
            .Replace("\t", "\\t");
    }

    private string ExtractJsonValue(
        string json,
        string key)
    {
        if (string.IsNullOrWhiteSpace(json))
            return "";

        string pattern =
            "\"" + key + "\":";

        int start = json.IndexOf(
            pattern,
            StringComparison.Ordinal
        );

        if (start < 0)
            return "";

        start += pattern.Length;

        while (
            start < json.Length &&
            char.IsWhiteSpace(json[start]))
        {
            start++;
        }

        if (
            start >= json.Length ||
            json[start] != '"')
        {
            return "";
        }

        start++;

        StringBuilder value =
            new StringBuilder();

        bool escaped = false;

        for (
            int index = start;
            index < json.Length;
            index++)
        {
            char character = json[index];

            if (escaped)
            {
                switch (character)
                {
                    case 'n':
                        value.Append('\n');
                        break;

                    case 'r':
                        value.Append('\r');
                        break;

                    case 't':
                        value.Append('\t');
                        break;

                    case '\\':
                        value.Append('\\');
                        break;

                    case '"':
                        value.Append('"');
                        break;

                    default:
                        value.Append(character);
                        break;
                }

                escaped = false;
                continue;
            }

            if (character == '\\')
            {
                escaped = true;
                continue;
            }

            if (character == '"')
            {
                return value.ToString();
            }

            value.Append(character);
        }

        return "";
    }
}
# ---------- end c_script_14 ----------
panel_53 = Panel(c_script_14.Status)
panel_54 = Panel(c_script_14.Message)
panel_55 = Panel(c_script_14.SessionFolder)
panel_56 = Panel(c_script_14.ManifestPath)
panel_57 = Panel(c_script_14.PathReady)

panel_58 = Panel(c_script_11.Status)
panel_59 = Panel(c_script_11.Message)
path_2 = FilePath(c_script_11.PointCloudPaths)
panel_60 = Panel(c_script_12.Status)
panel_61 = Panel(c_script_12.Message)
panel_62 = Panel(c_script_12.SessionFolder)
panel_63 = Panel(c_script_12.ManifestPath)
panel_64 = Panel(c_script_13.OutputPath)
panel_65 = Panel(c_script_13.InputSummary)
panel_66 = Panel(c_script_13.ReadyEvent)
panel_67 = Panel(c_script_13.Status)
import_2 = ImportContent(FilePath=path_2)  # -> Objects, Layers, Linetypes, HatchPatterns, AnnotationStyles, Materials, BlockDefinitions
trigger_10 = Trigger(Interval=1000, TimerInterval=1000, Target=[c_script_21, c_script_24, c_script_28, c_script_29, c_script_30])  # disabled
connect_8 = BooleanToggle(False)
download_3 = Button()
output_index_3 = ValueList({"1", "2", "3", "4", "5", "6", "7", "8", "9", "10"}, selected="1")
refresh_status_7 = BooleanToggle(False)

connect_9 = BooleanToggle(False)
download_4 = Button()
output_index_4 = ValueList({"1", "2", "3", "4", "5", "6", "7", "8", "9", "10"}, selected="1")
refresh_status_8 = BooleanToggle(False)
c_script_15 = CSharpScript(
    ConnectButton=connect_9,
    DownloadButton=download_4,
    SessionName="EOB_test03",
    DesignOutputIndex=output_index_4,
    AutoPoll=refresh_status_8)  # -> State, Status, Message, FilePath, DownloadJobId, Progress, DownloadReady; inputs ConnectButton: Boolean, DownloadButton: Boolean, SessionName: String, DesignOutputIndex: Int32, AutoPoll: Boolean
# ---------- c_script_15: C# ----------
// Grasshopper C# Script Instance
#region Usings
using System;
using System.Globalization;
using System.Net.Sockets;
using System.Text;

using Grasshopper;
using Grasshopper.Kernel;
#endregion

public class Script_Instance : GH_ScriptInstance
{
    // ============================================================
    // CONFIGURATION
    // ============================================================

    private const string GhAgentHost =
        "127.0.0.1";

    private const int GhAgentPort =
        6005;

    private const int MessageHeaderSize =
        8;

    private const int PollIntervalMilliseconds =
        500;

    // ============================================================
    // COMPONENT STATE
    // ============================================================

    private bool previousDownloadButton =
        false;

    private bool isConnected =
        false;

    private bool triedConnection =
        false;

    private bool pollScheduled =
        false;

    private bool downloadReadyPulse =
        false;

    private string activeJobId =
        "";

    private string activeSession =
        "";

    private int activeDesignOutputIndex =
        0;

    private string lastState =
        "Idle";

    private string lastStatus =
        "Disconnected";

    private string lastMessage =
        "Enable ConnectButton.";

    private string lastFilePath =
        "";

    private int lastProgress =
        0;

    // ============================================================
    // MAIN
    // ============================================================

    private void RunScript(
		bool ConnectButton,
		bool DownloadButton,
		string SessionName,
		int DesignOutputIndex,
		bool AutoPoll,
		ref object State,
		ref object Status,
		ref object Message,
		ref object FilePath,
		ref object DownloadJobId,
		ref object Progress,
		ref object DownloadReady)
    {
        // DownloadReady is an event pulse.
        // It is false by default for every Grasshopper solution.
        downloadReadyPulse =
            false;

        bool downloadPulse =
            DownloadButton &&
            !previousDownloadButton;

        previousDownloadButton =
            DownloadButton;

        try
        {
            // ----------------------------------------------------
            // Connection disabled
            // ----------------------------------------------------

            if (!ConnectButton)
            {
                isConnected =
                    false;

                triedConnection =
                    false;

                pollScheduled =
                    false;

                lastState =
                    "Idle";

                lastStatus =
                    "Disconnected";

                lastMessage =
                    "Connection toggle is off.";

                SetOutputs(
                    ref State,
                    ref Status,
                    ref Message,
                    ref FilePath,
                    ref DownloadJobId,
                    ref Progress,
                    ref DownloadReady
                );

                return;
            }

            // ----------------------------------------------------
            // Connect to the local GH Agent
            // ----------------------------------------------------

            if (
                !isConnected &&
                !triedConnection
            )
            {
                triedConnection =
                    true;

                string pingResponse =
                    SendCommand(
                        "{\"command\":\"ping\"}"
                    );

                if (
                    pingResponse.StartsWith(
                        "ERROR:",
                        StringComparison.Ordinal
                    )
                )
                {
                    ConnectionFailure(
                        pingResponse
                    );

                    SetOutputs(
                        ref State,
                        ref Status,
                        ref Message,
                        ref FilePath,
                        ref DownloadJobId,
                        ref Progress,
                        ref DownloadReady
                    );

                    return;
                }

                string pingStatus =
                    ExtractJsonValue(
                        pingResponse,
                        "status"
                    );

                if (
                    !string.Equals(
                        pingStatus,
                        "ok",
                        StringComparison.OrdinalIgnoreCase
                    )
                )
                {
                    isConnected =
                        false;

                    lastState =
                        "Connection error";

                    lastStatus =
                        "Connection failed";

                    lastMessage =
                        GetResponseMessage(
                            pingResponse,
                            "GH Agent ping failed."
                        );

                    SetOutputs(
                        ref State,
                        ref Status,
                        ref Message,
                        ref FilePath,
                        ref DownloadJobId,
                        ref Progress,
                        ref DownloadReady
                    );

                    return;
                }

                isConnected =
                    true;

                lastState =
                    "Ready";

                lastStatus =
                    "Connected";

                lastMessage =
                    GetResponseMessage(
                        pingResponse,
                        "Connected to GH Agent."
                    );
            }

            if (!isConnected)
            {
                SetOutputs(
                    ref State,
                    ref Status,
                    ref Message,
                    ref FilePath,
                    ref DownloadJobId,
                    ref Progress,
                    ref DownloadReady
                );

                return;
            }

            // ----------------------------------------------------
            // Submit design download
            // ----------------------------------------------------

            if (downloadPulse)
            {
                SubmitDownload(
                    SessionName,
                    DesignOutputIndex
                );
            }

            // ----------------------------------------------------
            // Poll active download
            // ----------------------------------------------------

            if (
                IsDownloadActive() &&
                AutoPoll
            )
            {
                PollDownloadJob();

                if (IsDownloadActive())
                {
                    ScheduleNextPoll();
                }
            }

            SetOutputs(
                ref State,
                ref Status,
                ref Message,
                ref FilePath,
                ref DownloadJobId,
                ref Progress,
                ref DownloadReady
            );
        }
        catch (Exception exception)
        {
            lastState =
                "Failed";

            lastStatus =
                "Component error";

            lastMessage =
                exception.Message;

            SetOutputs(
                ref State,
                ref Status,
                ref Message,
                ref FilePath,
                ref DownloadJobId,
                ref Progress,
                ref DownloadReady
            );
        }
    }

    // ============================================================
    // DOWNLOAD SUBMISSION
    // ============================================================

    private void SubmitDownload(
        string sessionName,
        int designOutputIndex)
    {
        string session =
            string.IsNullOrWhiteSpace(
                sessionName
            )
            ? ""
            : sessionName.Trim();

        if (
            string.IsNullOrWhiteSpace(
                session
            )
        )
        {
            throw new ArgumentException(
                "SessionName cannot be empty."
            );
        }

        if (designOutputIndex < 1)
        {
            throw new ArgumentException(
                "DesignOutputIndex must be at least 1."
            );
        }

        string payload =
            "{" +
            "\"command\":\"download_design_output\"," +
            "\"session\":\"" +
            EscapeJson(session) +
            "\"," +
            "\"design_output_index\":" +
            designOutputIndex.ToString(
                CultureInfo.InvariantCulture
            ) +
            "," +
            "\"category\":\"ghdata\"" +
            "}";

        lastState =
            "Submitting";

        lastStatus =
            "Submitting download";

        lastMessage =
            "Requesting design output from GH Agent.";

        string response =
            SendCommand(
                payload
            );

        if (
            response.StartsWith(
                "ERROR:",
                StringComparison.Ordinal
            )
        )
        {
            ConnectionFailure(
                response
            );

            return;
        }

        string responseStatus =
            ExtractJsonValue(
                response,
                "status"
            );

        if (
            !string.Equals(
                responseStatus,
                "ok",
                StringComparison.OrdinalIgnoreCase
            )
        )
        {
            lastState =
                "Failed";

            lastStatus =
                "Download submission failed";

            lastMessage =
                GetResponseMessage(
                    response,
                    response
                );

            return;
        }

        string jobId =
            ExtractJsonValue(
                response,
                "job_id"
            );

        if (
            string.IsNullOrWhiteSpace(
                jobId
            )
        )
        {
            lastState =
                "Failed";

            lastStatus =
                "Download submission failed";

            lastMessage =
                "GH Agent returned success without a job ID.";

            return;
        }

        activeJobId =
            jobId;

        activeSession =
            session;

        activeDesignOutputIndex =
            designOutputIndex;

        lastFilePath =
            "";

        lastProgress =
            0;

        lastState =
            "Download queued";

        lastStatus =
            ExtractJsonValue(
                response,
                "latest_status"
            );

        if (
            string.IsNullOrWhiteSpace(
                lastStatus
            )
        )
        {
            lastStatus =
                "download_queued";
        }

        lastMessage =
            GetResponseMessage(
                response,
                "Design download job submitted."
            );

        ScheduleNextPoll();
    }

    // ============================================================
    // JOB POLLING
    // ============================================================

    private void PollDownloadJob()
    {
        if (
            string.IsNullOrWhiteSpace(
                activeJobId
            )
        )
        {
            return;
        }

        string payload =
            "{" +
            "\"command\":\"get_job_status\"," +
            "\"job_id\":\"" +
            EscapeJson(activeJobId) +
            "\"" +
            "}";

        string response =
            SendCommand(
                payload
            );

        if (
            response.StartsWith(
                "ERROR:",
                StringComparison.Ordinal
            )
        )
        {
            ConnectionFailure(
                response
            );

            return;
        }

        string outerStatus =
            ExtractJsonValue(
                response,
                "status"
            );

        if (
            !string.Equals(
                outerStatus,
                "ok",
                StringComparison.OrdinalIgnoreCase
            )
        )
        {
            lastState =
                "Polling error";

            lastStatus =
                "Download status request failed";

            lastMessage =
                GetResponseMessage(
                    response,
                    response
                );

            return;
        }

        string jobJson =
            ExtractJsonObject(
                response,
                "job"
            );

        if (
            string.IsNullOrWhiteSpace(
                jobJson
            )
        )
        {
            lastState =
                "Polling error";

            lastStatus =
                "Download status unavailable";

            lastMessage =
                "GH Agent response did not contain a job object.";

            return;
        }

        string jobStatus =
            NormalizeStatus(
                ExtractJsonValue(
                    jobJson,
                    "status"
                )
            );

        string jobMessage =
            ExtractJsonValue(
                jobJson,
                "message"
            );

        string jobError =
            ExtractJsonValue(
                jobJson,
                "error"
            );

        lastProgress =
            ParseInteger(
                ExtractJsonValue(
                    jobJson,
                    "progress"
                ),
                lastProgress
            );

        if (
            !string.IsNullOrWhiteSpace(
                jobMessage
            )
        )
        {
            lastMessage =
                jobMessage;
        }

        lastStatus =
            string.IsNullOrWhiteSpace(
                jobStatus
            )
            ? "unknown"
            : jobStatus;

        if (
            jobStatus == "download_queued" ||
            jobStatus == "queued"
        )
        {
            lastState =
                "Download queued";

            return;
        }

        if (
            jobStatus == "download_running" ||
            jobStatus == "running"
        )
        {
            lastState =
                "Downloading";

            return;
        }

        if (
            jobStatus == "download_finished" ||
            jobStatus == "finished"
        )
        {
            lastState =
                "Finished";

            lastStatus =
                "download_finished";

            lastProgress =
                100;

            string resultJson =
                ExtractJsonObject(
                    jobJson,
                    "result"
                );

            lastFilePath =
                ExtractJsonValue(
                    resultJson,
                    "file_path"
                );

            if (
                string.IsNullOrWhiteSpace(
                    lastFilePath
                )
            )
            {
                /*
                 * Compatibility fallback in case file_path
                 * is nested inside the local file record.
                 */
                string fileJson =
                    ExtractJsonObject(
                        resultJson,
                        "file"
                    );

                lastFilePath =
                    ExtractJsonValue(
                        fileJson,
                        "local_path"
                    );
            }

            if (
                string.IsNullOrWhiteSpace(
                    lastFilePath
                )
            )
            {
                lastState =
                    "Finished with error";

                lastStatus =
                    "download_result_invalid";

                lastMessage =
                    "Download finished, but the result did not " +
                    "contain file_path or file.local_path.";

                return;
            }

            // A newly completed download with a valid path
            // emits one event pulse. It does not depend on whether
            // this path is identical to a previous download path.
            downloadReadyPulse =
                true;

            if (
                string.IsNullOrWhiteSpace(
                    lastMessage
                )
            )
            {
                lastMessage =
                    "Design output downloaded successfully.";
            }

            return;
        }

        if (
            jobStatus == "download_failed" ||
            jobStatus == "failed" ||
            jobStatus == "error"
        )
        {
            lastState =
                "Failed";

            lastStatus =
                "download_failed";

            lastProgress =
                100;

            if (
                !string.IsNullOrWhiteSpace(
                    jobError
                )
            )
            {
                lastMessage =
                    jobError;
            }
            else if (
                string.IsNullOrWhiteSpace(
                    lastMessage
                )
            )
            {
                lastMessage =
                    "Design output download failed.";
            }

            return;
        }

        if (jobStatus == "cancelled")
        {
            lastState =
                "Cancelled";

            lastStatus =
                "cancelled";

            lastProgress =
                100;

            if (
                string.IsNullOrWhiteSpace(
                    lastMessage
                )
            )
            {
                lastMessage =
                    "Design output download was cancelled.";
            }

            return;
        }

        lastState =
            "Download status unknown";
    }

    private bool IsDownloadActive()
    {
        string normalized =
            NormalizeStatus(
                lastStatus
            );

        return
            !string.IsNullOrWhiteSpace(
                activeJobId
            ) &&
            normalized != "download_finished" &&
            normalized != "finished" &&
            normalized != "download_failed" &&
            normalized != "failed" &&
            normalized != "error" &&
            normalized != "cancelled" &&
            normalized != "download_result_invalid";
    }

    // ============================================================
    // AUTOMATIC POLLING
    // ============================================================

    private void ScheduleNextPoll()
    {
        if (pollScheduled)
            return;

        GH_Document document =
            Component.OnPingDocument();

        if (document == null)
            return;

        pollScheduled =
            true;

        document.ScheduleSolution(
            PollIntervalMilliseconds,
            scheduledDocument =>
            {
                pollScheduled =
                    false;

                if (Component != null)
                {
                    Component.ExpireSolution(
                        false
                    );
                }
            }
        );
    }

    // ============================================================
    // CONNECTION
    // ============================================================

    private void ConnectionFailure(
        string message)
    {
        isConnected =
            false;

        triedConnection =
            true;

        lastState =
            "Connection error";

        lastStatus =
            "connection_failed";

        lastMessage =
            message;
    }

    private string SendCommand(
        string command)
    {
        try
        {
            using (
                TcpClient client =
                    new TcpClient()
            )
            {
                IAsyncResult connection =
                    client.BeginConnect(
                        GhAgentHost,
                        GhAgentPort,
                        null,
                        null
                    );

                bool connected =
                    connection.AsyncWaitHandle.WaitOne(
                        TimeSpan.FromMilliseconds(
                            500
                        )
                    );

                if (!connected)
                {
                    return
                        "ERROR: GH Agent connection timeout.";
                }

                client.EndConnect(
                    connection
                );

                using (
                    NetworkStream stream =
                        client.GetStream()
                )
                {
                    byte[] payload =
                        Encoding.UTF8.GetBytes(
                            command
                        );

                    byte[] header =
                        BuildHeader(
                            payload.Length
                        );

                    stream.Write(
                        header,
                        0,
                        header.Length
                    );

                    stream.Write(
                        payload,
                        0,
                        payload.Length
                    );

                    byte[] responseHeader =
                        ReadExact(
                            stream,
                            MessageHeaderSize
                        );

                    ulong responseSize =
                        ParseHeader(
                            responseHeader
                        );

                    if (
                        responseSize >
                        int.MaxValue
                    )
                    {
                        return
                            "ERROR: GH Agent response is too large.";
                    }

                    byte[] responsePayload =
                        ReadExact(
                            stream,
                            (int)responseSize
                        );

                    return
                        Encoding.UTF8.GetString(
                            responsePayload
                        );
                }
            }
        }
        catch (Exception exception)
        {
            return
                "ERROR: " +
                exception.Message;
        }
    }

    private byte[] BuildHeader(
        int payloadSize)
    {
        byte[] header =
            new byte[
                MessageHeaderSize
            ];

        ulong size =
            (ulong)payloadSize;

        for (
            int index = 0;
            index < MessageHeaderSize;
            index++
        )
        {
            header[
                MessageHeaderSize -
                1 -
                index
            ] =
                (byte)(
                    size &
                    0xFF
                );

            size >>=
                8;
        }

        return header;
    }

    private ulong ParseHeader(
        byte[] header)
    {
        ulong size =
            0;

        for (
            int index = 0;
            index < header.Length;
            index++
        )
        {
            size =
                (
                    size <<
                    8
                ) +
                header[index];
        }

        return size;
    }

    private byte[] ReadExact(
        NetworkStream stream,
        int size)
    {
        byte[] data =
            new byte[size];

        int offset =
            0;

        while (offset < size)
        {
            int read =
                stream.Read(
                    data,
                    offset,
                    size - offset
                );

            if (read == 0)
            {
                throw new InvalidOperationException(
                    "Connection closed before the response " +
                    "was complete."
                );
            }

            offset +=
                read;
        }

        return data;
    }

    // ============================================================
    // JSON HELPERS
    // ============================================================

    private string GetResponseMessage(
        string json,
        string fallback)
    {
        string message =
            ExtractJsonValue(
                json,
                "message"
            );

        return
            string.IsNullOrWhiteSpace(
                message
            )
            ? fallback
            : message;
    }

    private string NormalizeStatus(
        string value)
    {
        return
            string.IsNullOrWhiteSpace(
                value
            )
            ? ""
            : value
                .Trim()
                .ToLowerInvariant();
    }

    private int ParseInteger(
        string value,
        int fallback)
    {
        int integerValue;

        if (
            int.TryParse(
                value,
                NumberStyles.Integer,
                CultureInfo.InvariantCulture,
                out integerValue
            )
        )
        {
            return integerValue;
        }

        double doubleValue;

        if (
            double.TryParse(
                value,
                NumberStyles.Float,
                CultureInfo.InvariantCulture,
                out doubleValue
            )
        )
        {
            return
                (int)Math.Round(
                    doubleValue
                );
        }

        return fallback;
    }

    private string EscapeJson(
        string value)
    {
        if (value == null)
            return "";

        return value
            .Replace(
                "\\",
                "\\\\"
            )
            .Replace(
                "\"",
                "\\\""
            )
            .Replace(
                "\r",
                "\\r"
            )
            .Replace(
                "\n",
                "\\n"
            )
            .Replace(
                "\t",
                "\\t"
            );
    }

    private string ExtractJsonValue(
        string json,
        string key)
    {
        if (
            string.IsNullOrWhiteSpace(
                json
            )
        )
        {
            return "";
        }

        string pattern =
            "\"" +
            key +
            "\":";

        int start =
            json.IndexOf(
                pattern,
                StringComparison.Ordinal
            );

        if (start < 0)
            return "";

        start +=
            pattern.Length;

        while (
            start < json.Length &&
            char.IsWhiteSpace(
                json[start]
            )
        )
        {
            start++;
        }

        if (start >= json.Length)
            return "";

        if (json[start] == '"')
        {
            start++;

            StringBuilder value =
                new StringBuilder();

            bool escaped =
                false;

            for (
                int index = start;
                index < json.Length;
                index++
            )
            {
                char character =
                    json[index];

                if (escaped)
                {
                    switch (character)
                    {
                        case 'n':
                            value.Append('\n');
                            break;

                        case 'r':
                            value.Append('\r');
                            break;

                        case 't':
                            value.Append('\t');
                            break;

                        case '\\':
                            value.Append('\\');
                            break;

                        case '"':
                            value.Append('"');
                            break;

                        default:
                            value.Append(
                                character
                            );
                            break;
                    }

                    escaped =
                        false;

                    continue;
                }

                if (character == '\\')
                {
                    escaped =
                        true;

                    continue;
                }

                if (character == '"')
                {
                    return
                        value.ToString();
                }

                value.Append(
                    character
                );
            }

            return "";
        }

        if (
            json.Substring(start)
                .StartsWith(
                    "null",
                    StringComparison.Ordinal
                )
        )
        {
            return "";
        }

        int end =
            start;

        while (
            end < json.Length &&
            json[end] != ',' &&
            json[end] != '}'
        )
        {
            end++;
        }

        return
            json
                .Substring(
                    start,
                    end - start
                )
                .Trim();
    }

    private string ExtractJsonObject(
        string json,
        string key)
    {
        if (
            string.IsNullOrWhiteSpace(
                json
            )
        )
        {
            return "";
        }

        string pattern =
            "\"" +
            key +
            "\":";

        int keyIndex =
            json.IndexOf(
                pattern,
                StringComparison.Ordinal
            );

        if (keyIndex < 0)
            return "";

        int start =
            keyIndex +
            pattern.Length;

        while (
            start < json.Length &&
            char.IsWhiteSpace(
                json[start]
            )
        )
        {
            start++;
        }

        if (
            start >= json.Length ||
            json[start] != '{'
        )
        {
            return "";
        }

        int depth =
            0;

        bool insideString =
            false;

        bool escaped =
            false;

        for (
            int index = start;
            index < json.Length;
            index++
        )
        {
            char character =
                json[index];

            if (insideString)
            {
                if (escaped)
                {
                    escaped =
                        false;
                }
                else if (character == '\\')
                {
                    escaped =
                        true;
                }
                else if (character == '"')
                {
                    insideString =
                        false;
                }

                continue;
            }

            if (character == '"')
            {
                insideString =
                    true;

                continue;
            }

            if (character == '{')
            {
                depth++;
            }
            else if (character == '}')
            {
                depth--;

                if (depth == 0)
                {
                    return
                        json.Substring(
                            start,
                            index - start + 1
                        );
                }
            }
        }

        return "";
    }

    // ============================================================
    // OUTPUTS
    // ============================================================

    private void SetOutputs(
        ref object State,
        ref object Status,
        ref object Message,
        ref object FilePath,
        ref object DownloadJobId,
        ref object Progress,
        ref object DownloadReady)
    {
        State =
            lastState;

        Status =
            lastStatus;

        Message =
            lastMessage;

        FilePath =
            lastFilePath;

        DownloadJobId =
            activeJobId;

        Progress =
            lastProgress;

        DownloadReady =
            downloadReadyPulse;
    }
}
# ---------- end c_script_15 ----------
panel_68 = Panel(c_script_15.FilePath)
panel_69 = Panel(c_script_15.State)
panel_70 = Panel(c_script_15.Status)
panel_71 = Panel(c_script_15.Message)
panel_72 = Panel(c_script_15.DownloadJobId)
panel_73 = Panel(c_script_15.Progress)
panel_74 = Panel(c_script_15.DownloadReady)

enable = BooleanToggle(False)
manual_start = Button()
need_new_dataset = Button()
reset_counter = Button()
ready_for_next_request = BooleanToggle(False)
c_script_16 = CSharpScript(
    Enable=enable,
    ManualStart=manual_start,
    NeedNewDataset=need_new_dataset,
    ResetCounter=reset_counter,
    ReadyForNextRequest=ready_for_next_request,
    BaseSessionName="deco2_RT",
    StartIndex="1",
    Padding="2")  # -> SubmitWorkflow, SessionName, SessionIndex, NextIndex, CycleCount, RequestAccepted, Status; inputs Enable: Boolean, ManualStart: Boolean, NeedNewDataset: Boolean, ResetCounter: Boolean, ReadyForNextRequest: Boolean, BaseSessionName: String, StartIndex: Int32, Padding: Int32
# ---------- c_script_16: C# ----------
// Grasshopper Script Instance

#region Usings
using System;
using System.Globalization;

using Rhino;
using Rhino.Geometry;

using Grasshopper;
using Grasshopper.Kernel;
using Grasshopper.Kernel.Data;
using Grasshopper.Kernel.Types;
#endregion


public class Script_Instance : GH_ScriptInstance
{
    // ============================================================
    // EDGE-DETECTION STATE
    // ============================================================

    private bool previousManualStart = false;
    private bool previousNeedNewDataset = false;
    private bool previousResetCounter = false;


    // ============================================================
    // SESSION-CYCLE STATE
    // ============================================================

    private bool initialized = false;

    private int currentIndex = 1;
    private int cycleCount = 0;

    private string activeSessionName = "";

    private string lastStatus =
        "Session cycle controller disabled.";

    private bool submitPulse = false;
    private bool requestAccepted = false;


    // ============================================================
    // MAIN
    // ============================================================

    private void RunScript(
		bool Enable,
		bool ManualStart,
		bool NeedNewDataset,
		bool ResetCounter,
		bool ReadyForNextRequest,
		string BaseSessionName,
		int StartIndex,
		int Padding,
		ref object SubmitWorkflow,
		ref object SessionName,
		ref object SessionIndex,
		ref object NextIndex,
		ref object CycleCount,
		ref object RequestAccepted,
		ref object Status)
    {
        // --------------------------------------------------------
        // One-solution outputs
        // --------------------------------------------------------

        submitPulse = false;
        requestAccepted = false;


        // --------------------------------------------------------
        // Normalize configuration
        // --------------------------------------------------------

        string normalizedBaseName =
            NormalizeBaseSessionName(
                BaseSessionName
            );

        int normalizedStartIndex =
            Math.Max(
                1,
                StartIndex
            );

        int normalizedPadding =
            Math.Max(
                1,
                Padding
            );


        // --------------------------------------------------------
        // Initialize internal counter once
        // --------------------------------------------------------

        if (!initialized)
        {
            currentIndex =
                normalizedStartIndex;

            initialized = true;

            lastStatus =
                "Session counter initialized.";
        }


        // --------------------------------------------------------
        // Rising-edge detection
        // --------------------------------------------------------

        bool manualStartPulse =
            ManualStart &&
            !previousManualStart;

        bool needNewDatasetPulse =
            NeedNewDataset &&
            !previousNeedNewDataset;

        bool resetPulse =
            ResetCounter &&
            !previousResetCounter;

        previousManualStart =
            ManualStart;

        previousNeedNewDataset =
            NeedNewDataset;

        previousResetCounter =
            ResetCounter;


        // --------------------------------------------------------
        // Disabled state
        // --------------------------------------------------------

        if (!Enable)
        {
            lastStatus =
                "Session cycle controller disabled.";

            SetOutputs(
                ref SubmitWorkflow,
                ref SessionName,
                ref SessionIndex,
                ref NextIndex,
                ref CycleCount,
                ref RequestAccepted,
                ref Status
            );

            return;
        }


        // --------------------------------------------------------
        // Reset
        // --------------------------------------------------------

        if (resetPulse)
        {
            currentIndex =
                normalizedStartIndex;

            cycleCount = 0;

            activeSessionName = "";

            submitPulse = false;
            requestAccepted = false;

            lastStatus =
                "Session counter reset to " +
                normalizedStartIndex.ToString(
                    CultureInfo.InvariantCulture
                ) +
                ".";

            SetOutputs(
                ref SubmitWorkflow,
                ref SessionName,
                ref SessionIndex,
                ref NextIndex,
                ref CycleCount,
                ref RequestAccepted,
                ref Status
            );

            return;
        }


        // --------------------------------------------------------
        // Detect a new session request
        // --------------------------------------------------------

        bool requestPulse =
            manualStartPulse ||
            needNewDatasetPulse;

        if (!requestPulse)
        {
            if (
                string.IsNullOrWhiteSpace(
                    activeSessionName
                )
            )
            {
                lastStatus =
                    "Waiting for the first session request.";
            }

            SetOutputs(
                ref SubmitWorkflow,
                ref SessionName,
                ref SessionIndex,
                ref NextIndex,
                ref CycleCount,
                ref RequestAccepted,
                ref Status
            );

            return;
        }


        // --------------------------------------------------------
        // Busy protection
        // --------------------------------------------------------

        if (!ReadyForNextRequest)
        {
            submitPulse = false;
            requestAccepted = false;

            lastStatus =
                "Session request ignored because " +
                "the processing workflow is busy.";

            SetOutputs(
                ref SubmitWorkflow,
                ref SessionName,
                ref SessionIndex,
                ref NextIndex,
                ref CycleCount,
                ref RequestAccepted,
                ref Status
            );

            return;
        }


        // --------------------------------------------------------
        // Generate the next session
        // --------------------------------------------------------

        activeSessionName =
            BuildSessionName(
                normalizedBaseName,
                currentIndex,
                normalizedPadding
            );

        submitPulse = true;
        requestAccepted = true;

        cycleCount++;

        lastStatus =
            "Created session '" +
            activeSessionName +
            "' and submitted workflow cycle " +
            cycleCount.ToString(
                CultureInfo.InvariantCulture
            ) +
            ".";


        // --------------------------------------------------------
        // Advance counter for the following request
        // --------------------------------------------------------

        currentIndex++;


        SetOutputs(
            ref SubmitWorkflow,
            ref SessionName,
            ref SessionIndex,
            ref NextIndex,
            ref CycleCount,
            ref RequestAccepted,
            ref Status
        );
    }


    // ============================================================
    // OUTPUTS
    // ============================================================

    private void SetOutputs(
        ref object SubmitWorkflow,
        ref object SessionName,
        ref object SessionIndex,
        ref object NextIndex,
        ref object CycleCount,
        ref object RequestAccepted,
        ref object Status)
    {
        SubmitWorkflow =
            submitPulse;

        SessionName =
            activeSessionName;

        SessionIndex =
            string.IsNullOrWhiteSpace(
                activeSessionName
            )
            ? (object)null
            : currentIndex - 1;

        NextIndex =
            currentIndex;

        CycleCount =
            cycleCount;

        RequestAccepted =
            requestAccepted;

        Status =
            lastStatus;
    }


    // ============================================================
    // SESSION-NAME GENERATION
    // ============================================================

    private string BuildSessionName(
        string baseSessionName,
        int sessionIndex,
        int padding)
    {
        string indexText =
            sessionIndex.ToString(
                "D" + padding.ToString(
                    CultureInfo.InvariantCulture
                ),
                CultureInfo.InvariantCulture
            );

        return
            baseSessionName +
            "_" +
            indexText;
    }


    private string NormalizeBaseSessionName(
        string value)
    {
        string normalized =
            string.IsNullOrWhiteSpace(
                value
            )
            ? "EOB_design"
            : value.Trim();

        normalized =
            normalized
                .Replace(" ", "_")
                .Replace("-", "_");

        while (
            normalized.Contains("__")
        )
        {
            normalized =
                normalized.Replace(
                    "__",
                    "_"
                );
        }

        normalized =
            normalized.Trim('_');

        if (
            string.IsNullOrWhiteSpace(
                normalized
            )
        )
        {
            return "EOB_design";
        }

        return normalized;
    }
}
# ---------- end c_script_16 ----------
panel_75 = Panel(c_script_16.SubmitWorkflow)
panel_76 = Panel(c_script_16.SessionName)
panel_77 = Panel(c_script_16.SessionIndex)
panel_78 = Panel(c_script_16.NextIndex)
panel_79 = Panel(c_script_16.CycleCount)
panel_80 = Panel(c_script_16.RequestAccepted)
panel_81 = Panel(c_script_16.Status)

path_3 = FilePath(c_script_4.JsonPaths)
panel_82 = Panel(path_3)

# ---- group: Capture, Transform & Processing
capture_index_3 = ValueList({"1", "2", "3", "4", "5"}, selected="1")
mode_3 = ValueList({"pointcloud", "image", "depth", "all"}, selected="all")
pipeline_3 = ValueList({"base", "ref_cam", "eye_to_base"}, selected="eye_to_base")
eye_to_base_index_3 = ValueList({"1", "2", "3"}, selected="1")
reference_index_3 = ValueList({"1", "2", "3"}, selected="2")
output_index_5 = ValueList({"1", "2", "3", "4", "5", "6", "7", "8", "9", "10"}, selected="6")
processing_input_kind_2 = ValueList({"merged", "eye_to_base"}, selected="eye_to_base")
show_processing_preview_2 = BooleanToggle(True)
color_grouping_method_2 = ValueList({"gmm_bic", "dbscan", "reference"}, selected="gmm_bic")
panel_83 = Panel("EOB_test03")
processing_preview_time_2 = Slider(1, range=0..5)
max_color_groups_2 = Slider(1, range=1..5)
gmm_merge_distance_2 = Slider(6, range=0..20)
c_script_17 = CSharpScript(
    ConnectButton=connect,
    CaptureButton=c_script.CaptureTrigger,
    TransformButton=c_script.TransformTrigger,
    ProcessButton=c_script.ProcessTrigger,
    SessionName=panel_83,
    CaptureIndex=capture_index_3,
    Mode=mode_3,
    Pipeline=pipeline_3,
    EyeToBaseIndex=eye_to_base_index_3,
    ReferenceIndex=reference_index_3,
    OutputIndex=output_index_5,
    ProcessingInputKind=processing_input_kind_2,
    ShowProcessingPreview=show_processing_preview_2,
    ProcessingPreviewTime=processing_preview_time_2,
    ColorGroupingMethod=color_grouping_method_2,
    MaxColorGroups=max_color_groups_2,
    GmmMergeDistance=gmm_merge_distance_2,
    RefreshStatus=refresh_status)  # -> Status, Message; inputs ConnectButton: Boolean, CaptureButton: Boolean, TransformButton: Boolean, ProcessButton: Boolean, SessionName: String, CaptureIndex: Int32, Mode: String, Pipeline: String, EyeToBaseIndex: Int32, ReferenceIndex: Int32, OutputIndex: Int32, ProcessingInputKind: String, ShowProcessingPreview: Boolean, ProcessingPreviewTime: Double, ColorGroupingMethod: String, MaxColorGroups: Int32, GmmMergeDistance: Double, RefreshStatus: Boolean; same code as c_script_3
panel_84 = Panel(c_script_17.Status)
panel_85 = Panel(c_script_17.Message)

# ---- group: Download
file_types_3 = ValueList({"pointcloud", "image", "json"}, selected="json")
category_2 = ValueList({"all": "", "initial_pointcloud", "merged_pointcloud", "eye_to_base_pointcloud", "initial_rgb", "initial_depth", "initial_depth_rendered", "stitched_rgb", "stitched_height", "eye_to_base_rgb", "eye_to_base_height", "processed_clusters", "processing_params", "processing_report"}, selected="processed_clusters")
c_script_18 = CSharpScript(
    ConnectButton=connect,
    DownloadButton=c_script.DownloadTrigger,
    SessionName=panel_83,
    OutputIndex=output_index_5,
    FileTypes=file_types_3,
    Category=category_2,
    RefreshStatus=refresh_status)  # -> Status, Message, PointCloudPaths, ImagePaths, JsonPaths; inputs ConnectButton: Boolean, DownloadButton: Boolean, SessionName: String, OutputIndex: Int32, FileTypes: String, Category: String, RefreshStatus: Boolean; same code as c_script_4
panel_86 = Panel(c_script_18.Status)
panel_87 = Panel(c_script_18.Message)
path_4 = FilePath(c_script_18.PointCloudPaths)
import_3 = ImportContent(FilePath=path_4)  # -> Objects, Layers, Linetypes, HatchPatterns, AnnotationStyles, Materials, BlockDefinitions

# ----
reset_counter_2 = Button()
c_script_19 = CSharpScript(
    Trigger=c_script_14.PathReady,
    SessionName="EOB_test03",
    SessionFolder=c_script_14.SessionFolder,
    ResetCounter=reset_counter_2,
    StartIndex="1")  # -> OutputIndex, WritePulse, CurrentSession, NextIndex, Synchronized, Status; inputs Trigger: Boolean, SessionName: String, SessionFolder: String, ResetCounter: Boolean, StartIndex: Int32
# ---------- c_script_19: C# ----------
// Grasshopper Script Instance

#region Usings
using System;
using System.Globalization;
using System.IO;

using Rhino;
using Rhino.Geometry;

using Grasshopper;
using Grasshopper.Kernel;
using Grasshopper.Kernel.Data;
using Grasshopper.Kernel.Types;
#endregion


public class Script_Instance : GH_ScriptInstance
{
    // ============================================================
    // EDGE-DETECTION STATE
    // ============================================================

    private bool previousTrigger = false;
    private bool previousResetCounter = false;


    // ============================================================
    // COUNTER STATE
    // ============================================================

    private bool initialized = false;

    private string activeSession = "";

    private int currentOutputIndex = 1;
    private int nextOutputIndex = 1;

    private bool writePulse = false;
    private bool synchronized = false;

    private string lastStatus =
        "Waiting for a valid session and trigger.";


    // ============================================================
    // MAIN
    // ============================================================

    private void RunScript(
		bool Trigger,
		string SessionName,
		string SessionFolder,
		bool ResetCounter,
		int StartIndex,
		ref object OutputIndex,
		ref object WritePulse,
		ref object CurrentSession,
		ref object NextIndex,
		ref object Synchronized,
		ref object Status)
    {
        // --------------------------------------------------------
        // One-solution outputs
        // --------------------------------------------------------

        writePulse = false;


        // --------------------------------------------------------
        // Normalize configuration
        // --------------------------------------------------------

        int normalizedStartIndex =
            Math.Max(
                1,
                StartIndex
            );

        string normalizedSessionName =
            NormalizeSessionName(
                SessionName
            );

        string folderSessionName =
            ExtractSessionFolderName(
                SessionFolder
            );


        // --------------------------------------------------------
        // Initialize once
        // --------------------------------------------------------

        if (!initialized)
        {
            currentOutputIndex =
                normalizedStartIndex;

            nextOutputIndex =
                normalizedStartIndex;

            initialized = true;
        }


        // --------------------------------------------------------
        // Rising-edge detection
        // --------------------------------------------------------

        bool triggerPulse =
            Trigger &&
            !previousTrigger;

        bool resetPulse =
            ResetCounter &&
            !previousResetCounter;

        previousTrigger =
            Trigger;

        previousResetCounter =
            ResetCounter;


        // --------------------------------------------------------
        // Synchronization state
        // --------------------------------------------------------

        synchronized =
            !string.IsNullOrWhiteSpace(
                normalizedSessionName
            ) &&
            !string.IsNullOrWhiteSpace(
                folderSessionName
            ) &&
            string.Equals(
                normalizedSessionName,
                folderSessionName,
                StringComparison.OrdinalIgnoreCase
            );


        // --------------------------------------------------------
        // Manual reset
        // --------------------------------------------------------

        if (resetPulse)
        {
            activeSession = "";

            currentOutputIndex =
                normalizedStartIndex;

            nextOutputIndex =
                normalizedStartIndex;

            writePulse = false;

            lastStatus =
                "Output index counter reset to " +
                normalizedStartIndex.ToString(
                    CultureInfo.InvariantCulture
                ) +
                ".";

            SetOutputs(
                ref OutputIndex,
                ref WritePulse,
                ref CurrentSession,
                ref NextIndex,
                ref Synchronized,
                ref Status
            );

            return;
        }


        // --------------------------------------------------------
        // No trigger pulse
        // --------------------------------------------------------

        if (!triggerPulse)
        {
            if (
                string.IsNullOrWhiteSpace(
                    normalizedSessionName
                )
            )
            {
                lastStatus =
                    "Waiting for SessionName.";
            }
            else if (
                string.IsNullOrWhiteSpace(
                    folderSessionName
                )
            )
            {
                lastStatus =
                    "Waiting for SessionFolder.";
            }
            else if (!synchronized)
            {
                lastStatus =
                    "Session mismatch. SessionName is '" +
                    normalizedSessionName +
                    "', but SessionFolder resolves to '" +
                    folderSessionName +
                    "'.";
            }
            else
            {
                lastStatus =
                    "Ready for the next output request.";
            }

            SetOutputs(
                ref OutputIndex,
                ref WritePulse,
                ref CurrentSession,
                ref NextIndex,
                ref Synchronized,
                ref Status
            );

            return;
        }


        // --------------------------------------------------------
        // Validate active session
        // --------------------------------------------------------

        if (
            string.IsNullOrWhiteSpace(
                normalizedSessionName
            )
        )
        {
            writePulse = false;

            lastStatus =
                "Output request rejected: " +
                "SessionName is empty.";

            SetOutputs(
                ref OutputIndex,
                ref WritePulse,
                ref CurrentSession,
                ref NextIndex,
                ref Synchronized,
                ref Status
            );

            return;
        }

        if (
            string.IsNullOrWhiteSpace(
                folderSessionName
            )
        )
        {
            writePulse = false;

            lastStatus =
                "Output request rejected: " +
                "SessionFolder is empty or invalid.";

            SetOutputs(
                ref OutputIndex,
                ref WritePulse,
                ref CurrentSession,
                ref NextIndex,
                ref Synchronized,
                ref Status
            );

            return;
        }

        if (!synchronized)
        {
            writePulse = false;

            lastStatus =
                "Output request rejected: " +
                "SessionName '" +
                normalizedSessionName +
                "' does not match folder session '" +
                folderSessionName +
                "'.";

            SetOutputs(
                ref OutputIndex,
                ref WritePulse,
                ref CurrentSession,
                ref NextIndex,
                ref Synchronized,
                ref Status
            );

            return;
        }


        // --------------------------------------------------------
        // Detect a new session
        // --------------------------------------------------------

        bool sessionChanged =
            !string.Equals(
                activeSession,
                normalizedSessionName,
                StringComparison.OrdinalIgnoreCase
            );

        if (sessionChanged)
        {
            activeSession =
                normalizedSessionName;

            currentOutputIndex =
                normalizedStartIndex;

            nextOutputIndex =
                normalizedStartIndex;
        }


        // --------------------------------------------------------
        // Issue the current output index
        // --------------------------------------------------------

        int issuedIndex =
            nextOutputIndex;

        currentOutputIndex =
            issuedIndex;

        nextOutputIndex =
            issuedIndex + 1;


        // --------------------------------------------------------
        // Emit write pulse only after index is prepared
        // --------------------------------------------------------

        writePulse = true;

        lastStatus =
            (
                sessionChanged
                ? "New session detected. "
                : ""
            ) +
            "Issued output index " +
            issuedIndex.ToString(
                "00",
                CultureInfo.InvariantCulture
            ) +
            " for session '" +
            activeSession +
            "'.";


        SetOutputs(
            ref OutputIndex,
            ref WritePulse,
            ref CurrentSession,
            ref NextIndex,
            ref Synchronized,
            ref Status
        );
    }


    // ============================================================
    // OUTPUTS
    // ============================================================

    private void SetOutputs(
        ref object OutputIndex,
        ref object WritePulse,
        ref object CurrentSession,
        ref object NextIndex,
        ref object Synchronized,
        ref object Status)
    {
        OutputIndex =
            currentOutputIndex;

        WritePulse =
            writePulse;

        CurrentSession =
            activeSession;

        NextIndex =
            nextOutputIndex;

        Synchronized =
            synchronized;

        Status =
            lastStatus;
    }


    // ============================================================
    // SESSION HELPERS
    // ============================================================

    private string NormalizeSessionName(
        string value)
    {
        if (
            string.IsNullOrWhiteSpace(
                value
            )
        )
        {
            return "";
        }

        return value.Trim();
    }


    private string ExtractSessionFolderName(
        string sessionFolder)
    {
        if (
            string.IsNullOrWhiteSpace(
                sessionFolder
            )
        )
        {
            return "";
        }

        try
        {
            string normalizedPath =
                sessionFolder
                    .Trim()
                    .TrimEnd(
                        Path.DirectorySeparatorChar,
                        Path.AltDirectorySeparatorChar
                    );

            if (
                string.IsNullOrWhiteSpace(
                    normalizedPath
                )
            )
            {
                return "";
            }

            return Path.GetFileName(
                normalizedPath
            );
        }
        catch
        {
            return "";
        }
    }
}
# ---------- end c_script_19 ----------
panel_88 = Panel(c_script_19.OutputIndex)
panel_89 = Panel(c_script_19.WritePulse)
panel_90 = Panel(c_script_19.CurrentSession)
panel_91 = Panel(c_script_19.NextIndex)
panel_92 = Panel(c_script_19.Synchronized)
panel_93 = Panel(c_script_19.Status)

c_script_20 = CSharpScript(Signal=Toggle(False))  # -> Pulse, Status; inputs Signal: Boolean; same code as c_script_7
panel_94 = Panel(c_script_20.Pulse)
panel_95 = Panel(c_script_20.Status)

c_script_21 = CSharpScript(
    ConnectButton=connect_8,
    DownloadButton=download_3,
    SessionName="EOB_test03",
    DesignOutputIndex=output_index_3,
    AutoPoll=refresh_status_7)  # -> State, Status, Message, FilePath, DownloadJobId, Progress; inputs ConnectButton: Boolean, DownloadButton: Boolean, SessionName: String, DesignOutputIndex: Int32, AutoPoll: Boolean
# ---------- c_script_21: C# ----------
// Grasshopper C# Script Instance
#region Usings
using System;
using System.Globalization;
using System.Net.Sockets;
using System.Text;

using Grasshopper;
using Grasshopper.Kernel;
#endregion

public class Script_Instance : GH_ScriptInstance
{
    // ============================================================
    // CONFIGURATION
    // ============================================================

    private const string GhAgentHost =
        "127.0.0.1";

    private const int GhAgentPort =
        6005;

    private const int MessageHeaderSize =
        8;

    private const int PollIntervalMilliseconds =
        500;

    // ============================================================
    // COMPONENT STATE
    // ============================================================

    private bool previousDownloadButton =
        false;

    private bool isConnected =
        false;

    private bool triedConnection =
        false;

    private bool pollScheduled =
        false;

    private string activeJobId =
        "";

    private string activeSession =
        "";

    private int activeDesignOutputIndex =
        0;

    private string lastState =
        "Idle";

    private string lastStatus =
        "Disconnected";

    private string lastMessage =
        "Enable ConnectButton.";

    private string lastFilePath =
        "";

    private int lastProgress =
        0;

    // ============================================================
    // MAIN
    // ============================================================

    private void RunScript(
		bool ConnectButton,
		bool DownloadButton,
		string SessionName,
		int DesignOutputIndex,
		bool AutoPoll,
		ref object State,
		ref object Status,
		ref object Message,
		ref object FilePath,
		ref object DownloadJobId,
		ref object Progress)
    {
        bool downloadPulse =
            DownloadButton &&
            !previousDownloadButton;

        previousDownloadButton =
            DownloadButton;

        try
        {
            // ----------------------------------------------------
            // Connection disabled
            // ----------------------------------------------------

            if (!ConnectButton)
            {
                isConnected =
                    false;

                triedConnection =
                    false;

                pollScheduled =
                    false;

                lastState =
                    "Idle";

                lastStatus =
                    "Disconnected";

                lastMessage =
                    "Connection toggle is off.";

                SetOutputs(
                    ref State,
                    ref Status,
                    ref Message,
                    ref FilePath,
                    ref DownloadJobId,
                    ref Progress
                );

                return;
            }

            // ----------------------------------------------------
            // Connect to the local GH Agent
            // ----------------------------------------------------

            if (
                !isConnected &&
                !triedConnection
            )
            {
                triedConnection =
                    true;

                string pingResponse =
                    SendCommand(
                        "{\"command\":\"ping\"}"
                    );

                if (
                    pingResponse.StartsWith(
                        "ERROR:",
                        StringComparison.Ordinal
                    )
                )
                {
                    ConnectionFailure(
                        pingResponse
                    );

                    SetOutputs(
                        ref State,
                        ref Status,
                        ref Message,
                        ref FilePath,
                        ref DownloadJobId,
                        ref Progress
                    );

                    return;
                }

                string pingStatus =
                    ExtractJsonValue(
                        pingResponse,
                        "status"
                    );

                if (
                    !string.Equals(
                        pingStatus,
                        "ok",
                        StringComparison.OrdinalIgnoreCase
                    )
                )
                {
                    isConnected =
                        false;

                    lastState =
                        "Connection error";

                    lastStatus =
                        "Connection failed";

                    lastMessage =
                        GetResponseMessage(
                            pingResponse,
                            "GH Agent ping failed."
                        );

                    SetOutputs(
                        ref State,
                        ref Status,
                        ref Message,
                        ref FilePath,
                        ref DownloadJobId,
                        ref Progress
                    );

                    return;
                }

                isConnected =
                    true;

                lastState =
                    "Ready";

                lastStatus =
                    "Connected";

                lastMessage =
                    GetResponseMessage(
                        pingResponse,
                        "Connected to GH Agent."
                    );
            }

            if (!isConnected)
            {
                SetOutputs(
                    ref State,
                    ref Status,
                    ref Message,
                    ref FilePath,
                    ref DownloadJobId,
                    ref Progress
                );

                return;
            }

            // ----------------------------------------------------
            // Submit design download
            // ----------------------------------------------------

            if (downloadPulse)
            {
                SubmitDownload(
                    SessionName,
                    DesignOutputIndex
                );
            }

            // ----------------------------------------------------
            // Poll active download
            // ----------------------------------------------------

            if (
                IsDownloadActive() &&
                AutoPoll
            )
            {
                PollDownloadJob();

                if (IsDownloadActive())
                {
                    ScheduleNextPoll();
                }
            }

            SetOutputs(
                ref State,
                ref Status,
                ref Message,
                ref FilePath,
                ref DownloadJobId,
                ref Progress
            );
        }
        catch (Exception exception)
        {
            lastState =
                "Failed";

            lastStatus =
                "Component error";

            lastMessage =
                exception.Message;

            SetOutputs(
                ref State,
                ref Status,
                ref Message,
                ref FilePath,
                ref DownloadJobId,
                ref Progress
            );
        }
    }

    // ============================================================
    // DOWNLOAD SUBMISSION
    // ============================================================

    private void SubmitDownload(
        string sessionName,
        int designOutputIndex)
    {
        string session =
            string.IsNullOrWhiteSpace(
                sessionName
            )
            ? ""
            : sessionName.Trim();

        if (
            string.IsNullOrWhiteSpace(
                session
            )
        )
        {
            throw new ArgumentException(
                "SessionName cannot be empty."
            );
        }

        if (designOutputIndex < 1)
        {
            throw new ArgumentException(
                "DesignOutputIndex must be at least 1."
            );
        }

        string payload =
            "{" +
            "\"command\":\"download_design_output\"," +
            "\"session\":\"" +
            EscapeJson(session) +
            "\"," +
            "\"design_output_index\":" +
            designOutputIndex.ToString(
                CultureInfo.InvariantCulture
            ) +
            "," +
            "\"category\":\"ghdata\"" +
            "}";

        lastState =
            "Submitting";

        lastStatus =
            "Submitting download";

        lastMessage =
            "Requesting design output from GH Agent.";

        string response =
            SendCommand(
                payload
            );

        if (
            response.StartsWith(
                "ERROR:",
                StringComparison.Ordinal
            )
        )
        {
            ConnectionFailure(
                response
            );

            return;
        }

        string responseStatus =
            ExtractJsonValue(
                response,
                "status"
            );

        if (
            !string.Equals(
                responseStatus,
                "ok",
                StringComparison.OrdinalIgnoreCase
            )
        )
        {
            lastState =
                "Failed";

            lastStatus =
                "Download submission failed";

            lastMessage =
                GetResponseMessage(
                    response,
                    response
                );

            return;
        }

        string jobId =
            ExtractJsonValue(
                response,
                "job_id"
            );

        if (
            string.IsNullOrWhiteSpace(
                jobId
            )
        )
        {
            lastState =
                "Failed";

            lastStatus =
                "Download submission failed";

            lastMessage =
                "GH Agent returned success without a job ID.";

            return;
        }

        activeJobId =
            jobId;

        activeSession =
            session;

        activeDesignOutputIndex =
            designOutputIndex;

        lastFilePath =
            "";

        lastProgress =
            0;

        lastState =
            "Download queued";

        lastStatus =
            ExtractJsonValue(
                response,
                "latest_status"
            );

        if (
            string.IsNullOrWhiteSpace(
                lastStatus
            )
        )
        {
            lastStatus =
                "download_queued";
        }

        lastMessage =
            GetResponseMessage(
                response,
                "Design download job submitted."
            );

        ScheduleNextPoll();
    }

    // ============================================================
    // JOB POLLING
    // ============================================================

    private void PollDownloadJob()
    {
        if (
            string.IsNullOrWhiteSpace(
                activeJobId
            )
        )
        {
            return;
        }

        string payload =
            "{" +
            "\"command\":\"get_job_status\"," +
            "\"job_id\":\"" +
            EscapeJson(activeJobId) +
            "\"" +
            "}";

        string response =
            SendCommand(
                payload
            );

        if (
            response.StartsWith(
                "ERROR:",
                StringComparison.Ordinal
            )
        )
        {
            ConnectionFailure(
                response
            );

            return;
        }

        string outerStatus =
            ExtractJsonValue(
                response,
                "status"
            );

        if (
            !string.Equals(
                outerStatus,
                "ok",
                StringComparison.OrdinalIgnoreCase
            )
        )
        {
            lastState =
                "Polling error";

            lastStatus =
                "Download status request failed";

            lastMessage =
                GetResponseMessage(
                    response,
                    response
                );

            return;
        }

        string jobJson =
            ExtractJsonObject(
                response,
                "job"
            );

        if (
            string.IsNullOrWhiteSpace(
                jobJson
            )
        )
        {
            lastState =
                "Polling error";

            lastStatus =
                "Download status unavailable";

            lastMessage =
                "GH Agent response did not contain a job object.";

            return;
        }

        string jobStatus =
            NormalizeStatus(
                ExtractJsonValue(
                    jobJson,
                    "status"
                )
            );

        string jobMessage =
            ExtractJsonValue(
                jobJson,
                "message"
            );

        string jobError =
            ExtractJsonValue(
                jobJson,
                "error"
            );

        lastProgress =
            ParseInteger(
                ExtractJsonValue(
                    jobJson,
                    "progress"
                ),
                lastProgress
            );

        if (
            !string.IsNullOrWhiteSpace(
                jobMessage
            )
        )
        {
            lastMessage =
                jobMessage;
        }

        lastStatus =
            string.IsNullOrWhiteSpace(
                jobStatus
            )
            ? "unknown"
            : jobStatus;

        if (
            jobStatus == "download_queued" ||
            jobStatus == "queued"
        )
        {
            lastState =
                "Download queued";

            return;
        }

        if (
            jobStatus == "download_running" ||
            jobStatus == "running"
        )
        {
            lastState =
                "Downloading";

            return;
        }

        if (
            jobStatus == "download_finished" ||
            jobStatus == "finished"
        )
        {
            lastState =
                "Finished";

            lastStatus =
                "download_finished";

            lastProgress =
                100;

            string resultJson =
                ExtractJsonObject(
                    jobJson,
                    "result"
                );

            lastFilePath =
                ExtractJsonValue(
                    resultJson,
                    "file_path"
                );

            if (
                string.IsNullOrWhiteSpace(
                    lastFilePath
                )
            )
            {
                /*
                 * Compatibility fallback in case file_path
                 * is nested inside the local file record.
                 */
                string fileJson =
                    ExtractJsonObject(
                        resultJson,
                        "file"
                    );

                lastFilePath =
                    ExtractJsonValue(
                        fileJson,
                        "local_path"
                    );
            }

            if (
                string.IsNullOrWhiteSpace(
                    lastFilePath
                )
            )
            {
                lastState =
                    "Finished with error";

                lastStatus =
                    "download_result_invalid";

                lastMessage =
                    "Download finished, but the result did not " +
                    "contain file_path or file.local_path.";

                return;
            }

            if (
                string.IsNullOrWhiteSpace(
                    lastMessage
                )
            )
            {
                lastMessage =
                    "Design output downloaded successfully.";
            }

            return;
        }

        if (
            jobStatus == "download_failed" ||
            jobStatus == "failed" ||
            jobStatus == "error"
        )
        {
            lastState =
                "Failed";

            lastStatus =
                "download_failed";

            lastProgress =
                100;

            if (
                !string.IsNullOrWhiteSpace(
                    jobError
                )
            )
            {
                lastMessage =
                    jobError;
            }
            else if (
                string.IsNullOrWhiteSpace(
                    lastMessage
                )
            )
            {
                lastMessage =
                    "Design output download failed.";
            }

            return;
        }

        if (jobStatus == "cancelled")
        {
            lastState =
                "Cancelled";

            lastStatus =
                "cancelled";

            lastProgress =
                100;

            if (
                string.IsNullOrWhiteSpace(
                    lastMessage
                )
            )
            {
                lastMessage =
                    "Design output download was cancelled.";
            }

            return;
        }

        lastState =
            "Download status unknown";
    }

    private bool IsDownloadActive()
    {
        string normalized =
            NormalizeStatus(
                lastStatus
            );

        return
            !string.IsNullOrWhiteSpace(
                activeJobId
            ) &&
            normalized != "download_finished" &&
            normalized != "finished" &&
            normalized != "download_failed" &&
            normalized != "failed" &&
            normalized != "error" &&
            normalized != "cancelled" &&
            normalized != "download_result_invalid";
    }

    // ============================================================
    // AUTOMATIC POLLING
    // ============================================================

    private void ScheduleNextPoll()
    {
        if (pollScheduled)
            return;

        GH_Document document =
            Component.OnPingDocument();

        if (document == null)
            return;

        pollScheduled =
            true;

        document.ScheduleSolution(
            PollIntervalMilliseconds,
            scheduledDocument =>
            {
                pollScheduled =
                    false;

                if (Component != null)
                {
                    Component.ExpireSolution(
                        false
                    );
                }
            }
        );
    }

    // ============================================================
    // CONNECTION
    // ============================================================

    private void ConnectionFailure(
        string message)
    {
        isConnected =
            false;

        triedConnection =
            true;

        lastState =
            "Connection error";

        lastStatus =
            "connection_failed";

        lastMessage =
            message;
    }

    private string SendCommand(
        string command)
    {
        try
        {
            using (
                TcpClient client =
                    new TcpClient()
            )
            {
                IAsyncResult connection =
                    client.BeginConnect(
                        GhAgentHost,
                        GhAgentPort,
                        null,
                        null
                    );

                bool connected =
                    connection.AsyncWaitHandle.WaitOne(
                        TimeSpan.FromMilliseconds(
                            500
                        )
                    );

                if (!connected)
                {
                    return
                        "ERROR: GH Agent connection timeout.";
                }

                client.EndConnect(
                    connection
                );

                using (
                    NetworkStream stream =
                        client.GetStream()
                )
                {
                    byte[] payload =
                        Encoding.UTF8.GetBytes(
                            command
                        );

                    byte[] header =
                        BuildHeader(
                            payload.Length
                        );

                    stream.Write(
                        header,
                        0,
                        header.Length
                    );

                    stream.Write(
                        payload,
                        0,
                        payload.Length
                    );

                    byte[] responseHeader =
                        ReadExact(
                            stream,
                            MessageHeaderSize
                        );

                    ulong responseSize =
                        ParseHeader(
                            responseHeader
                        );

                    if (
                        responseSize >
                        int.MaxValue
                    )
                    {
                        return
                            "ERROR: GH Agent response is too large.";
                    }

                    byte[] responsePayload =
                        ReadExact(
                            stream,
                            (int)responseSize
                        );

                    return
                        Encoding.UTF8.GetString(
                            responsePayload
                        );
                }
            }
        }
        catch (Exception exception)
        {
            return
                "ERROR: " +
                exception.Message;
        }
    }

    private byte[] BuildHeader(
        int payloadSize)
    {
        byte[] header =
            new byte[
                MessageHeaderSize
            ];

        ulong size =
            (ulong)payloadSize;

        for (
            int index = 0;
            index < MessageHeaderSize;
            index++
        )
        {
            header[
                MessageHeaderSize -
                1 -
                index
            ] =
                (byte)(
                    size &
                    0xFF
                );

            size >>=
                8;
        }

        return header;
    }

    private ulong ParseHeader(
        byte[] header)
    {
        ulong size =
            0;

        for (
            int index = 0;
            index < header.Length;
            index++
        )
        {
            size =
                (
                    size <<
                    8
                ) +
                header[index];
        }

        return size;
    }

    private byte[] ReadExact(
        NetworkStream stream,
        int size)
    {
        byte[] data =
            new byte[size];

        int offset =
            0;

        while (offset < size)
        {
            int read =
                stream.Read(
                    data,
                    offset,
                    size - offset
                );

            if (read == 0)
            {
                throw new InvalidOperationException(
                    "Connection closed before the response " +
                    "was complete."
                );
            }

            offset +=
                read;
        }

        return data;
    }

    // ============================================================
    // JSON HELPERS
    // ============================================================

    private string GetResponseMessage(
        string json,
        string fallback)
    {
        string message =
            ExtractJsonValue(
                json,
                "message"
            );

        return
            string.IsNullOrWhiteSpace(
                message
            )
            ? fallback
            : message;
    }

    private string NormalizeStatus(
        string value)
    {
        return
            string.IsNullOrWhiteSpace(
                value
            )
            ? ""
            : value
                .Trim()
                .ToLowerInvariant();
    }

    private int ParseInteger(
        string value,
        int fallback)
    {
        int integerValue;

        if (
            int.TryParse(
                value,
                NumberStyles.Integer,
                CultureInfo.InvariantCulture,
                out integerValue
            )
        )
        {
            return integerValue;
        }

        double doubleValue;

        if (
            double.TryParse(
                value,
                NumberStyles.Float,
                CultureInfo.InvariantCulture,
                out doubleValue
            )
        )
        {
            return
                (int)Math.Round(
                    doubleValue
                );
        }

        return fallback;
    }

    private string EscapeJson(
        string value)
    {
        if (value == null)
            return "";

        return value
            .Replace(
                "\\",
                "\\\\"
            )
            .Replace(
                "\"",
                "\\\""
            )
            .Replace(
                "\r",
                "\\r"
            )
            .Replace(
                "\n",
                "\\n"
            )
            .Replace(
                "\t",
                "\\t"
            );
    }

    private string ExtractJsonValue(
        string json,
        string key)
    {
        if (
            string.IsNullOrWhiteSpace(
                json
            )
        )
        {
            return "";
        }

        string pattern =
            "\"" +
            key +
            "\":";

        int start =
            json.IndexOf(
                pattern,
                StringComparison.Ordinal
            );

        if (start < 0)
            return "";

        start +=
            pattern.Length;

        while (
            start < json.Length &&
            char.IsWhiteSpace(
                json[start]
            )
        )
        {
            start++;
        }

        if (start >= json.Length)
            return "";

        if (json[start] == '"')
        {
            start++;

            StringBuilder value =
                new StringBuilder();

            bool escaped =
                false;

            for (
                int index = start;
                index < json.Length;
                index++
            )
            {
                char character =
                    json[index];

                if (escaped)
                {
                    switch (character)
                    {
                        case 'n':
                            value.Append('\n');
                            break;

                        case 'r':
                            value.Append('\r');
                            break;

                        case 't':
                            value.Append('\t');
                            break;

                        case '\\':
                            value.Append('\\');
                            break;

                        case '"':
                            value.Append('"');
                            break;

                        default:
                            value.Append(
                                character
                            );
                            break;
                    }

                    escaped =
                        false;

                    continue;
                }

                if (character == '\\')
                {
                    escaped =
                        true;

                    continue;
                }

                if (character == '"')
                {
                    return
                        value.ToString();
                }

                value.Append(
                    character
                );
            }

            return "";
        }

        if (
            json.Substring(start)
                .StartsWith(
                    "null",
                    StringComparison.Ordinal
                )
        )
        {
            return "";
        }

        int end =
            start;

        while (
            end < json.Length &&
            json[end] != ',' &&
            json[end] != '}'
        )
        {
            end++;
        }

        return
            json
                .Substring(
                    start,
                    end - start
                )
                .Trim();
    }

    private string ExtractJsonObject(
        string json,
        string key)
    {
        if (
            string.IsNullOrWhiteSpace(
                json
            )
        )
        {
            return "";
        }

        string pattern =
            "\"" +
            key +
            "\":";

        int keyIndex =
            json.IndexOf(
                pattern,
                StringComparison.Ordinal
            );

        if (keyIndex < 0)
            return "";

        int start =
            keyIndex +
            pattern.Length;

        while (
            start < json.Length &&
            char.IsWhiteSpace(
                json[start]
            )
        )
        {
            start++;
        }

        if (
            start >= json.Length ||
            json[start] != '{'
        )
        {
            return "";
        }

        int depth =
            0;

        bool insideString =
            false;

        bool escaped =
            false;

        for (
            int index = start;
            index < json.Length;
            index++
        )
        {
            char character =
                json[index];

            if (insideString)
            {
                if (escaped)
                {
                    escaped =
                        false;
                }
                else if (character == '\\')
                {
                    escaped =
                        true;
                }
                else if (character == '"')
                {
                    insideString =
                        false;
                }

                continue;
            }

            if (character == '"')
            {
                insideString =
                    true;

                continue;
            }

            if (character == '{')
            {
                depth++;
            }
            else if (character == '}')
            {
                depth--;

                if (depth == 0)
                {
                    return
                        json.Substring(
                            start,
                            index - start + 1
                        );
                }
            }
        }

        return "";
    }

    // ============================================================
    // OUTPUTS
    // ============================================================

    private void SetOutputs(
        ref object State,
        ref object Status,
        ref object Message,
        ref object FilePath,
        ref object DownloadJobId,
        ref object Progress)
    {
        State =
            lastState;

        Status =
            lastStatus;

        Message =
            lastMessage;

        FilePath =
            lastFilePath;

        DownloadJobId =
            activeJobId;

        Progress =
            lastProgress;
    }
}
# ---------- end c_script_21 ----------

# ---- group: Upload to Master
c_script_22 = CSharpScript(
    ConnectButton=connect_4,
    ReadyEvent=c_script_13.ReadyEvent,
    SourceOutputIndex="1",
    CreatedBy="design_pc",
    UploadMessage="Design solution ready",
    AutoPoll=refresh_status_4)  # -> State, Status, Message, UploadJobId, Progress, Session, OutputIndex, MasterResponse; inputs ConnectButton: Boolean, ReadyEvent: String, SourceOutputIndex: Int32, CreatedBy: String, UploadMessage: String, AutoPoll: Boolean
# ---------- c_script_22: C# ----------
// Grasshopper C# Script Instance
#region Usings
using System;
using System.Globalization;
using System.Net.Sockets;
using System.Text;

using Grasshopper;
using Grasshopper.Kernel;
#endregion

public class Script_Instance : GH_ScriptInstance
{
    // ============================================================
    // CONFIGURATION
    // ============================================================

    private const string GhAgentHost = "127.0.0.1";
    private const int GhAgentPort = 6005;
    private const int MessageHeaderSize = 8;
    private const int PollIntervalMilliseconds = 500;

    // ============================================================
    // COMPONENT STATE
    // ============================================================

    private bool isConnected = false;
    private bool triedConnection = false;
    private bool pollScheduled = false;

    private string lastProcessedEventId = "";

    private string activeUploadJobId = "";
    private string activeSession = "";
    private string activeDomain = "";
    private int activeOutputIndex = 0;

    private string lastState = "Idle";
    private string lastStatus = "Disconnected";
    private string lastMessage = "Enable ConnectButton.";
    private int lastProgress = 0;
    private string lastMasterResponse = "";

    // ============================================================
    // MAIN
    // ============================================================

    private void RunScript(
		bool ConnectButton,
		string ReadyEvent,
		int SourceOutputIndex,
		string CreatedBy,
		string UploadMessage,
		bool AutoPoll,
		ref object State,
		ref object Status,
		ref object Message,
		ref object UploadJobId,
		ref object Progress,
		ref object Session,
		ref object OutputIndex,
		ref object MasterResponse)
    {
        try
        {
            // ----------------------------------------------------
            // Connection disabled
            // ----------------------------------------------------

            if (!ConnectButton)
            {
                isConnected = false;
                triedConnection = false;
                pollScheduled = false;

                lastState = "Idle";
                lastStatus = "Disconnected";
                lastMessage = "Connection toggle is off.";

                SetOutputs(
                    ref State,
                    ref Status,
                    ref Message,
                    ref UploadJobId,
                    ref Progress,
                    ref Session,
                    ref OutputIndex,
                    ref MasterResponse
                );

                return;
            }

            // ----------------------------------------------------
            // Connect to GH Agent
            // ----------------------------------------------------

            if (!isConnected && !triedConnection)
            {
                triedConnection = true;

                string pingResponse =
                    SendCommand(
                        "{\"command\":\"ping\"}"
                    );

                if (pingResponse.StartsWith("ERROR:"))
                {
                    isConnected = false;
                    lastState = "Connection error";
                    lastStatus = "Connection failed";
                    lastMessage = pingResponse;

                    SetOutputs(
                        ref State,
                        ref Status,
                        ref Message,
                        ref UploadJobId,
                        ref Progress,
                        ref Session,
                        ref OutputIndex,
                        ref MasterResponse
                    );

                    return;
                }

                string pingStatus =
                    ExtractJsonValue(
                        pingResponse,
                        "status"
                    );

                if (
                    !string.Equals(
                        pingStatus,
                        "ok",
                        StringComparison.OrdinalIgnoreCase))
                {
                    isConnected = false;
                    lastState = "Connection error";
                    lastStatus = "Connection failed";
                    lastMessage =
                        GetResponseMessage(
                            pingResponse,
                            "GH Agent ping failed."
                        );

                    SetOutputs(
                        ref State,
                        ref Status,
                        ref Message,
                        ref UploadJobId,
                        ref Progress,
                        ref Session,
                        ref OutputIndex,
                        ref MasterResponse
                    );

                    return;
                }

                isConnected = true;
                lastState = "Ready";
                lastStatus = "Connected";
                lastMessage =
                    GetResponseMessage(
                        pingResponse,
                        "Connected to GH Agent."
                    );
            }

            if (!isConnected)
            {
                SetOutputs(
                    ref State,
                    ref Status,
                    ref Message,
                    ref UploadJobId,
                    ref Progress,
                    ref Session,
                    ref OutputIndex,
                    ref MasterResponse
                );

                return;
            }

            // ----------------------------------------------------
            // Detect a new ready event
            // ----------------------------------------------------

            if (!string.IsNullOrWhiteSpace(ReadyEvent))
            {
                ReadyEventData eventData =
                    ParseReadyEvent(
                        ReadyEvent
                    );

                if (
                    eventData != null &&
                    !string.IsNullOrWhiteSpace(
                        eventData.EventId) &&
                    !string.Equals(
                        eventData.EventId,
                        lastProcessedEventId,
                        StringComparison.Ordinal))
                {
                    SubmitReadyEvent(
                        eventData,
                        SourceOutputIndex,
                        CreatedBy,
                        UploadMessage
                    );
                }
            }

            // ----------------------------------------------------
            // Poll active upload job
            // ----------------------------------------------------

            if (
                IsUploadActive() &&
                AutoPoll)
            {
                PollUploadJob();

                if (IsUploadActive())
                {
                    ScheduleNextPoll();
                }
            }

            SetOutputs(
                ref State,
                ref Status,
                ref Message,
                ref UploadJobId,
                ref Progress,
                ref Session,
                ref OutputIndex,
                ref MasterResponse
            );
        }
        catch (Exception exception)
        {
            lastState = "Failed";
            lastStatus = "Component error";
            lastMessage = exception.Message;

            SetOutputs(
                ref State,
                ref Status,
                ref Message,
                ref UploadJobId,
                ref Progress,
                ref Session,
                ref OutputIndex,
                ref MasterResponse
            );
        }
    }

    // ============================================================
    // READY EVENT SUBMISSION
    // ============================================================

    private void SubmitReadyEvent(
        ReadyEventData eventData,
        int sourceOutputIndex,
        string createdBy,
        string uploadMessage)
    {
        ValidateReadyEvent(eventData);

        bool isDesign =
            string.Equals(
                eventData.Domain,
                "design",
                StringComparison.OrdinalIgnoreCase
            );

        bool isMotion =
            string.Equals(
                eventData.Domain,
                "motion",
                StringComparison.OrdinalIgnoreCase
            );

        if (!isDesign && !isMotion)
        {
            throw new InvalidOperationException(
                "Unsupported output domain: '" +
                eventData.Domain +
                "'. Expected 'design' or 'motion'."
            );
        }

        int safeSourceOutputIndex =
            Math.Max(
                1,
                sourceOutputIndex
            );

        string command;
        string outputIndexField;
        string sourceIndexField;
        string defaultCreatedBy;
        string defaultUploadMessage;
        string submissionMessage;
        string submittedMessage;

        if (isDesign)
        {
            command =
                "upload_design_output";

            outputIndexField =
                "design_output_index";

            sourceIndexField =
                "source_processing_output_index";

            defaultCreatedBy =
                "design_pc";

            defaultUploadMessage =
                "Design solution ready.";

            submissionMessage =
                "Submitting registered design output to GH Agent.";

            submittedMessage =
                "Design upload job submitted.";
        }
        else
        {
            command =
                "upload_motion_output";

            outputIndexField =
                "motion_output_index";

            sourceIndexField =
                "source_design_output_index";

            defaultCreatedBy =
                "motion_pc";

            defaultUploadMessage =
                "Motion solution ready.";

            submissionMessage =
                "Submitting registered motion output to GH Agent.";

            submittedMessage =
                "Motion upload job submitted.";
        }

        string safeCreatedBy =
            string.IsNullOrWhiteSpace(
                createdBy
            )
            ? defaultCreatedBy
            : createdBy.Trim();

        string safeUploadMessage =
            string.IsNullOrWhiteSpace(
                uploadMessage
            )
            ? defaultUploadMessage
            : uploadMessage.Trim();

        string payload =
            "{" +
            "\"command\":\"" +
            EscapeJson(command) +
            "\"," +
            "\"session\":\"" +
            EscapeJson(eventData.Session) +
            "\"," +
            "\"" +
            outputIndexField +
            "\":" +
            eventData.OutputIndex.ToString(
                CultureInfo.InvariantCulture
            ) +
            "," +
            "\"" +
            sourceIndexField +
            "\":" +
            safeSourceOutputIndex.ToString(
                CultureInfo.InvariantCulture
            ) +
            "," +
            "\"created_by\":\"" +
            EscapeJson(safeCreatedBy) +
            "\"," +
            "\"message\":\"" +
            EscapeJson(safeUploadMessage) +
            "\"" +
            "}";

        lastState =
            "Submitting";

        lastStatus =
            "Submitting upload";

        lastMessage =
            submissionMessage;

        string response =
            SendCommand(
                payload
            );

        if (
            response.StartsWith(
                "ERROR:",
                StringComparison.Ordinal
            )
        )
        {
            ConnectionFailure(
                response
            );

            return;
        }

        string responseStatus =
            ExtractJsonValue(
                response,
                "status"
            );

        if (
            !string.Equals(
                responseStatus,
                "ok",
                StringComparison.OrdinalIgnoreCase
            )
        )
        {
            lastState =
                "Failed";

            lastStatus =
                "Upload submission failed";

            lastMessage =
                GetResponseMessage(
                    response,
                    response
                );

            /*
            * Do not consume the event when submission fails.
            * A later Grasshopper solution may retry it.
            */
            return;
        }

        string jobId =
            ExtractJsonValue(
                response,
                "job_id"
            );

        if (
            string.IsNullOrWhiteSpace(
                jobId
            )
        )
        {
            lastState =
                "Failed";

            lastStatus =
                "Upload submission failed";

            lastMessage =
                "GH Agent returned success without an upload job ID.";

            return;
        }

        /*
        * Consume the event only after GH Agent successfully
        * accepted the upload job.
        */
        lastProcessedEventId =
            eventData.EventId;

        activeUploadJobId =
            jobId;

        activeSession =
            eventData.Session;

        activeDomain =
            eventData.Domain;

        activeOutputIndex =
            eventData.OutputIndex;

        lastProgress =
            0;

        lastMasterResponse =
            "";

        lastState =
            "Upload queued";

        lastStatus =
            ExtractJsonValue(
                response,
                "latest_status"
            );

        if (
            string.IsNullOrWhiteSpace(
                lastStatus
            )
        )
        {
            lastStatus =
                "upload_queued";
        }

        lastMessage =
            GetResponseMessage(
                response,
                submittedMessage
            );

        ScheduleNextPoll();
    }

    // ============================================================
    // JOB POLLING
    // ============================================================

    private void PollUploadJob()
    {
        if (string.IsNullOrWhiteSpace(
            activeUploadJobId))
        {
            return;
        }

        string payload =
            "{" +
            "\"command\":\"get_job_status\"," +
            "\"job_id\":\"" +
            EscapeJson(activeUploadJobId) +
            "\"" +
            "}";

        string response =
            SendCommand(payload);

        if (response.StartsWith("ERROR:"))
        {
            ConnectionFailure(response);
            return;
        }

        string outerStatus =
            ExtractJsonValue(
                response,
                "status"
            );

        if (
            !string.Equals(
                outerStatus,
                "ok",
                StringComparison.OrdinalIgnoreCase))
        {
            lastState = "Polling error";
            lastStatus = "Upload status request failed";
            lastMessage =
                GetResponseMessage(
                    response,
                    response
                );

            return;
        }

        string jobJson =
            ExtractJsonObject(
                response,
                "job"
            );

        if (string.IsNullOrWhiteSpace(jobJson))
        {
            lastState = "Polling error";
            lastStatus = "Upload status unavailable";
            lastMessage =
                "GH Agent response did not contain a job object.";

            return;
        }

        string jobStatus =
            NormalizeStatus(
                ExtractJsonValue(
                    jobJson,
                    "status"
                )
            );

        string jobMessage =
            ExtractJsonValue(
                jobJson,
                "message"
            );

        string jobError =
            ExtractJsonValue(
                jobJson,
                "error"
            );

        lastProgress =
            ParseInteger(
                ExtractJsonValue(
                    jobJson,
                    "progress"
                ),
                lastProgress
            );

        if (!string.IsNullOrWhiteSpace(jobMessage))
        {
            lastMessage = jobMessage;
        }

        lastStatus =
            string.IsNullOrWhiteSpace(jobStatus)
            ? "unknown"
            : jobStatus;

        if (
            jobStatus == "upload_queued" ||
            jobStatus == "queued")
        {
            lastState = "Upload queued";
            return;
        }

        if (
            jobStatus == "upload_running" ||
            jobStatus == "running")
        {
            lastState = "Uploading";
            return;
        }

        if (
            jobStatus == "upload_finished" ||
            jobStatus == "finished")
        {
            lastState = "Finished";
            lastStatus = "upload_finished";
            lastProgress = 100;

            string resultJson =
                ExtractJsonObject(
                    jobJson,
                    "result"
                );

            lastMasterResponse =
                ExtractMasterResponse(
                    resultJson
                );

            if (string.IsNullOrWhiteSpace(lastMessage))
            {
                lastMessage =
                    "output uploaded to the Python master.";
            }

            return;
        }

        if (
            jobStatus == "upload_failed" ||
            jobStatus == "failed" ||
            jobStatus == "error")
        {
            lastState = "Failed";
            lastStatus = "upload_failed";
            lastProgress = 100;

            if (!string.IsNullOrWhiteSpace(jobError))
            {
                lastMessage = jobError;
            }
            else if (string.IsNullOrWhiteSpace(lastMessage))
            {
                lastMessage = "upload failed.";
            }

            return;
        }

        if (jobStatus == "cancelled")
        {
            lastState = "Cancelled";
            lastStatus = "cancelled";
            lastProgress = 100;

            if (string.IsNullOrWhiteSpace(lastMessage))
            {
                lastMessage =
                    "upload was cancelled.";
            }

            return;
        }

        lastState = "Upload status unknown";
    }

    private bool IsUploadActive()
    {
        string normalized =
            NormalizeStatus(
                lastStatus
            );

        return (
            !string.IsNullOrWhiteSpace(
                activeUploadJobId) &&
            normalized != "upload_finished" &&
            normalized != "finished" &&
            normalized != "upload_failed" &&
            normalized != "failed" &&
            normalized != "error" &&
            normalized != "cancelled"
        );
    }

    // ============================================================
    // AUTOMATIC POLLING
    // ============================================================

    private void ScheduleNextPoll()
    {
        if (pollScheduled)
            return;

        GH_Document document =
            Component.OnPingDocument();

        if (document == null)
            return;

        pollScheduled = true;

        document.ScheduleSolution(
            PollIntervalMilliseconds,
            scheduledDocument =>
            {
                pollScheduled = false;

                if (Component != null)
                {
                    Component.ExpireSolution(
                        false
                    );
                }
            }
        );
    }

    // ============================================================
    // READY EVENT PARSING
    // ============================================================

    private ReadyEventData ParseReadyEvent(
        string readyEvent)
    {
        string eventName =
            ExtractJsonValue(
                readyEvent,
                "event"
            );

        string eventStatus =
            NormalizeStatus(
                ExtractJsonValue(
                    readyEvent,
                    "status"
                )
            );

        if (
            !string.Equals(
                eventName,
                "local_output_ready",
                StringComparison.OrdinalIgnoreCase))
        {
            return null;
        }

        if (eventStatus != "ready")
        {
            return null;
        }

        ReadyEventData result =
            new ReadyEventData();

        result.EventId =
            ExtractJsonValue(
                readyEvent,
                "event_id"
            );

        result.Session =
            ExtractJsonValue(
                readyEvent,
                "session"
            );

        result.Domain =
            NormalizeStatus(
                ExtractJsonValue(
                    readyEvent,
                    "domain"
                )
            );

        result.OutputIndex =
            ParseInteger(
                ExtractJsonValue(
                    readyEvent,
                    "output_index"
                ),
                0
            );

        result.LocalPath =
            ExtractJsonValue(
                readyEvent,
                "local_path"
            );

        result.Category =
            ExtractJsonValue(
                readyEvent,
                "category"
            );

        return result;
    }

    private void ValidateReadyEvent(
        ReadyEventData eventData)
    {
        if (eventData == null)
        {
            throw new ArgumentException(
                "ReadyEvent could not be parsed."
            );
        }

        if (string.IsNullOrWhiteSpace(
            eventData.EventId))
        {
            throw new ArgumentException(
                "ReadyEvent is missing event_id."
            );
        }

        if (string.IsNullOrWhiteSpace(
            eventData.Session))
        {
            throw new ArgumentException(
                "ReadyEvent is missing session."
            );
        }

        if (string.IsNullOrWhiteSpace(
            eventData.Domain))
        {
            throw new ArgumentException(
                "ReadyEvent is missing domain."
            );
        }

        if (eventData.OutputIndex < 1)
        {
            throw new ArgumentException(
                "ReadyEvent output_index must be at least 1."
            );
        }

        if (string.IsNullOrWhiteSpace(
            eventData.LocalPath))
        {
            throw new ArgumentException(
                "ReadyEvent is missing local_path."
            );
        }
    }

    // ============================================================
    // CONNECTION
    // ============================================================

    private void ConnectionFailure(
        string message)
    {
        isConnected = false;
        triedConnection = true;

        lastState = "Connection error";
        lastStatus = "connection_failed";
        lastMessage = message;
    }

    private string SendCommand(
        string command)
    {
        try
        {
            using (
                TcpClient client =
                    new TcpClient())
            {
                IAsyncResult connection =
                    client.BeginConnect(
                        GhAgentHost,
                        GhAgentPort,
                        null,
                        null
                    );

                bool connected =
                    connection.AsyncWaitHandle.WaitOne(
                        TimeSpan.FromMilliseconds(
                            500
                        )
                    );

                if (!connected)
                {
                    return
                        "ERROR: GH Agent connection timeout.";
                }

                client.EndConnect(connection);

                using (
                    NetworkStream stream =
                        client.GetStream())
                {
                    byte[] payload =
                        Encoding.UTF8.GetBytes(
                            command
                        );

                    byte[] header =
                        BuildHeader(
                            payload.Length
                        );

                    stream.Write(
                        header,
                        0,
                        header.Length
                    );

                    stream.Write(
                        payload,
                        0,
                        payload.Length
                    );

                    byte[] responseHeader =
                        ReadExact(
                            stream,
                            MessageHeaderSize
                        );

                    ulong responseSize =
                        ParseHeader(
                            responseHeader
                        );

                    if (responseSize > int.MaxValue)
                    {
                        return
                            "ERROR: GH Agent response is too large.";
                    }

                    byte[] responsePayload =
                        ReadExact(
                            stream,
                            (int)responseSize
                        );

                    return Encoding.UTF8.GetString(
                        responsePayload
                    );
                }
            }
        }
        catch (Exception exception)
        {
            return
                "ERROR: " +
                exception.Message;
        }
    }

    private byte[] BuildHeader(
        int payloadSize)
    {
        byte[] header =
            new byte[MessageHeaderSize];

        ulong size =
            (ulong)payloadSize;

        for (
            int index = 0;
            index < MessageHeaderSize;
            index++)
        {
            header[
                MessageHeaderSize - 1 - index
            ] = (byte)(size & 0xFF);

            size >>= 8;
        }

        return header;
    }

    private ulong ParseHeader(
        byte[] header)
    {
        ulong size = 0;

        for (
            int index = 0;
            index < header.Length;
            index++)
        {
            size =
                (size << 8) +
                header[index];
        }

        return size;
    }

    private byte[] ReadExact(
        NetworkStream stream,
        int size)
    {
        byte[] data =
            new byte[size];

        int offset = 0;

        while (offset < size)
        {
            int read =
                stream.Read(
                    data,
                    offset,
                    size - offset
                );

            if (read == 0)
            {
                throw new InvalidOperationException(
                    "Connection closed before the response was complete."
                );
            }

            offset += read;
        }

        return data;
    }

    // ============================================================
    // JSON HELPERS
    // ============================================================

    private string ExtractMasterResponse(
        string resultJson)
    {
        if (string.IsNullOrWhiteSpace(resultJson))
        {
            return "";
        }

        string masterResponse =
            ExtractJsonObject(
                resultJson,
                "master_response"
            );

        return string.IsNullOrWhiteSpace(
            masterResponse)
            ? resultJson
            : masterResponse;
    }

    private string GetResponseMessage(
        string json,
        string fallback)
    {
        string message =
            ExtractJsonValue(
                json,
                "message"
            );

        return string.IsNullOrWhiteSpace(message)
            ? fallback
            : message;
    }

    private string NormalizeStatus(
        string value)
    {
        return string.IsNullOrWhiteSpace(value)
            ? ""
            : value.Trim().ToLowerInvariant();
    }

    private int ParseInteger(
        string value,
        int fallback)
    {
        int parsedInteger;

        if (
            int.TryParse(
                value,
                NumberStyles.Integer,
                CultureInfo.InvariantCulture,
                out parsedInteger))
        {
            return parsedInteger;
        }

        double parsedDouble;

        if (
            double.TryParse(
                value,
                NumberStyles.Float,
                CultureInfo.InvariantCulture,
                out parsedDouble))
        {
            return (int)Math.Round(parsedDouble);
        }

        return fallback;
    }

    private string EscapeJson(
        string value)
    {
        if (value == null)
            return "";

        return value
            .Replace("\\", "\\\\")
            .Replace("\"", "\\\"")
            .Replace("\r", "\\r")
            .Replace("\n", "\\n")
            .Replace("\t", "\\t");
    }

    private string ExtractJsonValue(
        string json,
        string key)
    {
        if (string.IsNullOrWhiteSpace(json))
            return "";

        string pattern =
            "\"" + key + "\":";

        int start =
            json.IndexOf(
                pattern,
                StringComparison.Ordinal
            );

        if (start < 0)
            return "";

        start += pattern.Length;

        while (
            start < json.Length &&
            char.IsWhiteSpace(json[start]))
        {
            start++;
        }

        if (start >= json.Length)
            return "";

        if (json[start] == '"')
        {
            start++;

            StringBuilder value =
                new StringBuilder();

            bool escaped = false;

            for (
                int index = start;
                index < json.Length;
                index++)
            {
                char character =
                    json[index];

                if (escaped)
                {
                    switch (character)
                    {
                        case 'n':
                            value.Append('\n');
                            break;

                        case 'r':
                            value.Append('\r');
                            break;

                        case 't':
                            value.Append('\t');
                            break;

                        case '\\':
                            value.Append('\\');
                            break;

                        case '"':
                            value.Append('"');
                            break;

                        default:
                            value.Append(character);
                            break;
                    }

                    escaped = false;
                    continue;
                }

                if (character == '\\')
                {
                    escaped = true;
                    continue;
                }

                if (character == '"')
                {
                    return value.ToString();
                }

                value.Append(character);
            }

            return "";
        }

        if (
            json.Substring(start)
                .StartsWith(
                    "null",
                    StringComparison.Ordinal))
        {
            return "";
        }

        int end = start;

        while (
            end < json.Length &&
            json[end] != ',' &&
            json[end] != '}')
        {
            end++;
        }

        return json
            .Substring(
                start,
                end - start
            )
            .Trim();
    }

    private string ExtractJsonObject(
        string json,
        string key)
    {
        if (string.IsNullOrWhiteSpace(json))
            return "";

        string pattern =
            "\"" + key + "\":";

        int keyIndex =
            json.IndexOf(
                pattern,
                StringComparison.Ordinal
            );

        if (keyIndex < 0)
            return "";

        int start =
            keyIndex +
            pattern.Length;

        while (
            start < json.Length &&
            char.IsWhiteSpace(json[start]))
        {
            start++;
        }

        if (
            start >= json.Length ||
            json[start] != '{')
        {
            return "";
        }

        int depth = 0;
        bool insideString = false;
        bool escaped = false;

        for (
            int index = start;
            index < json.Length;
            index++)
        {
            char character =
                json[index];

            if (insideString)
            {
                if (escaped)
                {
                    escaped = false;
                }
                else if (character == '\\')
                {
                    escaped = true;
                }
                else if (character == '"')
                {
                    insideString = false;
                }

                continue;
            }

            if (character == '"')
            {
                insideString = true;
                continue;
            }

            if (character == '{')
            {
                depth++;
            }
            else if (character == '}')
            {
                depth--;

                if (depth == 0)
                {
                    return json.Substring(
                        start,
                        index - start + 1
                    );
                }
            }
        }

        return "";
    }

    private string GetActiveDomainLabel()
    {
        if (
            string.Equals(
                activeDomain,
                "motion",
                StringComparison.OrdinalIgnoreCase
            )
        )
        {
            return "Motion";
        }

        if (
            string.Equals(
                activeDomain,
                "design",
                StringComparison.OrdinalIgnoreCase
            )
        )
        {
            return "Design";
        }

        return "Output";
    }

    // ============================================================
    // OUTPUTS
    // ============================================================

    private void SetOutputs(
        ref object State,
        ref object Status,
        ref object Message,
        ref object UploadJobId,
        ref object Progress,
        ref object Session,
        ref object OutputIndex,
        ref object MasterResponse)
    {
        State = lastState;
        Status = lastStatus;
        Message = lastMessage;
        UploadJobId = activeUploadJobId;
        Progress = lastProgress;
        Session = activeSession;
        OutputIndex = activeOutputIndex;
        MasterResponse = lastMasterResponse;
    }

    private class ReadyEventData
    {
        public string EventId;
        public string Session;
        public string Domain;
        public int OutputIndex;
        public string LocalPath;
        public string Category;
    }
}
# ---------- end c_script_22 ----------
# ----
path_5 = FilePath(path_3)
py3 = Python3Script(FileOrFolder=path_5, UseLatestInFolder=Toggle(True), MakeClosed=Toggle(True))  # -> Polylines, Centroids, MeanColors, Info
# ---------- py3: Python ----------
# GHPython script (Rhino/Grasshopper)
# Inputs:
#   FileOrFolder      : str (File Path OR folder)
#   UseLatestInFolder : bool (default True)
#   MakeClosed        : bool (default True)
# Outputs:
#   Polylines         : DataTree[Rhino.Geometry.Curve]           # in millimeters
#   Centroids         : DataTree[Rhino.Geometry.Point3d]         # in millimeters
#   MeanColors        : DataTree[System.Drawing.Color]
#   Info              : str

import os, json
import Rhino as rc
from Grasshopper import DataTree
from Grasshopper.Kernel.Data import GH_Path
import System
from System.Drawing import Color

# ---------- helpers ----------
def _bool_or_default(val, default):
    return default if (val is None) else bool(val)

def _latest_json_in_folder(folder):
    files = [os.path.join(folder, f) for f in os.listdir(folder) if f.lower().endswith(".json")]
    if not files:
        raise IOError("No .json files found in folder: {}".format(folder))
    files.sort(key=lambda p: os.path.getmtime(p), reverse=True)
    return files[0]

def _coerce_point3d(obj):
    if isinstance(obj, (list, tuple)) and len(obj) == 3:
        try:
            return rc.Geometry.Point3d(float(obj[0]), float(obj[1]), float(obj[2])), None
        except Exception as e:
            return None, "list/tuple cast failed: {}".format(e)
    if isinstance(obj, dict):
        lower = {str(k).lower(): v for k, v in obj.items()}
        if all(k in lower for k in ("x","y","z")):
            try:
                return rc.Geometry.Point3d(float(lower["x"]), float(lower["y"]), float(lower["z"])), None
            except Exception as e:
                return None, "dict cast failed: {}".format(e)
        return None, "dict missing x/y/z keys"
    return None, "unsupported type: {}".format(type(obj).__name__)

def _make_polylinecurve(pts, make_closed=True, tol=1e-9):
    if not pts or len(pts) < 2:
        return None
    pl = rc.Geometry.Polyline()
    for p in pts:
        pl.Add(p)
    if make_closed and pl.Count >= 3:
        last_idx = pl.Count - 1
        if pl[0].DistanceTo(pl[last_idx]) > tol:
            pl.Add(pl[0])
    try:
        plc = pl.ToPolylineCurve()
        if plc and plc.IsValid:
            return plc
    except:
        pass
    try:
        plc = rc.Geometry.PolylineCurve(list(pl))
        if plc and plc.IsValid:
            return plc
    except:
        pass
    return None

def _rgb_to_color(rgb):
    """rgb can be [r,g,b] in 0..1 or 0..255 -> System.Drawing.Color"""
    if not isinstance(rgb, (list, tuple)) or len(rgb) != 3:
        return None
    try:
        r, g, b = float(rgb[0]), float(rgb[1]), float(rgb[2])
    except:
        return None
    if max(r, g, b) <= 1.0:
        r, g, b = int(round(r * 255.0)), int(round(g * 255.0)), int(round(b * 255.0))
    else:
        r, g, b = int(round(r)), int(round(g)), int(round(b))
    r = max(0, min(255, r))
    g = max(0, min(255, g))
    b = max(0, min(255, b))
    return Color.FromArgb(255, r, g, b)

# --- meters -> millimeters helpers ---
def _mm_xform():
    """Uniform scale x1000 about world origin."""
    return rc.Geometry.Transform.Scale(rc.Geometry.Point3d.Origin, 1000.0)

def _to_mm_curve(curve):
    """Duplicate & scale a curve to mm."""
    if curve is None: return None
    dup = curve.DuplicateCurve()
    if dup is None: return None
    xf = _mm_xform()
    ok = dup.Transform(xf)
    return dup if ok else None

def _to_mm_point(pt):
    """Return a scaled copy of a point in mm."""
    if pt is None: return None
    p = rc.Geometry.Point3d(pt)
    p.Transform(_mm_xform())
    return p

# ---------- inputs / path ----------
if not FileOrFolder:
    raise ValueError("Provide a file path or a folder path to your JSON.")

use_latest = _bool_or_default(UseLatestInFolder, True)
make_closed = _bool_or_default(MakeClosed, True)

path = str(FileOrFolder)
if os.path.isdir(path):
    if use_latest:
        path = _latest_json_in_folder(path)
    else:
        raise ValueError("Folder given. Set UseLatestInFolder=True or pass a specific .json file path.")
elif not os.path.isfile(path):
    raise IOError("Path does not exist: {}".format(path))
elif not path.lower().endswith(".json"):
    raise IOError("File is not a .json: {}".format(path))

# ---------- load ----------
with open(path, "r") as f:
    data = json.load(f)

clusters = data.get("clusters", [])
units_in = data.get("units", "meters")  # original units in file (for Info)

# ---------- outputs ----------
Polylines  = DataTree[rc.Geometry.Curve]()          # in mm
Centroids  = DataTree[rc.Geometry.Point3d]()        # in mm
MeanColors = DataTree[Color]()                      

made_pl = 0
made_cent = 0
made_color = 0

# ---------- build ----------
for i, c in enumerate(clusters):
    # indices + color group
    try:
        plane_idx   = int(c.get("plane_index", 1)) if isinstance(c, dict) else 1
        cluster_idx = int(c.get("cluster_index", i)) if isinstance(c, dict) else i
    except:
        plane_idx, cluster_idx = 1, i

    cg = c.get("color_group", {}) if isinstance(c, dict) else {}
    try:
        group_id = int(cg.get("group_id", -1))
    except:
        group_id = -1

    # branch path = {group_id; cluster_index}
    path_key = GH_Path(group_id, cluster_idx)

    # hull -> polyline (meters)
    hull_raw = c.get("hull_3d", [])
    pts = []
    if isinstance(hull_raw, list):
        for h in hull_raw:
            pt, _ = _coerce_point3d(h)
            if pt is not None:
                pts.append(pt)

    plc_m = _make_polylinecurve(pts, make_closed)
    plc_mm = _to_mm_curve(plc_m) if (plc_m is not None and plc_m.IsValid) else None
    if plc_mm is not None and plc_mm.IsValid:
        Polylines.Add(plc_mm, path_key)
        made_pl += 1

    # centroid (meters -> mm)
    cent_raw = c.get("centroid_3d", None)
    if cent_raw is not None:
        cpt_m, _ = _coerce_point3d(cent_raw)
        cpt_mm = _to_mm_point(cpt_m)
        if cpt_mm is not None:
            Centroids.Add(cpt_mm, path_key)
            made_cent += 1

    # mean color (unitless)
    mean_rgb = cg.get("group_mean_rgb", None)
    col = _rgb_to_color(mean_rgb) if mean_rgb is not None else None
    if col is not None:
        MeanColors.Add(col, path_key)
        made_color += 1

# ---------- summary ----------
Info = "File: {} | Clusters: {} | Polylines(mm): {} | Centroids(mm): {} | MeanColors: {} | source_units: {}".format(
    os.path.basename(path), len(clusters), made_pl, made_cent, made_color, units_in
)
# ---------- end py3 ----------
panel_96 = Panel(py3.Info)
crv = Curve(py3.Polylines)
pt_3 = Point(py3.Centroids)
panel_97 = Panel(py3.MeanColors)

panel_98 = Panel(c_script_21.State)
panel_99 = Panel(c_script_21.Status)
panel_100 = Panel(c_script_21.Message)
panel_101 = Panel(c_script_21.DownloadJobId)
panel_102 = Panel(c_script_21.Progress)
panel_103 = Panel(c_script_21.FilePath)
panel_104 = Panel(c_script_22.State)
panel_105 = Panel(c_script_22.Status)
panel_106 = Panel(c_script_22.Message)
panel_107 = Panel(c_script_22.UploadJobId)
panel_108 = Panel(c_script_22.Progress)
panel_109 = Panel(c_script_22.Session)
panel_110 = Panel(c_script_22.OutputIndex)
panel_111 = Panel(c_script_22.MasterResponse)
read = Button()

# ---- group: Workflow Manager Client
trigger_11 = Trigger(Interval=1000, TimerInterval=1000, Target=c_script_23)  # disabled
connect_10 = BooleanToggle(False)
submit_workflow_2 = Button()
cancel_workflow = Button()
workflow_sequence = ValueList({"capture_transform_process_download", "transform_process_download", "download_only"}, selected="capture_transform_process_download")
capture_index_4 = ValueList({"1", "2", "3", "4", "5"}, selected="1")
mode_4 = ValueList({"pointcloud", "image", "depth", "all"}, selected="all")
transform_pipeline = ValueList({"base", "ref_cam", "eye_to_base"}, selected="eye_to_base")
eye_to_base_index_4 = ValueList({"1", "2", "3"}, selected="1")
reference_index_4 = ValueList({"1", "2", "3"}, selected="2")
output_index_6 = ValueList({"1", "2", "3", "4", "5", "6", "7", "8", "9", "10"}, selected="1")
processing_input_kind_3 = ValueList({"merged", "eye_to_base"}, selected="eye_to_base")
show_processing_preview_3 = BooleanToggle(True)
color_grouping_method_3 = ValueList({"gmm_bic", "dbscan", "reference"}, selected="gmm_bic")
download_file_types = ValueList({"pointcloud", "image", "json"}, selected="json")
download_categories = ValueList({"all": "", "initial_pointcloud", "merged_pointcloud", "eye_to_base_pointcloud", "initial_rgb", "initial_depth", "initial_depth_rendered", "stitched_rgb", "stitched_height", "eye_to_base_rgb", "eye_to_base_height", "processed_clusters", "processing_params", "processing_report"}, selected="processed_clusters")
refresh_status_9 = BooleanToggle(False)
processing_preview_time_3 = Slider(1, range=0..5)
max_color_groups_3 = Slider(1, range=1..5)
gmm_merge_distance_3 = Slider(6, range=0..20)
c_script_23 = CSharpScript(
    ConnectButton=connect_10,
    SubmitWorkflow=submit_workflow_2,
    CancelWorkflow=cancel_workflow,
    WorkflowSequence=workflow_sequence,
    SessionName="EOB_test03",
    CaptureIndex=capture_index_4,
    CaptureMode=mode_4,
    TransformPipeline=transform_pipeline,
    EyeToBaseIndex=eye_to_base_index_4,
    ReferenceIndex=reference_index_4,
    OutputIndex=output_index_6,
    ProcessingInputKind=processing_input_kind_3,
    ShowProcessingPreview=show_processing_preview_3,
    ProcessingPreviewTime=processing_preview_time_3,
    ColorGroupingMethod=color_grouping_method_3,
    MaxColorGroups=max_color_groups_3,
    GmmMergeDistance=gmm_merge_distance_3,
    DownloadFileTypes=download_file_types,
    DownloadCategories=download_categories,
    RefreshStatus=refresh_status_9)  # -> State, Status, Message, WorkflowId, DownloadJobId, CurrentStage, Progress, PointCloudPaths, ImagePaths, JsonPaths; inputs ConnectButton: Boolean, SubmitWorkflow: Boolean, CancelWorkflow: Boolean, WorkflowSequence: String, SessionName: String, CaptureIndex: Int32, CaptureMode: String, TransformPipeline: String, EyeToBaseIndex: Int32, ReferenceIndex: Int32, OutputIndex: Int32, ProcessingInputKind: String, ShowProcessingPreview: Boolean, ProcessingPreviewTime: Double, ColorGroupingMethod: String, MaxColorGroups: Int32, GmmMergeDistance: Double, DownloadFileTypes: String, DownloadCategories: String, RefreshStatus: Boolean
# ---------- c_script_23: C# ----------
// Grasshopper Script Instance
#region Usings
using System;
using System.Text;
using System.Net.Sockets;
using System.Collections.Generic;
using System.Globalization;

using Rhino;
using Rhino.Geometry;

using Grasshopper;
using Grasshopper.Kernel;
using Grasshopper.Kernel.Data;
using Grasshopper.Kernel.Types;
#endregion

public class Script_Instance : GH_ScriptInstance
{
    // ============================================================
    // CONFIGURATION
    // ============================================================

    private const string Host = "127.0.0.1";
    private const int Port = 6005;

    /*
    * User-facing GH modes:
    *
    * capture_transform_process_download
    *     Python: capture_transform_process
    *     GH Agent: download
    *
    * transform_process_download
    *     Python: transform_process
    *     GH Agent: download
    *
    * download_only
    *     Python: no workflow
    *     GH Agent: download existing session outputs
    */
    private const string FullPythonWorkflowName =
        "capture_transform_process";

    private const string SkipCapturePythonWorkflowName =
        "transform_process";

    // ============================================================
    // CONNECTION STATE
    // ============================================================

    private bool isConnected = false;
    private bool triedConnect = false;

    // ============================================================
    // BUTTON EDGE DETECTION
    // ============================================================

    private bool previousSubmitWorkflow = false;
    private bool previousCancelWorkflow = false;

    // ============================================================
    // COMPONENT STATE
    // ============================================================

    private enum ComponentPhase
    {
        Idle,
        SubmittingWorkflow,
        RunningPythonWorkflow,
        SubmittingDownload,
        RunningDownload,
        ReadingManifest,
        Finished,
        Failed,
        Cancelled
    }

    private ComponentPhase phase =
        ComponentPhase.Idle;

    private string lastStatus =
        "Disconnected";

    private string lastMessage =
        "Enable ConnectButton.";

    private string activeSession = "";
    private string activeSequence = "";
    private string activePythonWorkflowName = "";

    private string workflowId = "";
    private string downloadJobId = "";

    private string currentStage = "";
    private int workflowProgress = 0;

    private bool downloadWasSubmitted = false;
    private bool manifestWasRead = false;

    private int activeOutputIndex = 1;
    private string activeDownloadFileTypes = "";
    private string activeDownloadCategories = "";

    private List<string> lastPointCloudPaths =
        new List<string>();

    private List<string> lastImagePaths =
        new List<string>();

    private List<string> lastJsonPaths =
        new List<string>();

    // ============================================================
    // MAIN
    // ============================================================

    private void RunScript(
		bool ConnectButton,
		bool SubmitWorkflow,
		bool CancelWorkflow,
		string WorkflowSequence,
		string SessionName,
		int CaptureIndex,
		string CaptureMode,
		string TransformPipeline,
		int EyeToBaseIndex,
		int ReferenceIndex,
		int OutputIndex,
		string ProcessingInputKind,
		bool ShowProcessingPreview,
		double ProcessingPreviewTime,
		string ColorGroupingMethod,
		int MaxColorGroups,
		double GmmMergeDistance,
		string DownloadFileTypes,
		string DownloadCategories,
		bool RefreshStatus,
		ref object State,
		ref object Status,
		ref object Message,
		ref object WorkflowId,
		ref object DownloadJobId,
		ref object CurrentStage,
		ref object Progress,
		ref object PointCloudPaths,
		ref object ImagePaths,
		ref object JsonPaths)
    {
        bool submitPulse =
            SubmitWorkflow &&
            !previousSubmitWorkflow;

        bool cancelPulse =
            CancelWorkflow &&
            !previousCancelWorkflow;

        previousSubmitWorkflow =
            SubmitWorkflow;

        previousCancelWorkflow =
            CancelWorkflow;

        // --------------------------------------------------------
        // Connection off
        // --------------------------------------------------------

        if (!ConnectButton)
        {
            isConnected = false;
            triedConnect = false;

            lastStatus = "Disconnected";
            lastMessage = "Connection toggle is off.";

            SetOutputs(
                ref State,
                ref Status,
                ref Message,
                ref WorkflowId,
                ref DownloadJobId,
                ref CurrentStage,
                ref Progress,
                ref PointCloudPaths,
                ref ImagePaths,
                ref JsonPaths
            );

            return;
        }

        // --------------------------------------------------------
        // Initial connection
        // --------------------------------------------------------

        if (
            ConnectButton &&
            !isConnected &&
            !triedConnect)
        {
            triedConnect = true;

            string response = SendCommand(
                "{\"command\":\"ping\"}"
            );

            if (response.StartsWith("ERROR:"))
            {
                isConnected = false;
                lastStatus = "Connection failed";
                lastMessage = response;
            }
            else
            {
                string outerStatus =
                    ExtractJsonValue(
                        response,
                        "status"
                    );

                if (
                    string.Equals(
                        outerStatus,
                        "ok",
                        StringComparison.OrdinalIgnoreCase
                    ))
                {
                    isConnected = true;
                    lastStatus = "Connected";

                    string responseMessage =
                        ExtractJsonValue(
                            response,
                            "message"
                        );

                    lastMessage =
                        string.IsNullOrWhiteSpace(
                            responseMessage
                        )
                        ? response
                        : responseMessage;
                }
                else
                {
                    isConnected = false;
                    lastStatus = "Connection failed";

                    string responseMessage =
                        ExtractJsonValue(
                            response,
                            "message"
                        );

                    lastMessage =
                        string.IsNullOrWhiteSpace(
                            responseMessage
                        )
                        ? response
                        : responseMessage;
                }
            }
        }

        if (!isConnected)
        {
            SetOutputs(
                ref State,
                ref Status,
                ref Message,
                ref WorkflowId,
                ref DownloadJobId,
                ref CurrentStage,
                ref Progress,
                ref PointCloudPaths,
                ref ImagePaths,
                ref JsonPaths
            );

            return;
        }

        // --------------------------------------------------------
        // Submit
        // --------------------------------------------------------

        if (submitPulse)
        {
            SubmitNewWorkflow(
                WorkflowSequence,
                SessionName,
                CaptureIndex,
                CaptureMode,
                TransformPipeline,
                EyeToBaseIndex,
                ReferenceIndex,
                OutputIndex,
                ProcessingInputKind,
                ShowProcessingPreview,
                ProcessingPreviewTime,
                ColorGroupingMethod,
                MaxColorGroups,
                GmmMergeDistance,
                DownloadFileTypes,
                DownloadCategories
            );
        }

        // --------------------------------------------------------
        // Cancel
        // --------------------------------------------------------

        if (cancelPulse)
        {
            CancelActiveWorkflow();
        }

        // --------------------------------------------------------
        // Poll workflow or download
        // --------------------------------------------------------

        if (RefreshStatus)
        {
            RefreshCurrentState();
        }

        SetOutputs(
            ref State,
            ref Status,
            ref Message,
            ref WorkflowId,
            ref DownloadJobId,
            ref CurrentStage,
            ref Progress,
            ref PointCloudPaths,
            ref ImagePaths,
            ref JsonPaths
        );
    }

    // ============================================================
    // SUBMISSION
    // ============================================================

    private void SubmitNewWorkflow(
        string workflowSequence,
        string sessionName,
        int captureIndex,
        string captureMode,
        string transformPipeline,
        int eyeToBaseIndex,
        int referenceIndex,
        int outputIndex,
        string processingInputKind,
        bool showProcessingPreview,
        double processingPreviewTime,
        string colorGroupingMethod,
        int maxColorGroups,
        double gmmMergeDistance,
        string downloadFileTypes,
        string downloadCategories)
    {
        if (IsBusy())
        {
            lastStatus = "Workflow already active";
            lastMessage =
                "Wait for the current workflow to finish, fail, " +
                "or cancel it before submitting another workflow.";

            return;
        }

        string normalizedSequence =
            NormalizeWorkflowSequence(
                workflowSequence
            );

        if (string.IsNullOrWhiteSpace(
            normalizedSequence))
        {
            phase = ComponentPhase.Failed;
            lastStatus = "Workflow rejected";
            lastMessage =
                "Unsupported workflow sequence: " +
                workflowSequence;

            return;
        }

        string pythonWorkflowName =
            ResolvePythonWorkflowName(
                normalizedSequence
            );

        string session =
            string.IsNullOrWhiteSpace(
                sessionName
            )
            ? "RQC_Capture_Session"
            : sessionName.Trim();

        string pipeline =
            NormalizeTransformPipeline(
                transformPipeline
            );

        string processInputKind =
            ResolveProcessingInputKind(
                processingInputKind,
                pipeline
            );

        string groupingMethod =
            NormalizeColorGroupingMethod(
                colorGroupingMethod
            );

        string mode =
            string.IsNullOrWhiteSpace(
                captureMode
            )
            ? "all"
            : captureMode
                .Trim()
                .ToLowerInvariant();

        int safeCaptureIndex =
            Math.Max(1, captureIndex);

        int safeEyeToBaseIndex =
            Math.Max(1, eyeToBaseIndex);

        int safeReferenceIndex =
            Math.Max(1, referenceIndex);

        int safeOutputIndex =
            Math.Max(1, outputIndex);

        int safeMaxGroups =
            Math.Max(1, maxColorGroups);

        double safeMergeDistance =
            Math.Max(0.0, gmmMergeDistance);

        string previewTimeJson =
            BuildPreviewTimeJson(
                showProcessingPreview,
                processingPreviewTime
            );

        string stageConfigsJson =
            BuildStageConfigsJson(
                normalizedSequence,
                mode,
                safeCaptureIndex,
                pipeline,
                safeEyeToBaseIndex,
                safeReferenceIndex,
                safeOutputIndex,
                processInputKind,
                showProcessingPreview,
                previewTimeJson,
                groupingMethod,
                safeMaxGroups,
                safeMergeDistance
            );

        string payload =
            "{" +
            "\"command\":\"submit_workflow\"," +
            "\"workflow_name\":\"" +
            EscapeJson(pythonWorkflowName) +
            "\"," +
            "\"session\":\"" +
            EscapeJson(session) +
            "\"," +
            "\"stage_configs\":" +
            stageConfigsJson +
            "," +
            "\"runtime\":{" +
            "\"requested_by\":\"grasshopper\"," +
            "\"workflow_sequence\":\"" +
            EscapeJson(normalizedSequence) +
            "\"" +
            "}" +
            "}";

        ResetRunState();

        activeSession = session;
        activeSequence = normalizedSequence;
        activePythonWorkflowName =
            pythonWorkflowName;

        activeOutputIndex =
            safeOutputIndex;

        activeDownloadFileTypes =
            downloadFileTypes;

        activeDownloadCategories =
            downloadCategories;

        // ----------------------------------------------------
        // Download-only mode
        // ----------------------------------------------------

        if (activeSequence == "download_only")
        {
            phase =
                ComponentPhase.SubmittingDownload;

            lastStatus = "Download-only started";
            lastMessage =
                "Skipping Python workflow. Existing outputs " +
                "from session '" +
                activeSession +
                "' will be downloaded.";

            return;
        }

        // ----------------------------------------------------
        // Python workflow modes
        // ----------------------------------------------------

        phase =
            ComponentPhase.SubmittingWorkflow;

        lastStatus = "Submitting workflow";
        lastMessage =
            "Sending workflow to GH Agent.";

        string response =
            SendCommand(payload);

        if (response.StartsWith("ERROR:"))
        {
            Fail(
                "Workflow submission failed",
                response
            );

            return;
        }

        string outerStatus =
            ExtractJsonValue(
                response,
                "status"
            );

        if (
            !string.Equals(
                outerStatus,
                "ok",
                StringComparison.OrdinalIgnoreCase
            ))
        {
            string responseMessage =
                ExtractJsonValue(
                    response,
                    "message"
                );

            Fail(
                "Workflow submission failed",
                string.IsNullOrWhiteSpace(
                    responseMessage
                )
                ? response
                : responseMessage
            );

            return;
        }

        workflowId =
            ExtractJsonValue(
                response,
                "workflow_id"
            );

        if (string.IsNullOrWhiteSpace(
            workflowId))
        {
            Fail(
                "Workflow submission failed",
                "The GH Agent returned success but no " +
                "workflow_id was provided.\n" +
                response
            );

            return;
        }

        phase =
            ComponentPhase.RunningPythonWorkflow;

        lastStatus = "Workflow submitted";
        lastMessage =
            "Python workflow submitted: " +
            workflowId;
    }

    private string BuildStageConfigsJson(
        string normalizedSequence,
        string captureMode,
        int captureIndex,
        string transformPipeline,
        int eyeToBaseIndex,
        int referenceIndex,
        int outputIndex,
        string processingInputKind,
        bool showProcessingPreview,
        string previewTimeJson,
        string groupingMethod,
        int maxColorGroups,
        double mergeDistance)
    {
        List<string> stageEntries =
            new List<string>();

        if (
            normalizedSequence ==
            "capture_transform_process_download")
        {
            string captureConfig =
                "\"capture\":{" +
                "\"camera_index\":0," +
                "\"capture_index\":" +
                captureIndex.ToString(
                    CultureInfo.InvariantCulture
                ) +
                "," +
                "\"mode\":\"" +
                EscapeJson(captureMode) +
                "\"" +
                "}";

            stageEntries.Add(captureConfig);
        }

        string transformConfig =
            "\"transform\":{" +
            "\"pipeline\":\"" +
            EscapeJson(transformPipeline) +
            "\"," +
            "\"eye_to_base_index\":" +
            eyeToBaseIndex.ToString(
                CultureInfo.InvariantCulture
            ) +
            "," +
            "\"reference_index\":" +
            referenceIndex.ToString(
                CultureInfo.InvariantCulture
            ) +
            "," +
            "\"output_index\":" +
            outputIndex.ToString(
                CultureInfo.InvariantCulture
            ) +
            "}";

        stageEntries.Add(transformConfig);

        string processConfig =
            "\"process\":{" +
            "\"output_index\":" +
            outputIndex.ToString(
                CultureInfo.InvariantCulture
            ) +
            "," +
            "\"input_kind\":\"" +
            EscapeJson(processingInputKind) +
            "\"," +
            "\"show_preview\":" +
            BoolToJson(
                showProcessingPreview
            ) +
            "," +
            "\"preview_time_sec\":" +
            previewTimeJson +
            "," +
            "\"color_grouping_method\":\"" +
            EscapeJson(groupingMethod) +
            "\"," +
            "\"gmm_max_groups\":" +
            maxColorGroups.ToString(
                CultureInfo.InvariantCulture
            ) +
            "," +
            "\"gmm_merge_distance\":" +
            mergeDistance.ToString(
                "0.########",
                CultureInfo.InvariantCulture
            ) +
            "}";

        stageEntries.Add(processConfig);

        return "{" +
            string.Join(",", stageEntries) +
            "}";
    }

    // ============================================================
    // REFRESH STATE
    // ============================================================

    private void RefreshCurrentState()
    {
        switch (phase)
        {
            case ComponentPhase.RunningPythonWorkflow:
                RefreshWorkflowStatus();
                break;

            case ComponentPhase.SubmittingDownload:
                SubmitDownload();
                break;

            case ComponentPhase.RunningDownload:
                RefreshDownloadStatus();
                break;

            case ComponentPhase.ReadingManifest:
                ReadLocalManifest();
                break;
        }
    }

    // ============================================================
    // PYTHON WORKFLOW STATUS
    // ============================================================

    private void RefreshWorkflowStatus()
    {
        if (string.IsNullOrWhiteSpace(
            workflowId))
        {
            Fail(
                "Workflow status error",
                "No active workflow_id is stored."
            );

            return;
        }

        string payload =
            "{" +
            "\"command\":\"get_workflow_status\"," +
            "\"workflow_id\":\"" +
            EscapeJson(workflowId) +
            "\"," +
            "\"session\":\"" +
            EscapeJson(activeSession) +
            "\"" +
            "}";

        string response =
            SendCommand(payload);

        if (response.StartsWith("ERROR:"))
        {
            ConnectionFailure(response);
            return;
        }

        string outerStatus =
            ExtractJsonValue(
                response,
                "status"
            );

        if (
            !string.Equals(
                outerStatus,
                "ok",
                StringComparison.OrdinalIgnoreCase
            ))
        {
            string responseMessage =
                ExtractJsonValue(
                    response,
                    "message"
                );

            lastStatus =
                "Workflow status request failed";

            lastMessage =
                string.IsNullOrWhiteSpace(
                    responseMessage
                )
                ? response
                : responseMessage;

            return;
        }

        string workflowJson =
            ExtractJsonObject(
                response,
                "workflow"
            );

        if (string.IsNullOrWhiteSpace(
            workflowJson))
        {
            lastStatus =
                "Workflow status unavailable";

            lastMessage =
                "The response did not contain a workflow object.\n" +
                response;

            return;
        }

        string workflowStatus =
            NormalizeStatus(
                ExtractJsonValue(
                    workflowJson,
                    "status"
                )
            );

        currentStage =
            ExtractJsonValue(
                workflowJson,
                "current_stage"
            );

        workflowProgress =
            ParseInteger(
                ExtractJsonValue(
                    workflowJson,
                    "progress"
                ),
                workflowProgress
            );

        string workflowMessage =
            ExtractJsonValue(
                workflowJson,
                "message"
            );

        string workflowError =
            ExtractJsonValue(
                workflowJson,
                "error"
            );

        lastStatus =
            string.IsNullOrWhiteSpace(
                workflowStatus
            )
            ? "Workflow status unknown"
            : workflowStatus;

        lastMessage =
            !string.IsNullOrWhiteSpace(
                workflowMessage
            )
            ? workflowMessage
            : (
                "Stage: " +
                (
                    string.IsNullOrWhiteSpace(
                        currentStage
                    )
                    ? "(none)"
                    : currentStage
                ) +
                " | Progress: " +
                workflowProgress.ToString(
                    CultureInfo.InvariantCulture
                ) +
                "%"
            );

        if (workflowStatus == "finished")
        {
            workflowProgress = 100;
            currentStage = "";

            if (!downloadWasSubmitted)
            {
                phase =
                    ComponentPhase.SubmittingDownload;

                lastStatus =
                    "Python workflow finished";

                lastMessage =
                    "Python workflow completed. " +
                    "Download is ready to be submitted.";
            }

            return;
        }

        if (
            workflowStatus == "failed" ||
            workflowStatus == "error")
        {
            Fail(
                "Python workflow failed",
                string.IsNullOrWhiteSpace(
                    workflowError
                )
                ? lastMessage
                : workflowError
            );

            return;
        }

        if (workflowStatus == "cancelled")
        {
            phase =
                ComponentPhase.Cancelled;

            lastStatus = "Workflow cancelled";

            lastMessage =
                string.IsNullOrWhiteSpace(
                    workflowMessage
                )
                ? "The Python workflow was cancelled."
                : workflowMessage;
        }
    }

    // ============================================================
    // DOWNLOAD
    // ============================================================

    private void SubmitDownload()
    {
        if (downloadWasSubmitted)
        {
            phase =
                ComponentPhase.RunningDownload;

            return;
        }

        string fileTypesJson =
            BuildFileTypesArray(
                activeDownloadFileTypes
            );

        string payload =
            "{" +
            "\"command\":\"downloadable_outputs\"," +
            "\"session\":\"" +
            EscapeJson(activeSession) +
            "\"," +
            "\"output_index\":" +
            activeOutputIndex.ToString(
                CultureInfo.InvariantCulture
            ) +
            "," +
            "\"file_types\":" +
            fileTypesJson +
            "}";

        lastStatus = "Submitting download";
        lastMessage =
            "Requesting workflow outputs from the Python Agent.";

        string response =
            SendCommand(payload);

        if (response.StartsWith("ERROR:"))
        {
            Fail(
                "Download submission failed",
                response
            );

            return;
        }

        string outerStatus =
            ExtractJsonValue(
                response,
                "status"
            );

        if (
            !string.Equals(
                outerStatus,
                "ok",
                StringComparison.OrdinalIgnoreCase
            ))
        {
            string responseMessage =
                ExtractJsonValue(
                    response,
                    "message"
                );

            Fail(
                "Download submission failed",
                string.IsNullOrWhiteSpace(
                    responseMessage
                )
                ? response
                : responseMessage
            );

            return;
        }

        downloadJobId =
            ExtractJsonValue(
                response,
                "job_id"
            );

        if (string.IsNullOrWhiteSpace(
            downloadJobId))
        {
            Fail(
                "Download submission failed",
                "The GH Agent returned success but did not " +
                "provide a download job_id.\n" +
                response
            );

            return;
        }

        downloadWasSubmitted = true;

        phase =
            ComponentPhase.RunningDownload;

        lastStatus = "Download submitted";
        lastMessage =
            "Download job submitted: " +
            downloadJobId;
    }

    private void RefreshDownloadStatus()
    {
        if (string.IsNullOrWhiteSpace(
            downloadJobId))
        {
            Fail(
                "Download status error",
                "No download job_id is stored."
            );

            return;
        }

        string payload =
            "{" +
            "\"command\":\"get_job_status\"," +
            "\"job_id\":\"" +
            EscapeJson(downloadJobId) +
            "\"" +
            "}";

        string response =
            SendCommand(payload);

        if (response.StartsWith("ERROR:"))
        {
            ConnectionFailure(response);
            return;
        }

        string outerStatus =
            ExtractJsonValue(
                response,
                "status"
            );

        if (
            !string.Equals(
                outerStatus,
                "ok",
                StringComparison.OrdinalIgnoreCase
            ))
        {
            string responseMessage =
                ExtractJsonValue(
                    response,
                    "message"
                );

            lastStatus =
                "Download status request failed";

            lastMessage =
                string.IsNullOrWhiteSpace(
                    responseMessage
                )
                ? response
                : responseMessage;

            return;
        }

        string jobJson =
            ExtractJsonObject(
                response,
                "job"
            );

        if (string.IsNullOrWhiteSpace(
            jobJson))
        {
            lastStatus =
                "Download status unavailable";

            lastMessage =
                "The response did not contain a job object.\n" +
                response;

            return;
        }

        string jobStatus =
            NormalizeStatus(
                ExtractJsonValue(
                    jobJson,
                    "status"
                )
            );

        string jobMessage =
            ExtractJsonValue(
                jobJson,
                "message"
            );

        string jobError =
            ExtractJsonValue(
                jobJson,
                "error"
            );

        lastStatus =
            string.IsNullOrWhiteSpace(
                jobStatus
            )
            ? "Download status unknown"
            : jobStatus;

        lastMessage =
            string.IsNullOrWhiteSpace(
                jobMessage
            )
            ? response
            : jobMessage;

        if (
            jobStatus == "download_finished" ||
            jobStatus == "finished")
        {
            phase =
                ComponentPhase.ReadingManifest;

            lastStatus = "Download finished";
            lastMessage =
                "Download completed. Reading local session manifest.";

            return;
        }

        if (
            jobStatus == "download_failed" ||
            jobStatus == "failed" ||
            jobStatus == "error")
        {
            Fail(
                "Download failed",
                string.IsNullOrWhiteSpace(
                    jobError
                )
                ? lastMessage
                : jobError
            );

            return;
        }

        if (jobStatus == "cancelled")
        {
            phase =
                ComponentPhase.Cancelled;

            lastStatus = "Download cancelled";
            lastMessage =
                string.IsNullOrWhiteSpace(
                    jobMessage
                )
                ? "The download job was cancelled."
                : jobMessage;
        }
    }

    // ============================================================
    // LOCAL MANIFEST
    // ============================================================

    private void ReadLocalManifest()
    {
        string fileTypesJson =
            BuildFileTypesArray(
                activeDownloadFileTypes
            );

        string categoriesJson =
            BuildCategoriesArray(
                activeDownloadCategories
            );

        string payload =
            "{" +
            "\"command\":\"list_local_downloads\"," +
            "\"session\":\"" +
            EscapeJson(activeSession) +
            "\"," +
            "\"output_index\":" +
            activeOutputIndex.ToString(
                CultureInfo.InvariantCulture
            ) +
            "," +
            "\"file_types\":" +
            fileTypesJson +
            "," +
            "\"categories\":" +
            categoriesJson +
            "}";

        string response =
            SendCommand(payload);

        if (response.StartsWith("ERROR:"))
        {
            Fail(
                "Manifest read failed",
                response
            );

            return;
        }

        string outerStatus =
            ExtractJsonValue(
                response,
                "status"
            );

        if (
            !string.Equals(
                outerStatus,
                "ok",
                StringComparison.OrdinalIgnoreCase
            ))
        {
            string responseMessage =
                ExtractJsonValue(
                    response,
                    "message"
                );

            Fail(
                "Manifest read failed",
                string.IsNullOrWhiteSpace(
                    responseMessage
                )
                ? response
                : responseMessage
            );

            return;
        }

        lastPointCloudPaths =
            ExtractLocalPathsByCategory(
                response,
                "pointclouds"
            );

        lastImagePaths =
            ExtractLocalPathsByCategory(
                response,
                "images"
            );

        lastJsonPaths =
            ExtractLocalPathsByCategory(
                response,
                "json"
            );

        manifestWasRead = true;
        phase = ComponentPhase.Finished;

        if (activeSequence == "download_only")
        {
            lastStatus = "Download finished";
            lastMessage =
                "Existing session outputs were downloaded and " +
                "the local manifest was read successfully.";
        }
        else
        {
            lastStatus = "Workflow finished";
            lastMessage =
                "Python workflow, download, and local manifest read " +
                "completed successfully.";
        }
    }

    // ============================================================
    // CANCELLATION
    // ============================================================

    private void CancelActiveWorkflow()
    {
        if (string.IsNullOrWhiteSpace(
            workflowId))
        {
            lastStatus = "Nothing to cancel";
            lastMessage =
                "No Python workflow_id is currently stored.";

            return;
        }

        if (
            phase !=
                ComponentPhase.RunningPythonWorkflow &&
            phase !=
                ComponentPhase.SubmittingWorkflow)
        {
            lastStatus =
                "Workflow cancellation unavailable";

            lastMessage =
                "Python workflow cancellation is only available " +
                "while the Python workflow is active.";

            return;
        }

        string payload =
            "{" +
            "\"command\":\"cancel_workflow\"," +
            "\"workflow_id\":\"" +
            EscapeJson(workflowId) +
            "\"," +
            "\"session\":\"" +
            EscapeJson(activeSession) +
            "\"" +
            "}";

        string response =
            SendCommand(payload);

        if (response.StartsWith("ERROR:"))
        {
            lastStatus =
                "Cancellation request failed";

            lastMessage = response;
            return;
        }

        string outerStatus =
            ExtractJsonValue(
                response,
                "status"
            );

        if (
            !string.Equals(
                outerStatus,
                "ok",
                StringComparison.OrdinalIgnoreCase
            ))
        {
            string responseMessage =
                ExtractJsonValue(
                    response,
                    "message"
                );

            lastStatus =
                "Cancellation request failed";

            lastMessage =
                string.IsNullOrWhiteSpace(
                    responseMessage
                )
                ? response
                : responseMessage;

            return;
        }

        lastStatus =
            "Cancellation requested";

        lastMessage =
            "Cancellation was requested for workflow " +
            workflowId +
            ". Refresh status to confirm.";
    }

    // ============================================================
    // NORMALIZATION
    // ============================================================

    private string NormalizeWorkflowSequence(
        string value)
    {
        string normalized =
            string.IsNullOrWhiteSpace(value)
            ? "capture_transform_process_download"
            : value
                .Trim()
                .ToLowerInvariant()
                .Replace(" ", "_")
                .Replace("-", "_")
                .Replace(">", "_")
                .Replace(",", "_");

        while (normalized.Contains("__"))
        {
            normalized =
                normalized.Replace("__", "_");
        }

        if (
            normalized == "full" ||
            normalized ==
                "capture_transform_process_download")
        {
            return
                "capture_transform_process_download";
        }

        if (
            normalized == "skip_capture" ||
            normalized ==
                "transform_process_download")
        {
            return
                "transform_process_download";
        }

        if (
            normalized == "download" ||
            normalized == "download_only")
        {
            return "download_only";
        }

        return "";
    }

    private string ResolvePythonWorkflowName(
        string normalizedSequence)
    {
        if (
            normalizedSequence ==
            "capture_transform_process_download")
        {
            return FullPythonWorkflowName;
        }

        if (
            normalizedSequence ==
            "transform_process_download")
        {
            return SkipCapturePythonWorkflowName;
        }

        if (normalizedSequence == "download_only")
        {
            return "";
        }

        return "";
    }

    private string NormalizeTransformPipeline(
        string value)
    {
        string normalized =
            string.IsNullOrWhiteSpace(value)
            ? "eye_to_base"
            : value.Trim().ToLowerInvariant();

        if (
            normalized != "eye_to_base" &&
            normalized != "base" &&
            normalized != "ref_cam")
        {
            return "eye_to_base";
        }

        return normalized;
    }

    private string ResolveProcessingInputKind(
        string requestedValue,
        string transformPipeline)
    {
        string normalized =
            string.IsNullOrWhiteSpace(
                requestedValue
            )
            ? ""
            : requestedValue
                .Trim()
                .ToLowerInvariant();

        if (
            normalized == "eye_to_base" ||
            normalized == "merged" ||
            normalized == "initial")
        {
            return normalized;
        }

        if (
            transformPipeline == "base" ||
            transformPipeline == "ref_cam")
        {
            return "merged";
        }

        return "eye_to_base";
    }

    private string NormalizeColorGroupingMethod(
        string value)
    {
        string normalized =
            string.IsNullOrWhiteSpace(value)
            ? "gmm_bic"
            : value.Trim().ToLowerInvariant();

        if (
            normalized != "gmm_bic" &&
            normalized != "dbscan" &&
            normalized != "reference")
        {
            return "gmm_bic";
        }

        return normalized;
    }

    private string NormalizeStatus(
        string value)
    {
        return string.IsNullOrWhiteSpace(value)
            ? ""
            : value.Trim().ToLowerInvariant();
    }

    private string BuildPreviewTimeJson(
        bool showPreview,
        double previewTime)
    {
        if (!showPreview)
            return "null";

        if (previewTime <= 0.0)
            return "null";

        return previewTime.ToString(
            "0.########",
            CultureInfo.InvariantCulture
        );
    }

    // ============================================================
    // FILE TYPE AND CATEGORY JSON
    // ============================================================

    private string BuildFileTypesArray(
        string fileTypes)
    {
        if (string.IsNullOrWhiteSpace(
            fileTypes))
        {
            return
                "[\"pointcloud\",\"image\",\"json\"]";
        }

        string[] parts =
            fileTypes.Split(',');

        List<string> cleaned =
            new List<string>();

        HashSet<string> unique =
            new HashSet<string>(
                StringComparer.OrdinalIgnoreCase
            );

        foreach (string part in parts)
        {
            string value =
                part.Trim().ToLowerInvariant();

            string normalized = "";

            if (
                value == "pointcloud" ||
                value == "pointclouds" ||
                value == "pcd" ||
                value == "ply")
            {
                normalized = "pointcloud";
            }
            else if (
                value == "image" ||
                value == "images" ||
                value == "img" ||
                value == "png")
            {
                normalized = "image";
            }
            else if (value == "json")
            {
                normalized = "json";
            }

            if (
                !string.IsNullOrWhiteSpace(
                    normalized
                ) &&
                unique.Add(normalized))
            {
                cleaned.Add(
                    "\"" +
                    normalized +
                    "\""
                );
            }
        }

        if (cleaned.Count == 0)
        {
            return
                "[\"pointcloud\",\"image\",\"json\"]";
        }

        return "[" +
            string.Join(",", cleaned) +
            "]";
    }

    private string BuildCategoriesArray(
        string categories)
    {
        if (string.IsNullOrWhiteSpace(
            categories))
        {
            return "[]";
        }

        string[] parts =
            categories.Split(',');

        List<string> cleaned =
            new List<string>();

        HashSet<string> unique =
            new HashSet<string>(
                StringComparer.OrdinalIgnoreCase
            );

        foreach (string part in parts)
        {
            string value =
                part
                    .Trim()
                    .ToLowerInvariant();

            if (string.IsNullOrWhiteSpace(
                value))
            {
                continue;
            }

            if (unique.Add(value))
            {
                cleaned.Add(
                    "\"" +
                    EscapeJson(value) +
                    "\""
                );
            }
        }

        return "[" +
            string.Join(",", cleaned) +
            "]";
    }

    // ============================================================
    // PATH EXTRACTION
    // ============================================================

    private List<string> ExtractLocalPathsByCategory(
        string json,
        string category)
    {
        HashSet<string> uniquePaths =
            new HashSet<string>(
                StringComparer.OrdinalIgnoreCase
            );

        List<string> paths =
            new List<string>();

        int searchStart = 0;

        while (true)
        {
            int localPathIndex =
                json.IndexOf(
                    "\"local_path\":",
                    searchStart,
                    StringComparison.Ordinal
                );

            if (localPathIndex < 0)
                break;

            string path =
                ExtractJsonStringAt(
                    json,
                    localPathIndex +
                    "\"local_path\":".Length
                );

            if (!string.IsNullOrWhiteSpace(
                path))
            {
                string normalizedPath =
                    path
                        .Replace("/", "\\")
                        .ToLowerInvariant();

                string categoryFolder =
                    "\\" +
                    category.ToLowerInvariant() +
                    "\\";

                if (
                    normalizedPath.Contains(
                        categoryFolder
                    ))
                {
                    if (uniquePaths.Add(path))
                    {
                        paths.Add(path);
                    }
                }
            }

            searchStart =
                localPathIndex + 1;
        }

        return paths;
    }

    private string ExtractJsonStringAt(
        string json,
        int start)
    {
        while (
            start < json.Length &&
            char.IsWhiteSpace(json[start]))
        {
            start++;
        }

        if (
            start >= json.Length ||
            json[start] != '"')
        {
            return "";
        }

        start++;

        StringBuilder value =
            new StringBuilder();

        bool escaped = false;

        for (
            int i = start;
            i < json.Length;
            i++)
        {
            char character = json[i];

            if (escaped)
            {
                switch (character)
                {
                    case '\\':
                        value.Append('\\');
                        break;

                    case '"':
                        value.Append('"');
                        break;

                    case 'n':
                        value.Append('\n');
                        break;

                    case 'r':
                        value.Append('\r');
                        break;

                    case 't':
                        value.Append('\t');
                        break;

                    default:
                        value.Append(character);
                        break;
                }

                escaped = false;
                continue;
            }

            if (character == '\\')
            {
                escaped = true;
                continue;
            }

            if (character == '"')
            {
                return value.ToString();
            }

            value.Append(character);
        }

        return "";
    }

    // ============================================================
    // COMPONENT STATE
    // ============================================================

    private bool IsBusy()
    {
        return (
            phase ==
                ComponentPhase.SubmittingWorkflow ||
            phase ==
                ComponentPhase.RunningPythonWorkflow ||
            phase ==
                ComponentPhase.SubmittingDownload ||
            phase ==
                ComponentPhase.RunningDownload ||
            phase ==
                ComponentPhase.ReadingManifest
        );
    }

    private void ResetRunState()
    {
        workflowId = "";
        downloadJobId = "";

        currentStage = "";
        workflowProgress = 0;

        downloadWasSubmitted = false;
        manifestWasRead = false;

        lastPointCloudPaths =
            new List<string>();

        lastImagePaths =
            new List<string>();

        lastJsonPaths =
            new List<string>();
    }

    private void Fail(
        string status,
        string message)
    {
        phase = ComponentPhase.Failed;
        lastStatus = status;
        lastMessage = message;
    }

    private void ConnectionFailure(
        string message)
    {
        isConnected = false;
        triedConnect = true;

        lastStatus = "Connection lost";
        lastMessage = message;
    }

    private string BuildStateText()
    {
        switch (phase)
        {
            case ComponentPhase.Idle:
                return "Idle";

            case ComponentPhase.SubmittingWorkflow:
                return "Submitting Python workflow";

            case ComponentPhase.RunningPythonWorkflow:
                return (
                    "Python workflow running" +
                    " | Stage: " +
                    (
                        string.IsNullOrWhiteSpace(
                            currentStage
                        )
                        ? "(none)"
                        : currentStage
                    ) +
                    " | Progress: " +
                    workflowProgress.ToString(
                        CultureInfo.InvariantCulture
                    ) +
                    "%"
                );

            case ComponentPhase.SubmittingDownload:
                return "Submitting download";
                            
            case ComponentPhase.RunningDownload:
                return "Download running";

            case ComponentPhase.ReadingManifest:
                return "Reading local manifest";

            case ComponentPhase.Finished:
                return "Finished";

            case ComponentPhase.Failed:
                return "Failed";

            case ComponentPhase.Cancelled:
                return "Cancelled";
        }

        return phase.ToString();
    }

    private void SetOutputs(
        ref object State,
        ref object Status,
        ref object Message,
        ref object WorkflowId,
        ref object DownloadJobId,
        ref object CurrentStage,
        ref object Progress,
        ref object PointCloudPaths,
        ref object ImagePaths,
        ref object JsonPaths)
    {
        State = BuildStateText();
        Status = lastStatus;
        Message = lastMessage;

        WorkflowId = workflowId;
        DownloadJobId = downloadJobId;

        CurrentStage = currentStage;
        Progress = workflowProgress;

        PointCloudPaths =
            lastPointCloudPaths;

        ImagePaths =
            lastImagePaths;

        JsonPaths =
            lastJsonPaths;
    }

    // ============================================================
    // TCP
    // ============================================================

    private string SendCommand(
        string command)
    {
        const int headerSize = 8;

        try
        {
            using (
                TcpClient client =
                    new TcpClient())
            {
                IAsyncResult result =
                    client.BeginConnect(
                        Host,
                        Port,
                        null,
                        null
                    );

                bool success =
                    result.AsyncWaitHandle.WaitOne(
                        TimeSpan.FromMilliseconds(
                            300
                        )
                    );

                if (!success)
                {
                    return
                        "ERROR: GH Agent connection timeout.";
                }

                client.EndConnect(result);

                using (
                    NetworkStream stream =
                        client.GetStream())
                {
                    byte[] payload =
                        Encoding.UTF8.GetBytes(
                            command
                        );

                    byte[] header =
                        new byte[headerSize];

                    ulong size =
                        (ulong)payload.Length;

                    for (
                        int i = 0;
                        i < headerSize;
                        i++)
                    {
                        header[
                            headerSize - 1 - i
                        ] = (byte)(
                            size & 0xFF
                        );

                        size >>= 8;
                    }

                    stream.Write(
                        header,
                        0,
                        header.Length
                    );

                    stream.Write(
                        payload,
                        0,
                        payload.Length
                    );

                    byte[] responseHeader =
                        ReadExact(
                            stream,
                            headerSize
                        );

                    ulong responseSize = 0;

                    for (
                        int i = 0;
                        i < headerSize;
                        i++)
                    {
                        responseSize =
                            (
                                responseSize << 8
                            ) +
                            responseHeader[i];
                    }

                    if (
                        responseSize >
                        int.MaxValue)
                    {
                        return
                            "ERROR: Agent response is too large.";
                    }

                    byte[] responsePayload =
                        ReadExact(
                            stream,
                            (int)responseSize
                        );

                    return Encoding.UTF8.GetString(
                        responsePayload
                    );
                }
            }
        }
        catch (Exception exception)
        {
            return (
                "ERROR: " +
                exception.Message
            );
        }
    }

    private byte[] ReadExact(
        NetworkStream stream,
        int size)
    {
        byte[] data =
            new byte[size];

        int offset = 0;

        while (offset < size)
        {
            int read =
                stream.Read(
                    data,
                    offset,
                    size - offset
                );

            if (read == 0)
            {
                throw new Exception(
                    "Connection closed."
                );
            }

            offset += read;
        }

        return data;
    }

    // ============================================================
    // JSON HELPERS
    // ============================================================

    private string BoolToJson(
        bool value)
    {
        return value
            ? "true"
            : "false";
    }

    private string EscapeJson(
        string value)
    {
        if (value == null)
            return "";

        return value
            .Replace("\\", "\\\\")
            .Replace("\"", "\\\"")
            .Replace("\r", "\\r")
            .Replace("\n", "\\n")
            .Replace("\t", "\\t");
    }

    private string ExtractJsonValue(
        string json,
        string key)
    {
        if (string.IsNullOrWhiteSpace(
            json))
        {
            return "";
        }

        string pattern =
            "\"" + key + "\":";

        int start =
            json.IndexOf(
                pattern,
                StringComparison.Ordinal
            );

        if (start < 0)
            return "";

        start += pattern.Length;

        while (
            start < json.Length &&
            char.IsWhiteSpace(json[start]))
        {
            start++;
        }

        if (start >= json.Length)
            return "";

        if (json[start] == '"')
        {
            start++;

            StringBuilder value =
                new StringBuilder();

            bool escaped = false;

            for (
                int i = start;
                i < json.Length;
                i++)
            {
                char character = json[i];

                if (escaped)
                {
                    switch (character)
                    {
                        case 'n':
                            value.Append('\n');
                            break;

                        case 'r':
                            value.Append('\r');
                            break;

                        case 't':
                            value.Append('\t');
                            break;

                        case '\\':
                            value.Append('\\');
                            break;

                        case '"':
                            value.Append('"');
                            break;

                        default:
                            value.Append(character);
                            break;
                    }

                    escaped = false;
                    continue;
                }

                if (character == '\\')
                {
                    escaped = true;
                    continue;
                }

                if (character == '"')
                {
                    return value.ToString();
                }

                value.Append(character);
            }

            return "";
        }

        if (
            json.Substring(start)
                .StartsWith(
                    "null",
                    StringComparison.Ordinal
                ))
        {
            return "";
        }

        int end = start;

        while (
            end < json.Length &&
            json[end] != ',' &&
            json[end] != '}')
        {
            end++;
        }

        return json
            .Substring(
                start,
                end - start
            )
            .Trim();
    }

    private string ExtractJsonObject(
        string json,
        string key)
    {
        if (string.IsNullOrWhiteSpace(
            json))
        {
            return "";
        }

        string pattern =
            "\"" + key + "\":";

        int keyIndex =
            json.IndexOf(
                pattern,
                StringComparison.Ordinal
            );

        if (keyIndex < 0)
            return "";

        int start =
            keyIndex + pattern.Length;

        while (
            start < json.Length &&
            char.IsWhiteSpace(json[start]))
        {
            start++;
        }

        if (
            start >= json.Length ||
            json[start] != '{')
        {
            return "";
        }

        int depth = 0;
        bool insideString = false;
        bool escaped = false;

        for (
            int i = start;
            i < json.Length;
            i++)
        {
            char character = json[i];

            if (insideString)
            {
                if (escaped)
                {
                    escaped = false;
                }
                else if (character == '\\')
                {
                    escaped = true;
                }
                else if (character == '"')
                {
                    insideString = false;
                }

                continue;
            }

            if (character == '"')
            {
                insideString = true;
                continue;
            }

            if (character == '{')
            {
                depth++;
            }
            else if (character == '}')
            {
                depth--;

                if (depth == 0)
                {
                    return json.Substring(
                        start,
                        i - start + 1
                    );
                }
            }
        }

        return "";
    }

    private int ParseInteger(
        string value,
        int fallback)
    {
        int parsed;

        if (
            int.TryParse(
                value,
                NumberStyles.Integer,
                CultureInfo.InvariantCulture,
                out parsed
            ))
        {
            return parsed;
        }

        /*
         * Handle a JSON number serialized as a decimal, if needed.
         */
        double parsedDouble;

        if (
            double.TryParse(
                value,
                NumberStyles.Float,
                CultureInfo.InvariantCulture,
                out parsedDouble
            ))
        {
            return (int)Math.Round(
                parsedDouble
            );
        }

        return fallback;
    }
}
# ---------- end c_script_23 ----------
panel_112 = Panel(c_script_23.State)
panel_113 = Panel(c_script_23.Status)
panel_114 = Panel(c_script_23.Message)
panel_115 = Panel(c_script_23.WorkflowId)
panel_116 = Panel(c_script_23.DownloadJobId)
panel_117 = Panel(c_script_23.CurrentStage)
panel_118 = Panel(c_script_23.Progress)
path_6 = FilePath(c_script_23.PointCloudPaths)
path_7 = FilePath(c_script_23.JsonPaths)
import_4 = ImportContent(FilePath=path_6)  # -> Objects, Layers, Linetypes, HatchPatterns, AnnotationStyles, Materials, BlockDefinitions

# ----
c_script_24 = CSharpScript(FilePath=c_script_21.FilePath, Read=read)  # -> Metadata, Keys, InputSummary, Data, Status; inputs FilePath: String, Read: Boolean
# ---------- c_script_24: C# ----------
// Grasshopper C# Script Instance
#region Usings
using System;
using System.Collections.Generic;
using System.Globalization;
using System.IO;
using System.Reflection;

using GH_IO.Serialization;

using Grasshopper;
using Grasshopper.Kernel;
using Grasshopper.Kernel.Data;
using Grasshopper.Kernel.Types;
#endregion

public class Script_Instance : GH_ScriptInstance
{
    // ============================================================
    // COMPONENT STATE
    // ============================================================

    private bool previousRead = false;

    private List<string> lastMetadata =
        new List<string>();

    private List<string> lastKeys =
        new List<string>();

    private List<string> lastInputSummary =
        new List<string>();

    private GH_Structure<IGH_Goo> lastCombinedTree =
        new GH_Structure<IGH_Goo>();

    private string lastStatus = "Ready.";

    // ============================================================
    // MAIN
    // ============================================================

    private void RunScript(
		string FilePath,
		bool Read,
		ref object Metadata,
		ref object Keys,
		ref object InputSummary,
		ref object Data,
		ref object Status)
    {
        bool readPulse =
            Read &&
            !previousRead;

        previousRead = Read;

        try
        {
            if (readPulse)
            {
                ReadManagedArchive(
                    FilePath
                );
            }

            SetOutputs(
                ref Metadata,
                ref Keys,
                ref InputSummary,
                ref Data,
                ref Status
            );
        }
        catch (Exception exception)
        {
            lastStatus =
                "Managed Data Input failed: " +
                exception.Message;

            SetOutputs(
                ref Metadata,
                ref Keys,
                ref InputSummary,
                ref Data,
                ref Status
            );
        }
    }

    // ============================================================
    // ARCHIVE READING
    // ============================================================

    private void ReadManagedArchive(
        string filePath)
    {
        string validatedPath =
            ValidateFilePath(
                filePath
            );

        byte[] archiveBytes =
            File.ReadAllBytes(
                validatedPath
            );

        if (
            archiveBytes == null ||
            archiveBytes.Length == 0)
        {
            throw new IOException(
                "The selected file is empty."
            );
        }

        GH_Archive archive =
            new GH_Archive();

        bool deserialized =
            archive.Deserialize_Binary(
                archiveBytes
            );

        if (!deserialized)
        {
            throw new InvalidDataException(
                "The file could not be deserialized as a " +
                "Grasshopper binary archive."
            );
        }

        GH_IReader archiveRoot =
            archive.GetRootNode;

        if (archiveRoot == null)
        {
            throw new InvalidDataException(
                "The archive does not contain a root node."
            );
        }

        GH_IReader managedRoot =
            archiveRoot.FindChunk(
                "DECO2_Managed_Data"
            );

        if (managedRoot == null)
        {
            throw new InvalidDataException(
                "The archive does not contain the expected " +
                "DECO2_Managed_Data chunk."
            );
        }

        ValidateArchiveFormat(
            managedRoot
        );

        int inputCount =
            managedRoot.GetInt32(
                "InputCount"
            );

        GH_Structure<IGH_Goo> combinedTree =
            new GH_Structure<IGH_Goo>();

        List<string> keys =
            new List<string>();

        List<string> summaries =
            new List<string>();

        int totalReconstructedItems = 0;
        int totalReconstructedBranches = 0;

        for (
            int inputIndex = 0;
            inputIndex < inputCount;
            inputIndex++)
        {
            GH_IReader inputChunk =
                managedRoot.FindChunk(
                    "Input",
                    inputIndex
                );

            string fallbackKey =
                GetAlphabeticName(
                    inputIndex
                );

            if (inputChunk == null)
            {
                keys.Add(fallbackKey);

                summaries.Add(
                    fallbackKey +
                    " : Missing input chunk"
                );

                continue;
            }

            string key =
                GetStringOrDefault(
                    inputChunk,
                    "Key",
                    fallbackKey
                );

            keys.Add(key);

            InputReadResult result =
                ReadInputIntoCombinedTree(
                    inputChunk,
                    inputIndex,
                    combinedTree
                );

            totalReconstructedItems +=
                result.ItemCount;

            totalReconstructedBranches +=
                result.BranchCount;

            summaries.Add(
                BuildInputSummary(
                    inputChunk,
                    inputIndex,
                    result
                )
            );
        }

        lastCombinedTree =
            combinedTree;

        lastKeys =
            keys;

        lastInputSummary =
            summaries;

        lastMetadata =
            BuildMetadata(
                validatedPath,
                managedRoot,
                inputCount
            );

        lastStatus =
            "Archive loaded successfully. " +
            inputCount.ToString(
                CultureInfo.InvariantCulture
            ) +
            " input(s), " +
            totalReconstructedBranches.ToString(
                CultureInfo.InvariantCulture
            ) +
            " branch(es), and " +
            totalReconstructedItems.ToString(
                CultureInfo.InvariantCulture
            ) +
            " item(s) reconstructed.";
    }

    // ============================================================
    // COMBINED TREE RECONSTRUCTION
    // ============================================================

    private InputReadResult ReadInputIntoCombinedTree(
        GH_IReader inputChunk,
        int inputIndex,
        GH_Structure<IGH_Goo> combinedTree)
    {
        InputReadResult result =
            new InputReadResult();

        int expectedPathCount =
            GetInt32OrDefault(
                inputChunk,
                "PathCount",
                0
            );

        for (
            int branchIndex = 0;
            branchIndex < expectedPathCount;
            branchIndex++)
        {
            GH_IReader branchChunk =
                inputChunk.FindChunk(
                    "Branch",
                    branchIndex
                );

            if (branchChunk == null)
            {
                throw new InvalidDataException(
                    "Input " +
                    GetAlphabeticName(inputIndex) +
                    " is missing branch chunk " +
                    branchIndex.ToString(
                        CultureInfo.InvariantCulture
                    ) +
                    "."
                );
            }

            GH_Path originalPath =
                ReadPath(
                    branchChunk,
                    inputIndex,
                    branchIndex
                );

            GH_Path combinedPath =
                PrefixPath(
                    inputIndex,
                    originalPath
                );

            /*
             * Preserve empty branches.
             */
            combinedTree.EnsurePath(
                combinedPath
            );

            result.BranchCount++;

            int itemCount =
                GetInt32OrDefault(
                    branchChunk,
                    "ItemCount",
                    0
                );

            for (
                int itemIndex = 0;
                itemIndex < itemCount;
                itemIndex++)
            {
                GH_IReader itemChunk =
                    branchChunk.FindChunk(
                        "Item",
                        itemIndex
                    );

                if (itemChunk == null)
                {
                    throw new InvalidDataException(
                        "Input " +
                        GetAlphabeticName(inputIndex) +
                        ", branch " +
                        branchIndex.ToString(
                            CultureInfo.InvariantCulture
                        ) +
                        " is missing item chunk " +
                        itemIndex.ToString(
                            CultureInfo.InvariantCulture
                        ) +
                        "."
                    );
                }

                bool isNull =
                    GetBooleanOrDefault(
                        itemChunk,
                        "IsNull",
                        false
                    );

                if (isNull)
                {
                    combinedTree.Append(
                        null,
                        combinedPath
                    );

                    result.ItemCount++;
                    continue;
                }

                IGH_Goo goo =
                    ReadGoo(
                        itemChunk,
                        inputIndex,
                        branchIndex,
                        itemIndex
                    );

                combinedTree.Append(
                    goo,
                    combinedPath
                );

                result.ItemCount++;
            }
        }

        return result;
    }

    private GH_Path PrefixPath(
        int inputIndex,
        GH_Path originalPath)
    {
        int originalLength =
            originalPath == null
            ? 0
            : originalPath.Length;

        int[] combinedIndices =
            new int[
                originalLength + 1
            ];

        combinedIndices[0] =
            inputIndex;

        if (originalPath != null)
        {
            for (
                int index = 0;
                index < originalLength;
                index++)
            {
                combinedIndices[
                    index + 1
                ] = originalPath[index];
            }
        }

        return new GH_Path(
            combinedIndices
        );
    }

    private GH_Path ReadPath(
        GH_IReader branchChunk,
        int inputIndex,
        int branchIndex)
    {
        GH_IReader pathChunk =
            branchChunk.FindChunk(
                "Path"
            );

        if (pathChunk == null)
        {
            throw new InvalidDataException(
                "Input " +
                GetAlphabeticName(inputIndex) +
                ", branch " +
                branchIndex.ToString(
                    CultureInfo.InvariantCulture
                ) +
                " is missing its Path chunk."
            );
        }

        GH_Path path =
            new GH_Path();

        bool pathRead =
            path.Read(
                pathChunk
            );

        if (!pathRead)
        {
            throw new InvalidDataException(
                "Could not reconstruct the path for input " +
                GetAlphabeticName(inputIndex) +
                ", branch " +
                branchIndex.ToString(
                    CultureInfo.InvariantCulture
                ) +
                "."
            );
        }

        return path;
    }

    // ============================================================
    // GOO RECONSTRUCTION
    // ============================================================

    private IGH_Goo ReadGoo(
        GH_IReader itemChunk,
        int inputIndex,
        int branchIndex,
        int itemIndex)
    {
        string runtimeTypeName =
            GetStringOrDefault(
                itemChunk,
                "RuntimeType",
                ""
            );

        if (string.IsNullOrWhiteSpace(
            runtimeTypeName))
        {
            throw new InvalidDataException(
                BuildItemLocation(
                    inputIndex,
                    branchIndex,
                    itemIndex
                ) +
                " has no RuntimeType."
            );
        }

        Type runtimeType =
            ResolveRuntimeType(
                runtimeTypeName
            );

        if (runtimeType == null)
        {
            throw new TypeLoadException(
                BuildItemLocation(
                    inputIndex,
                    branchIndex,
                    itemIndex
                ) +
                " uses an unavailable type: " +
                runtimeTypeName
            );
        }

        if (
            !typeof(IGH_Goo).IsAssignableFrom(
                runtimeType
            ))
        {
            throw new InvalidDataException(
                BuildItemLocation(
                    inputIndex,
                    branchIndex,
                    itemIndex
                ) +
                " does not implement IGH_Goo: " +
                runtimeType.FullName
            );
        }

        object instance;

        try
        {
            instance =
                Activator.CreateInstance(
                    runtimeType
                );
        }
        catch (Exception exception)
        {
            throw new InvalidOperationException(
                BuildItemLocation(
                    inputIndex,
                    branchIndex,
                    itemIndex
                ) +
                " could not create type " +
                runtimeType.FullName +
                ". A public parameterless constructor is required.",
                exception
            );
        }

        IGH_Goo goo =
            instance as IGH_Goo;

        if (goo == null)
        {
            throw new InvalidOperationException(
                BuildItemLocation(
                    inputIndex,
                    branchIndex,
                    itemIndex
                ) +
                " could not be converted to IGH_Goo."
            );
        }

        GH_IReader gooChunk =
            itemChunk.FindChunk(
                "Goo"
            );

        if (gooChunk == null)
        {
            throw new InvalidDataException(
                BuildItemLocation(
                    inputIndex,
                    branchIndex,
                    itemIndex
                ) +
                " is missing its Goo chunk."
            );
        }

        bool gooRead =
            goo.Read(
                gooChunk
            );

        if (!gooRead)
        {
            throw new InvalidDataException(
                BuildItemLocation(
                    inputIndex,
                    branchIndex,
                    itemIndex
                ) +
                " could not deserialize type " +
                runtimeType.FullName +
                "."
            );
        }

        return goo;
    }

    private Type ResolveRuntimeType(
        string assemblyQualifiedName)
    {
        Type resolvedType =
            Type.GetType(
                assemblyQualifiedName,
                false
            );

        if (resolvedType != null)
        {
            return resolvedType;
        }

        /*
         * Fallback when assembly versions differ but the same full
         * runtime type exists in a loaded assembly.
         */
        string fullTypeName =
            assemblyQualifiedName
                .Split(',')[0]
                .Trim();

        foreach (
            Assembly assembly
            in AppDomain.CurrentDomain
                .GetAssemblies())
        {
            try
            {
                resolvedType =
                    assembly.GetType(
                        fullTypeName,
                        false
                    );

                if (resolvedType != null)
                {
                    return resolvedType;
                }
            }
            catch
            {
                /*
                 * Ignore assemblies that cannot expose the type.
                 */
            }
        }

        return null;
    }

    private string BuildItemLocation(
        int inputIndex,
        int branchIndex,
        int itemIndex)
    {
        return
            "Input " +
            GetAlphabeticName(inputIndex) +
            ", branch " +
            branchIndex.ToString(
                CultureInfo.InvariantCulture
            ) +
            ", item " +
            itemIndex.ToString(
                CultureInfo.InvariantCulture
            );
    }

    // ============================================================
    // METADATA AND SUMMARIES
    // ============================================================

    private List<string> BuildMetadata(
        string validatedPath,
        GH_IReader managedRoot,
        int inputCount)
    {
        List<string> metadata =
            new List<string>();

        metadata.Add(
            "File: " +
            validatedPath
        );

        metadata.Add(
            "Format: " +
            GetStringOrDefault(
                managedRoot,
                "Format",
                "Unknown"
            )
        );

        metadata.Add(
            "Format Version: " +
            GetInt32OrDefault(
                managedRoot,
                "FormatVersion",
                0
            ).ToString(
                CultureInfo.InvariantCulture
            )
        );

        metadata.Add(
            "Created At: " +
            GetStringOrDefault(
                managedRoot,
                "CreatedAt",
                ""
            )
        );

        metadata.Add(
            "Session: " +
            GetStringOrDefault(
                managedRoot,
                "Session",
                ""
            )
        );

        metadata.Add(
            "Domain: " +
            GetStringOrDefault(
                managedRoot,
                "Domain",
                ""
            )
        );

        metadata.Add(
            "Output Index: " +
            GetInt32OrDefault(
                managedRoot,
                "OutputIndex",
                0
            ).ToString(
                CultureInfo.InvariantCulture
            )
        );

        metadata.Add(
            "Stored Inputs: " +
            inputCount.ToString(
                CultureInfo.InvariantCulture
            )
        );

        metadata.Add(
            "Combined path format: " +
            "{input_index; original_path...}"
        );

        return metadata;
    }

    private string BuildInputSummary(
        GH_IReader inputChunk,
        int inputIndex,
        InputReadResult result)
    {
        string key =
            GetStringOrDefault(
                inputChunk,
                "Key",
                GetAlphabeticName(inputIndex)
            );

        string typeName =
            GetStringOrDefault(
                inputChunk,
                "TypeName",
                "Unknown"
            );

        string structureName =
            GetStringOrDefault(
                inputChunk,
                "StructureName",
                "Unknown"
            );

        return
            inputIndex.ToString(
                CultureInfo.InvariantCulture
            ) +
            " → " +
            key +
            " : " +
            typeName +
            " | " +
            structureName +
            " | Reconstructed items: " +
            result.ItemCount.ToString(
                CultureInfo.InvariantCulture
            ) +
            " | Branches: " +
            result.BranchCount.ToString(
                CultureInfo.InvariantCulture
            );
    }

    // ============================================================
    // FORMAT VALIDATION
    // ============================================================

    private void ValidateArchiveFormat(
        GH_IReader managedRoot)
    {
        string format =
            GetStringOrDefault(
                managedRoot,
                "Format",
                ""
            );

        if (
            !string.Equals(
                format,
                "DECO2_MANAGED_GHDATA",
                StringComparison.Ordinal
            ))
        {
            throw new InvalidDataException(
                "Unsupported archive format: " +
                format
            );
        }

        int formatVersion =
            GetInt32OrDefault(
                managedRoot,
                "FormatVersion",
                0
            );

        if (formatVersion != 1)
        {
            throw new InvalidDataException(
                "Unsupported archive format version: " +
                formatVersion.ToString(
                    CultureInfo.InvariantCulture
                )
            );
        }

        if (
            !managedRoot.ItemExists(
                "InputCount"
            ))
        {
            throw new InvalidDataException(
                "The archive is missing its InputCount field."
            );
        }
    }

    // ============================================================
    // FILE VALIDATION
    // ============================================================

    private string ValidateFilePath(
        string filePath)
    {
        if (string.IsNullOrWhiteSpace(
            filePath))
        {
            throw new ArgumentException(
                "FilePath cannot be empty."
            );
        }

        string resolvedPath =
            Path.GetFullPath(
                filePath.Trim()
            );

        if (!File.Exists(resolvedPath))
        {
            throw new FileNotFoundException(
                "The .ghdata file does not exist.",
                resolvedPath
            );
        }

        string extension =
            Path.GetExtension(
                resolvedPath
            );

        if (
            !string.Equals(
                extension,
                ".ghdata",
                StringComparison.OrdinalIgnoreCase
            ))
        {
            throw new ArgumentException(
                "The selected file must use the .ghdata extension."
            );
        }

        return resolvedPath;
    }

    // ============================================================
    // SAFE READER HELPERS
    // ============================================================

    private string GetStringOrDefault(
        GH_IReader reader,
        string itemName,
        string fallback)
    {
        if (
            reader == null ||
            !reader.ItemExists(itemName))
        {
            return fallback;
        }

        return reader.GetString(
            itemName
        );
    }

    private int GetInt32OrDefault(
        GH_IReader reader,
        string itemName,
        int fallback)
    {
        if (
            reader == null ||
            !reader.ItemExists(itemName))
        {
            return fallback;
        }

        return reader.GetInt32(
            itemName
        );
    }

    private bool GetBooleanOrDefault(
        GH_IReader reader,
        string itemName,
        bool fallback)
    {
        if (
            reader == null ||
            !reader.ItemExists(itemName))
        {
            return fallback;
        }

        return reader.GetBoolean(
            itemName
        );
    }

    // ============================================================
    // GENERAL HELPERS
    // ============================================================

    private string GetAlphabeticName(
        int zeroBasedIndex)
    {
        int value =
            zeroBasedIndex;

        string result =
            "";

        do
        {
            result =
                (char)(
                    'A' +
                    value % 26
                ) +
                result;

            value =
                value / 26 -
                1;
        }
        while (value >= 0);

        return result;
    }

    // ============================================================
    // OUTPUTS
    // ============================================================

    private void SetOutputs(
        ref object Metadata,
        ref object Keys,
        ref object InputSummary,
        ref object Data,
        ref object Status)
    {
        Metadata =
            lastMetadata;

        Keys =
            lastKeys;

        InputSummary =
            lastInputSummary;

        Data =
            lastCombinedTree;

        Status =
            lastStatus;
    }

    private class InputReadResult
    {
        public int BranchCount;
        public int ItemCount;
    }
}
# ---------- end c_script_24 ----------
path_8 = FilePath(c_script_18.JsonPaths)
panel_119 = Panel(path_8)
panel_120 = Panel(c_script_24.Metadata)
panel_121 = Panel(c_script_24.Keys)
panel_122 = Panel(c_script_24.InputSummary)
panel_123 = Panel(c_script_24.Status)
data = Data(c_script_24.Data)

c_script_25 = CSharpScript(CycleTrigger=c_script_15.DownloadReady)  # -> ReadyPulse, Ready, Status; inputs CycleTrigger: Boolean, Code: String, Errors: String
# ---------- c_script_25: C# ----------
// Grasshopper Script Instance

#region Usings
using System;

using Rhino;
using Rhino.Geometry;

using Grasshopper;
using Grasshopper.Kernel;
using Grasshopper.Kernel.Data;
using Grasshopper.Kernel.Types;
#endregion


public class Script_Instance : GH_ScriptInstance
{
    // ============================================================
    // EDGE-DETECTION STATE
    // ============================================================

    private bool previousCycleTrigger = false;


    // ============================================================
    // CYCLE STATE
    // ============================================================

    private bool cycleArmed = false;
    private bool cycleCompleted = false;

    private string codeAtCycleStart = "";
    private string errorsAtCycleStart = "";

    private bool readyPulse = false;
    private bool ready = false;

    private string lastStatus =
        "Waiting for a motion-planning cycle.";


    // ============================================================
    // MAIN
    // ============================================================

    private void RunScript(
		bool CycleTrigger,
		string Code,
		string Errors,
		ref object ReadyPulse,
		ref object Ready,
		ref object Status)
    {
        // --------------------------------------------------------
        // ReadyPulse is always a one-solution event.
        // --------------------------------------------------------

        readyPulse = false;


        // --------------------------------------------------------
        // Normalize text inputs.
        // --------------------------------------------------------

        string normalizedCode =
            NormalizeText(
                Code
            );

        string normalizedErrors =
            NormalizeText(
                Errors
            );


        // --------------------------------------------------------
        // Rising-edge detection for a new planning cycle.
        // --------------------------------------------------------

        bool cyclePulse =
            CycleTrigger &&
            !previousCycleTrigger;

        previousCycleTrigger =
            CycleTrigger;


        // --------------------------------------------------------
        // Arm a new cycle.
        //
        // Store the currently retained outputs so they cannot be
        // mistaken for newly generated results.
        // --------------------------------------------------------

        if (cyclePulse)
        {
            cycleArmed = true;
            cycleCompleted = false;

            ready = false;
            readyPulse = false;

            codeAtCycleStart =
                normalizedCode;

            errorsAtCycleStart =
                normalizedErrors;

            lastStatus =
                "Motion-planning cycle armed. " +
                "Waiting for new Code or Errors output.";

            SetOutputs(
                ref ReadyPulse,
                ref Ready,
                ref Status
            );

            return;
        }


        // --------------------------------------------------------
        // No active cycle.
        // --------------------------------------------------------

        if (!cycleArmed)
        {
            ready = false;

            lastStatus =
                "Waiting for CycleTrigger.";

            SetOutputs(
                ref ReadyPulse,
                ref Ready,
                ref Status
            );

            return;
        }


        // --------------------------------------------------------
        // A completed cycle must not pulse again.
        // --------------------------------------------------------

        if (cycleCompleted)
        {
            ready = true;

            lastStatus =
                "Motion code is ready. " +
                "Waiting for the next CycleTrigger.";

            SetOutputs(
                ref ReadyPulse,
                ref Ready,
                ref Status
            );

            return;
        }


        // --------------------------------------------------------
        // Detect whether planner outputs changed after arming.
        // --------------------------------------------------------

        bool codeChanged =
            !string.Equals(
                normalizedCode,
                codeAtCycleStart,
                StringComparison.Ordinal
            );

        bool errorsChanged =
            !string.Equals(
                normalizedErrors,
                errorsAtCycleStart,
                StringComparison.Ordinal
            );

        bool plannerOutputChanged =
            codeChanged ||
            errorsChanged;


        // --------------------------------------------------------
        // Ignore retained values from the previous cycle.
        // --------------------------------------------------------

        if (!plannerOutputChanged)
        {
            ready = false;

            lastStatus =
                "Waiting for the motion planner to update.";

            SetOutputs(
                ref ReadyPulse,
                ref Ready,
                ref Status
            );

            return;
        }


        // --------------------------------------------------------
        // Failure condition.
        // --------------------------------------------------------

        if (
            string.IsNullOrWhiteSpace(
                normalizedCode
            ) &&
            !string.IsNullOrWhiteSpace(
                normalizedErrors
            )
        )
        {
            ready = false;
            cycleCompleted = false;

            lastStatus =
                "Motion planning failed: " +
                normalizedErrors;

            SetOutputs(
                ref ReadyPulse,
                ref Ready,
                ref Status
            );

            return;
        }


        // --------------------------------------------------------
        // Conflicting condition.
        //
        // Do not accept generated code when Robots also reports
        // an error.
        // --------------------------------------------------------

        if (
            !string.IsNullOrWhiteSpace(
                normalizedCode
            ) &&
            !string.IsNullOrWhiteSpace(
                normalizedErrors
            )
        )
        {
            ready = false;
            cycleCompleted = false;

            lastStatus =
                "Motion planner returned both Code and Errors. " +
                "The result was rejected.";

            SetOutputs(
                ref ReadyPulse,
                ref Ready,
                ref Status
            );

            return;
        }


        // --------------------------------------------------------
        // Successful planning result.
        // --------------------------------------------------------

        if (
            !string.IsNullOrWhiteSpace(
                normalizedCode
            ) &&
            string.IsNullOrWhiteSpace(
                normalizedErrors
            )
        )
        {
            ready = true;
            readyPulse = true;

            cycleCompleted = true;
            cycleArmed = false;

            lastStatus =
                "Motion code generated successfully.";

            SetOutputs(
                ref ReadyPulse,
                ref Ready,
                ref Status
            );

            return;
        }


        // --------------------------------------------------------
        // Outputs changed, but neither success nor error is final.
        // --------------------------------------------------------

        ready = false;

        lastStatus =
            "Motion planner output changed, " +
            "but no final result is available yet.";

        SetOutputs(
            ref ReadyPulse,
            ref Ready,
            ref Status
        );
    }


    // ============================================================
    // OUTPUTS
    // ============================================================

    private void SetOutputs(
        ref object ReadyPulse,
        ref object Ready,
        ref object Status)
    {
        ReadyPulse =
            readyPulse;

        Ready =
            ready;

        Status =
            lastStatus;
    }


    // ============================================================
    // TEXT NORMALIZATION
    // ============================================================

    private string NormalizeText(
        string value)
    {
        return value == null
            ? ""
            : value.Trim();
    }
}
# ---------- end c_script_25 ----------
panel_124 = Panel(c_script_25.ReadyPulse)
panel_125 = Panel(c_script_25.Ready)
panel_126 = Panel(c_script_25.Status)

panel_127 = Panel(data)

path_9 = FilePath(path_8)
py3_2 = Python3Script(FileOrFolder=path_9, UseLatestInFolder=Toggle(True), MakeClosed=Toggle(True))  # -> Polylines, Centroids, MeanColors, Info; same code as py3
panel_128 = Panel(py3_2.Info)
crv_2 = Curve(py3_2.Polylines)
pt_4 = Point(py3_2.Centroids)
panel_129 = Panel(py3_2.MeanColors)

c_script_26 = CSharpScript(Data=data)  # -> A, B, C, D, E, Status; inputs Data: tree
# ---------- c_script_26: C# ----------
// Grasshopper C# Script Instance
#region Usings
using System;
using System.Collections;
using System.Collections.Generic;

using Grasshopper;
using Grasshopper.Kernel;
using Grasshopper.Kernel.Data;
using Grasshopper.Kernel.Types;
#endregion

public class Script_Instance : GH_ScriptInstance
{
    private void RunScript(
		DataTree<object> Data,
		ref object A,
		ref object B,
		ref object C,
		ref object D,
		ref object E,
		ref object Status)
    {
        GH_Structure<IGH_Goo> treeA =
            new GH_Structure<IGH_Goo>();

        GH_Structure<IGH_Goo> treeB =
            new GH_Structure<IGH_Goo>();

        GH_Structure<IGH_Goo> treeC =
            new GH_Structure<IGH_Goo>();

        GH_Structure<IGH_Goo> treeD =
            new GH_Structure<IGH_Goo>();

        GH_Structure<IGH_Goo> treeE =
            new GH_Structure<IGH_Goo>();

        try
        {
            IGH_Structure sourceTree =
                GetInputTree();

            if (sourceTree == null)
            {
                Status =
                    "No input data tree was provided.";

                SetOutputs(
                    treeA,
                    treeB,
                    treeC,
                    treeD,
                    treeE,
                    ref A,
                    ref B,
                    ref C,
                    ref D,
                    ref E
                );

                return;
            }

            int mappedBranchCount = 0;
            int mappedItemCount = 0;
            int ignoredBranchCount = 0;

            for (
                int branchIndex = 0;
                branchIndex < sourceTree.PathCount;
                branchIndex++)
            {
                GH_Path combinedPath =
                    sourceTree.get_Path(
                        branchIndex
                    );

                if (
                    combinedPath == null ||
                    combinedPath.Length == 0)
                {
                    ignoredBranchCount++;
                    continue;
                }

                int outputIndex =
                    combinedPath[0];

                GH_Structure<IGH_Goo> targetTree =
                    GetTargetTree(
                        outputIndex,
                        treeA,
                        treeB,
                        treeC,
                        treeD,
                        treeE
                    );

                if (targetTree == null)
                {
                    ignoredBranchCount++;
                    continue;
                }

                GH_Path restoredPath =
                    RemoveFirstPathIndex(
                        combinedPath
                    );

                /*
                 * Keep empty branches from the source tree.
                 */
                targetTree.EnsurePath(
                    restoredPath
                );

                IList branch =
                    sourceTree.get_Branch(
                        branchIndex
                    );

                if (branch != null)
                {
                    for (
                        int itemIndex = 0;
                        itemIndex < branch.Count;
                        itemIndex++)
                    {
                        IGH_Goo goo =
                            branch[itemIndex]
                            as IGH_Goo;

                        targetTree.Append(
                            goo,
                            restoredPath
                        );

                        mappedItemCount++;
                    }
                }

                mappedBranchCount++;
            }

            SetOutputs(
                treeA,
                treeB,
                treeC,
                treeD,
                treeE,
                ref A,
                ref B,
                ref C,
                ref D,
                ref E
            );

            Status =
                "Remapped " +
                mappedBranchCount +
                " branch(es) and " +
                mappedItemCount +
                " item(s) into outputs A–E.";

            if (ignoredBranchCount > 0)
            {
                Status =
                    Status +
                    " Ignored " +
                    ignoredBranchCount +
                    " branch(es) outside output range A–E.";
            }
        }
        catch (Exception exception)
        {
            SetOutputs(
                treeA,
                treeB,
                treeC,
                treeD,
                treeE,
                ref A,
                ref B,
                ref C,
                ref D,
                ref E
            );

            Status =
                "Data remapping failed: " +
                exception.Message;
        }
    }

    // ============================================================
    // INPUT TREE
    // ============================================================

    private IGH_Structure GetInputTree()
    {
        /*
         * Data is the only component input and should use Tree access.
         * Reading Component.Params.Input[0].VolatileData avoids relying
         * on the RunScript object wrapper.
         */
        if (
            Component.Params.Input.Count == 0)
        {
            return null;
        }

        IGH_Param inputParameter =
            Component.Params.Input[0];

        if (
            inputParameter == null ||
            inputParameter.VolatileData == null ||
            inputParameter.VolatileData.IsEmpty)
        {
            return null;
        }

        return inputParameter.VolatileData;
    }

    // ============================================================
    // PATH RESTORATION
    // ============================================================

    private GH_Path RemoveFirstPathIndex(
        GH_Path combinedPath)
    {
        if (
            combinedPath == null ||
            combinedPath.Length <= 1)
        {
            /*
             * A path containing only the input index, such as {0},
             * maps back to the default Grasshopper path {0}.
             */
            return new GH_Path(0);
        }

        int[] restoredIndices =
            new int[
                combinedPath.Length - 1
            ];

        for (
            int index = 1;
            index < combinedPath.Length;
            index++)
        {
            restoredIndices[
                index - 1
            ] = combinedPath[index];
        }

        return new GH_Path(
            restoredIndices
        );
    }

    // ============================================================
    // OUTPUT SELECTION
    // ============================================================

    private GH_Structure<IGH_Goo> GetTargetTree(
        int outputIndex,
        GH_Structure<IGH_Goo> treeA,
        GH_Structure<IGH_Goo> treeB,
        GH_Structure<IGH_Goo> treeC,
        GH_Structure<IGH_Goo> treeD,
        GH_Structure<IGH_Goo> treeE)
    {
        switch (outputIndex)
        {
            case 0:
                return treeA;

            case 1:
                return treeB;

            case 2:
                return treeC;

            case 3:
                return treeD;

            case 4:
                return treeE;

            default:
                return null;
        }
    }

    // ============================================================
    // OUTPUT ASSIGNMENT
    // ============================================================

    private void SetOutputs(
        GH_Structure<IGH_Goo> treeA,
        GH_Structure<IGH_Goo> treeB,
        GH_Structure<IGH_Goo> treeC,
        GH_Structure<IGH_Goo> treeD,
        GH_Structure<IGH_Goo> treeE,
        ref object A,
        ref object B,
        ref object C,
        ref object D,
        ref object E)
    {
        A = treeA;
        B = treeB;
        C = treeC;
        D = treeD;
        E = treeE;
    }
}
# ---------- end c_script_26 ----------
data_2 = Data(c_script_26.A)
data_3 = Data(c_script_26.B)
data_4 = Data(c_script_26.C)
panel_130 = Panel(c_script_26.Status)

trigger_12 = Trigger(Interval=1000, TimerInterval=1000, Target=c_script_27)  # disabled
connect_11 = BooleanToggle(False)
c_script_27 = CSharpScript(ConnectButton=connect_11, RefreshStatus=c_script_25.ReadyPulse, SessionName="EOB_test03")  # -> Status, Message, SessionFolder, ManifestPath, PathReady; inputs ConnectButton: Boolean, RefreshStatus: Boolean, SessionName: String; same code as c_script_14
panel_131 = Panel(c_script_27.Status)
panel_132 = Panel(c_script_27.Message)
panel_133 = Panel(c_script_27.SessionFolder)
panel_134 = Panel(c_script_27.ManifestPath)
panel_135 = Panel(c_script_27.PathReady)

# ---- group: Motion Local Upload Directory Generator
c_script_28 = CSharpScript(ConnectButton=connect_8, RefreshStatus=refresh_status_7, SessionName="EOB_test03")  # -> Status, Message, SessionFolder, ManifestPath; inputs ConnectButton: Boolean, RefreshStatus: Boolean, SessionName: String; same code as c_script_12

# ----
path_10 = FilePath(path_7)
py3_3 = Python3Script(FileOrFolder=path_10, UseLatestInFolder=Toggle(True), MakeClosed=Toggle(True))  # -> Polylines, Centroids, MeanColors, Info; same code as py3
panel_136 = Panel(py3_3.Info)
crv_3 = Curve(py3_3.Polylines)
pt_5 = Point(py3_3.Centroids)
panel_137 = Panel(py3_3.MeanColors)

panel_138 = Panel(path_7)
panel_139 = Panel(c_script_28.Status)
panel_140 = Panel(c_script_28.Message)
panel_141 = Panel(c_script_28.ManifestPath)
write_2 = Button()

# ---- group: Motion Local Upload
c_script_29 = CSharpScript(
    Directory=c_script_28.SessionFolder,
    FileName="script",
    Session="EOB_test03",
    OutputIndex=output_index_3,
    Write=write_2,
    ProgramData="first test for motion")  # -> OutputPath, ProgramSummary, ReadyEvent, Status; inputs Directory: String, FileName: String, Session: String, OutputIndex: Int32, Write: Boolean, ProgramData: tree
# ---------- c_script_29: C# ----------
// Grasshopper C# Script Instance
#region Usings
using System;
using System.Collections;
using System.Collections.Generic;
using System.Globalization;
using System.IO;
using System.Linq;
using System.Net.Sockets;
using System.Text;

using Grasshopper;
using Grasshopper.Kernel;
using Grasshopper.Kernel.Data;
using Grasshopper.Kernel.Types;
#endregion

public class Script_Instance : GH_ScriptInstance
{
    // ============================================================
    // CONFIGURATION
    // ============================================================

    private const string GhAgentHost =
        "127.0.0.1";

    private const int GhAgentPort =
        6005;

    private const int MessageHeaderSize =
        8;

    private const string OutputDomain =
        "motion";

    private const string DefaultCategory =
        "program";

    private const string DefaultExtension =
        ".txt";

    // ============================================================
    // COMPONENT STATE
    // ============================================================

    private bool previousWrite =
        false;

    private string lastOutputPath =
        "";

    private string lastReadyEvent =
        "";

    private string lastStatus =
        "Ready.";

    private string lastProgramSummary =
        "No program data.";

    // ============================================================
    // MAIN
    // ============================================================

    private void RunScript(
		string Directory,
		string FileName,
		string Session,
		int OutputIndex,
		bool Write,
		DataTree<object> ProgramData,
		ref object OutputPath,
		ref object ProgramSummary,
		ref object ReadyEvent,
		ref object Status)
    {
        bool writePulse =
            Write &&
            !previousWrite;

        previousWrite =
            Write;

        try
        {
            ProgramContent program =
                CollectProgramContent(
                    ProgramData
                );

            lastProgramSummary =
                program.Summary;

            string validationError =
                ValidateSettings(
                    Directory,
                    FileName,
                    Session,
                    OutputIndex
                );

            if (
                !string.IsNullOrWhiteSpace(
                    validationError
                )
            )
            {
                lastStatus =
                    validationError;

                SetOutputs(
                    ref OutputPath,
                    ref ProgramSummary,
                    ref ReadyEvent,
                    ref Status
                );

                return;
            }

            string fileType =
                NormalizeFileType(
                    FileName
                );

            string extension =
                "." +
                fileType;

            string resolvedFileName =
                BuildFileName(
                    fileType,
                    OutputIndex
                );

            lastOutputPath =
                Path.GetFullPath(
                    Path.Combine(
                        Directory.Trim(),
                        resolvedFileName
                    )
                );

            if (!writePulse)
            {
                lastStatus =
                    program.HasContent
                    ? (
                        "Ready. Program contains " +
                        program.LineCount +
                        " line(s) and " +
                        program.CharacterCount +
                        " character(s)."
                    )
                    : "Ready. No program data.";

                SetOutputs(
                    ref OutputPath,
                    ref ProgramSummary,
                    ref ReadyEvent,
                    ref Status
                );

                return;
            }

            if (!program.HasContent)
            {
                lastStatus =
                    "Write rejected: ProgramData contains no text.";

                SetOutputs(
                    ref OutputPath,
                    ref ProgramSummary,
                    ref ReadyEvent,
                    ref Status
                );

                return;
            }

            string outputDirectory =
                Path.GetDirectoryName(
                    lastOutputPath
                );

            if (
                string.IsNullOrWhiteSpace(
                    outputDirectory
                )
            )
            {
                throw new InvalidOperationException(
                    "Could not resolve the output directory."
                );
            }

            System.IO.Directory.CreateDirectory(
                outputDirectory
            );

            WriteProgramFile(
                lastOutputPath,
                program.Text
            );

            if (!File.Exists(lastOutputPath))
            {
                throw new IOException(
                    "Program write completed, but the file " +
                    "does not exist: " +
                    lastOutputPath
                );
            }

            string registrationResponse =
                RegisterLocalUpload(
                    Session.Trim(),
                    OutputIndex,
                    fileType,
                    lastOutputPath
                );

            string registrationStatus =
                ExtractJsonValue(
                    registrationResponse,
                    "status"
                );

            if (
                !string.Equals(
                    registrationStatus,
                    "ok",
                    StringComparison.OrdinalIgnoreCase
                )
            )
            {
                string registrationMessage =
                    ExtractJsonValue(
                        registrationResponse,
                        "message"
                    );

                throw new InvalidOperationException(
                    "The robot program was written, but local " +
                    "registration failed: " +
                    (
                        string.IsNullOrWhiteSpace(
                            registrationMessage
                        )
                        ? registrationResponse
                        : registrationMessage
                    )
                );
            }

            string eventId =
                Guid.NewGuid().ToString();

            string createdAt =
                DateTime.UtcNow.ToString(
                    "o",
                    CultureInfo.InvariantCulture
                );

            lastReadyEvent =
                BuildReadyEvent(
                    eventId,
                    createdAt,
                    Session.Trim(),
                    OutputIndex,
                    lastOutputPath,
                    fileType,
                    extension,
                    program
                );

            lastStatus =
                "Robot program was written and " +
                "registered successfully.";

            SetOutputs(
                ref OutputPath,
                ref ProgramSummary,
                ref ReadyEvent,
                ref Status
            );
        }
        catch (Exception exception)
        {
            lastStatus =
                "Motion Program Output failed: " +
                exception.Message;

            SetOutputs(
                ref OutputPath,
                ref ProgramSummary,
                ref ReadyEvent,
                ref Status
            );
        }
    }

    // ============================================================
    // PROGRAM DATA COLLECTION
    // ============================================================

    private ProgramContent CollectProgramContent(
        DataTree<object> programData)
    {
        List<string> lines =
            new List<string>();

        int branchCount =
            0;

        int itemCount =
            0;

        if (programData != null)
        {
            branchCount =
                programData.BranchCount;

            for (
                int branchIndex = 0;
                branchIndex < programData.BranchCount;
                branchIndex++)
            {
                IList<object> branch =
                    programData.Branch(
                        branchIndex
                    );

                if (branch == null)
                    continue;

                for (
                    int itemIndex = 0;
                    itemIndex < branch.Count;
                    itemIndex++)
                {
                    object item =
                        branch[itemIndex];

                    List<string> itemLines =
                        ConvertItemToLines(
                            item
                        );

                    foreach (
                        string line
                        in itemLines
                    )
                    {
                        lines.Add(
                            line ?? ""
                        );
                    }

                    itemCount++;
                }
            }
        }

        string text =
            string.Join(
                Environment.NewLine,
                lines
            );

        bool hasContent =
            !string.IsNullOrWhiteSpace(
                text
            );

        int characterCount =
            text.Length;

        int lineCount =
            lines.Count;

        string summary =
            "Robot Program" +
            " | Branches: " +
            branchCount +
            " | Items: " +
            itemCount +
            " | Lines: " +
            lineCount +
            " | Characters: " +
            characterCount +
            " | Has Content: " +
            hasContent;

        return new ProgramContent(
            text,
            hasContent,
            branchCount,
            itemCount,
            lineCount,
            characterCount,
            summary
        );
    }

    private List<string> ConvertItemToLines(
        object item)
    {
        List<string> lines =
            new List<string>();

        if (item == null)
            return lines;

        GH_String ghString =
            item as GH_String;

        if (ghString != null)
        {
            AddTextLines(
                lines,
                ghString.Value
            );

            return lines;
        }

        IGH_Goo goo =
            item as IGH_Goo;

        if (goo != null)
        {
            object scriptValue =
                goo.ScriptVariable();

            if (
                scriptValue != null &&
                !ReferenceEquals(
                    scriptValue,
                    item
                )
            )
            {
                return ConvertItemToLines(
                    scriptValue
                );
            }

            AddTextLines(
                lines,
                goo.ToString()
            );

            return lines;
        }

        string stringValue =
            item as string;

        if (stringValue != null)
        {
            AddTextLines(
                lines,
                stringValue
            );

            return lines;
        }

        IEnumerable enumerable =
            item as IEnumerable;

        if (
            enumerable != null &&
            !(item is string)
        )
        {
            foreach (
                object child
                in enumerable
            )
            {
                lines.AddRange(
                    ConvertItemToLines(
                        child
                    )
                );
            }

            return lines;
        }

        AddTextLines(
            lines,
            Convert.ToString(
                item,
                CultureInfo.InvariantCulture
            )
        );

        return lines;
    }

    private void AddTextLines(
        List<string> target,
        string value)
    {
        if (value == null)
            return;

        string normalized =
            value
                .Replace(
                    "\r\n",
                    "\n"
                )
                .Replace(
                    "\r",
                    "\n"
                );

        string[] split =
            normalized.Split(
                new char[] { '\n' },
                StringSplitOptions.None
            );

        target.AddRange(
            split
        );
    }

    // ============================================================
    // FILE WRITING
    // ============================================================

    private void WriteProgramFile(
        string outputPath,
        string programText)
    {
        string temporaryPath =
            outputPath +
            ".writing";

        if (File.Exists(temporaryPath))
        {
            File.Delete(
                temporaryPath
            );
        }

        UTF8Encoding utf8WithoutBom =
            new UTF8Encoding(
                false
            );

        File.WriteAllText(
            temporaryPath,
            programText,
            utf8WithoutBom
        );

        if (!File.Exists(temporaryPath))
        {
            throw new IOException(
                "Temporary robot program file was not created."
            );
        }

        if (File.Exists(outputPath))
        {
            File.Delete(
                outputPath
            );
        }

        File.Move(
            temporaryPath,
            outputPath
        );
    }

    // ============================================================
    // LOCAL GH AGENT REGISTRATION
    // ============================================================

    private string RegisterLocalUpload(
        string session,
        int outputIndex,
        string category,
        string localPath)
    {
        string payload =
            "{" +
            "\"command\":\"register_local_upload\"," +
            "\"session\":\"" +
            EscapeJson(session) +
            "\"," +
            "\"local_path\":\"" +
            EscapeJson(localPath) +
            "\"," +
            "\"domain\":\"motion\"," +
            "\"category\":\"" +
            EscapeJson(category) +
            "\"," +
            "\"motion_output_index\":" +
            outputIndex.ToString(
                CultureInfo.InvariantCulture
            ) +
            "," +
            "\"upload_status\":\"pending\"" +
            "}";

        string response =
            SendCommand(
                payload
            );

        if (
            response.StartsWith(
                "ERROR:",
                StringComparison.Ordinal
            )
        )
        {
            throw new InvalidOperationException(
                response
            );
        }

        return response;
    }

    // ============================================================
    // PATHS AND VALIDATION
    // ============================================================

    private string ValidateSettings(
        string directory,
        string fileName,
        string session,
        int outputIndex)
    {
        if (string.IsNullOrWhiteSpace(directory))
        {
            return "Directory cannot be empty.";
        }

        string trimmedDirectory =
            directory.Trim();

        if (!Path.IsPathRooted(trimmedDirectory))
        {
            return "Directory must be an absolute path.";
        }

        if (
            !System.IO.Directory.Exists(
                trimmedDirectory
            )
        )
        {
            return
                "Directory does not exist: " +
                trimmedDirectory;
        }

        if (string.IsNullOrWhiteSpace(fileName))
        {
            return
                "FileName cannot be empty. " +
                "Examples: script, mod, modx, urp.";
        }

        string trimmedFileName =
            fileName
                .Trim()
                .TrimStart('.');

        if (string.IsNullOrWhiteSpace(trimmedFileName))
        {
            return "FileName is invalid.";
        }

        foreach (char character in trimmedFileName)
        {
            if (!char.IsLetterOrDigit(character))
            {
                return
                    "FileName may contain only letters " +
                    "and numbers. Examples: script, mod, modx, urp.";
            }
        }

        if (string.IsNullOrWhiteSpace(session))
        {
            return "Session cannot be empty.";
        }

        string trimmedSession =
            session.Trim();

        if (
            Path.GetFileName(trimmedSession) !=
            trimmedSession
        )
        {
            return
                "Session must be a folder name, not a path.";
        }

        if (outputIndex < 1)
        {
            return
                "OutputIndex must be at least 1.";
        }

        return "";
    }

    private string NormalizeFileType(
        string value)
    {
        string fileType =
            string.IsNullOrWhiteSpace(value)
            ? "txt"
            : value
                .Trim()
                .TrimStart('.')
                .ToLowerInvariant();

        StringBuilder cleaned =
            new StringBuilder();

        foreach (char character in fileType)
        {
            if (char.IsLetterOrDigit(character))
            {
                cleaned.Append(character);
            }
        }

        string result =
            cleaned.ToString();

        if (string.IsNullOrWhiteSpace(result))
        {
            throw new ArgumentException(
                "FileName is invalid."
            );
        }

        return result;
    }

    private string BuildFileName(
        string fileType,
        int outputIndex)
    {
        return
            "motion_" +
            fileType +
            "_" +
            outputIndex.ToString(
                "00",
                CultureInfo.InvariantCulture
            ) +
            "." +
            fileType;
    }

    private string NormalizeName(
        string value,
        string fallback)
    {
        string raw =
            string.IsNullOrWhiteSpace(
                value
            )
            ? fallback
            : value
                .Trim()
                .ToLowerInvariant();

        StringBuilder cleaned =
            new StringBuilder();

        foreach (
            char character
            in raw
        )
        {
            cleaned.Append(
                char.IsLetterOrDigit(
                    character
                )
                ? character
                : '_'
            );
        }

        string result =
            cleaned.ToString();

        while (
            result.Contains(
                "__"
            )
        )
        {
            result =
                result.Replace(
                    "__",
                    "_"
                );
        }

        result =
            result.Trim('_');

        return
            string.IsNullOrWhiteSpace(
                result
            )
            ? fallback
            : result;
    }

    // ============================================================
    // READY EVENT
    // ============================================================

    private string BuildReadyEvent(
        string eventId,
        string createdAt,
        string session,
        int outputIndex,
        string outputPath,
        string category,
        string extension,
        ProgramContent program)
    {
        string summary =
            EscapeJson(
                program.Summary
            );

        return
            "{" +
            "\"event_id\":\"" +
            EscapeJson(eventId) +
            "\"," +
            "\"event\":\"local_output_ready\"," +
            "\"status\":\"ready\"," +
            "\"created_at\":\"" +
            EscapeJson(createdAt) +
            "\"," +
            "\"session\":\"" +
            EscapeJson(session) +
            "\"," +
            "\"domain\":\"motion\"," +
            "\"output_index\":" +
            outputIndex.ToString(
                CultureInfo.InvariantCulture
            ) +
            "," +
            "\"local_path\":\"" +
            EscapeJson(outputPath) +
            "\"," +
            "\"category\":\"" +
            EscapeJson(category) +
            "\"," +
            "\"file_extension\":\"" +
            EscapeJson(extension) +
            "\"," +
            "\"connected_input_count\":1," +
            "\"populated_input_count\":" +
            (
                program.HasContent
                ? "1"
                : "0"
            ) +
            "," +
            "\"input_summary\":[" +
            "\"" +
            summary +
            "\"" +
            "]" +
            "}";
    }

    // ============================================================
    // GH AGENT CONNECTION
    // ============================================================

    private string SendCommand(
        string command)
    {
        try
        {
            using (
                TcpClient client =
                    new TcpClient()
            )
            {
                IAsyncResult connection =
                    client.BeginConnect(
                        GhAgentHost,
                        GhAgentPort,
                        null,
                        null
                    );

                bool connected =
                    connection.AsyncWaitHandle.WaitOne(
                        TimeSpan.FromMilliseconds(
                            500
                        )
                    );

                if (!connected)
                {
                    return
                        "ERROR: GH Agent connection timeout.";
                }

                client.EndConnect(
                    connection
                );

                using (
                    NetworkStream stream =
                        client.GetStream()
                )
                {
                    byte[] payload =
                        Encoding.UTF8.GetBytes(
                            command
                        );

                    byte[] header =
                        BuildHeader(
                            payload.Length
                        );

                    stream.Write(
                        header,
                        0,
                        header.Length
                    );

                    stream.Write(
                        payload,
                        0,
                        payload.Length
                    );

                    byte[] responseHeader =
                        ReadExact(
                            stream,
                            MessageHeaderSize
                        );

                    ulong responseSize =
                        ParseHeader(
                            responseHeader
                        );

                    if (responseSize > int.MaxValue)
                    {
                        return
                            "ERROR: GH Agent response is too large.";
                    }

                    byte[] responsePayload =
                        ReadExact(
                            stream,
                            (int)responseSize
                        );

                    return
                        Encoding.UTF8.GetString(
                            responsePayload
                        );
                }
            }
        }
        catch (Exception exception)
        {
            return
                "ERROR: " +
                exception.Message;
        }
    }

    private byte[] BuildHeader(
        int payloadSize)
    {
        byte[] header =
            new byte[
                MessageHeaderSize
            ];

        ulong size =
            (ulong)payloadSize;

        for (
            int index = 0;
            index < MessageHeaderSize;
            index++
        )
        {
            header[
                MessageHeaderSize -
                1 -
                index
            ] =
                (byte)(
                    size &
                    0xFF
                );

            size >>=
                8;
        }

        return header;
    }

    private ulong ParseHeader(
        byte[] header)
    {
        ulong size =
            0;

        for (
            int index = 0;
            index < header.Length;
            index++
        )
        {
            size =
                (
                    size <<
                    8
                ) +
                header[index];
        }

        return size;
    }

    private byte[] ReadExact(
        NetworkStream stream,
        int size)
    {
        byte[] data =
            new byte[size];

        int offset =
            0;

        while (offset < size)
        {
            int read =
                stream.Read(
                    data,
                    offset,
                    size - offset
                );

            if (read == 0)
            {
                throw new IOException(
                    "Connection closed before the response " +
                    "was complete."
                );
            }

            offset +=
                read;
        }

        return data;
    }

    // ============================================================
    // JSON HELPERS
    // ============================================================

    private string EscapeJson(
        string value)
    {
        if (value == null)
            return "";

        return value
            .Replace(
                "\\",
                "\\\\"
            )
            .Replace(
                "\"",
                "\\\""
            )
            .Replace(
                "\r",
                "\\r"
            )
            .Replace(
                "\n",
                "\\n"
            )
            .Replace(
                "\t",
                "\\t"
            );
    }

    private string ExtractJsonValue(
        string json,
        string key)
    {
        if (
            string.IsNullOrWhiteSpace(
                json
            )
        )
        {
            return "";
        }

        string pattern =
            "\"" +
            key +
            "\":";

        int start =
            json.IndexOf(
                pattern,
                StringComparison.Ordinal
            );

        if (start < 0)
            return "";

        start +=
            pattern.Length;

        while (
            start < json.Length &&
            char.IsWhiteSpace(
                json[start]
            )
        )
        {
            start++;
        }

        if (start >= json.Length)
            return "";

        if (json[start] == '"')
        {
            start++;

            StringBuilder value =
                new StringBuilder();

            bool escaped =
                false;

            for (
                int index = start;
                index < json.Length;
                index++
            )
            {
                char character =
                    json[index];

                if (escaped)
                {
                    switch (character)
                    {
                        case 'n':
                            value.Append('\n');
                            break;

                        case 'r':
                            value.Append('\r');
                            break;

                        case 't':
                            value.Append('\t');
                            break;

                        case '\\':
                            value.Append('\\');
                            break;

                        case '"':
                            value.Append('"');
                            break;

                        default:
                            value.Append(
                                character
                            );
                            break;
                    }

                    escaped =
                        false;

                    continue;
                }

                if (character == '\\')
                {
                    escaped =
                        true;

                    continue;
                }

                if (character == '"')
                {
                    return
                        value.ToString();
                }

                value.Append(
                    character
                );
            }

            return "";
        }

        int end =
            start;

        while (
            end < json.Length &&
            json[end] != ',' &&
            json[end] != '}'
        )
        {
            end++;
        }

        return
            json
                .Substring(
                    start,
                    end - start
                )
                .Trim();
    }

    // ============================================================
    // OUTPUTS
    // ============================================================

    private void SetOutputs(
        ref object OutputPath,
        ref object ProgramSummary,
        ref object ReadyEvent,
        ref object Status)
    {
        OutputPath =
            lastOutputPath;

        ProgramSummary =
            lastProgramSummary;

        ReadyEvent =
            lastReadyEvent;

        Status =
            lastStatus;
    }

    private class ProgramContent
    {
        public string Text;
        public bool HasContent;

        public int BranchCount;
        public int ItemCount;
        public int LineCount;
        public int CharacterCount;

        public string Summary;

        public ProgramContent(
            string text,
            bool hasContent,
            int branchCount,
            int itemCount,
            int lineCount,
            int characterCount,
            string summary)
        {
            Text =
                text;

            HasContent =
                hasContent;

            BranchCount =
                branchCount;

            ItemCount =
                itemCount;

            LineCount =
                lineCount;

            CharacterCount =
                characterCount;

            Summary =
                summary;
        }
    }
}
# ---------- end c_script_29 ----------

# ----
panel_142 = Panel(c_script_29.OutputPath)
panel_143 = Panel(c_script_29.ProgramSummary)
panel_144 = Panel(c_script_29.Status)

# ---- group: Upload to Master
c_script_30 = CSharpScript(
    ConnectButton=connect_8,
    ReadyEvent=c_script_29.ReadyEvent,
    SourceOutputIndex=output_index_3,
    CreatedBy="motion_pc",
    UploadMessage="Motion solution ready",
    AutoPoll=refresh_status_7)  # -> State, Status, Message, UploadJobId, Progress, Session, OutputIndex, MasterResponse; inputs ConnectButton: Boolean, ReadyEvent: String, SourceOutputIndex: Int32, CreatedBy: String, UploadMessage: String, AutoPoll: Boolean; same code as c_script_22

# ----
panel_145 = Panel(c_script_30.State)
panel_146 = Panel(c_script_30.Status)
panel_147 = Panel(c_script_30.Message)
panel_148 = Panel(c_script_30.UploadJobId)
panel_149 = Panel(c_script_30.Progress)
panel_150 = Panel(c_script_30.Session)
panel_151 = Panel(c_script_30.OutputIndex)
panel_152 = Panel(c_script_30.MasterResponse)
